# Grasshopper definition ARCH470_Classwork2_OzgurGulsuna_2307668.gh (Grasshopper 1.0.7)

branchlenght = Slider(30, range=0..30)
curl = BooleanToggle(False)
origin = Point(<point referenced from the Rhino model>)
verticalslide = Slider(1.822, range=0..5)
branchlayer = Slider(3, range=1..4)
branchresolution = Slider(-15, range=-15..30)
md_slider = MDSlider(
    SliderMode=0,
    slider_value=Point(0.2094920043, 0.4193678031, 0.5),
    x_domain=Domain(0, 10),
    y_domain=Domain(-30, 30),
    z_domain=Domain(0, 1))
md_slider_2 = MDSlider(
    SliderMode=0,
    slider_value=Point(0.8110861469, 0.6714385849, 0.5),
    x_domain=Domain(0, 10),
    y_domain=Domain(-15, 15),
    z_domain=Domain(0, 1))
layerlenght1 = Slider(0.13, range=0..0.5)
layerlenght2 = Slider(0.26, range=0.1..1)
layerlenght3 = Slider(0.79, range=0.1..1)
curlamount = Slider(-20.513, range=-40..40)
curlangle = Slider(159.381, range=0..360)
pointyedges = Slider(0.4, range=0..1)
colour_swatch = ColourSwatch(SwatchColor=RGB(173, 209, 108))
colour_swatch_2 = ColourSwatch(SwatchColor=RGB(61, 117, 37))
rotation = Slider(0, range=0..360)

# ---- group: Main Cluster
multiplication = Multiplication(A=md_slider_2, B=layerlenght1)
multiplication_2 = Multiplication(A=md_slider, B=layerlenght1)
multiplication_3 = Multiplication(A=md_slider_2, B=layerlenght2)
multiplication_4 = Multiplication(A=md_slider, B=layerlenght2)
multiplication_5 = Multiplication(A=md_slider_2, B=layerlenght3)
multiplication_6 = Multiplication(A=md_slider, B=layerlenght3)
radians = Radians(Degrees=rotation)
expression = Expression(x=radians, y=branchlenght, Expression="{y*sin(x),y*cos(x),0}")
addition = Addition(A=branchlenght, B=branchresolution)
addition_2 = Addition(A=branchlenght, B=branchresolution)
move = Move(Geometry=origin, Motion="{0,10,0}")  # -> Geometry, Transform
move_2 = Move(Geometry=origin, Motion="{0,0,10}")  # -> Geometry, Transform
addition_3 = Addition(A=addition, B=addition)
addition_4 = Addition(A=addition_3, B=addition_3)
move_3 = Move(Geometry=origin, Motion=expression)  # -> Geometry, Transform
line = Line(StartPoint=origin, EndPoint=move_3.Geometry)
bezier_span = BezierSpan(StartPoint=origin, StartTangent=md_slider_2, EndPoint=move_3.Geometry, EndTangent=md_slider)  # -> Curve, Length, Domain
bezier_span_2 = BezierSpan(StartPoint=origin, StartTangent=multiplication, EndPoint=move_3.Geometry, EndTangent=multiplication_2)  # -> Curve, Length, Domain
bezier_span_3 = BezierSpan(StartPoint=origin, StartTangent=multiplication_3, EndPoint=move_3.Geometry, EndTangent=multiplication_4)  # -> Curve, Length, Domain
bezier_span_4 = BezierSpan(StartPoint=origin, StartTangent=multiplication_5, EndPoint=move_3.Geometry, EndTangent=multiplication_6)  # -> Curve, Length, Domain
addition_5 = Addition(A=addition_2, B=addition_2)
plane_3pt = Plane3Pt(PointA=origin, PointB=move.Geometry, PointC=move_2.Geometry)
addition_6 = Addition(A=addition_4, B=addition_4)
addition_7 = Addition(A=addition_2, B=addition_2)
addition_8 = Addition(A=addition_5, B=addition_5)
divide_distance = DivideDistance(Curve=line, Distance=verticalslide)  # -> Points, Tangents, Parameters
divide_curve = DivideCurve(Curve=line, Count=addition, Kinks=False)  # -> Points, Tangents, Parameters
fit_line = FitLine(Points=[divide_curve.Points, divide_distance.Points])
divide_curve_2 = DivideCurve(Curve=bezier_span_4.Curve, Count=addition_8, Kinks=False)  # -> Points, Tangents, Parameters
divide_curve_3 = DivideCurve(Curve=bezier_span.Curve, Count=addition_6, Kinks=False)  # -> Points, Tangents, Parameters
divide_curve_4 = DivideCurve(Curve=bezier_span_2.Curve, Count=addition_2, Kinks=False)  # -> Points, Tangents, Parameters
divide_curve_5 = DivideCurve(Curve=bezier_span_3.Curve, Count=addition_7, Kinks=False)  # -> Points, Tangents, Parameters
dispatch = Dispatch(List=divide_curve_2.Points, DispatchPattern=[True, False])  # -> ListA, ListB
dispatch_2 = Dispatch(List=divide_curve_5.Points, DispatchPattern=[True, False])  # -> ListA, ListB
dispatch_3 = Dispatch(List=fit_line, DispatchPattern=curl)  # -> ListA, ListB
dispatch_4 = Dispatch(List=divide_curve_3.Points, DispatchPattern=[True, False])  # -> ListA, ListB
dispatch_5 = Dispatch(List=dispatch_4.ListA, DispatchPattern=[True, False])  # -> ListA, ListB
dispatch_6 = Dispatch(List=dispatch_4.ListB, DispatchPattern=[True, False])  # -> ListA, ListB
larger_than = LargerThan(FirstNumber=branchlayer, SecondNumber="2")  # -> LargerThan, OrEqualTo
dispatch_7 = Dispatch(List=divide_curve.Points, DispatchPattern=larger_than.LargerThan)  # -> ListA, ListB
gate_not = GateNot(A=larger_than.LargerThan)
dispatch_8 = Dispatch(List=divide_distance.Points, DispatchPattern=gate_not)  # -> ListA, ListB
relay = Relay([dispatch_7.ListA, dispatch_8.ListA])
relay_2 = Relay([dispatch_7.ListA, dispatch_8.ListA])
relay_3 = Relay([dispatch_7.ListA, dispatch_8.ListA])
relay_4 = Relay([dispatch_7.ListA, dispatch_8.ListA])
equality = Equality(FirstNumber=branchlayer, SecondNumber="1")  # -> Equality, Inequality
equality_2 = Equality(FirstNumber=branchlayer, SecondNumber="2")  # -> Equality, Inequality
equality_3 = Equality(FirstNumber=branchlayer, SecondNumber="3")  # -> Equality, Inequality
equality_4 = Equality(FirstNumber=branchlayer, SecondNumber="4")  # -> Equality, Inequality
dispatch_9 = Dispatch(List=dispatch_5.ListA, DispatchPattern=[True, False])  # -> ListA, ListB
dispatch_10 = Dispatch(List=dispatch_5.ListB, DispatchPattern=[True, False])  # -> ListA, ListB
dispatch_11 = Dispatch(List=dispatch_6.ListA, DispatchPattern=[True, False])  # -> ListA, ListB
dispatch_12 = Dispatch(List=dispatch_6.ListB, DispatchPattern=[True, False])  # -> ListA, ListB
dispatch_13 = Dispatch(List=dispatch.ListB, DispatchPattern=[True, False])  # -> ListA, ListB
dispatch_14 = Dispatch(List=dispatch.ListA, DispatchPattern=[True, False])  # -> ListA, ListB
dispatch_15 = Dispatch(List=relay_4, DispatchPattern=equality.Equality)  # -> ListA, ListB
dispatch_16 = Dispatch(List=relay_3, DispatchPattern=equality_2.Equality)  # -> ListA, ListB
dispatch_17 = Dispatch(List=dispatch_2.ListA, DispatchPattern=equality_2.Equality)  # -> ListA, ListB
dispatch_18 = Dispatch(List=relay, DispatchPattern=equality_3.Equality)  # -> ListA, ListB
dispatch_19 = Dispatch(List=divide_curve_4.Points, DispatchPattern=equality_3.Equality)  # -> ListA, ListB
dispatch_20 = Dispatch(List=dispatch_2.ListA, DispatchPattern=equality_3.Equality)  # -> ListA, ListB
dispatch_21 = Dispatch(List=dispatch_2.ListA, DispatchPattern=equality_3.Equality)  # -> ListA, ListB
dispatch_22 = Dispatch(List=dispatch_14.ListA, DispatchPattern=equality_3.Equality)  # -> ListA, ListB
dispatch_23 = Dispatch(List=dispatch_14.ListA, DispatchPattern=equality_3.Equality)  # -> ListA, ListB
dispatch_24 = Dispatch(List=dispatch_14.ListA, DispatchPattern=equality_3.Equality)  # -> ListA, ListB
dispatch_25 = Dispatch(List=dispatch_14.ListB, DispatchPattern=equality_3.Equality)  # -> ListA, ListB
dispatch_26 = Dispatch(List=dispatch_14.ListB, DispatchPattern=equality_3.Equality)  # -> ListA, ListB
dispatch_27 = Dispatch(List=relay_2, DispatchPattern=equality_4.Equality)  # -> ListA, ListB
dispatch_28 = Dispatch(List=divide_curve_4.Points, DispatchPattern=equality_4.Equality)  # -> ListA, ListB
dispatch_29 = Dispatch(List=divide_curve_4.Points, DispatchPattern=equality_4.Equality)  # -> ListA, ListB
dispatch_30 = Dispatch(List=dispatch_2.ListB, DispatchPattern=equality_4.Equality)  # -> ListA, ListB
dispatch_31 = Dispatch(List=dispatch_2.ListB, DispatchPattern=equality_4.Equality)  # -> ListA, ListB
dispatch_32 = Dispatch(List=dispatch_2.ListA, DispatchPattern=equality_4.Equality)  # -> ListA, ListB
dispatch_33 = Dispatch(List=dispatch_2.ListA, DispatchPattern=equality_4.Equality)  # -> ListA, ListB
dispatch_34 = Dispatch(List=dispatch_14.ListA, DispatchPattern=equality_4.Equality)  # -> ListA, ListB
dispatch_35 = Dispatch(List=dispatch_14.ListA, DispatchPattern=equality_4.Equality)  # -> ListA, ListB
dispatch_36 = Dispatch(List=dispatch_13.ListA, DispatchPattern=equality_4.Equality)  # -> ListA, ListB
dispatch_37 = Dispatch(List=dispatch_13.ListA, DispatchPattern=equality_4.Equality)  # -> ListA, ListB
dispatch_38 = Dispatch(List=dispatch_14.ListB, DispatchPattern=equality_4.Equality)  # -> ListA, ListB
dispatch_39 = Dispatch(List=dispatch_14.ListB, DispatchPattern=equality_4.Equality)  # -> ListA, ListB
dispatch_40 = Dispatch(List=dispatch_13.ListB, DispatchPattern=equality_4.Equality)  # -> ListA, ListB
dispatch_41 = Dispatch(List=dispatch_13.ListB, DispatchPattern=equality_4.Equality)  # -> ListA, ListB
line_2 = Line(StartPoint=dispatch_16.ListA, EndPoint=dispatch_2.ListA)
line_3 = Line(StartPoint=dispatch_17.ListA, EndPoint=dispatch_9.ListA)
line_4 = Line(StartPoint=dispatch_17.ListA, EndPoint=dispatch_9.ListB)
line_5 = Line(StartPoint=dispatch_18.ListA, EndPoint=divide_curve_4.Points)
line_6 = Line(StartPoint=dispatch_19.ListA, EndPoint=dispatch_2.ListA)
line_7 = Line(StartPoint=dispatch_20.ListA, EndPoint=dispatch_14.ListB)
line_8 = Line(StartPoint=dispatch_21.ListA, EndPoint=dispatch_14.ListA)
line_9 = Line(StartPoint=dispatch_23.ListA, EndPoint=dispatch_9.ListA)
line_10 = Line(StartPoint=dispatch_24.ListA, EndPoint=dispatch_10.ListA)
line_11 = Line(StartPoint=dispatch_25.ListA, EndPoint=dispatch_9.ListB)
line_12 = Line(StartPoint=dispatch_26.ListA, EndPoint=dispatch_10.ListB)
line_13 = Line(StartPoint=dispatch_27.ListA, EndPoint=divide_curve_4.Points)
line_14 = Line(StartPoint=dispatch_28.ListA, EndPoint=dispatch_2.ListA)
line_15 = Line(StartPoint=dispatch_29.ListA, EndPoint=dispatch_2.ListB)
line_16 = Line(StartPoint=dispatch_30.ListA, EndPoint=dispatch_13.ListB)
line_17 = Line(StartPoint=dispatch_31.ListA, EndPoint=dispatch_14.ListB)
line_18 = Line(StartPoint=dispatch_32.ListA, EndPoint=dispatch_13.ListA)
line_19 = Line(StartPoint=dispatch_33.ListA, EndPoint=dispatch_14.ListA)
line_20 = Line(StartPoint=dispatch_34.ListA, EndPoint=dispatch_11.ListA)
line_21 = Line(StartPoint=dispatch_35.ListA, EndPoint=dispatch_9.ListA)
line_22 = Line(StartPoint=dispatch_36.ListA, EndPoint=dispatch_10.ListA)
line_23 = Line(StartPoint=dispatch_37.ListA, EndPoint=dispatch_12.ListA)
line_24 = Line(StartPoint=dispatch_38.ListA, EndPoint=dispatch_9.ListB)
line_25 = Line(StartPoint=dispatch_39.ListA, EndPoint=dispatch_11.ListB)
line_26 = Line(StartPoint=dispatch_40.ListA, EndPoint=dispatch_12.ListB)
line_27 = Line(StartPoint=dispatch_41.ListA, EndPoint=dispatch_10.ListB)
line_28 = Line(StartPoint=dispatch_15.ListA, EndPoint=dispatch_9.ListA)

# ---- group: Pointy End
expression_2 = Expression(x=addition_6, y=branchlayer, Expression="x*(y-2)")
larger_than_2 = LargerThan(FirstNumber=branchlayer, SecondNumber=3)  # -> LargerThan, OrEqualTo
expression_3 = Expression(x=addition_6, y=branchlayer, Expression="x*y/4")
smaller_than = SmallerThan(FirstNumber=branchlayer, SecondNumber=2)  # -> SmallerThan, OrEqualTo
dispatch_42 = Dispatch(List=expression_2, DispatchPattern=larger_than_2.OrEqualTo)  # -> ListA, ListB
dispatch_43 = Dispatch(List=expression_3, DispatchPattern=smaller_than.OrEqualTo)  # -> ListA, ListB
divide_curve_6 = DivideCurve(Curve=bezier_span.Curve, Count=[dispatch_42.ListA, dispatch_43.ListA], Kinks=False)  # -> Points, Tangents, Parameters
dispatch_44 = Dispatch(List=divide_curve_6.Points, DispatchPattern=[True, False])  # -> ListA, ListB
split_list = SplitList(List=divide_curve_6.Tangents, Index=Slider(30, range=0..30))  # -> ListA, ListB
move_away_from = MoveAwayFrom(Geometry=dispatch_44.ListA, Emitter=split_list.ListB, Distance=pointyedges)  # -> Geometry, Transform
split_list_2 = SplitList(List=dispatch_44.ListA, Index=1)  # -> ListA, ListB
line_29 = Line(StartPoint=dispatch_44.ListA, EndPoint=move_away_from.Geometry)
line_30 = Line(StartPoint=move_away_from.Geometry, EndPoint=split_list_2.ListB)
join_curves = JoinCurves(Curves=[line_29, line_30], Preserve=False)

# ----
dispatch_45 = Dispatch(List=join_curves, DispatchPattern=curl)  # -> ListA, flatten(ListB)

# ---- group: Render
join_curves_2 = JoinCurves(
    Curves=[line_3, line_2, line_4, line_5, line_6, line_7, line_8, line_9, line_10, line_11, line_12, line_13, line_14, line_15, line_16, line_17, line_18, line_19, line_20, line_21, line_22, line_23, line_24, line_25, line_26, line_27, line_28, join_curves, dispatch_3.ListB],
    Preserve=False)
mirror = Mirror(Geometry=join_curves_2, Plane=plane_3pt)  # -> Geometry, Transform
dispatch_46 = Dispatch(List=join_curves_2, DispatchPattern=curl)  # -> ListA, flatten(ListB)
dispatch_47 = Dispatch(List=mirror.Geometry, DispatchPattern=curl)  # -> ListA, flatten(ListB)
join_curves_3 = JoinCurves(Curves=[dispatch_46.ListB, dispatch_47.ListB], Preserve=False)
boundary_surfaces = BoundarySurfaces(Edges=join_curves_3)
custom_preview = CustomPreview(Geometry=[join_curves_3, dispatch_45.ListB], Material=colour_swatch)
custom_preview_2 = CustomPreview(Geometry=boundary_surfaces, Material=colour_swatch_2)

# ---- group: Test
join_curves_4 = JoinCurves(Curves=[join_curves_2, mirror.Geometry], Preserve=False)
vector_xyz = VectorXYZ(XComponent=Slider(50, range=0..50), YComponent=0, ZComponent=0)  # -> Vector, Length
radians_2 = Radians(Degrees=Slider(30, range=0..90))
move_4 = Move(Geometry=join_curves_4, Motion=vector_xyz.Vector)  # -> Geometry, Transform
point = Point(<point referenced from the Rhino model>)
move_5 = Move(Geometry=point, Motion=vector_xyz.Vector)  # -> Geometry, Transform
plane_3pt_2 = Plane3Pt(PointA=move_5.Geometry, PointB="{50,10,0}", PointC="{0,0,0}")
rotate = Rotate(Geometry=move_4.Geometry, Angle=radians_2, Plane=plane_3pt_2)  # -> Geometry, Transform
plane_3pt_3 = Plane3Pt(PointA=move_5.Geometry, PointB="{50,10,0}", PointC="{50,0,10}")
mirror_2 = Mirror(Geometry=rotate.Geometry, Plane=plane_3pt_3)  # -> Geometry, Transform

# ---- group: Swirl
smaller_than_2 = SmallerThan(FirstNumber=curlamount, SecondNumber="0")  # -> SmallerThan, OrEqualTo
larger_than_3 = LargerThan(FirstNumber=curlamount, SecondNumber="0")  # -> LargerThan, OrEqualTo
negative = Negative(Value=curlangle)
negative_2 = Negative(Value=curlamount)
multiplication_7 = Multiplication(A=[smaller_than_2.SmallerThan, smaller_than_2.OrEqualTo], B=negative_2)
multiplication_8 = Multiplication(A=[smaller_than_2.SmallerThan, smaller_than_2.OrEqualTo], B=negative)
multiplication_9 = Multiplication(A=[larger_than_3.LargerThan, larger_than_3.OrEqualTo], B=curlangle)
multiplication_10 = Multiplication(A=[larger_than_3.LargerThan, larger_than_3.OrEqualTo], B=curlamount)
addition_9 = Addition(A=multiplication_7, B=multiplication_10)
addition_10 = Addition(A=multiplication_8, B=multiplication_9)
dispatch_48 = Dispatch(List=mirror.Geometry, DispatchPattern=curl)  # -> flatten(ListA), ListB
dispatch_49 = Dispatch(List=join_curves_2, DispatchPattern=curl)  # -> flatten(ListA), ListB
vector_xyz_2 = VectorXYZ(XComponent=curlamount, YComponent="0", ZComponent="0")  # -> Vector, Length
dispatch_50 = Dispatch(List=fit_line, DispatchPattern=curl)  # -> ListA, ListB
vector_xyz_3 = VectorXYZ(XComponent="0", YComponent=curlamount, ZComponent="0")  # -> Vector, Length
origin_2 = Point(<point referenced from the Rhino model>)
radians_3 = Radians(Degrees=addition_10)
move_6 = Move(Geometry=origin_2, Motion=vector_xyz_2.Vector)  # -> Geometry, Transform
move_7 = Move(Geometry=origin_2, Motion=vector_xyz_3.Vector)  # -> Geometry, Transform
plane_3pt_4 = Plane3Pt(PointA=move_6.Geometry, PointB=origin_2, PointC=move_7.Geometry)
arc = Arc(Plane=plane_3pt_4, Radius=addition_9, Angle=radians_3)  # -> Arc, Length
bend_deform = BendDeform(Geometry=[dispatch_49.ListA, dispatch_50.ListA, dispatch_48.ListA], BendingArc=arc.Arc)
dispatch_51 = Dispatch(List=bend_deform, DispatchPattern=curl)  # -> flatten(ListA), flatten(ListB)
dispatch_52 = Dispatch(List=bend_deform, DispatchPattern=curl)  # -> flatten(ListA), flatten(ListB)
boundary_surfaces_2 = BoundarySurfaces(Edges=dispatch_51.ListA)
custom_preview_3 = CustomPreview(Geometry=dispatch_52.ListA, Material=colour_swatch)
custom_preview_4 = CustomPreview(Geometry=boundary_surfaces_2, Material=colour_swatch_2)
