# Grasshopper definition leaf_v4.gh (Grasshopper 1.0.7)

number_slider = Slider(0.574, range=0..1)
number_slider_2 = Slider(0.773, range=0..1)
number_slider_3 = Slider(20, range=0..20)
multiplication = Multiplication(A=number_slider_3, B=number_slider_2)
multiplication_2 = Multiplication(A=number_slider_3, B=number_slider_2)
multiplication_3 = Multiplication(A=multiplication, B=number_slider)
number_slider_4 = Slider(2.517, range=0..10)
construct_domain = ConstructDomain(DomainStart="0", DomainEnd="1")
construct_domain_2 = ConstructDomain(DomainStart="0", DomainEnd=number_slider_3)
construct_domain_3 = ConstructDomain(DomainStart="0", DomainEnd="1")
construct_domain_4 = ConstructDomain(DomainStart="0", DomainEnd="1")
construct_domain_5 = ConstructDomain(DomainStart="0", DomainEnd=multiplication_3)
remap_numbers = RemapNumbers(Value=number_slider, Source=construct_domain_4, Target=construct_domain_5)  # -> Mapped, Clipped
construct_domain_6 = ConstructDomain(DomainStart=remap_numbers.Mapped, DomainEnd=multiplication_2)
remap_numbers_2 = RemapNumbers(Value=Slider(0.365, range=0..1), Source=construct_domain_3, Target=construct_domain_6)  # -> Mapped, Clipped
remap_numbers_3 = RemapNumbers(Value=number_slider_2, Source=construct_domain, Target=construct_domain_2)  # -> Mapped, Clipped
vector_xyz = VectorXYZ(XComponent=0, YComponent=remap_numbers_2.Mapped, ZComponent=0)  # -> Vector, Length
vector_xyz_2 = VectorXYZ(XComponent=0, YComponent=number_slider_3, ZComponent=0)  # -> Vector, Length
vector_xyz_3 = VectorXYZ(XComponent=0, YComponent=remap_numbers.Mapped, ZComponent=0)  # -> Vector, Length
origin = Point(<point referenced from the Rhino model>)
vector_xyz_4 = VectorXYZ(XComponent=0, YComponent=remap_numbers_3.Mapped, ZComponent=0)  # -> Vector, Length
move = Move(Geometry=origin, Motion=vector_xyz_2.Vector)  # -> Geometry, Transform
move_2 = Move(Geometry=origin, Motion=vector_xyz.Vector)  # -> Geometry, Transform
move_3 = Move(Geometry=origin, Motion=vector_xyz_4.Vector)  # -> Geometry, Transform
move_4 = Move(Geometry=origin, Motion=vector_xyz_3.Vector)  # -> Geometry, Transform
line = Line(StartPoint=origin, EndPoint=move.Geometry)
vector_xyz_5 = VectorXYZ(XComponent=Slider(5.3, range=0..10), YComponent=0, ZComponent=0)  # -> Vector, Length
number_slider_5 = Slider(2.7, range=0..10)
vector_xyz_6 = VectorXYZ(XComponent=Slider(6.2, range=0..10), YComponent=0, ZComponent=0)  # -> Vector, Length
number_slider_6 = Slider(1.138, range=0..1.57)
number_slider_7 = Slider(0.607, range=0..1.57)
vector_xyz_7 = VectorXYZ(XComponent=Slider(9.1, range=0..10), YComponent=0, ZComponent=0)  # -> Vector, Length
range = Range(Domain=Domain(0, 1), Steps=10)
number_slider_8 = Slider(0.375, range=0..1.57)
curve_domain = CurveDomain(Curve=line)  # -> Curve, Domain
move_5 = Move(Geometry=move_3.Geometry, Motion=vector_xyz_5.Vector)  # -> Geometry, Transform
move_6 = Move(Geometry=move_2.Geometry, Motion=vector_xyz_6.Vector)  # -> Geometry, Transform
move_7 = Move(Geometry=move_4.Geometry, Motion=vector_xyz_7.Vector)  # -> Geometry, Transform
rotate_3d = Rotate3D(Geometry=move_6.Geometry, Angle=Slider(0.539, range=-1.57..1.57), Center=move_2.Geometry, Axis=Vector(0, 0, 1))  # -> Geometry, Transform
rotate_3d_2 = Rotate3D(Geometry=move_5.Geometry, Angle=Slider(0.601, range=-1.57..1.57), Center=move_3.Geometry, Axis=Vector(0, 0, 1))  # -> Geometry, Transform
rotate_3d_3 = Rotate3D(Geometry=move_7.Geometry, Angle=Slider(0.028, range=-1.57..1.57), Center=move_4.Geometry, Axis=Vector(0, 0, 1))  # -> Geometry, Transform
vector_2pt = Vector2Pt(PointA=move_3.Geometry, PointB=rotate_3d_2.Geometry, Unitize=False)  # -> Vector, Length
vector_2pt_2 = Vector2Pt(PointA=move_4.Geometry, PointB=rotate_3d_3.Geometry, Unitize=False)  # -> Vector, Length
vector_2pt_3 = Vector2Pt(PointA=move_2.Geometry, PointB=rotate_3d.Geometry, Unitize=False)  # -> Vector, Length
multiplication_4 = Multiplication(A=number_slider_6, B=-1)
multiplication_5 = Multiplication(A=vector_2pt_2.Vector, B=Slider(0.46, range=0..1))
multiplication_6 = Multiplication(A=number_slider_7, B=-1)
multiplication_7 = Multiplication(A=vector_2pt.Vector, B=Slider(0.69, range=0..1))
multiplication_8 = Multiplication(A=vector_2pt.Vector, B=Slider(0.41, range=0..1))
multiplication_9 = Multiplication(A=vector_2pt_2.Vector, B=Slider(0.51, range=0..1))
multiplication_10 = Multiplication(A=vector_2pt_3.Vector, B=Slider(0.67, range=0..1))
multiplication_11 = Multiplication(A=number_slider_8, B=-1)
multiplication_12 = Multiplication(A=vector_2pt_3.Vector, B=Slider(0.27, range=0..1))
move_8 = Move(Geometry=move_3.Geometry, Motion=multiplication_7)  # -> Geometry, Transform
move_9 = Move(Geometry=move_4.Geometry, Motion=multiplication_9)  # -> Geometry, Transform
move_10 = Move(Geometry=move_8.Geometry, Motion=multiplication_8)  # -> Geometry, Transform
move_11 = Move(Geometry=move_9.Geometry, Motion=multiplication_5)  # -> Geometry, Transform
move_12 = Move(Geometry=move_2.Geometry, Motion=multiplication_12)  # -> Geometry, Transform
move_13 = Move(Geometry=move_12.Geometry, Motion=multiplication_10)  # -> Geometry, Transform
rotate_3d_4 = Rotate3D(Geometry=move_11.Geometry, Angle=number_slider_7, Center=move_9.Geometry, Axis=Vector(0, 0, 1))  # -> Geometry, Transform
rotate_3d_5 = Rotate3D(Geometry=move_10.Geometry, Angle=multiplication_4, Center=move_8.Geometry, Axis=Vector(0, 0, 1))  # -> Geometry, Transform
rotate_3d_6 = Rotate3D(Geometry=move_11.Geometry, Angle=multiplication_6, Center=move_9.Geometry, Axis=Vector(0, 0, 1))  # -> Geometry, Transform
rotate_3d_7 = Rotate3D(Geometry=move_10.Geometry, Angle=number_slider_6, Center=move_8.Geometry, Axis=Vector(0, 0, 1))  # -> Geometry, Transform
rotate_3d_8 = Rotate3D(Geometry=move_13.Geometry, Angle=number_slider_8, Center=move_12.Geometry, Axis=Vector(0, 0, 1))  # -> Geometry, Transform
rotate_3d_9 = Rotate3D(Geometry=move_13.Geometry, Angle=multiplication_11, Center=move_12.Geometry, Axis=Vector(0, 0, 1))  # -> Geometry, Transform
merge = Merge(Data1=[move.Geometry, move_3.Geometry, move_8.Geometry, rotate_3d_7.Geometry])
merge_2 = Merge(Data1=[rotate_3d_7.Geometry, move_8.Geometry, rotate_3d_2.Geometry])
merge_3 = Merge(Data1=[rotate_3d_2.Geometry, move_8.Geometry, rotate_3d_5.Geometry])
merge_4 = Merge(Data1=[rotate_3d_5.Geometry, move_8.Geometry, move_3.Geometry, move_2.Geometry, move_12.Geometry, rotate_3d_8.Geometry])
merge_5 = Merge(Data1=[rotate_3d_8.Geometry, move_12.Geometry, rotate_3d.Geometry])
merge_6 = Merge(Data1=[rotate_3d.Geometry, move_12.Geometry, rotate_3d_9.Geometry])
merge_7 = Merge(Data1=[rotate_3d_9.Geometry, move_12.Geometry, move_2.Geometry, move_4.Geometry, move_9.Geometry, rotate_3d_4.Geometry])
merge_8 = Merge(Data1=[rotate_3d_4.Geometry, move_9.Geometry, rotate_3d_3.Geometry])
merge_9 = Merge(Data1=[rotate_3d_3.Geometry, move_9.Geometry, rotate_3d_6.Geometry])
merge_10 = Merge(Data1=[rotate_3d_6.Geometry, move_9.Geometry, move_4.Geometry, origin])
interpolate = Interpolate(Vertices=merge, Degree=1, Periodic=False, KnotStyle=1)  # -> Curve, Length, Domain
interpolate_2 = Interpolate(Vertices=merge_6, Degree=1, Periodic=False, KnotStyle=1)  # -> Curve, Length, Domain
interpolate_3 = Interpolate(Vertices=merge_2, Degree=1, Periodic=False, KnotStyle=1)  # -> Curve, Length, Domain
interpolate_4 = Interpolate(Vertices=merge_3, Degree=1, Periodic=False, KnotStyle=1)  # -> Curve, Length, Domain
interpolate_5 = Interpolate(Vertices=merge_7, Degree=1, Periodic=False, KnotStyle=1)  # -> Curve, Length, Domain
interpolate_6 = Interpolate(Vertices=merge_5, Degree=1, Periodic=False, KnotStyle=1)  # -> Curve, Length, Domain
interpolate_7 = Interpolate(Vertices=merge_4, Degree=1, Periodic=False, KnotStyle=1)  # -> Curve, Length, Domain
interpolate_8 = Interpolate(Vertices=merge_8, Degree=1, Periodic=False, KnotStyle=1)  # -> Curve, Length, Domain
interpolate_9 = Interpolate(Vertices=merge_9, Degree=1, Periodic=False, KnotStyle=1)  # -> Curve, Length, Domain
interpolate_10 = Interpolate(Vertices=merge_10, Degree=1, Periodic=False, KnotStyle=1)  # -> Curve, Length, Domain
nurbs_curve = NurbsCurve(Vertices=merge_8, Degree=2, Periodic=False)  # -> Curve, Length, Domain
nurbs_curve_2 = NurbsCurve(Vertices=merge_5, Degree=2, Periodic=False)  # -> Curve, Length, Domain
nurbs_curve_3 = NurbsCurve(Vertices=merge_10, Degree=2, Periodic=False)  # -> Curve, Length, Domain
nurbs_curve_4 = NurbsCurve(Vertices=merge_7, Degree=2, Periodic=False)  # -> Curve, Length, Domain
nurbs_curve_5 = NurbsCurve(Vertices=merge_4, Degree=2, Periodic=False)  # -> Curve, Length, Domain
nurbs_curve_6 = NurbsCurve(Vertices=merge_6, Degree=2, Periodic=False)  # -> Curve, Length, Domain
nurbs_curve_7 = NurbsCurve(Vertices=merge_9, Degree=2, Periodic=False)  # -> Curve, Length, Domain
nurbs_curve_8 = NurbsCurve(Vertices=merge_3, Degree=2, Periodic=False)  # -> Curve, Length, Domain
nurbs_curve_9 = NurbsCurve(Vertices=merge_2, Degree=2, Periodic=False)  # -> Curve, Length, Domain
nurbs_curve_10 = NurbsCurve(Vertices=merge, Degree=3, Periodic=False)  # -> Curve, Length, Domain
interpolate_11 = Interpolate(
    Vertices=[move.Geometry, rotate_3d_7.Geometry, rotate_3d_2.Geometry, rotate_3d_5.Geometry, rotate_3d_8.Geometry, rotate_3d.Geometry, rotate_3d_9.Geometry, rotate_3d_4.Geometry, rotate_3d_3.Geometry, rotate_3d_6.Geometry, origin],
    Degree=3,
    Periodic=False,
    KnotStyle=1)  # -> Curve, Length, Domain
merge_11 = Merge(Data1=[move.Geometry, rotate_3d_7.Geometry, rotate_3d_2.Geometry, rotate_3d_5.Geometry, rotate_3d_8.Geometry, rotate_3d.Geometry, rotate_3d_9.Geometry, rotate_3d_4.Geometry, rotate_3d_3.Geometry, rotate_3d_6.Geometry, origin])
curve_closest_point = CurveClosestPoint(Point=merge_11, Curve=interpolate_11.Curve)  # -> Point, flatten(Parameter), Distance
shatter = Shatter(Curve=interpolate_11.Curve, Parameters=curve_closest_point.Parameter)
merge_12 = Merge(Data1=[nurbs_curve_10.Curve, nurbs_curve_9.Curve, nurbs_curve_8.Curve, nurbs_curve_5.Curve, nurbs_curve_2.Curve, nurbs_curve_6.Curve, nurbs_curve_4.Curve, nurbs_curve.Curve, nurbs_curve_7.Curve, nurbs_curve_3.Curve])
tween_curve = TweenCurve(CurveA=shatter, CurveB=merge_12, Factor=Slider(0.7, range=0..1), BlendType=0)
tween_curve_2 = TweenCurve(CurveA=shatter, CurveB=merge_12, Factor=Slider(0.3, range=0..1), BlendType=0)
