# Grasshopper definition 3D_Vector_Lines_test.gh (Grasshopper 1.0.7)

recgrid = Rectangular(Plane=PlaneXY(0, 0, 0), SizeX=2, SizeY=2, ExtentX=10, ExtentY=10)  # -> flatten(Cells), Points
pt = Point(<point referenced from the Rhino model>)
pt_2 = Point(<point referenced from the Rhino model>)
pt_3 = Point(<point referenced from the Rhino model>)
pt_4 = Point(<point referenced from the Rhino model>)
box = Box2Pt(PointA=pt, PointB=pt_2, Plane=PlaneXY(0, 0, 0))
pop2d = Populate2D(Region={Plane=PlaneXY(0, 0, 0), Size=Domain2(u=0..20, v=0..20)}, Count=100, Seed=1)
pt_5 = Point(recgrid.Points)
pcharge = PointCharge(Point=pt_3, Charge=expr("x/100", Slider(0.076, range=0..1)), Decay=Slider(0.188, range=0..1), Bounds=box)
pcharge_2 = PointCharge(Point=pt_4, Charge=expr("x/100", Slider(-0.029, range=-1..1)), Decay=Slider(0.214, range=0..1))
fspin = SpinForce(Plane=pt_4, Strength=Slider(0.001, range=0..10), Radius=Slider(9.029, range=0..10), Decay=2, Bounds=box)
mergef = MergeFields(Fields=[pcharge_2, fspin, pcharge])
fline = FieldLine(Field=mergef, Point=pt_5, Steps=1000, Accuracy=0.1, Method=3)
