# Grasshopper definition 3dline_v8.gh (Grasshopper 1.0.7)

random = Random(Range=Domain(0, 1), Number=12, Seed=544)
split_list = SplitList(List=random, Index=1)  # -> ListA, ListB
split_list_2 = SplitList(List=split_list.ListB, Index=1)  # -> ListA, ListB
split_list_3 = SplitList(List=split_list_2.ListB, Index=1)  # -> ListA, ListB
split_list_4 = SplitList(List=split_list_3.ListB, Index=1)  # -> ListA, ListB
split_list_5 = SplitList(List=split_list_4.ListB, Index=1)  # -> ListA, ListB
split_list_6 = SplitList(List=split_list_5.ListB, Index=1)  # -> ListA, ListB
split_list_7 = SplitList(List=split_list_6.ListB, Index=1)  # -> ListA, ListB
split_list_8 = SplitList(List=split_list_7.ListB, Index=1)  # -> ListA, ListB
split_list_9 = SplitList(List=split_list_8.ListB, Index=1)  # -> ListA, ListB
split_list_10 = SplitList(List=split_list_9.ListB, Index=1)  # -> ListA, ListB
split_list_11 = SplitList(List=split_list_10.ListB, Index=1)  # -> ListA, ListB
split_list_12 = SplitList(List=split_list_11.ListB, Index=1)  # -> ListA, ListB
construct_point = ConstructPoint(XCoordinate=split_list_10.ListA, YCoordinate=split_list_11.ListA, ZCoordinate=split_list_12.ListA)
pln = Plane(PlaneXY(0, 0, 0))
point = Point(<point referenced from the Rhino model>)
construct_point_2 = ConstructPoint(XCoordinate=split_list_7.ListA, YCoordinate=split_list_8.ListA, ZCoordinate=split_list_9.ListA)
construct_point_3 = ConstructPoint(XCoordinate=split_list_4.ListA, YCoordinate=split_list_5.ListA, ZCoordinate=split_list_6.ListA)
point_2 = Point(<point referenced from the Rhino model>)
construct_point_4 = ConstructPoint(XCoordinate=split_list.ListA, YCoordinate=split_list_2.ListA, ZCoordinate=split_list_3.ListA)
number_slider = Slider(20, range=0..50)
time = Slider(0, range=0..100)
number_slider_2 = Slider(2, range=0..10)
number_slider_3 = Slider(20, range=0..20)
random_2 = Random(Range=Domain(0, 50), Number=10, Seed=Slider(31852, range=0..100000))
point_3 = Point(<point referenced from the Rhino model>)
point_4 = Point(<point referenced from the Rhino model>)
vector_2pt = Vector2Pt(PointA=construct_point_2, PointB=construct_point, Unitize=False)  # -> Vector, Length
vector_2pt_2 = Vector2Pt(PointA=point_2, PointB=point, Unitize=False)  # -> Vector, Length
box_2pt = Box2Pt(PointA=point_3, PointB=point_4, Plane=PlaneXY(0, 0, 0))
trigger = Trigger(Interval=20, TimerInterval=20, Target=[data_recorder, random_3])  # disabled
rectangular = Rectangular(Plane=PlaneXY(0, 0, 0), SizeX=2, SizeY=2, ExtentX=10, ExtentY=10)  # -> flatten(Cells), Points
rectangular_2 = Rectangular(Plane=PlaneXY(0, 0, 0), SizeX=number_slider_2, SizeY=number_slider_2, ExtentX=number_slider_3, ExtentY=number_slider_3)  # -> flatten(Cells), Points
data_recorder = DataRecorder(flatten("1"), DataLimit=-10, RecordData=True)
point_5 = Point(<point referenced from the Rhino model>)
populate_3d = Populate3D(
    Region={Plane=PlaneXY(0, 0, 0), X=Domain(0, 10), Y=Domain(0, 10), Z=Domain(0, 2)},
    Count=expr("x*4", 10),
    Seed=Slider(446, range=0..500))
point_6 = Point(<point referenced from the Rhino model>)
number_slider_4 = Slider(400, range=0..400)
series = Series(Start=0, Step=2, Count=100)
number_slider_5 = Slider(2500, range=0..5000)
point_7 = Point(<point referenced from the Rhino model>)
point_8 = Point(flatten(rectangular_2.Points))
point_9 = Point(rectangular.Points)
linear_array = LinearArray(Geometry=point_9, Direction=Vector(0, 0, 1), Count=20)  # -> flatten(Geometry), Transform
bounding_box = BoundingBox(Content=linear_array.Geometry, Plane=PlaneXY(0, 0, 0), UnionBox=True)  # -> Box, Box_2
move = Move(Geometry=bounding_box.Box, Motion=Vector(10, 10, -80))  # -> Geometry, Transform
populate_3d_2 = Populate3D(Region=move.Geometry, Count=number_slider, Seed=2)
list_length = ListLength(List=data_recorder)
dispatch = Dispatch(List=populate_3d, DispatchPattern=[True, False])  # -> ListA, ListB
point_charge = PointCharge(Point=point_6, Charge=expr("x/100", Slider(1, range=-1..1)), Decay=Slider(-1, range=-1..1))
point_charge_2 = PointCharge(Point=point_5, Charge=expr("x/100", Slider(36.098, range=-1..100)), Decay=Slider(95.838, range=0..100))
point_10 = Point(<point referenced from the Rhino model>)
list_item = ListItem(List=populate_3d_2, Index=random_2, Wrap=True)
panel = Panel(list_length)
construct_domain = ConstructDomain(DomainStart=10, DomainEnd=expr("x/4", number_slider_5))
vector_2pt_3 = Vector2Pt(PointA=dispatch.ListB, PointB=dispatch.ListA, Unitize=False)  # -> Vector, Length
point_charge_3 = PointCharge(Point=point_10, Charge=expr("x/100", Slider(5, range=-50.001..50)), Decay=Slider(2, range=0..100))
random_3 = Random(Range=construct_domain, Number=number_slider, Seed=5)
dispatch_2 = Dispatch(List=vector_2pt_3.Vector, DispatchPattern=[True, False])  # -> ListA, ListB
spin_force = SpinForce(Plane=point_7, Strength=Slider(43.165, range=0..150), Radius=Slider(3.355, range=0..10), Decay=1)
merge_fields = MergeFields(Fields=[point_charge, spin_force, point_charge_2])
dom = ConstructDomain(DomainStart=1, DomainEnd=5)
addition = Addition(A=number_slider_4, B=random_3)
remap = RemapNumbers(Value=number_slider_4, Source=Domain(0, 400), Target=dom)  # -> Mapped, Clipped
modulus = Modulus(A=addition, B=number_slider_5)
remap_2 = RemapNumbers(Value=number_slider_4, Source=Domain(0, 1), Target=Domain(0, 1))  # -> Mapped, Clipped
rectangle = Rectangle(Plane=PlaneXY(0, 0, 0), XSize=Domain(0, 20), YSize=Domain(0, 20), Radius=0)  # -> Rectangle, Length
nurbs = NurbsCurve(Degree=3, Periodic=False)  # -> Curve, Length, Domain
number_slider_6 = Slider(5, range=0..10)
move_2 = Move(Geometry=rectangle.Rectangle, Motion=Vector(0, 0, 15))  # -> Geometry, Transform
field_line = FieldLine(Field=merge_fields, Point=populate_3d_2, Steps=number_slider_5, Accuracy=0.1, Method=3)
point_on_curve = PointOnCurve(field_line, parameter=0.207)  # disabled
divide_curve = DivideCurve(Curve=field_line, Count=1, Kinks=False)  # -> Points, Tangents, Parameters
evaluate_curve = EvaluateCurve(Curve=field_line, Parameter=modulus)  # -> flatten(Point), Tangent, Angle
construct_plane = ConstructPlane(Origin=evaluate_curve.Point, XAxis=Vector(1, 0, 0), YAxis=vector_2pt_2.Vector)
construct_plane_2 = ConstructPlane(Origin=evaluate_curve.Point, XAxis=dispatch_2.ListA, YAxis=dispatch_2.ListB)
dispatch_3 = Dispatch(List=evaluate_curve.Point, DispatchPattern=[True, False])  # -> ListA, ListB
point_charge_4 = PointCharge(Point=dispatch_3.ListA, Charge=expr("x/1000", Slider(0, range=-50..50)), Decay=Slider(2, range=0..100))
list_item_2 = ListItem(List=point_charge_4, Index=5, Wrap=True)
point_charge_5 = PointCharge(Point=dispatch_3.ListB, Charge=expr("x/1000", Slider(-1, range=-50..50)), Decay=Slider(2, range=-10..10))  # disabled
dispatch_4 = Dispatch(List=divide_curve.Points, DispatchPattern=[True, False])  # -> flatten(ListA), ListB
eval = EvaluateCurve()  # -> Point, Tangent, Angle
dom_2 = ConstructDomain(DomainStart=270, DomainEnd=323)
pdecon = Deconstruct(Point=evaluate_curve.Point)  # -> XComponent, YComponent, ZComponent
graph = GraphMapper(
    pdecon.ZComponent,
    x0=10,
    x1=50,
    y0=0,
    y1=5,
    container_name="Bezier",
    cpx=[0, 0.3647647202, 0.8019129634, 1],
    cpy=[0, 0.3550440669, 0.7998511195, 0.9939051867])
spin_force_2 = SpinForce(Plane=construct_plane_2, Strength=expr("x/100", Slider(0.001, range=0..1)), Radius=graph, Decay=Slider(1, range=0..100))
merge_fields_2 = MergeFields(Fields=flatten([spin_force_2, point_charge_3]))
field_line_2 = FieldLine(Field=merge_fields_2, Point=point_8, Steps=1000, Accuracy=0.1, Method=1)
tensor_display = TensorDisplay(Field=merge_fields_2, Section=move_2.Geometry, Samples=1000)
length = Length(Curve=field_line_2)
rebuild_curve = RebuildCurve(Curve=field_line_2, Degree=2, Count=10, Tangents=False)  # disabled
bounds = Bounds(Numbers=length)
divdist = DivideDistance(Curve=field_line_2)  # -> Points, Tangents, Parameters
pt = Point(<point referenced from the Rhino model>)  # disabled
pl = ConstructPlane(Origin=Point(0, 0, 0), XAxis=Vector(1, 0, 0), YAxis=Vector(0, 1, 0))  # disabled
remap_numbers = RemapNumbers(Value=length, Source=bounds, Target=Domain(0, 1))  # -> Mapped, Clipped
crv_cp = CurveClosestPoint(Point=pt, Curve=field_line_2)  # -> Point, Parameter, Distance; disabled
move_3 = Move(Geometry=pl, Motion=Vector(0, 0, 80))  # -> Geometry, Transform; disabled
gradient = Gradient(
    LowerLimit=0,
    UpperLimit=1,
    Parameter=remap_numbers.Mapped,
    stops=[0: RGB(40, 48, 27), 0.201: RGB(80, 55, 25), 0.493: RGB(159, 65, 29), 0.742: RGB(174, 166, 129), 0.937: RGB(224, 224, 224)])
pcx = CurvePlane(Curve=field_line_2, Plane=move_3.Geometry)  # -> Points, ParamsC, ParamsP; disabled
custom_preview = CustomPreview(Geometry=field_line_2, Material=gradient)
item = ListItem(Index=10, Wrap=True)
