# Grasshopper definition jury_v3.gh (Grasshopper 1.0.7)
# plug-ins: Pufferfish

number_slider = Slider(20, range=0..100)
number_slider_2 = Slider(20, range=0..100)
number_slider_3 = Slider(5, range=0..10)
multiplication = Multiplication(A=number_slider_2, B=0.275)
multiplication_2 = Multiplication(A=number_slider, B=0.275)
time = Slider(250, range=0..400)
lenght = Slider(4000, range=0..5000)
number_slider_4 = Slider(10, range=0..100)
division = Division(A=number_slider_4, B=number_slider_3)
division_2 = Division(A=number_slider_4, B=number_slider_3)
number_slider_5 = Slider(10, range=0..100)
division_3 = Division(A=number_slider_5, B=number_slider_3)
division_4 = Division(A=number_slider_5, B=number_slider_3)
rectangle = Rectangle(Plane=PlaneXY(0, 0, 0), XSize=division, YSize=division_3, Radius=0)  # -> Rectangle, Length
number_slider_6 = Slider(150, range=0..200)
addition = Addition(A=division_2, B=multiplication)
density = Slider(40, range=0..200)
addition_2 = Addition(A=division_4, B=multiplication_2)
multiplication_3 = Multiplication(A=number_slider_4, B=2)
multiplication_4 = Multiplication(A=number_slider_5, B=2)
pt = ConstructPoint(XCoordinate=0, YCoordinate=0, ZCoordinate=0)
arrrec = RectangularArray(Geometry=pt, Cell=rectangle.Rectangle, XCount=number_slider, YCount=number_slider_2)  # -> Geometry, Transform
rectangle_2 = Rectangle(Plane=PlaneXY(0, 0, 0), XSize=multiplication_3, YSize=multiplication_4, Radius=0)  # -> Rectangle, Length
pt_2 = ConstructPoint(XCoordinate=0, YCoordinate=0, ZCoordinate=expr("x*-3", number_slider_6))
point_charge = PointCharge(Point=pt_2, Charge=expr("x/100", Slider(0.001, range=-50.001..50)), Decay=Slider(0, range=0..100))
populate_3d = Populate3D(Region={Plane=PlaneXY(0, 0, 0), X=Domain(0, 10), Y=Domain(0, 10), Z=Domain(0, 2)}, Count=density, Seed=58654)
pt_3 = ConstructPoint(XCoordinate=0, YCoordinate=0, ZCoordinate=expr("x*2", number_slider_6))
point_charge_2 = PointCharge(Point=pt_3, Charge=expr("x/100", Slider(-0.001, range=-50.001..50)), Decay=Slider(0.35, range=0..100))
vec = VectorXYZ(
    XComponent=expr("x*-1", number_slider_4),
    YComponent=expr("x*-1", number_slider_5),
    ZComponent=expr("x*-1", number_slider_6))  # -> Vector, Length
pop2d = Populate2D(Region=rectangle_2.Rectangle, Count=density, Seed=1)  # -> flatten(Population)
box = CenterBox(Base=PlaneXY(0, 0, 0), X=number_slider_4, Y=number_slider_5, Z=number_slider_6)
vec_2 = VectorXYZ(XComponent=expr("x*-2", addition), YComponent=expr("x*-2", addition_2), ZComponent=expr("x*-0.5", number_slider_6))  # -> Vector, Length
move = Move(Geometry=box, Motion=Vector(0, 0, 30))  # -> Geometry, Transform
pop3d = Populate3D(Region=move.Geometry, Count=density, Seed=56456456)
cluster = Cluster(L=pop3d)
pl = PlaneNormal(Origin=pop3d, ZAxis=cluster)
cluster_2 = Cluster(L=populate_3d)
pcharge = PointCharge(Point=pt_2, Charge=expr("x/100", Slider(1, range=-1..1)), Decay=Slider(-0.75, range=-5..1))
move_2 = Move(Geometry=pop2d, Motion=vec.Vector)  # -> Geometry, Transform
move_3 = Move(Geometry=arrrec.Geometry, Motion=vec_2.Vector)  # -> Geometry, Transform
construct_domain = ConstructDomain(DomainStart=0, DomainEnd=expr("x", lenght))
fspin = SpinForce(Plane=pl, Strength=Slider(1, range=0..150), Radius=Slider(10, range=0..10), Decay=2)
number_slider_7 = Slider(3, range=0..10)
mergef = MergeFields(Fields=flatten([pcharge, fspin]))
random = Random(Range=construct_domain, Number=density, Seed=31)
multiplication_5 = Multiplication(A=time, B=10)
subtraction = Subtraction(A=multiplication_5, B=random)
fline = FieldLine(Field=mergef, Point=move_2.Geometry, Steps=lenght, Accuracy=0.1, Method=3)
modulus = Modulus(A=subtraction, B=lenght)
eval = EvaluateCurve(Curve=fline, Parameter=modulus)  # -> flatten(Point), Tangent, Angle
evaluate_field = EvaluateField(Field=mergef, Point=eval.Point)  # -> Tensor, Strength
rotate_3d = Rotate3D(Geometry=evaluate_field.Tensor, Angle=2.35619449, Center=eval.Point, Axis=cluster_2)  # -> Geometry, Transform
plane_normal = PlaneNormal(Origin=eval.Point, ZAxis=rotate_3d.Geometry)
deconstruct = Deconstruct(Point=eval.Point)  # -> XComponent, YComponent, ZComponent
graph_mapper = GraphMapper(
    deconstruct.ZComponent,
    x0=-20,
    x1=130,
    y0=0,
    y1=500,
    container_name="Bezier",
    cpx=[0, 0, 1, 1],
    cpy=[0, 0.875, 0.8951612711, 0])
graph_mapper_2 = GraphMapper(deconstruct.ZComponent, x0=-20, x1=130, y0=0, y1=5, container_name="Bezier", cpx=[0, 0, 1, 1], cpy=[1, 0, 0, 1])
graph_mapper_3 = GraphMapper(
    deconstruct.ZComponent,
    x0=-20,
    x1=250,
    y0=0,
    y1=10,
    container_name="Bezier",
    cpx=[0, 0.1090909094, 0.4878787994, 1],
    cpy=[0, 0.4959677458, 0.2540322542, 0])
multiplication_6 = Multiplication(A=graph_mapper_3, B=2)
spin_force = SpinForce(
    Plane=plane_normal,
    Strength=expr("x/100", Slider(0.005, range=0..10)),
    Radius=multiplication_6,
    Decay=Slider(0.95, range=0..10))
merge_fields = MergeFields(Fields=flatten([point_charge, point_charge_2, spin_force]))
field_line = FieldLine(Field=merge_fields, Point=move_3.Geometry, Steps=5000, Accuracy=0.1, Method=1)
planesrf = PlaneSurface(Plane=PlaneXY(0, 0, 0), XSize=Domain(-10, 10), YSize=Domain(-10, 10))
reb = RebuildCurve(Curve=field_line, Degree=2, Count=30, Tangents=False)
move_4 = Move(Geometry=planesrf, Motion=Vector(0, 0, 150))  # -> Geometry, Transform
plntrimcrv = PlaneTrimCurve(Curve=reb, Plane=move_4.Geometry, Flip=True)  # -> flatten(Trimmed), Parameters, Intersected
length = Length(Curve=plntrimcrv.Trimmed)
bounds = Bounds(Numbers=length)
series = Series(Start=0, Step=1, Count=200)
pcx = CurvePlane(Plane=move_4.Geometry)  # -> flatten(Points), ParamsC, ParamsP
remap_numbers = RemapNumbers(Value=length, Source=bounds, Target=Domain(0, 1))  # -> Mapped, Clipped
colour = ColourPicker(PickedColour=RGB(0, 0, 0))
item = ListItem(List=pcx.Points, Index=series, Wrap=True)
item_2 = ListItem(Index=series, Wrap=True)
gradient = Gradient(LowerLimit=0, UpperLimit=1, Parameter=remap_numbers.Mapped, stops=[0: RGB(255, 255, 255), 1: RGB(0, 0, 0)])
custom_preview = CustomPreview(Geometry=plntrimcrv.Trimmed, Material=gradient)
ptstrimcrv = PointsTrimCurve(Curve=item_2, Points=item, Flip=False)  # -> Trimmed, SubDomains, Intersected

# ==== cluster Cluster
L = ClusterInput()
lng = ListLength(List=L)
random = Random(Range=Domain(-1, 1), Number=lng, Seed=6)
random_2 = Random(Range=Domain(-1, 1), Number=lng, Seed=2)
random_3 = Random(Range=Domain(-1, 1), Number=lng, Seed=12)
vec = VectorXYZ(XComponent=random_2, YComponent=random, ZComponent=random_3)  # -> Vector, Length
V = ClusterOutput(vec.Vector)
