# Grasshopper definition layers.gh (Grasshopper 1.0.7)
# plug-ins: Kangaroo2 Components

number_slider = Slider(5, range=0..10)
number_slider_2 = Slider(5, range=0..10)
pop2d = Populate2D(Region={Plane=PlaneXY(0, 0, 0), Size=Domain2(u=0..20, v=0..20)}, Count=Slider(3, range=0..10), Seed=567)
pt = Point(<point referenced from the Rhino model>)
move = Move(Geometry=pop2d, Motion=Vector(0, 0, 10))  # -> Geometry, Transform
pop2d_2 = Populate2D(Region={Plane=PlaneXY(0, 0, 0), Size=Domain2(u=0..12, v=0..5)}, Count=Slider(40, range=0..100), Seed=1456)
arrrec = RectangularArray(Geometry=pt, Cell={Plane=PlaneXY(0, 0, 0), Size=Domain2(u=0..4, v=0..4)}, XCount=number_slider, YCount=number_slider)  # -> Geometry, Transform
arrrec_2 = RectangularArray(Geometry=pt, Cell={Plane=PlaneXY(0, 0, 0), Size=Domain2(u=0..4, v=0..4)}, XCount=number_slider_2, YCount=number_slider_2)  # -> Geometry, Transform
pop2d_3 = Populate2D(Region={Plane=PlaneXY(0, 0, 0), Size=Domain2(u=0..20, v=0..20)}, Count=Slider(8, range=0..10), Seed=54)
move_2 = Move(Geometry=arrrec_2.Geometry, Motion=Vector(-22, -22, 0))  # -> Geometry, Transform
move_3 = Move(Geometry=pop2d_2, Motion=Vector(-20, -20, 0))  # -> Geometry, Transform
move_4 = Move(Geometry=pop2d_3, Motion=Vector(0, 0, 5))  # -> Geometry, Transform
srf = Surface(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)
srf_2 = Surface(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)
srf_3 = Surface(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)
planesrf = PlaneSurface(Plane=move_3.Geometry, XSize=Domain(-0.3, 0.3), YSize=Domain(-0.3, 0.3))
move_5 = Move(Geometry=srf_3, Motion=Vector(0, 0, 5))  # -> Geometry, Transform
move_6 = Move(Geometry=srf_2, Motion=Vector(0, 0, 5))  # -> Geometry, Transform
pop2d_4 = Populate2D(Region={Plane=PlaneXY(0, 0, 0), Size=Domain2(u=0..20, v=0..20)}, Count=Slider(16, range=0..16), Seed=1)
planesrf_2 = PlaneSurface(Plane=move_2.Geometry, XSize=Domain(-1, 1), YSize=Domain(-1, 1))
inter = InterconnectPoints(Pts=[move_4.Geometry, move.Geometry, pop2d_4])
move_7 = Move(Geometry=move_6.Geometry, Motion=Vector(0, 0, 5))  # -> Geometry, Transform
dom = ConstructDomain(DomainStart=0, DomainEnd=1)
len = Length(Curve=inter)
bnd = Bounds(Numbers=len)
remap = RemapNumbers(Value=len, Source=bnd, Target=Domain(0, 1))  # -> Mapped, Clipped
rot3d = Rotate3D(
    Geometry=[inter, srf, move_7.Geometry, move_5.Geometry],
    Angle=Slider(1.3, range=0..5),
    Center=Point(10, 10, 10),
    Axis=Vector(1, -1, 0))  # -> Geometry, Transform
gradient = Gradient(LowerLimit=0, UpperLimit=1, Parameter=remap.Mapped, stops=[0: RGB(0, 0, 0), 1: RGB(255, 255, 255)])
preview = CustomPreview(Geometry=rot3d.Geometry, Material=gradient)
