# Grasshopper definition surface_test_environment_v5.gh (Grasshopper 1.0.7)
# plug-ins: Pufferfish, Physarealm, Kangaroo2 Components, Shortest Walk in Gh, horsterCameraControl

time = Slider(360, range=180..360)
time_2 = Slider(300, range=180..360)
division = Division(A=time, B=5)
addition = Addition(A=division, B=288)
number_slider = Slider(20, range=0..100)
number_slider_2 = Slider(20, range=0..100)
number_slider_3 = Slider(5, range=0..10)
multiplication = Multiplication(A=number_slider_2, B=0.275)
multiplication_2 = Multiplication(A=number_slider, B=0.275)
lenght = Slider(4000, range=0..5000)
number_slider_4 = Slider(10, range=0..100)
division_2 = Division(A=number_slider_4, B=number_slider_3)
division_3 = Division(A=number_slider_4, B=number_slider_3)
number_slider_5 = Slider(10, range=0..100)
division_4 = Division(A=number_slider_5, B=number_slider_3)
division_5 = Division(A=number_slider_5, B=number_slider_3)
rectangle = Rectangle(Plane=PlaneXY(0, 0, 0), XSize=division_2, YSize=division_4, Radius=0)  # -> Rectangle, Length
number_slider_6 = Slider(150, range=0..200)
addition_2 = Addition(A=division_3, B=multiplication)
density = Slider(20, range=0..200)
addition_3 = Addition(A=division_5, B=multiplication_2)
multiplication_3 = Multiplication(A=number_slider_4, B=2)
multiplication_4 = Multiplication(A=number_slider_5, B=2)
pt = ConstructPoint(XCoordinate=0, YCoordinate=0, ZCoordinate=0)
arrrec = RectangularArray(Geometry=pt, Cell=rectangle.Rectangle, XCount=number_slider, YCount=number_slider_2)  # -> Geometry, Transform
rectangle_2 = Rectangle(Plane=PlaneXY(0, 0, 0), XSize=multiplication_3, YSize=multiplication_4, Radius=0)  # -> Rectangle, Length
pt_2 = ConstructPoint(XCoordinate=0, YCoordinate=0, ZCoordinate=expr("x*-3", number_slider_6))
point_charge = PointCharge(Point=pt_2, Charge=expr("x/100", Slider(0.001, range=-50.001..50)), Decay=Slider(0, range=0..100))
populate_3d = Populate3D(Region={Plane=PlaneXY(0, 0, 0), X=Domain(0, 10), Y=Domain(0, 10), Z=Domain(0, 2)}, Count=density, Seed=58654)
pt_3 = ConstructPoint(XCoordinate=0, YCoordinate=0, ZCoordinate=expr("x*2", number_slider_6))
point_charge_2 = PointCharge(Point=pt_3, Charge=expr("x/100", Slider(-0.001, range=-50.001..50)), Decay=Slider(0.35, range=0..100))
vec = VectorXYZ(
    XComponent=expr("x*-1", number_slider_4),
    YComponent=expr("x*-1", number_slider_5),
    ZComponent=expr("x*-1", number_slider_6))  # -> Vector, Length
pop2d = Populate2D(Region=rectangle_2.Rectangle, Count=density, Seed=1)  # -> flatten(Population)
box = CenterBox(Base=PlaneXY(0, 0, 0), X=number_slider_4, Y=number_slider_5, Z=number_slider_6)
vec_2 = VectorXYZ(XComponent=expr("x*-2", addition_2), YComponent=expr("x*-2", addition_3), ZComponent=expr("x*-0.5", number_slider_6))  # -> Vector, Length
move = Move(Geometry=box, Motion=Vector(0, 0, 30))  # -> Geometry, Transform
pop3d = Populate3D(Region=move.Geometry, Count=density, Seed=56456456)
cluster = Cluster(L=pop3d)
pl = PlaneNormal(Origin=pop3d, ZAxis=cluster)
cluster_2 = Cluster(L=populate_3d)
pcharge = PointCharge(Point=pt_2, Charge=expr("x/100", Slider(1, range=-1..1)), Decay=Slider(-0.75, range=-5..1))
move_2 = Move(Geometry=pop2d, Motion=vec.Vector)  # -> Geometry, Transform
move_3 = Move(Geometry=arrrec.Geometry, Motion=vec_2.Vector)  # -> Geometry, Transform
construct_domain = ConstructDomain(DomainStart=0, DomainEnd=expr("x", lenght))
fspin = SpinForce(Plane=pl, Strength=Slider(1, range=0..150), Radius=Slider(10, range=0..10), Decay=2)
number_slider_7 = Slider(3, range=0..10)
mergef = MergeFields(Fields=flatten([pcharge, fspin]))
multiplication_5 = Multiplication(A=addition, B=10)
random = Random(Range=construct_domain, Number=density, Seed=31)
subtraction = Subtraction(A=multiplication_5, B=random)
fline = FieldLine(Field=mergef, Point=move_2.Geometry, Steps=lenght, Accuracy=0.1, Method=3)
modulus = Modulus(A=subtraction, B=lenght)
eval = EvaluateCurve(Curve=fline, Parameter=modulus)  # -> flatten(Point), Tangent, Angle
evaluate_field = EvaluateField(Field=mergef, Point=eval.Point)  # -> Tensor, Strength
rotate_3d = Rotate3D(Geometry=evaluate_field.Tensor, Angle=2.35619449, Center=eval.Point, Axis=cluster_2)  # -> Geometry, Transform
plane_normal = PlaneNormal(Origin=eval.Point, ZAxis=rotate_3d.Geometry)
number_slider_8 = Slider(-52.1, range=-100..0)
pt_4 = Point([<point referenced from the Rhino model> x54])
pt_5 = Point([Point(-18.02058058, 11.26218216, 78.08147021), Point(-17.71586708, 6.135892401, 151.5055019), Point(6.680257831, 14.38221341, -21.1583887), Point(-10.56075766, -15.14873669, 4.352259269), Point(16.2652882, 9.968771205, -33.43015236), Point(13.42850181, -0.1305878808, 72.6700905)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])
subtraction_2 = Subtraction(A=time, B=180)
pl_2 = ConstructPlane(Origin=eval.Point, XAxis=Vector(1, 0, 0), YAxis=Vector(0, 1, 0))
inter = InterconnectPoints(Pts=eval.Point)
length = Length(Curve=inter)
bounds = Bounds(Numbers=length)
multiplication_6 = Multiplication(A=subtraction_2, B=0.8)
deconstruct = Deconstruct(Point=eval.Point)  # -> XComponent, YComponent, ZComponent
graph_mapper = GraphMapper(
    deconstruct.ZComponent,
    x0=-20,
    x1=130,
    y0=0,
    y1=500,
    container_name="Bezier",
    cpx=[0, 0, 1, 1],
    cpy=[0, 0.875, 0.8951612711, 0])
graph_mapper_2 = GraphMapper(deconstruct.ZComponent, x0=-20, x1=130, y0=0, y1=5, container_name="Bezier", cpx=[0, 0, 1, 1], cpy=[1, 0, 0, 1])
graph_mapper_3 = GraphMapper(
    deconstruct.ZComponent,
    x0=-20,
    x1=250,
    y0=0,
    y1=10,
    container_name="Bezier",
    cpx=[0, 0.1090909094, 0.4878787994, 1],
    cpy=[0, 0.4959677458, 0.2540322542, 0])
multiplication_7 = Multiplication(A=graph_mapper_3, B=2)
spin_force = SpinForce(
    Plane=plane_normal,
    Strength=expr("x/100", Slider(0.008, range=0..10)),
    Radius=multiplication_7,
    Decay=Slider(0.85, range=0..10))
len = Length(Curve=inter)
remap_numbers = RemapNumbers(Value=length, Source=bounds, Target=Domain(0, 1))  # -> Mapped, Clipped
pt_6 = ConstructPoint(XCoordinate=0, YCoordinate=0, ZCoordinate=multiplication_6)
pt_7 = ConstructPoint(XCoordinate=0, YCoordinate=0, ZCoordinate=0)
sph = Sphere(Base=pl_2, Radius=Slider(1, range=0..10))
inter_2 = InterconnectPoints(Pts=eval.Point)
scale = Scale(Geometry=sph, Center=pl_2, Factor=1.5)  # -> Geometry, Transform
move_4 = Move(Geometry=pt_7, Motion=pt_6)  # -> Geometry, Transform
move_5 = Move(Geometry=pt_7, Motion=Vector(0, 0, 1000))  # -> Geometry, Transform
gradient = Gradient(LowerLimit=0, UpperLimit=1, Parameter=remap_numbers.Mapped, stops=[0: RGB(255, 130, 160), 0.85: RGB(220, 0, 40)])
preview = CustomPreview(
    Geometry=sph,
    Material={diffuse=RGB(0, 0, 0), emission=RGB(0, 0, 0), shine=1, specular=RGB(255, 255, 255), transparency=1})
expression = Expression(x=Slider(46, range=0..100), y=len, Expression="x>y")
dispatch = Dispatch(List=inter, DispatchPattern=expression)  # -> ListA, ListB
merge_fields = MergeFields(Fields=flatten([point_charge, point_charge_2, spin_force]))
preview_2 = CustomPreview(
    Geometry=scale.Geometry,
    Material={diffuse=RGB(0, 0, 0), emission=RGB(0, 0, 0), shine=1, specular=RGB(255, 255, 255), transparency=1})
setcam = SetCamera(CameraLocation=move_4.Geometry, TargetLocation=move_5.Geometry, Activate=Toggle(True))
box_2 = Box2Pt(PointA=Point(-40, -40, -50), PointB=Point(40, 40, 150), Plane=PlaneXY(0, 0, 0))
ptemi = PointEmitter(Points=eval.Point)
ptsf = PointsFood(Points=eval.Point)
custom_preview = CustomPreview(Geometry=dispatch.ListA, Material=gradient)
boxenvir = BoxEnvironment(XResolution=100, YResolution=100, ZResolution=100, Box=box_2)
trigger = Trigger(Interval=20, TimerInterval=20, Target=prealm)  # disabled
field_line = FieldLine(Field=merge_fields, Point=move_3.Geometry, Steps=3000, Accuracy=0.1, Method=1)
prealm = Physarealm(Environment=boxenvir, Emitter=ptemi, Food=ptsf, Reset=True)  # -> ChemoAttractorField, Population, Iteration
poploc = PopulationLocations(Population=prealm.Population)
poptrail = PopulationTrail(Population=prealm.Population, HistoryStep=10, Reset=False)
planesrf = PlaneSurface(Plane=PlaneXY(0, 0, 0), XSize=Domain(-10, 10), YSize=Domain(-10, 10))
prox = Proximity3D(Points=poploc, Group=Slider(13, range=0..20))  # -> flatten(Links), Topology
length_2 = Length(Curve=field_line)
dupln = RemoveDuplicateLines(Lines=prox.Links, Tolerance=0.01)
move_6 = Move(Geometry=planesrf, Motion=Vector(0, 0, 50))  # -> Geometry, Transform
reb = RebuildCurve(Curve=field_line, Degree=2, Count=30, Tangents=False)
bounds_2 = Bounds(Numbers=length_2)
avr = Average(Input=poploc)
colour = ColourPicker(PickedColour=RGB(0, 0, 0))
ln = Line(StartPoint=poploc, EndPoint=avr)
shortwalk = ShortestWalk(Curves=dupln, WantedPath=ln)  # -> ShortestWalk, Succession, Direction, Length
series = Series(Start=0, Step=1, Count=400)
pcx = CurvePlane(Curve=reb, Plane=move_6.Geometry)  # -> flatten(Points), ParamsC, ParamsP
remap_numbers_2 = RemapNumbers(Value=length_2, Source=bounds_2, Target=Domain(0, 1))  # -> Mapped, Clipped
join = JoinCurves(Curves=shortwalk.ShortestWalk, Preserve=False)
brep = Brep(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)
plntrimcrv = PlaneTrimCurve(Curve=reb, Plane=move_6.Geometry, Flip=True)  # -> flatten(Trimmed), Parameters, Intersected
brep_2 = Brep(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)
item = ListItem(List=pcx.Points, Index=series, Wrap=True)
item_2 = ListItem(Index=series, Wrap=True)
brep_3 = Brep(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)
brep_4 = Brep(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)
divide = DivideCurve(Curve=join, Count=Slider(6, range=0..20), Kinks=False)  # -> Points, Tangents, Parameters
move_7 = Move(Geometry=brep, Motion=Vector(0, 0, -250))  # -> Geometry, Transform
gradient_2 = Gradient(LowerLimit=0, UpperLimit=1, Parameter=remap_numbers_2.Mapped, stops=[0.296: RGB(0, 0, 0), 1: RGB(255, 255, 255)])
scale_2 = Scale(Geometry=move_7.Geometry, Center=Point(0, 0, 0), Factor=0.5)  # -> Geometry, Transform
ptstrimcrv = PointsTrimCurve(Curve=reb, Points=item, Flip=False)  # -> flatten(Trimmed), SubDomains, Intersected
intcrv_t = InterpolateT(Vertices=divide.Points, TangentStart=Vector(0, 0, 0), TangentEnd=Vector(0, 0, 0), KnotStyle=1)  # -> Curve, Length, Domain
mesh_uv = MeshSurface(Surface=scale_2.Geometry, UCount=30, VCount=40, Overhang=True, Equalize=False)
custom_preview_2 = CustomPreview(Geometry=field_line, Material=gradient_2)
custom_preview_3 = CustomPreview(Geometry=plntrimcrv.Trimmed, Material=gradient_2)
demesh = DeconstructMesh(Mesh=mesh_uv)  # -> Vertices, Faces, Colours, Normals
pt_8 = Point(demesh.Vertices)
evf = EvaluateField(Field=merge_fields, Point=pt_8)  # -> Tensor, Strength
vec_3 = Vector(evf.Tensor)
amp = Amplitude(Vector=vec_3, Amplitude=Slider(15, range=0..100))
move_8 = Move(Geometry=pt_8, Motion=amp)  # -> Geometry, Transform
conmesh = ConstructMesh(Vertices=move_8.Geometry, Faces=demesh.Faces)
subdmesh = SubDFromMesh(Mesh=conmesh, Creases=1, Corners=1, Interpolate=False)
swatch = ColourSwatch(SwatchColor=RGBA(112, 112, 112, 51))
preview_3 = CustomPreview(
    Geometry=subdmesh,
    Material={diffuse=RGB(0, 0, 0), emission=RGB(0, 0, 0), shine=1, specular=RGB(255, 255, 255), transparency=1})

# ==== cluster Cluster
L = ClusterInput()
lng = ListLength(List=L)
random = Random(Range=Domain(-1, 1), Number=lng, Seed=6)
random_2 = Random(Range=Domain(-1, 1), Number=lng, Seed=2)
random_3 = Random(Range=Domain(-1, 1), Number=lng, Seed=12)
vec = VectorXYZ(XComponent=random_2, YComponent=random, ZComponent=random_3)  # -> Vector, Length
V = ClusterOutput(vec.Vector)
