# Grasshopper definition exp_on_mesh.gh (Grasshopper 1.0.7)
# plug-ins: Pufferfish

pt = Point([<point referenced from the Rhino model> x5000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])
pt_2 = Point([<point referenced from the Rhino model> x5000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])
pt_3 = Point([<point referenced from the Rhino model> x3278])
number_slider = Slider(8, range=0..100)
pt_4 = Point([<point referenced from the Rhino model> x3339])
number_slider_2 = Slider(12, range=0..100)
pt_5 = Point([<point referenced from the Rhino model> x192])
pt_6 = Point([<point referenced from the Rhino model> x5000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])
pt_7 = Point([<point referenced from the Rhino model> x5000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])
oct = OcTree(Points=pt_7, Square=False, Group=5)  # -> Boxes, Points; disabled
con = DelaunayEdges(Points=pt_5, Plane=PlaneXY(0, 0, 0))  # -> Connectivity, Edges
del = DelaunayMesh(Points=pt_4, Plane=PlaneXY(0, 0, 0))
prox = Proximity3D(Points=pt_2, Group=Slider(5, range=0..100))  # -> Links, Topology
voxmsh = VoxelMesh(
    Points=pt,
    Plane=PlaneXY(0, 0, 0),
    SizeX=number_slider,
    SizeY=number_slider,
    SizeZ=number_slider,
    Triangulate=Toggle(False))
voxmsh_2 = VoxelMesh(
    Points=pt_6,
    Plane=PlaneXY(0, 0, 0),
    SizeX=number_slider_2,
    SizeY=number_slider_2,
    SizeZ=number_slider_2,
    Triangulate=Toggle(True))
del_2 = DelaunayMesh(Plane=PlaneXY(0, 0, 0))
qrmesh = QuadRemesh(Mesh=voxmsh, Settings={aqc=True, as=50, dhe=True, gci=0, null=False, pme=0, sa=0, tqc=2000})  # disabled
number_slider_3 = Slider(5000, range=0..10000)
number_slider_4 = Slider(10, range=0..10)
msmooth = SmoothMesh(Strength=0.5, SkipNaked=True, Iterations=1)
number_slider_5 = Slider(0.1, range=0..0.1)
qrsettings = QuadRemeshSettings(TargetCount=15000, AdaptiveSize=0, AdaptiveCount=False, HardEdges=False, SeamEdges=0, Symmetry=0, GuideCurves=0)
msmooth_2 = SmoothMesh(Mesh=voxmsh_2, Strength=Slider(0.8, range=0..1), SkipNaked=True, Iterations=Slider(20, range=0..30))
qrmesh_2 = QuadRemesh(Mesh=msmooth_2, Settings=qrsettings)
preview = CustomPreview(
    Geometry=qrmesh_2,
    Material={diffuse=RGB(227, 216, 78), emission=RGB(0, 0, 0), shine=0.5363875031, specular=RGB(19, 19, 19), transparency=0.4258456528})
