# Grasshopper definition pre_II_1.gh (Grasshopper 1.0.7)
# plug-ins: Pufferfish, Physarealm, Kangaroo2 Components, Shortest Walk in Gh, horsterCameraControl, Telepathy, Shader Nodes

emission = EmissionBSDF(Color=RGB(255, 192, 115), Strength=0.25)
anisotropic = AnisotropicBSDF(
    Color=RGB(255, 255, 255),
    Tangent=Vector(0, 0, 0),
    Normal=Vector(0, 0, 0),
    Roughness=0,
    Anisotropy=0,
    Rotation=0,
    Distribution="Multiscatter_GGX")
layer_weight = LayerWeight(Blend=0.94, Normal=Vector(0, 0, 0))  # -> Fresnel, Facing
diffuse = DiffuseBSDF(Color=RGB(222, 169, 44), Roughness=0, Normal=Vector(0, 0, 0))
color_ramp = ColorRamp(
    Fac=layer_weight.Facing,
    StopColours=[ColourSwatch(SwatchColor=RGB(28, 24, 24)), ColourSwatch(SwatchColor=RGB(255, 255, 255))],
    StopPositions=[Slider(0, range=0..1), Slider(1, range=0..1)],
    Interpolation="Ease")  # -> Color, Alpha
layer_weight_2 = LayerWeight(Blend=0.94, Normal=Vector(0, 0, 0))  # -> Fresnel, Facing
divide = Divide(Value1=1, Value2=color_ramp.Color, UseClamp=False)
color_ramp_2 = ColorRamp(
    Fac=layer_weight_2.Facing,
    StopColours=[ColourSwatch(SwatchColor=RGB(0, 0, 0)), ColourSwatch(SwatchColor=RGB(255, 255, 255)), ColourSwatch(SwatchColor=RGB(255, 255, 255)), ColourSwatch(SwatchColor=RGB(0, 0, 0))],
    StopPositions=[Slider(0.3, range=0..1), Slider(0.29, range=0..1), Slider(0.21, range=0..1), Slider(0.2, range=0..1)],
    Interpolation="Ease")  # -> Color, Alpha
refraction = RefractionBSDF(Color=RGB(255, 255, 255), Roughness=0, IOR=divide, Normal=Vector(0, 0, 0), Distribution="Beckmann")
blend = Blend(Closure1=refraction, Closure2=anisotropic, Fac=color_ramp_2.Color)
layer_weight_3 = LayerWeight(Blend=0.94, Normal=Vector(0, 0, 0))  # -> Fresnel, Facing
layer_weight_4 = LayerWeight(Blend=0.95, Normal=Vector(0, 0, 0))  # -> Fresnel, Facing
emission_2 = EmissionBSDF(Color=RGB(0, 255, 0), Strength=1)
color_ramp_3 = ColorRamp(
    Fac=layer_weight_3.Facing,
    StopColours=[ColourSwatch(SwatchColor=RGB(0, 0, 0)), ColourSwatch(SwatchColor=RGB(255, 255, 255)), ColourSwatch(SwatchColor=RGB(255, 255, 255))],
    StopPositions=[Slider(0.51, range=0..1), Slider(0.17, range=0..1), Slider(0, range=0..1)],
    Interpolation="Ease")  # -> Color, Alpha
blend_2 = Blend(Closure1=blend, Closure2=RGB(128, 128, 128), Fac=color_ramp_3.Color)
diffuse_2 = DiffuseBSDF(Color=RGB(0, 255, 0), Roughness=0, Normal=Vector(0, 0, 0))
refraction_2 = RefractionBSDF(Color=RGB(255, 255, 255), Roughness=0, IOR=1.1, Normal=Vector(0, 0, 0), Distribution="GGX")
output = Output(Surface=blend_2, Volume=RGB(128, 128, 128), Displacement=Vector(0, 0, 0))
output_2 = Output(Surface=emission_2, Volume=RGB(128, 128, 128), Displacement=Vector(0, 0, 0))
output_3 = Output(Surface=refraction_2, Volume=RGB(128, 128, 128), Displacement=Vector(0, 0, 0))
trigger = Trigger(Interval=1000, TimerInterval=1000)
density = Slider(50, range=10..50)
viscosity = Slider(100, range=0..200)
lenght = Slider(353, range=0..500)
mepoint = Point(<point referenced from the Rhino model>)
mepoint_2 = RemoteSender(mepoint)
pt = ConstructPoint(XCoordinate=0, YCoordinate=0, ZCoordinate=0)  # disabled
toggle = BooleanToggle(True)  # disabled
density_2 = RemoteSender(density)
viscosity_2 = RemoteSender(viscosity)
move = Move(Geometry=pt, Motion=Vector(0, 0, 1000))  # -> Geometry, Transform; disabled
time = RemoteSender(lenght)
# Camera
time_2 = RemoteReceiver(time)  # disabled
subtraction = Subtraction(A=time_2, B=180)  # disabled
multiplication = Multiplication(A=subtraction, B=0.8)  # disabled
pt_2 = ConstructPoint(XCoordinate=0, YCoordinate=0, ZCoordinate=multiplication)  # disabled
move_2 = Move(Geometry=pt, Motion=pt_2)  # -> Geometry, Transform; disabled
setcam = SetCamera(CameraLocation=move_2.Geometry, TargetLocation=move.Geometry, Activate=toggle)  # disabled
number_slider = Slider(10, range=0..100)
# Bounding Sphere
number_slider_2 = Slider(500, range=0..500)
pt_3 = ConstructPoint(XCoordinate=0, YCoordinate=0, ZCoordinate=-2000)
density_3 = RemoteReceiver(density_2)
lenght_2 = Slider(200, range=0..5000)
time_3 = RemoteReceiver(time)
dom = ConstructDomain(DomainStart=0, DomainEnd=lenght_2)
density_4 = RemoteReceiver(density_2)
viscosity_3 = RemoteReceiver(viscosity_2)
density_5 = RemoteReceiver(density_2)
remap = RemapNumbers(Value=time_3, Source=Domain(0, 1000), Target=dom)  # -> Mapped, Clipped
pt_4 = ConstructPoint(XCoordinate=0, YCoordinate=0, ZCoordinate=0)
fallof = Slider(300, range=0..1000)
radiusbound = RemoteSender(number_slider_2)
# Point Grid Representation
radiusbound_2 = RemoteReceiver(radiusbound)
# Wormholes
radiusbound_3 = RemoteReceiver(radiusbound)
# Line Representation
radiusbound_4 = RemoteReceiver(radiusbound)
expression = Expression(x=radiusbound_4, y=density_5, Expression="(x/6*sqrt(3))^2*y/10000*pi")
division = Division(A=radiusbound_2, B=100)
multiplication_2 = Multiplication(A=number_slider, B=division, C=-1)
box = CenterBox(Base=PlaneXY(0, 0, 0), X=division, Y=division, Z=division)
polygon = Polygon(Plane=PlaneXY(0, 0, 0), Radius=expr("x/6*sqrt(3)", radiusbound_4), Segments=4, FilletRadius=0)  # -> Polygon, Length
expression_2 = Expression(x=radiusbound_3, y=density_3, Expression="x^2*y/100000*pi")
sph = Sphere(Base=PlaneXY(0, 0, 0), Radius=expr("X*0.5", radiusbound_3))
vec = VectorXYZ(XComponent=multiplication_2, YComponent=multiplication_2, ZComponent=multiplication_2)  # -> Vector, Length
arrbox = BoxArray(Geometry=pt_4, Cell=box, XCount=number_slider, YCount=number_slider, ZCount=number_slider)  # -> Geometry, Transform
expression_3 = Expression(x=number_slider_2, y=density_4, Expression="x^2*y/100000*pi")
vec_2 = VectorXYZ(XComponent=0, YComponent=0, ZComponent=expr("-0.5*x", radiusbound_4))  # -> Vector, Length
# This moves the time black hole
move_3 = Move(Geometry=sph, Motion=Vector(0, 0, -75))  # -> Geometry, Transform
pcharge = PointCharge(Point=pt_3, Charge=expr("x/100", Slider(5, range=-1..5)), Decay=Slider(-0.4, range=-5..1))
mepoint_3 = RemoteReceiver(mepoint_2)
move_4 = Move(Geometry=arrbox.Geometry, Motion=vec.Vector)  # -> Geometry, Transform
pop3d = Populate3D(Region=move_3.Geometry, Count=expression_2, Seed=54465483)
sph_2 = Sphere(Base=PlaneXY(0, 0, 0), Radius=number_slider_2)
move_5 = Move(Geometry=polygon.Polygon, Motion=vec_2.Vector)  # -> Geometry, Transform
pop2d = Populate2D(Region=move_5.Geometry, Count=expression, Seed=1)
dom_2 = ConstructDomain(DomainStart=0, DomainEnd=fallof)
circle = CircleCNR(Center=Point(0, 0, 0), Normal=Vector(0, 0, 1), Radius=expr("x/6", radiusbound_4))
move_6 = Move(Geometry=sph_2, Motion=Vector(0, 0, 150))  # -> Geometry, Transform
brepinc = PointInBrep(Brep=move_3.Geometry, Point=pop3d, Strict=False)
move_7 = Move(Geometry=circle, Motion=vec_2.Vector)  # -> Geometry, Transform
dispatch = Dispatch(List=pop3d, DispatchPattern=brepinc)  # -> ListA, ListB
incurve = PointInCurve(Point=pop2d, Curve=move_7.Geometry)  # -> Relationship, Point
pop3d_2 = Populate3D(Region=move_6.Geometry, Count=expression_3, Seed=56456456)
randomize = Cluster_2(L=dispatch.ListA)
dispatch_2 = Dispatch(List=pop2d, DispatchPattern=incurve.Relationship)  # -> ListA, ListB
brepinc_2 = PointInBrep(Brep=move_6.Geometry, Point=pop3d_2, Strict=False)
inter = InterconnectPoints()
pt_5 = ConstructPoint(XCoordinate=0, YCoordinate=0, ZCoordinate=-550)
# Dimension Basis / Secondary Pendulum
number_slider_3 = Slider(0.001, range=-50.001..50)
remap_2 = RemapNumbers(Source=Domain(0, 1), Target=Domain(0, 1))  # -> Mapped, Clipped
pt_6 = Point(dispatch_2.ListA)
pl = PlaneNormal(Origin=dispatch.ListA, ZAxis=randomize)
dispatch_3 = Dispatch(List=pop3d_2, DispatchPattern=brepinc_2)  # -> ListA, ListB
number_slider_4 = Slider(30, range=0..100)
centerholes = RemoteSender(pl)
centerholes_2 = RemoteReceiver(centerholes)
cluster = Cluster_2(L=dispatch_3.ListA)
move_8 = Move(Geometry=pt_6, Motion=Vector(1, 1, 0))  # -> Geometry, Transform
move_9 = Move(Geometry=pt_6, Motion=Vector(-1, 1, 0))  # -> Geometry, Transform
pl_2 = PlaneNormal(Origin=dispatch_3.ListA, ZAxis=cluster)
point_charge = PointCharge(Point=pt_3, Charge=expr("x/100", number_slider_3), Decay=Slider(0, range=0..100))
point_charge_2 = PointCharge(Point=pt_5, Charge=expr("x/100", Slider(-0.001, range=-50.001..50)), Decay=Slider(0.35, range=0..100))
ln = Line(StartPoint=pt_6, EndPoint=move_8.Geometry)
ln_2 = Line(StartPoint=pt_6, EndPoint=move_9.Geometry)
dimpoints = RemoteSender(pl_2)
# Dimension Basis / Primary Pendulum
dimpoints_2 = RemoteReceiver(dimpoints)
fspin = SpinForce(Plane=dimpoints_2, Strength=Slider(4, range=0..150), Radius=expr("x*0.5+5", Slider(100, range=0..500)), Decay=2)
mergef = MergeFields(Fields=flatten([fspin, pcharge]))
primary_field = RemoteSender(mergef)
primary_field_2 = RemoteReceiver(primary_field)
fline = FieldLine(Field=primary_field_2, Point=centerholes_2, Steps=lenght_2, Accuracy=1, Method=1)
eval = EvaluateCurve(Curve=fline, Parameter=remap.Mapped)  # -> Point, Tangent, Angle
pl_3 = ConstructPlane(Origin=eval.Point, XAxis=Vector(1, 0, 0), YAxis=Vector(0, 1, 0))
dist = Distance(PointA=mepoint_3, PointB=eval.Point)
greater_than = GreaterThan(Value1=dist, Value2=fallof, UseClamp=False)
dispatch_4 = Dispatch(List=pl_3, DispatchPattern=invert(greater_than))  # -> ListA, ListB
dispatch_5 = Dispatch(List=dist, DispatchPattern=invert(greater_than))  # -> ListA, ListB
# fall figure wrt distance
graph = GraphMapper(
    dispatch_5.ListA,
    x0=0,
    x1=200,
    y0=0,
    y1=20,
    container_name="Bezier",
    cpx=[0, 0.9256190062, 0.9986251593, 1],
    cpy=[0.6451612711, 0.6359916925, 0.6509399414, 0.02911514044])
sph_3 = Sphere(Base=dispatch_4.ListA, Radius=graph)
msphere = MeshSphere(Base=dispatch_4.ListA, Radius=graph, UCount=number_slider_4, VCount=number_slider_4)
worms = RemoteSender(dispatch_4.ListA)
# Interconnections
worms_2 = RemoteReceiver(worms)
inter_2 = InterconnectPoints(Pts=worms_2)
len = Length(Curve=inter_2)
expression_4 = Expression(x=Slider(100, range=0..500), y=len, Expression="x>y")
dispatch_6 = Dispatch(List=inter_2, DispatchPattern=expression_4)  # -> ListA, ListB
length = Length(Curve=dispatch_6.ListA)
bounds = Bounds(Numbers=length)
remap_numbers = RemapNumbers(Value=length, Source=bounds, Target=Domain(3, 0.5))  # -> Mapped, Clipped
remap_numbers_2 = RemapNumbers(Value=length, Source=bounds, Target=Domain(1.1, 1))  # -> Mapped, Clipped
refraction_3 = RefractionBSDF(Color=RGB(255, 255, 255), Roughness=0, IOR=remap_numbers_2.Mapped, Normal=Vector(0, 0, 0), Distribution="GGX")
pipe = Pipe(Curve=dispatch_6.ListA, Radius=remap_numbers.Mapped, Caps=0)  # -> flatten(Pipe)
preview = CustomPreview(
    Geometry=pipe,
    Material={diffuse=RGB(255, 105, 180), emission=RGB(0, 0, 0), shine=0, specular=RGB(255, 255, 255), transparency=0})
output_4 = Output(Surface=refraction_3, Volume=RGB(128, 128, 128), Displacement=Vector(0, 0, 0))

# ----
# interconnections depend on size of blackhole
end = EndPoints(Curve=dispatch_6.ListA)  # -> Start, End
mepoint_4 = RemoteReceiver(mepoint_2)
mepoint_5 = RemoteReceiver(mepoint_2)
dist_2 = Distance(PointA=end.Start, PointB=mepoint_4)  # -> expr("x/70", Distance)
dist_3 = Distance(PointA=end.End, PointB=mepoint_5)  # -> expr("x/70", Distance)
graph_2 = GraphMapper(dist_2, x0=0.65, x1=2.85, y0=0, y1=1, container_name="Bezier", cpx=[0, 1, 1, 1], cpy=[1, 1, 1, 0.1825518012])
graph_3 = GraphMapper(dist_3, x0=0.65, x1=2.85, y0=0, y1=1, container_name="Bezier", cpx=[0, 1, 1, 1], cpy=[1, 1, 1, 0.1928737164])
lng = ListLength(List=dispatch_6.ListA)
series = Series(Start=0, Step=0, Count=lng)
series_2 = Series(Start=1, Step=0, Count=lng)
weave = Weave(Pattern=[0, 1], Stream0=graph_2, Stream1=graph_3, NullGaps=False)
weave_2 = Weave(Pattern=[0, 1], Stream0=series, Stream1=series_2, NullGaps=False)
partition = PartitionList(List=weave, Size=2)
partition_2 = PartitionList(List=weave_2, Size=2)
vpipe = PipeVariable(Curve=reparameterize(graft(dispatch_6.ListA)), Parameters=partition_2, Radii=partition, Caps=0)  # -> flatten(Pipe)
preview_2 = CustomPreview(
    Geometry=vpipe,
    Material={diffuse=RGB(255, 105, 180), emission=RGB(0, 0, 0), shine=0, specular=RGB(255, 255, 255), transparency=0})

preview_3 = CustomPreview(
    Geometry=msphere,
    Material={diffuse=RGB(255, 105, 180), emission=RGB(0, 0, 0), shine=0, specular=RGB(255, 255, 255), transparency=0})
worms_3 = RemoteReceiver(worms)
mepoint_6 = RemoteReceiver(mepoint_2)
primary_field_3 = RemoteReceiver(primary_field)
worms_4 = RemoteReceiver(worms)
dist_4 = Distance(PointA=worms_3, PointB=mepoint_6)
lng_2 = ListLength(List=worms_4)
populate_3d = Populate3D(Region={Plane=PlaneXY(0, 0, 0), X=Domain(0, 10), Y=Domain(0, 10), Z=Domain(0, 2)}, Count=lng_2, Seed=58654)
graph_4 = GraphMapper(
    dist_4,
    x0=0,
    x1=300,
    y0=0,
    y1=20,
    container_name="Bezier",
    cpx=[0, 0.5112859011, 0.75, 1],
    cpy=[0.5057080984, 0.451572597, 0.75, 0])
cluster_2 = Cluster(L=populate_3d)
evaluate_field = EvaluateField(Field=primary_field_3, Point=worms_4)  # -> Tensor, Strength
rotate_3d = Rotate3D(Geometry=evaluate_field.Tensor, Angle=2.35619449, Center=worms_4, Axis=cluster_2)  # -> Geometry, Transform
plane_normal = PlaneNormal(Origin=worms_4, ZAxis=rotate_3d.Geometry)
number_slider_5 = Slider(20, range=0..100)  # disabled
number_slider_6 = Slider(20, range=0..100)  # disabled
spin_force = SpinForce(Plane=plane_normal, Strength=expr("x/100", Slider(0.008, range=0..10)), Radius=graph_4, Decay=Slider(0.85, range=0..10))
number_slider_7 = Slider(5, range=0..10)  # disabled
merge_fields = MergeFields(Fields=flatten([point_charge, point_charge_2, spin_force]))
multiplication_3 = Multiplication(A=number_slider_6, B=0.275)  # disabled
multiplication_4 = Multiplication(A=number_slider_5, B=0.275)  # disabled
secondary_field = RemoteSender(merge_fields)
secondary_field_2 = RemoteReceiver(secondary_field)
evf = EvaluateField(Field=secondary_field_2, Point=move_4.Geometry)  # -> Tensor, Strength
amp = Amplitude(Vector=evf.Tensor, Amplitude=Slider(15, range=0..100))
move_10 = Move(Geometry=move_4.Geometry, Motion=amp)  # -> Geometry, Transform
secondary_field_3 = RemoteReceiver(secondary_field)
fline_2 = FieldLine(Field=secondary_field_3, Point=pt_6, Steps=50, Accuracy=10, Method=1)
extrcrv = ExtrudeAlong(Base=ln, Curve=fline_2)  # disabled
extrcrv_2 = ExtrudeAlong(Base=ln_2, Curve=fline_2)
preview_4 = CustomPreview(
    Geometry=[extrcrv, extrcrv_2],
    Material={diffuse=RGB(0, 0, 0), emission=RGB(250, 250, 40), shine=0, specular=RGB(255, 255, 255), transparency=0})
pt_7 = ConstructPoint(XCoordinate=0, YCoordinate=0, ZCoordinate=0)  # disabled
time_4 = Slider(360, range=180..360)  # disabled
time_5 = Slider(300, range=180..360)  # disabled
number_slider_8 = Slider(50, range=0..100)
division_2 = Division(A=number_slider_8, B=number_slider_7)  # disabled
division_3 = Division(A=number_slider_8, B=number_slider_7)  # disabled
addition = Addition(A=division_3, B=multiplication_3)  # disabled
number_slider_9 = Slider(50, range=0..100)
division_4 = Division(A=number_slider_9, B=number_slider_7)  # disabled
division_5 = Division(A=number_slider_9, B=number_slider_7)  # disabled
rectangle = Rectangle(Plane=PlaneXY(0, 0, 0), XSize=division_2, YSize=division_4, Radius=0)  # -> Rectangle, Length; disabled
addition_2 = Addition(A=division_5, B=multiplication_4)  # disabled
arrrec = RectangularArray(Geometry=pt_7, Cell=rectangle.Rectangle, XCount=number_slider_5, YCount=number_slider_6)  # -> Geometry, Transform; disabled
number_slider_10 = Slider(50, range=0..200)
vec_3 = VectorXYZ(XComponent=expr("x*-2", addition), YComponent=expr("x*-2", addition_2), ZComponent=expr("x*-0.5", number_slider_10))  # -> Vector, Length; disabled
move_11 = Move(Geometry=arrrec.Geometry, Motion=vec_3.Vector)  # -> Geometry, Transform; disabled
multiplication_5 = Multiplication(A=number_slider_8, B=2)
multiplication_6 = Multiplication(A=number_slider_9, B=2)
rectangle_2 = Rectangle(Plane=PlaneXY(0, 0, 0), XSize=multiplication_5, YSize=multiplication_6, Radius=0)  # -> Rectangle, Length
division_6 = Division(A=time_4, B=5)  # disabled
vec_4 = VectorXYZ(
    XComponent=expr("x*-1", number_slider_8),
    YComponent=expr("x*-1", number_slider_9),
    ZComponent=expr("x*-1", number_slider_10))  # -> Vector, Length
addition_3 = Addition(A=division_6, B=288)  # disabled
# Bounding Box
box_2 = CenterBox(Base=PlaneXY(0, 0, 0), X=number_slider_8, Y=number_slider_9, Z=number_slider_10)
move_12 = Move(Geometry=box_2, Motion=Vector(0, 0, 30))  # -> Geometry, Transform
density_6 = Slider(20, range=0..200)
pop2d_2 = Populate2D(Region=rectangle_2.Rectangle, Count=density_6, Seed=1)  # -> flatten(Population)
move_13 = Move(Geometry=pop2d_2, Motion=vec_4.Vector)  # -> Geometry, Transform
number_slider_11 = Slider(-0.75, range=-5..1)  # disabled
number_slider_12 = Slider(46, range=0..100)  # disabled
number_slider_13 = Slider(1, range=-1..1)  # disabled
pop3d_3 = Populate3D(Region={Plane=PlaneXY(0, 0, 0), X=Domain(0, 10), Y=Domain(0, 10), Z=Domain(0, 2)}, Count=density_6, Seed=56456456)
pt_8 = ConstructPoint(XCoordinate=0, YCoordinate=0, ZCoordinate=expr("x*-3", number_slider_10))  # disabled
lenght_3 = Slider(4000, range=0..5000)  # disabled
cluster_3 = Cluster(L=pop3d_3)
pl_4 = PlaneNormal(Origin=pop3d_3, ZAxis=cluster_3)
construct_domain = ConstructDomain(DomainStart=0, DomainEnd=expr("x", lenght_3))  # disabled
pcharge_2 = PointCharge(Point=pt_8, Charge=expr("x/100", number_slider_13), Decay=number_slider_11)  # disabled
multiplication_7 = Multiplication(A=addition_3, B=10)  # disabled
fspin_2 = SpinForce(Plane=pl_4, Strength=Slider(1, range=0..150), Radius=Slider(10, range=0..10), Decay=2)
mergef_2 = MergeFields(Fields=flatten([pcharge_2, fspin_2]))  # disabled
number_slider_14 = Slider(-52.1, range=-100..0)  # disabled
random = Random(Range=construct_domain, Number=density_6, Seed=31)  # disabled
subtraction_2 = Subtraction(A=multiplication_7, B=random)  # disabled
modulus = Modulus(A=subtraction_2, B=lenght_3)  # disabled
subtraction_3 = Subtraction(A=time_4, B=180)  # disabled
multiplication_8 = Multiplication(A=subtraction_3, B=0.8)  # disabled
pt_9 = Point([<point referenced from the Rhino model> x54])  # disabled
pt_10 = Point([Point(-18.02058058, 11.26218216, 78.08147021), Point(-17.71586708, 6.135892401, 151.5055019), Point(6.680257831, 14.38221341, -21.1583887), Point(-10.56075766, -15.14873669, 4.352259269), Point(16.2652882, 9.968771205, -33.43015236), Point(13.42850181, -0.1305878808, 72.6700905)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])  # disabled
pt_11 = ConstructPoint(XCoordinate=0, YCoordinate=0, ZCoordinate=multiplication_8)  # disabled
pt_12 = ConstructPoint(XCoordinate=0, YCoordinate=0, ZCoordinate=0)  # disabled
toggle_2 = BooleanToggle(True)  # disabled
fline_3 = FieldLine(Field=mergef_2, Point=move_13.Geometry, Steps=lenght_3, Accuracy=0.1, Method=3)  # disabled
move_14 = Move(Geometry=pt_12, Motion=pt_11)  # -> Geometry, Transform; disabled
move_15 = Move(Geometry=pt_12, Motion=Vector(0, 0, 1000))  # -> Geometry, Transform; disabled
setcam_2 = SetCamera(CameraLocation=move_14.Geometry, TargetLocation=move_15.Geometry, Activate=toggle_2)  # disabled
pt_13 = ConstructPoint(XCoordinate=0, YCoordinate=0, ZCoordinate=expr("x*2", number_slider_10))  # disabled
populate_3d_2 = Populate3D(Region={Plane=PlaneXY(0, 0, 0), X=Domain(0, 10), Y=Domain(0, 10), Z=Domain(0, 2)}, Count=density_6, Seed=58654)  # disabled
number_slider_15 = Slider(0.001, range=-50.001..50)  # disabled
number_slider_16 = Slider(0, range=0..100)  # disabled
number_slider_17 = Slider(-0.001, range=-50.001..50)  # disabled
number_slider_18 = Slider(0.35, range=0..100)  # disabled
eval_2 = EvaluateCurve(Curve=fline_3, Parameter=modulus)  # -> flatten(Point), Tangent, Angle; disabled
inter_3 = InterconnectPoints(Pts=eval_2.Point)  # disabled
length_2 = Length(Curve=inter_3)  # disabled
bounds_2 = Bounds(Numbers=length_2)  # disabled
len_2 = Length(Curve=inter_3)  # disabled
remap_numbers_3 = RemapNumbers(Value=length_2, Source=bounds_2, Target=Domain(0, 1))  # -> Mapped, Clipped; disabled
expression_5 = Expression(x=number_slider_12, y=len_2, Expression="x>y")  # disabled
dispatch_7 = Dispatch(List=inter_3, DispatchPattern=expression_5)  # -> ListA, ListB; disabled
gradient = Gradient(LowerLimit=0, UpperLimit=1, Parameter=remap_numbers_3.Mapped, stops=[0: RGB(255, 130, 160), 0.85: RGB(220, 0, 40)])  # disabled
custom_preview = CustomPreview(Geometry=dispatch_7.ListA, Material=gradient)  # disabled
cluster_4 = Cluster(L=populate_3d_2)  # disabled
number_slider_19 = Slider(1, range=0..10)  # disabled
point_charge_3 = PointCharge(Point=pt_8, Charge=expr("x/100", number_slider_15), Decay=number_slider_16)  # disabled
point_charge_4 = PointCharge(Point=pt_13, Charge=expr("x/100", number_slider_17), Decay=number_slider_18)  # disabled
pl_5 = ConstructPlane(Origin=eval_2.Point, XAxis=Vector(1, 0, 0), YAxis=Vector(0, 1, 0))  # disabled
deconstruct = Deconstruct(Point=eval_2.Point)  # -> XComponent, YComponent, ZComponent; disabled
graph_mapper = GraphMapper(deconstruct.ZComponent, x0=-20, x1=130, y0=0, y1=5, container_name="Bezier", cpx=[0, 0, 1, 1], cpy=[1, 0, 0, 1])  # disabled
graph_mapper_2 = GraphMapper(
    deconstruct.ZComponent,
    x0=-20,
    x1=130,
    y0=0,
    y1=500,
    container_name="Bezier",
    cpx=[0, 0, 1, 1],
    cpy=[0, 0.875, 0.8951612711, 0])  # disabled
graph_mapper_3 = GraphMapper(
    deconstruct.ZComponent,
    x0=-20,
    x1=250,
    y0=0,
    y1=10,
    container_name="Bezier",
    cpx=[0, 0.1090909094, 0.4878787994, 1],
    cpy=[0, 0.4959677458, 0.2540322542, 0])  # disabled
evaluate_field_2 = EvaluateField(Field=mergef_2, Point=eval_2.Point)  # -> Tensor, Strength; disabled
multiplication_9 = Multiplication(A=graph_mapper_3, B=2)  # disabled
sph_4 = Sphere(Base=pl_5, Radius=number_slider_19)  # disabled
number_slider_20 = Slider(3, range=0..10)  # disabled
number_slider_21 = Slider(0.008, range=0..10)  # disabled
inter_4 = InterconnectPoints(Pts=eval_2.Point)  # disabled
number_slider_22 = Slider(0.85, range=0..10)  # disabled
scale = Scale(Geometry=sph_4, Center=pl_5, Factor=1.5)  # -> Geometry, Transform; disabled
rotate_3d_2 = Rotate3D(Geometry=evaluate_field_2.Tensor, Angle=2.35619449, Center=eval_2.Point, Axis=cluster_4)  # -> Geometry, Transform; disabled
preview_5 = CustomPreview(
    Geometry=sph_4,
    Material={diffuse=RGB(0, 0, 0), emission=RGB(0, 0, 0), shine=1, specular=RGB(255, 255, 255), transparency=1})  # disabled
preview_6 = CustomPreview(
    Geometry=scale.Geometry,
    Material={diffuse=RGB(0, 0, 0), emission=RGB(0, 0, 0), shine=1, specular=RGB(255, 255, 255), transparency=1})  # disabled
box_3 = Box2Pt(PointA=Point(-40, -40, -50), PointB=Point(40, 40, 150), Plane=PlaneXY(0, 0, 0))  # disabled
plane_normal_2 = PlaneNormal(Origin=eval_2.Point, ZAxis=rotate_3d_2.Geometry)  # disabled
ptemi = PointEmitter(Points=eval_2.Point)  # disabled
ptsf = PointsFood(Points=eval_2.Point)  # disabled
trigger_2 = Trigger(Interval=-20, TimerInterval=20, Target=prealm)  # disabled
boxenvir = BoxEnvironment(XResolution=100, YResolution=100, ZResolution=100, Box=box_3)  # disabled
spin_force_2 = SpinForce(Plane=plane_normal_2, Strength=expr("x/100", number_slider_21), Radius=multiplication_9, Decay=number_slider_22)  # disabled
merge_fields_2 = MergeFields(Fields=flatten([point_charge_3, point_charge_4, spin_force_2]))  # disabled
prealm = Physarealm(Environment=boxenvir, Emitter=ptemi, Food=ptsf, Reset=True)  # -> ChemoAttractorField, Population, Iteration; disabled
number_slider_23 = Slider(13, range=0..20)  # disabled
poploc = PopulationLocations(Population=prealm.Population)  # disabled
poptrail = PopulationTrail(Population=prealm.Population, HistoryStep=10, Reset=False)  # disabled
prox = Proximity3D(Points=poploc, Group=number_slider_23)  # -> flatten(Links), Topology; disabled
dupln = RemoveDuplicateLines(Lines=prox.Links, Tolerance=0.01)  # disabled
avr = Average(Input=poploc)  # disabled
ln_3 = Line(StartPoint=poploc, EndPoint=avr)  # disabled
shortwalk = ShortestWalk(Curves=dupln, WantedPath=ln_3)  # -> ShortestWalk, Succession, Direction, Length; disabled
number_slider_24 = Slider(6, range=0..20)  # disabled
join = JoinCurves(Curves=shortwalk.ShortestWalk, Preserve=False)  # disabled
divide_2 = DivideCurve(Curve=join, Count=number_slider_24, Kinks=False)  # -> Points, Tangents, Parameters; disabled
intcrv_t = InterpolateT(Vertices=divide_2.Points, TangentStart=Vector(0, 0, 0), TangentEnd=Vector(0, 0, 0), KnotStyle=1)  # -> Curve, Length, Domain; disabled
series_3 = Series(Start=0, Step=1, Count=400)  # disabled
item = ListItem(Index=series_3, Wrap=True)  # disabled
field_line = FieldLine(Field=merge_fields_2, Point=move_11.Geometry, Steps=3000, Accuracy=0.1, Method=1)  # disabled
length_3 = Length(Curve=field_line)  # disabled
planesrf = PlaneSurface(Plane=PlaneXY(0, 0, 0), XSize=Domain(-10, 10), YSize=Domain(-10, 10))  # disabled
reb = RebuildCurve(Curve=field_line, Degree=2, Count=30, Tangents=False)  # disabled
move_16 = Move(Geometry=planesrf, Motion=Vector(0, 0, 50))  # -> Geometry, Transform; disabled
bounds_3 = Bounds(Numbers=length_3)  # disabled
pcx = CurvePlane(Curve=reb, Plane=move_16.Geometry)  # -> flatten(Points), ParamsC, ParamsP; disabled
item_2 = ListItem(List=pcx.Points, Index=series_3, Wrap=True)  # disabled
ptstrimcrv = PointsTrimCurve(Curve=reb, Points=item_2, Flip=False)  # -> flatten(Trimmed), SubDomains, Intersected; disabled
remap_numbers_4 = RemapNumbers(Value=length_3, Source=bounds_3, Target=Domain(0, 1))  # -> Mapped, Clipped; disabled
plntrimcrv = PlaneTrimCurve(Curve=reb, Plane=move_16.Geometry, Flip=True)  # -> flatten(Trimmed), Parameters, Intersected; disabled
brep = Brep(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)  # disabled
brep_2 = Brep(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)  # disabled
brep_3 = Brep(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)  # disabled
brep_4 = Brep(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)  # disabled
colour = ColourPicker(PickedColour=RGB(0, 0, 0))  # disabled
move_17 = Move(Geometry=brep, Motion=Vector(0, 0, -250))  # -> Geometry, Transform; disabled
gradient_2 = Gradient(LowerLimit=0, UpperLimit=1, Parameter=remap_numbers_4.Mapped, stops=[0.296: RGB(0, 0, 0), 1: RGB(255, 255, 255)])  # disabled
scale_2 = Scale(Geometry=move_17.Geometry, Center=Point(0, 0, 0), Factor=0.5)  # -> Geometry, Transform; disabled
mesh_uv = MeshSurface(Surface=scale_2.Geometry, UCount=30, VCount=40, Overhang=True, Equalize=False)  # disabled
custom_preview_2 = CustomPreview(Geometry=field_line, Material=gradient_2)  # disabled
custom_preview_3 = CustomPreview(Geometry=plntrimcrv.Trimmed, Material=gradient_2)  # disabled
demesh = DeconstructMesh(Mesh=mesh_uv)  # -> Vertices, Faces, Colours, Normals; disabled
pt_14 = Point(demesh.Vertices)  # disabled
evf_2 = EvaluateField(Field=merge_fields_2, Point=pt_14)  # -> Tensor, Strength; disabled
number_slider_25 = Slider(15, range=0..100)  # disabled
vec_5 = Vector(evf_2.Tensor)  # disabled
amp_2 = Amplitude(Vector=vec_5, Amplitude=number_slider_25)  # disabled
move_18 = Move(Geometry=pt_14, Motion=amp_2)  # -> Geometry, Transform; disabled
conmesh = ConstructMesh(Vertices=move_18.Geometry, Faces=demesh.Faces)  # disabled
subdmesh = SubDFromMesh(Mesh=conmesh, Creases=1, Corners=1, Interpolate=False)  # disabled
swatch = ColourSwatch(SwatchColor=RGBA(112, 112, 112, 51))  # disabled
preview_7 = CustomPreview(
    Geometry=subdmesh,
    Material={diffuse=RGB(0, 0, 0), emission=RGB(0, 0, 0), shine=1, specular=RGB(255, 255, 255), transparency=1})  # disabled

# ==== cluster Cluster
L = ClusterInput()
lng = ListLength(List=L)
random = Random(Range=Domain(-1, 1), Number=lng, Seed=6)
random_2 = Random(Range=Domain(-1, 1), Number=lng, Seed=2)
random_3 = Random(Range=Domain(-1, 1), Number=lng, Seed=12)
vec = VectorXYZ(XComponent=random_2, YComponent=random, ZComponent=random_3)  # -> Vector, Length
V = ClusterOutput(vec.Vector)

# ==== cluster Cluster_2
L = ClusterInput()
lng = ListLength(List=L)
random = Random(Range=Domain(-1, 1), Number=lng, Seed=2)
random_2 = Random(Range=Domain(-1, 1), Number=lng, Seed=6)
random_3 = Random(Range=Domain(-1, 1), Number=lng, Seed=12)
vec = VectorXYZ(XComponent=random, YComponent=random_2, ZComponent=random_3)  # -> Vector, Length
V = ClusterOutput(vec.Vector)
