# Grasshopper definition pre_II_pres.gh (Grasshopper 1.0.7)
# plug-ins: horsterCameraControl, Telepathy, Shader Nodes, Kangaroo2 Components, Pufferfish, DendroGH

layer_weight = LayerWeight(Blend=0.8, Normal=Vector(0, 0, 0))  # -> Fresnel, Facing
layer_weight_2 = LayerWeight(Blend=0.7, Normal=Vector(0, 0, 0))  # -> Fresnel, Facing
layer_weight_3 = LayerWeight(Blend=0.94, Normal=Vector(0, 0, 0))  # -> Fresnel, Facing
emission = EmissionBSDF(Color=RGB(255, 192, 115), Strength=0.25)
anisotropic = AnisotropicBSDF(
    Color=RGB(255, 255, 255),
    Tangent=Vector(0, 0, 0),
    Normal=Vector(0, 0, 0),
    Roughness=0,
    Anisotropy=0,
    Rotation=0,
    Distribution="Multiscatter_GGX")
diffuse = DiffuseBSDF(Color=RGB(222, 169, 44), Roughness=0, Normal=Vector(0, 0, 0))
emission_2 = EmissionBSDF(Color=RGB(255, 229, 0), Strength=2)
color_ramp = ColorRamp(
    Fac=layer_weight.Facing,
    StopColours=[ColourSwatch(SwatchColor=RGB(0, 0, 24)), ColourSwatch(SwatchColor=RGB(255, 255, 255))],
    StopPositions=[Slider(0.43, range=0..1), Slider(0.48, range=0..1)],
    Interpolation="Ease")  # -> Color, Alpha
color_ramp_2 = ColorRamp(
    Fac=layer_weight.Facing,
    StopColours=[ColourSwatch(SwatchColor=RGB(0, 0, 24)), ColourSwatch(SwatchColor=RGB(255, 255, 255))],
    StopPositions=[Slider(0, range=0..1), Slider(0.85, range=0..1)],
    Interpolation="Ease")  # -> Color, Alpha
color_ramp_3 = ColorRamp(
    Fac=layer_weight_2.Facing,
    StopColours=[ColourSwatch(SwatchColor=RGB(255, 255, 255)), ColourSwatch(SwatchColor=RGB(0, 0, 0))],
    StopPositions=[Slider(1, range=0..1), Slider(0.5, range=0..1)],
    Interpolation="Ease")  # -> Color, Alpha
color_ramp_4 = ColorRamp(
    Fac=layer_weight_3.Facing,
    StopColours=[ColourSwatch(SwatchColor=RGB(28, 24, 24)), ColourSwatch(SwatchColor=RGB(255, 255, 255))],
    StopPositions=[Slider(0, range=0..1), Slider(1, range=0..1)],
    Interpolation="Ease")  # -> Color, Alpha
glass = GlassBSDF(Color=RGB(255, 255, 255), Roughness=0, IOR=1.05, Normal=Vector(0, 0, 0), Distribution="Multiscatter_GGX")
emission_3 = EmissionBSDF(Color=RGB(255, 255, 255), Strength=1)
layer_weight_4 = LayerWeight(Blend=0.94, Normal=Vector(0, 0, 0))  # -> Fresnel, Facing
diffuse_2 = DiffuseBSDF(Color=RGB(128, 128, 128), Roughness=0, Normal=Vector(0, 0, 0))
transparent = TransparentBSDF(Color=RGB(255, 255, 255))
divide = Divide(Value1=1, Value2=color_ramp_4.Color, UseClamp=False)
blend = Blend(Closure1=emission_2, Closure2=transparent, Fac=color_ramp_2.Color)
layer_weight_5 = LayerWeight(Blend=0.45, Normal=Vector(0, 0, 0))  # -> Fresnel, Facing
glossy = GlossyBSDF(Color=RGB(255, 255, 255), Roughness=0, Normal=Vector(0, 0, 0), Distribution="Multiscatter_GGX")
layer_weight_6 = LayerWeight(Blend=0.45, Normal=Vector(0, 0, 0))  # -> Fresnel, Facing
emission_4 = EmissionBSDF(Color=RGB(255, 249, 194), Strength=1)
transparent_2 = TransparentBSDF(Color=RGBA(255, 255, 255, 0))
layer_weight_7 = LayerWeight(Blend=Slider(0.87, range=0..1), Normal=Vector(0, 0, 0))  # -> Fresnel, Facing
blend_2 = Blend(Closure1=glass, Closure2=emission_3, Fac=0.5)
blend_3 = Blend(Closure1=transparent_2, Closure2=blend_2, Fac=color_ramp_3.Color)
color_ramp_5 = ColorRamp(
    Fac=layer_weight_4.Facing,
    StopColours=[ColourSwatch(SwatchColor=RGB(0, 0, 0)), ColourSwatch(SwatchColor=RGB(255, 255, 255)), ColourSwatch(SwatchColor=RGB(255, 255, 255)), ColourSwatch(SwatchColor=RGB(0, 0, 0))],
    StopPositions=[Slider(0.3, range=0..1), Slider(0.29, range=0..1), Slider(0.21, range=0..1), Slider(0.2, range=0..1)],
    Interpolation="Ease")  # -> Color, Alpha
glass_2 = GlassBSDF(Color=RGB(255, 255, 255), Roughness=0, IOR=1.05, Normal=Vector(0, 0, 0), Distribution="Multiscatter_GGX")
refraction = RefractionBSDF(Color=RGB(255, 255, 255), Roughness=0, IOR=divide, Normal=Vector(0, 0, 0), Distribution="Beckmann")
blend_4 = Blend(Closure1=emission_4, Closure2=blend, Fac=color_ramp.Color)
transparent_3 = TransparentBSDF(Color=RGB(255, 255, 255))
diffuse_3 = DiffuseBSDF(Color=RGB(205, 242, 255), Roughness=0, Normal=Vector(0, 0, 0))
blend_5 = Blend(Closure1=diffuse_3, Closure2=transparent_3, Fac=layer_weight_7.Facing)
transparent_4 = TransparentBSDF(Color=RGB(255, 255, 255))
layer_weight_8 = LayerWeight(Blend=0.7, Normal=Vector(0, 0, 0))  # -> Fresnel, Facing
color_ramp_6 = ColorRamp(
    Fac=layer_weight_5.Fresnel,
    StopColours=[ColourSwatch(SwatchColor=RGB(0, 0, 24)), ColourSwatch(SwatchColor=RGB(255, 255, 255))],
    StopPositions=[Slider(0, range=0..1), Slider(1, range=0..1)],
    Interpolation="Ease")  # -> Color, Alpha
blend_6 = Blend(Closure1=refraction, Closure2=anisotropic, Fac=color_ramp_5.Color)
layer_weight_9 = LayerWeight(Blend=0.8, Normal=Vector(0, 0, 0))  # -> Fresnel, Facing
layer_weight_10 = LayerWeight(Blend=0.5, Normal=Vector(0, 0, 0))  # -> Fresnel, Facing
layer_weight_11 = LayerWeight(Blend=0.8, Normal=Vector(0, 0, 0))  # -> Fresnel, Facing
output = Output(Surface=blend_3, Volume=RGB(128, 128, 128), Displacement=Vector(0, 0, 0))  # disabled
blend_7 = Blend(Closure1=transparent, Closure2=blend_4, Fac=0.5)
swatch = ColourSwatch(SwatchColor=RGB(0, 255, 255))
blend_8 = Blend(Closure1=blend_5, Closure2=transparent_4, Fac=layer_weight_6.Facing)
blend_9 = Blend(Closure1=transparent_4, Closure2=blend_8, Fac=layer_weight_8.Facing)
layer_weight_12 = LayerWeight(Blend=0.94, Normal=Vector(0, 0, 0))  # -> Fresnel, Facing
divide_2 = Divide(Value1=1, Value2=color_ramp_6.Color, UseClamp=False)
layer_weight_13 = LayerWeight(Blend=0.95, Normal=Vector(0, 0, 0))  # -> Fresnel, Facing
output_2 = Output(Surface=blend_7, Volume=RGB(128, 128, 128), Displacement=Vector(0, 0, 0))
diffuse_4 = DiffuseBSDF(Color=swatch, Roughness=0, Normal=Vector(0, 0, 0))
transparent_5 = TransparentBSDF(Color=swatch)
glass_3 = GlassBSDF(Color=swatch, Roughness=layer_weight_10.Facing, IOR=1, Normal=Vector(0, 0, 0), Distribution="Multiscatter_GGX")
glossy_2 = GlossyBSDF(Color=RGB(202, 85, 190), Roughness=0.2, Normal=Vector(0, 0, 0), Distribution="Multiscatter_GGX")
transparent_6 = TransparentBSDF(Color=RGBA(255, 255, 255, 0))
color_ramp_7 = ColorRamp(
    Fac=layer_weight_9.Facing,
    StopColours=[ColourSwatch(SwatchColor=RGB(0, 0, 0)), ColourSwatch(SwatchColor=RGB(255, 255, 255))],
    StopPositions=[Slider(0.95, range=0..1), Slider(0.57, range=0..1)],
    Interpolation="Ease")  # -> Color, Alpha
emission_5 = EmissionBSDF(Color=RGB(223, 255, 255), Strength=2)
emission_6 = EmissionBSDF(Color=RGB(0, 0, 255), Strength=0.7)
color_ramp_8 = ColorRamp(
    Fac=layer_weight_11.Facing,
    StopColours=[ColourSwatch(SwatchColor=RGB(0, 0, 0)), ColourSwatch(SwatchColor=RGB(255, 255, 255))],
    StopPositions=[Slider(0.54, range=0..1), Slider(0, range=0..1)],
    Interpolation="Ease")  # -> Color, Alpha
emission_7 = EmissionBSDF(Color=RGB(0, 255, 0), Strength=1)
color_ramp_9 = ColorRamp(
    Fac=layer_weight_12.Facing,
    StopColours=[ColourSwatch(SwatchColor=RGB(0, 0, 0)), ColourSwatch(SwatchColor=RGB(255, 255, 255)), ColourSwatch(SwatchColor=RGB(255, 255, 255))],
    StopPositions=[Slider(0.51, range=0..1), Slider(0.17, range=0..1), Slider(0, range=0..1)],
    Interpolation="Ease")  # -> Color, Alpha
blend_10 = Blend(Closure1=blend_6, Closure2=RGB(128, 128, 128), Fac=color_ramp_9.Color)
refraction_2 = RefractionBSDF(Color=RGB(255, 255, 255), Roughness=0, IOR=1.1, Normal=Vector(0, 0, 0), Distribution="GGX")
blend_11 = Blend(Closure1=RGB(128, 128, 128), Closure2=RGB(128, 128, 128), Fac=color_ramp_6.Color)
output_3 = Output(Surface=blend_5, Volume=RGB(128, 128, 128), Displacement=Vector(0, 0, 0))  # disabled
output_4 = Output(Surface=blend_10, Volume=RGB(128, 128, 128), Displacement=Vector(0, 0, 0))
blend_12 = Blend(Closure1=transparent_6, Closure2=emission_5, Fac=color_ramp_7.Color)
glossy_3 = GlossyBSDF(Color=RGB(107, 255, 255), Roughness=0.2, Normal=Vector(0, 0, 0), Distribution="Multiscatter_GGX")
diffuse_5 = DiffuseBSDF(Color=RGB(131, 189, 255), Roughness=0, Normal=Vector(0, 0, 0))
output_5 = Output(Surface=glass_3, Volume=RGB(128, 128, 128), Displacement=Vector(0, 0, 0))
color_ramp_10 = ColorRamp(
    Fac=layer_weight_9.Facing,
    StopColours=[ColourSwatch(SwatchColor=RGB(0, 0, 0)), ColourSwatch(SwatchColor=RGB(255, 255, 255))],
    StopPositions=[Slider(0.92, range=0..1), Slider(0.72, range=0..1)],
    Interpolation="Ease")  # -> Color, Alpha
blend_13 = Blend(Closure1=blend_12, Closure2=emission_6, Fac=color_ramp_10.Color)
output_6 = Output(Surface=refraction_2, Volume=RGB(128, 128, 128), Displacement=Vector(0, 0, 0))
output_7 = Output(Surface=emission_7, Volume=RGB(128, 128, 128), Displacement=Vector(0, 0, 0))
emission_8 = EmissionBSDF(Color=RGB(255, 0, 255), Strength=1)
blend_14 = Blend(Closure1=blend_13, Closure2=emission_8, Fac=color_ramp_8.Color)
blend_15 = Blend(Closure1=blend_14, Closure2=transparent_6, Fac=0.5)
output_8 = Output(Surface=blend_13, Volume=RGB(128, 128, 128), Displacement=Vector(0, 0, 0))
blend_16 = Blend(Closure1=glossy_2, Closure2=diffuse_5, Fac=color_ramp_8.Color)
time = Slider(360, range=180..360)  # disabled
number_slider = Slider(-52.1, range=-100..0)  # disabled
subtraction = Subtraction(A=time, B=180)  # disabled
population = Slider(1000, range=0..1000)
multiplication = Multiplication(A=subtraction, B=0.8)  # disabled
density = Slider(50, range=10..100)
viscosity = Slider(100, range=0..200)
temperature = Slider(100, range=-270..280)
mepoint = Point(<point referenced from the Rhino model>)
time_2 = Slider(50, range=40..50)
mepoint_2 = RemoteSender(mepoint)
pt = ConstructPoint(XCoordinate=0, YCoordinate=0, ZCoordinate=multiplication)  # disabled
pt_2 = ConstructPoint(XCoordinate=0, YCoordinate=0, ZCoordinate=0)  # disabled
mepoint_3 = RemoteReceiver(mepoint_2)
toggle = BooleanToggle(True)  # disabled
sph = Sphere(Base=mepoint_3, Radius=Slider(100, range=0..100))
pop3d = Populate3D(Region=sph, Count=1000, Seed=1)
temperature_2 = RemoteSender(temperature)
move = Move(Geometry=pt_2, Motion=pt)  # -> Geometry, Transform; disabled
move_2 = Move(Geometry=pt_2, Motion=Vector(0, 0, 1000))  # -> Geometry, Transform; disabled
viscosity_2 = RemoteSender(viscosity)
density_2 = RemoteSender(density)
pt_3 = ConstructPoint(XCoordinate=0, YCoordinate=0, ZCoordinate=0)  # disabled
time_3 = RemoteSender(time_2)
# Camera
time_4 = RemoteReceiver(time_3)  # disabled
subtraction_2 = Subtraction(A=time_4, B=180)  # disabled
multiplication_2 = Multiplication(A=subtraction_2, B=0.8)  # disabled
pt_4 = ConstructPoint(XCoordinate=0, YCoordinate=0, ZCoordinate=multiplication_2)  # disabled
toggle_2 = BooleanToggle(True)  # disabled
setcam = SetCamera(CameraLocation=move.Geometry, TargetLocation=move_2.Geometry, Activate=toggle)  # disabled
move_3 = Move(Geometry=pt_3, Motion=pt_4)  # -> Geometry, Transform; disabled
move_4 = Move(Geometry=pt_3, Motion=Vector(0, 0, 1000))  # -> Geometry, Transform; disabled
setcam_2 = SetCamera(CameraLocation=move_3.Geometry, TargetLocation=move_4.Geometry, Activate=toggle_2)  # disabled
mepoint_4 = RemoteReceiver(mepoint_2)
toggle_3 = BooleanToggle(True)  # disabled
number_slider_2 = Slider(10, range=0..10)  # disabled
number_slider_3 = Slider(13, range=0..100)  # disabled
density_3 = RemoteReceiver(density_2)
density_4 = RemoteReceiver(density_2)
viscosity_3 = RemoteReceiver(viscosity_2)
# Bounding Sphere
number_slider_4 = Slider(500, range=0..500)
pt_5 = ConstructPoint(XCoordinate=0, YCoordinate=0, ZCoordinate=-2000)
lenght = Slider(200, range=0..5000)
time_5 = RemoteReceiver(time_3)
dom = ConstructDomain(DomainStart=0, DomainEnd=lenght)
vsettings = CreateSettings(VoxelSize=6.66, Bandwidth=2, Isovalue=0, Adaptivity=0.1)
remap = RemapNumbers(Value=time_5, Source=Domain(0, 1000), Target=dom)  # -> Mapped, Clipped
number_slider_5 = Slider(0.25, range=0..1)  # disabled
number_slider_6 = Slider(6, range=0..30)  # disabled
fallof = Slider(150, range=0..1000)
radiusbound = RemoteSender(number_slider_4)
# Wormholes
radiusbound_2 = RemoteReceiver(radiusbound)
expression = Expression(x=radiusbound_2, y=density_3, Expression="x^2*y/100000*pi")
sph_2 = Sphere(Base=PlaneXY(0, 0, 0), Radius=expr("X*0.5", radiusbound_2))
expression_2 = Expression(x=number_slider_4, y=density_4, Expression="x^2*y/100000*pi")
# This moves the time black hole
move_5 = Move(Geometry=sph_2, Motion=Vector(0, 0, -75))  # -> Geometry, Transform
pcharge = PointCharge(Point=pt_5, Charge=expr("x/100", Slider(5, range=-1..5)), Decay=Slider(-0.4, range=-5..1))
mepoint_5 = RemoteReceiver(mepoint_2)
pop3d_2 = Populate3D(Region=move_5.Geometry, Count=expression, Seed=54465483)
sph_3 = Sphere(Base=PlaneXY(0, 0, 0), Radius=number_slider_4)
vsettings_2 = CreateSettings(VoxelSize=1, Bandwidth=1, Isovalue=0, Adaptivity=0.1)
dom_2 = ConstructDomain(DomainStart=0, DomainEnd=fallof)
move_6 = Move(Geometry=sph_3, Motion=Vector(0, 0, 150))  # -> Geometry, Transform
brepinc = PointInBrep(Brep=move_5.Geometry, Point=pop3d_2, Strict=False)
preview = CustomPreview(Material=ColourSwatch(SwatchColor=RGB(255, 255, 255)))
dispatch = Dispatch(List=pop3d_2, DispatchPattern=brepinc)  # -> ListA, ListB
pop3d_3 = Populate3D(Region=move_6.Geometry, Count=expression_2, Seed=56456456)
randomize = Cluster(L=dispatch.ListA)
brepinc_2 = PointInBrep(Brep=move_6.Geometry, Point=pop3d_3, Strict=False)
pt_6 = ConstructPoint(XCoordinate=0, YCoordinate=0, ZCoordinate=-550)
# Dimension Basis / Secondary Pendulum
number_slider_7 = Slider(0.001, range=-50.001..50)
pl = PlaneNormal(Origin=dispatch.ListA, ZAxis=randomize)
dispatch_2 = Dispatch(List=pop3d_3, DispatchPattern=brepinc_2)  # -> ListA, ListB
number_slider_8 = Slider(30, range=0..100)
centerholes = RemoteSender(pl)
centerholes_2 = RemoteReceiver(centerholes)
cluster = Cluster(L=dispatch_2.ListA)
number_slider_9 = Slider(2.77, range=0..10)  # disabled
number_slider_10 = Slider(1.3, range=0..10)  # disabled
vsettings_3 = CreateSettings(VoxelSize=number_slider_9, Bandwidth=number_slider_10, Isovalue=0, Adaptivity=0.1)  # disabled
pl_2 = PlaneNormal(Origin=dispatch_2.ListA, ZAxis=cluster)
point_charge = PointCharge(Point=pt_5, Charge=expr("x/100", number_slider_7), Decay=Slider(0, range=0..100))  # disabled
point_charge_2 = PointCharge(Point=pt_6, Charge=expr("x/100", Slider(-0.001, range=-50.001..50)), Decay=Slider(0.35, range=0..100))  # disabled
vsettings_4 = CreateSettings(VoxelSize=number_slider_9, Bandwidth=number_slider_10, Isovalue=0, Adaptivity=0.1)  # disabled
dimpoints = RemoteSender(pl_2)
# Dimension Basis / Primary Pendulum
dimpoints_2 = RemoteReceiver(dimpoints)
fspin = SpinForce(Plane=dimpoints_2, Strength=Slider(4, range=0..150), Radius=expr("x*0.5+5", Slider(100, range=0..500)), Decay=2)
mergef = MergeFields(Fields=flatten([fspin, pcharge]))
primary_field = RemoteSender(mergef)
primary_field_2 = RemoteReceiver(primary_field)
fline = FieldLine(Field=primary_field_2, Point=centerholes_2, Steps=lenght, Accuracy=1, Method=1)
eval = EvaluateCurve(Curve=fline, Parameter=remap.Mapped)  # -> Point, Tangent, Angle
pl_3 = ConstructPlane(Origin=eval.Point, XAxis=Vector(1, 0, 0), YAxis=Vector(0, 1, 0))
dist = Distance(PointA=mepoint_5, PointB=eval.Point)
greater_than = GreaterThan(Value1=dist, Value2=fallof, UseClamp=False)
dispatch_3 = Dispatch(List=pl_3, DispatchPattern=invert(greater_than))  # -> ListA, ListB
dispatch_4 = Dispatch(List=dist, DispatchPattern=invert(greater_than))  # -> ListA, ListB
# fall figure wrt distance
graph = GraphMapper(
    dispatch_4.ListA,
    x0=0,
    x1=150,
    y0=0,
    y1=20,
    container_name="Bezier",
    cpx=[0, 0.8421875238, 0.7837508917, 1],
    cpy=[0.6451612711, 0.6135716438, 0.0732151866, 0])
sph_4 = Sphere(Base=dispatch_3.ListA, Radius=graph)
msphere = MeshSphere(Base=dispatch_3.ListA, Radius=graph, UCount=number_slider_8, VCount=number_slider_8)
worms = RemoteSender(dispatch_3.ListA)

# ----
# Interconnections
number_slider_11 = Slider(100, range=0..500)
worms_2 = RemoteReceiver(worms)
inter = InterconnectPoints(Pts=worms_2)
len = Length(Curve=inter)
expression_3 = Expression(x=number_slider_11, y=len, Expression="x>y")
dispatch_5 = Dispatch(List=inter, DispatchPattern=expression_3)  # -> ListA, ListB
length = Length(Curve=dispatch_5.ListA)
bounds = Bounds(Numbers=length)
remap_numbers = RemapNumbers(Value=length, Source=bounds, Target=Domain(3, 0.5))  # -> Mapped, Clipped
remap_numbers_2 = RemapNumbers(Value=length, Source=bounds, Target=Domain(1.1, 1))  # -> Mapped, Clipped
pipe = Pipe(Curve=dispatch_5.ListA, Radius=remap_numbers.Mapped, Caps=0)  # -> flatten(Pipe)
preview_2 = CustomPreview(
    Geometry=pipe,
    Material={diffuse=RGB(255, 105, 180), emission=RGB(0, 0, 0), shine=0, specular=RGB(255, 255, 255), transparency=0})
refraction_3 = RefractionBSDF(Color=RGB(255, 255, 255), Roughness=0, IOR=remap_numbers_2.Mapped, Normal=Vector(0, 0, 0), Distribution="GGX")
output_9 = Output(Surface=refraction_3, Volume=RGB(128, 128, 128), Displacement=Vector(0, 0, 0))

# ----
# interconnections depend on size of blackhole
end = EndPoints(Curve=dispatch_5.ListA)  # -> Start, End
mepoint_6 = RemoteReceiver(mepoint_2)
mepoint_7 = RemoteReceiver(mepoint_2)
dist_2 = Distance(PointA=end.Start, PointB=mepoint_6)  # -> expr("x/70", Distance)
dist_3 = Distance(PointA=end.End, PointB=mepoint_7)  # -> expr("x/70", Distance)
graph_2 = GraphMapper(dist_2, x0=0.65, x1=2.85, y0=0, y1=1.5, container_name="Bezier", cpx=[0, 1, 0, 1], cpy=[1, 1, 0, 0.01405465603])
graph_3 = GraphMapper(dist_3, x0=0.65, x1=2.85, y0=0, y1=1.5, container_name="Bezier", cpx=[0, 1, 0, 1], cpy=[1, 1, 0, 0])
lng = ListLength(List=dispatch_5.ListA)
series = Series(Start=0, Step=0, Count=lng)
series_2 = Series(Start=1, Step=0, Count=lng)
weave = Weave(Pattern=[0, 1], Stream0=graph_2, Stream1=graph_3, NullGaps=False)
weave_2 = Weave(Pattern=[0, 1], Stream0=series, Stream1=series_2, NullGaps=False)
partition = PartitionList(List=weave, Size=2)
partition_2 = PartitionList(List=weave_2, Size=2)
vpipe = PipeVariable(Curve=reparameterize(graft(dispatch_5.ListA)), Parameters=partition_2, Radii=partition, Caps=0)  # -> flatten(Pipe)
preview_3 = CustomPreview(
    Geometry=vpipe,
    Material={diffuse=RGB(255, 105, 180), emission=RGB(0, 0, 0), shine=0, specular=RGB(255, 255, 255), transparency=0})

preview_4 = CustomPreview(
    Geometry=msphere,
    Material={diffuse=RGB(255, 105, 180), emission=RGB(0, 0, 0), shine=0, specular=RGB(255, 255, 255), transparency=0})
preview_5 = CustomPreview(
    Geometry=msphere,
    Material={diffuse=RGB(0, 0, 0), emission=RGB(0, 255, 0), shine=0, specular=RGB(255, 255, 255), transparency=0})
mepoint_8 = RemoteReceiver(mepoint_2)
primary_field_3 = RemoteReceiver(primary_field)
lng_2 = ListLength(List=eval.Point)
dist_4 = Distance(PointA=eval.Point, PointB=mepoint_8)
populate_3d = Populate3D(Region={Plane=PlaneXY(0, 0, 0), X=Domain(0, 10), Y=Domain(0, 10), Z=Domain(0, 2)}, Count=lng_2, Seed=58654)
fallof_2 = Slider(150, range=0..1000)
graph_4 = GraphMapper(
    dist_4,
    x0=0,
    x1=150,
    y0=0,
    y1=20,
    container_name="Bezier",
    cpx=[0, 0.5139731765, 0.75, 1],
    cpy=[0.5057080984, 0.4579564929, 0.75, 0])
cluster_2 = Cluster_2(L=populate_3d)
number_slider_12 = Slider(100, range=0..100)
dom_3 = ConstructDomain(DomainStart=8, DomainEnd=0.2)
dist_5 = Distance(PointA=mepoint_8, PointB=eval.Point)
dom_4 = ConstructDomain(DomainStart=0, DomainEnd=fallof_2)
evaluate_field = EvaluateField(Field=primary_field_3, Point=eval.Point)  # -> Tensor, Strength
greater_than_2 = GreaterThan(Value1=dist_5, Value2=fallof_2, UseClamp=False)
series_3 = Series(Start=0, Step=1, Count=10)
rotate_3d = Rotate3D(Geometry=evaluate_field.Tensor, Angle=2.35619449, Center=eval.Point, Axis=cluster_2)  # -> Geometry, Transform
vsettings_5 = CreateSettings(VoxelSize=0.5, Bandwidth=1, Isovalue=0, Adaptivity=0.1)
plane_normal = PlaneNormal(Origin=eval.Point, ZAxis=rotate_3d.Geometry)
dispatch_6 = Dispatch(List=plane_normal, DispatchPattern=invert(greater_than_2))  # -> ListA, ListB
dispatch_7 = Dispatch(List=graph_4, DispatchPattern=invert(greater_than_2))  # -> ListA, ListB
number_slider_13 = Slider(2, range=0..10)
vsettings_6 = CreateSettings(VoxelSize=1, Bandwidth=1, Isovalue=0.02, Adaptivity=0.5)
spin_force = SpinForce(
    Plane=dispatch_6.ListA,
    Strength=expr("x/100", Slider(0.008, range=0..10)),
    Radius=dispatch_7.ListA,
    Decay=Slider(0.85, range=0..10))
merge_fields = MergeFields(Fields=flatten([point_charge, point_charge_2, spin_force]))
secondary_field = RemoteSender(merge_fields)
secondary_field_2 = RemoteReceiver(secondary_field)
secondary_field_3 = RemoteReceiver(secondary_field)
secondary_field_4 = RemoteReceiver(secondary_field)  # disabled

# ----
# Point Grid Representation
size = Slider(5, range=0..100)  # disabled
num = Slider(40, range=0..100)  # disabled
number_slider_14 = Slider(5, range=0..100)  # disabled
secondary_field_5 = RemoteReceiver(secondary_field)  # disabled
multiplication_3 = Multiplication(A=size, B=0.5, C=num)  # disabled
multiplication_4 = Multiplication(A=multiplication_3, B=-1)  # disabled
addition = Addition(A=num, B=1)  # disabled
series_4 = Series(Start=multiplication_4, Step=size, Count=addition)  # disabled
series_5 = Series(Start=multiplication_4, Step=size, Count=addition)  # disabled
series_6 = Series(Start=multiplication_4, Step=size, Count=addition)  # disabled
vec = VectorXYZ(XComponent=expr("x*-1", multiplication_3), YComponent=expr("x*-1", multiplication_3), ZComponent=series_4)  # -> Vector, Length; disabled
vec_2 = VectorXYZ(XComponent=expr("x*-1", multiplication_3), YComponent=expr("x*-1", multiplication_3), ZComponent=series_5)  # -> Vector, Length; disabled
vec_3 = VectorXYZ(XComponent=expr("x*-1", multiplication_3), YComponent=expr("x*-1", multiplication_3), ZComponent=series_6)  # -> Vector, Length; disabled
sqgrid = Square(Plane=vec.Vector, Size=size, ExtentX=num, ExtentY=num)  # -> Cells, Points; disabled
sqgrid_2 = Square(Plane=vec_2.Vector, Size=size, ExtentX=num, ExtentY=num)  # -> Cells, Points; disabled
sqgrid_3 = Square(Plane=vec_3.Vector, Size=size, ExtentX=num, ExtentY=num)  # -> Cells, Points; disabled
move_7 = Move(Geometry=sqgrid.Points, Motion=Vector(0, 0, 0))  # -> Geometry, Transform; disabled
rotate = Rotate(Geometry=sqgrid_2.Points, Angle=1.570796327, Plane=PlaneXY(0, 0, 0))  # -> Geometry, Transform; disabled
pl_4 = ConstructPlane(Origin=Point(-50, 0, 0), XAxis=Vector(0, 1, 0), YAxis=Vector(0, 0, 1))  # disabled
rotate_2 = Rotate(Geometry=sqgrid_3.Points, Angle=-1.570796327, Plane=pl_4)  # -> Geometry, Transform; disabled
move_8 = Move(Geometry=rotate_2.Geometry, Motion=Vector(0, 0, 0))  # -> Geometry, Transform; disabled
move_9 = Move(Geometry=rotate.Geometry, Motion=Vector(0, 0, 0))  # -> Geometry, Transform; disabled
evf = EvaluateField(Field=secondary_field_5, Point=move_7.Geometry)  # -> Tensor, Strength; disabled
evf_2 = EvaluateField(Field=secondary_field_5, Point=move_9.Geometry)  # -> Tensor, Strength; disabled
evf_3 = EvaluateField(Field=secondary_field_5, Point=move_8.Geometry)  # -> Tensor, Strength; disabled
amp = Amplitude(Vector=evf.Tensor, Amplitude=number_slider_14)  # disabled
amp_2 = Amplitude(Vector=evf_2.Tensor, Amplitude=number_slider_14)  # disabled
amp_3 = Amplitude(Vector=evf_3.Tensor, Amplitude=number_slider_14)  # disabled
move_10 = Move(Geometry=move_7.Geometry, Motion=amp)  # -> Geometry, Transform; disabled
move_11 = Move(Geometry=move_9.Geometry, Motion=amp_2)  # -> Geometry, Transform; disabled
move_12 = Move(Geometry=move_8.Geometry, Motion=amp_3)  # -> Geometry, Transform; disabled
pt_7 = Point(move_10.Geometry)  # disabled
pt_8 = Point(move_11.Geometry)  # disabled
pt_9 = Point(move_12.Geometry)  # disabled
pline = PolyLine(Vertices=pt_9, Closed=False)  # disabled
pline_2 = PolyLine(Vertices=pt_8, Closed=False)  # disabled
pline_3 = PolyLine(Vertices=pt_7, Closed=False)  # disabled
swatch_2 = ColourSwatch(SwatchColor=RGBA(0, 0, 196, 109))  # disabled
swatch_3 = ColourSwatch(SwatchColor=RGB(12, 0, 255))  # disabled
relay = Relay([pline_3, pline_2, pline])  # disabled
preview_6 = CustomPreview(Geometry=relay, Material=swatch_2)  # disabled
preview_7 = CustomPreview(Geometry=pt_8, Material=swatch_3)  # disabled

# ----
# Spherical Deformation
resolution = Slider(40, range=0..100)  # disabled
closedomain = Slider(100, range=0..100)  # disabled
number_slider_15 = Slider(15, range=0..100)  # disabled
mepoint_9 = RemoteReceiver(mepoint_2)  # disabled
secondary_field_6 = RemoteReceiver(secondary_field)  # disabled
scalefactor = Slider(0.8, range=0..10)  # disabled
pl_5 = ConstructPlane(Origin=mepoint_9, XAxis=Vector(1, 0, 0), YAxis=Vector(0, 1, 0))  # disabled
msphereex = MeshSphereEx(Base=pl_5, Radius=closedomain, Count=resolution)  # disabled
demesh = DeconstructMesh(Mesh=msphereex)  # -> Vertices, Faces, Colours, Normals; disabled
evf_4 = EvaluateField(Field=secondary_field_6, Point=demesh.Vertices)  # -> Tensor, Strength; disabled
amp_4 = Amplitude(Vector=evf_4.Tensor, Amplitude=number_slider_15)  # disabled
move_13 = Move(Geometry=demesh.Vertices, Motion=amp_4)  # -> Geometry, Transform; disabled
conmesh = ConstructMesh(Vertices=move_13.Geometry, Faces=demesh.Faces)  # disabled
subdmesh = SubDFromMesh(Mesh=conmesh, Creases=1, Corners=1, Interpolate=False)  # disabled
scale = Scale(Geometry=subdmesh, Center=Point(0, 0, 0), Factor=scalefactor)  # -> Geometry, Transform; disabled
preview_8 = CustomPreview(
    Geometry=scale.Geometry,
    Material={diffuse=RGB(0, 0, 0), emission=RGB(0, 0, 0), shine=1, specular=RGB(255, 255, 255), transparency=1})  # disabled

# ----
# Point Grid Representation
# Grid Connections
secondary_field_7 = RemoteReceiver(secondary_field)  # disabled
radiusbound_3 = RemoteReceiver(radiusbound)  # disabled
division = Division(A=radiusbound_3, B=50)  # disabled
box = CenterBox(Base=PlaneXY(0, 0, 0), X=division, Y=division, Z=division)  # disabled
number_slider_16 = Slider(5, range=0..100)  # disabled
pt_10 = ConstructPoint(XCoordinate=0, YCoordinate=0, ZCoordinate=0)  # disabled
arrbox = BoxArray(Geometry=pt_10, Cell=box, XCount=number_slider_16, YCount=number_slider_16, ZCount=number_slider_16)  # -> Geometry, Transform; disabled
number_slider_17 = Slider(21.936, range=0..100)  # disabled
multiplication_5 = Multiplication(A=number_slider_16, B=division, C=-1)  # disabled
vec_4 = VectorXYZ(XComponent=multiplication_5, YComponent=multiplication_5, ZComponent=multiplication_5)  # -> Vector, Length; disabled
move_14 = Move(Geometry=arrbox.Geometry, Motion=vec_4.Vector)  # -> Geometry, Transform; disabled
evf_5 = EvaluateField(Field=secondary_field_7, Point=move_14.Geometry)  # -> Tensor, Strength; disabled
amp_5 = Amplitude(Vector=evf_5.Tensor, Amplitude=number_slider_17)  # disabled
move_15 = Move(Geometry=move_14.Geometry, Motion=amp_5)  # -> Geometry, Transform; disabled
number_slider_18 = Slider(28, range=0..30)  # disabled
inter_2 = InterconnectPoints(Pts=move_15.Geometry)  # disabled
len_2 = Length(Curve=inter_2)  # disabled
greater_than_3 = GreaterThan(Value1=len_2, Value2=number_slider_18, UseClamp=False)  # disabled
swatch_4 = ColourSwatch(SwatchColor=RGB(255, 255, 255))  # disabled
dispatch_8 = Dispatch(List=inter_2, DispatchPattern=greater_than_3)  # -> ListA, ListB; disabled
preview_9 = CustomPreview(Geometry=dispatch_8.ListB, Material=swatch_4)  # disabled

# ----
# Line Representation
radiusbound_4 = RemoteReceiver(radiusbound)
density_5 = RemoteReceiver(density_2)
expression_4 = Expression(x=radiusbound_4, y=density_5, Expression="(x/6*sqrt(3))^2*y/10000*pi")
polygon = Polygon(Plane=PlaneXY(0, 0, 0), Radius=expr("x/6*sqrt(3)", radiusbound_4), Segments=4, FilletRadius=0)  # -> Polygon, Length
vec_5 = VectorXYZ(XComponent=0, YComponent=0, ZComponent=expr("-0.1*x", radiusbound_4))  # -> Vector, Length
move_16 = Move(Geometry=polygon.Polygon, Motion=vec_5.Vector)  # -> Geometry, Transform
pop2d = Populate2D(Region=move_16.Geometry, Count=expression_4, Seed=1)
circle = CircleCNR(Center=Point(0, 0, 0), Normal=Vector(0, 0, 1), Radius=expr("x/6", radiusbound_4))
move_17 = Move(Geometry=circle, Motion=vec_5.Vector)  # -> Geometry, Transform
incurve = PointInCurve(Point=pop2d, Curve=move_17.Geometry)  # -> Relationship, Point
secondary_field_8 = RemoteReceiver(secondary_field)
dispatch_9 = Dispatch(List=pop2d, DispatchPattern=incurve.Relationship)  # -> ListA, ListB
pt_11 = Point(dispatch_9.ListA)
fline_2 = FieldLine(Field=secondary_field_8, Point=pt_11, Steps=60, Accuracy=10, Method=1)
move_18 = Move(Geometry=pt_11, Motion=Vector(0.1, 0.1, 0))  # -> Geometry, Transform
move_19 = Move(Geometry=pt_11, Motion=Vector(-0.1, 0.1, 0))  # -> Geometry, Transform
ln = Line(StartPoint=pt_11, EndPoint=move_18.Geometry)
ln_2 = Line(StartPoint=pt_11, EndPoint=move_19.Geometry)
extrcrv = ExtrudeAlong(Base=ln, Curve=fline_2)  # disabled
extrcrv_2 = ExtrudeAlong(Base=ln_2, Curve=fline_2)  # disabled
preview_10 = CustomPreview(
    Geometry=[extrcrv, extrcrv_2],
    Material={diffuse=RGB(0, 0, 0), emission=RGB(250, 250, 40), shine=0, specular=RGB(255, 255, 255), transparency=0})

initial_polygon = RemoteSender(move_16.Geometry)
initial_polygon_2 = RemoteReceiver(initial_polygon)
boundary = BoundarySurfaces(Edges=initial_polygon_2)
popgeo = PopulateGeometry(Geometry=boundary, Count=population, Seed=1)
fline_3 = FieldLine(Field=secondary_field_2, Point=flatten(popgeo), Steps=30, Accuracy=10, Method=1)
end_2 = EndPoints(Curve=fline_3)  # -> Start, End
pt_12 = Point(end_2.End)
fline_4 = FieldLine(Field=secondary_field_3, Point=pt_12, Steps=10, Accuracy=10, Method=3)
divide_3 = DivideCurve(Curve=fline_4, Count=5, Kinks=False)  # -> flatten(Points), Tangents, Parameters
scatteredpoints = RemoteSender(divide_3.Points)
scatteredpoints_2 = RemoteReceiver(scatteredpoints)
scatteredpoints_3 = RemoteReceiver(scatteredpoints)  # disabled
dist_6 = Distance(PointA=scatteredpoints_2, PointB=mepoint_4)
bnd = Bounds(Numbers=dist_6)
voxmsh = VoxelMesh(
    Points=scatteredpoints_3,
    Plane=PlaneXY(0, 0, 0),
    SizeX=number_slider_3,
    SizeY=number_slider_3,
    SizeZ=number_slider_3,
    Triangulate=toggle_3)  # disabled
remap_2 = RemapNumbers(Value=dist_6, Source=Domain(0, 180), Target=Domain(15, 3))  # -> Mapped, Clipped
msmooth = SmoothMesh(Mesh=voxmsh, Strength=number_slider_5, SkipNaked=True, Iterations=number_slider_6)  # disabled
vpoints = PointsToVolume(Points=scatteredpoints_2, PointRadius=Slider(12, range=0..100), Settings=vsettings)
demesh_2 = DeconstructMesh(Mesh=msmooth)  # -> Vertices, Faces, Colours, Normals; disabled
vsmooth = SmoothVolume(Volume=vpoints, Width=2, Type=3, Iterations=1)
fline_5 = FieldLine(Field=secondary_field_4, Point=demesh_2.Vertices, Steps=5, Accuracy=10, Method=3)  # disabled
mvolume = VolumeToMesh(Volume=vsmooth, VolumeSettings=vsettings_2)
eval_2 = EvaluateCurve(Curve=fline_5, Parameter=expr("x/3", number_slider_2))  # -> Point, Tangent, Angle; disabled
qrmesh = QuadRemesh(Mesh=mvolume, Settings={aqc=True, as=50, dhe=True, gci=0, null=False, pme=0, sa=0, tqc=2000})
conmesh_2 = ConstructMesh(Vertices=eval_2.Point, Faces=demesh_2.Faces)  # disabled
vmesh = MeshToVolume(Mesh=conmesh_2, Settings=vsettings_3)  # disabled
msmooth_2 = SmoothMesh(Mesh=qrmesh, Strength=0.9, SkipNaked=True, Iterations=1)
vsmooth_2 = SmoothVolume(Volume=vmesh, Width=2, Type=3, Iterations=2)  # disabled

explode = Explode(Curve=fline_2, Recursive=True)  # -> Segments, Vertices
pt_13 = Point(flatten(explode.Vertices))
preview_11 = CustomPreview(Geometry=fline_2, Material=ColourSwatch(SwatchColor=RGB(255, 255, 255)))

scatteredpoints2 = RemoteSender(pt_13)
mvolume_2 = VolumeToMesh(Volume=vsmooth_2, VolumeSettings=vsettings_4)  # disabled
preview_12 = CustomPreview(
    Geometry=mvolume_2,
    Material={diffuse=RGB(255, 105, 180), emission=RGB(0, 0, 0), shine=0, specular=RGB(255, 255, 255), transparency=0})  # disabled
lng_3 = ListLength(List=fline_2)
preview_13 = CustomPreview(Geometry=pline, Material=swatch_2)  # disabled

explode_2 = Explode(Curve=fline_2, Recursive=True)  # -> Segments, Vertices; disabled
len_3 = Length(Curve=explode_2.Segments)  # disabled
remap_3 = RemapNumbers(Value=len_3, Source=Domain(1, 30), Target=Domain(0, 1))  # -> Mapped, Clipped; disabled
gradient = Gradient(
    LowerLimit=0,
    UpperLimit=1,
    Parameter=remap_3.Mapped,
    stops=[0.0679: RGB(75, 107, 169), 0.235: RGB(173, 203, 249), 0.383: RGB(254, 244, 84), 0.662: RGB(234, 126, 0), 1: RGB(234, 38, 0)])  # disabled
preview_14 = CustomPreview(Geometry=explode_2.Segments, Material=gradient)  # disabled

crvdom = CurveDomain(Curve=fline_2)  # -> Curve, Domain
len_4 = Length(Curve=fline_2)
dup = DuplicateData(Data=dom_3, Number=lng_3, Order=True)
range = Range(Domain=dup, Steps=number_slider_12)
divide_4 = DivideCurve(Curve=fline_2, Count=number_slider_12, Kinks=False)  # -> Points, Tangents, Parameters
pt_14 = Point(divide_4.Points)
vpoints_2 = PointsToVolume(Points=pt_14, PointRadius=range, Settings=vsettings_5)  # disabled
vcurve = CurveToVolume(Curves=fline_2, CurveRadius=Slider(1, range=0..10), Settings=vsettings_5)
vsmooth_3 = SmoothVolume(Volume=vcurve, Width=1, Type=2, Iterations=2)
mvolume_3 = VolumeToMesh(Volume=vsmooth_3, VolumeSettings=vsettings_6)
preview_15 = CustomPreview(
    Geometry=mvolume_3,
    Material={diffuse=RGB(255, 105, 180), emission=RGB(0, 0, 0), shine=0, specular=RGB(255, 255, 255), transparency=0})

# ==== cluster Cluster
L = ClusterInput()
lng = ListLength(List=L)
random = Random(Range=Domain(-1, 1), Number=lng, Seed=2)
random_2 = Random(Range=Domain(-1, 1), Number=lng, Seed=6)
random_3 = Random(Range=Domain(-1, 1), Number=lng, Seed=12)
vec = VectorXYZ(XComponent=random, YComponent=random_2, ZComponent=random_3)  # -> Vector, Length
V = ClusterOutput(vec.Vector)

# ==== cluster Cluster_2
L = ClusterInput()
lng = ListLength(List=L)
random = Random(Range=Domain(-1, 1), Number=lng, Seed=5454)
random_2 = Random(Range=Domain(-1, 1), Number=lng, Seed=5754)
random_3 = Random(Range=Domain(-1, 1), Number=lng, Seed=5)
vec = VectorXYZ(XComponent=random_3, YComponent=random_2, ZComponent=random)  # -> Vector, Length
V = ClusterOutput(vec.Vector)
