# Grasshopper definition BlackholeinG_2.gh (Grasshopper 1.0.7)
# plug-ins: Shader Nodes

number_slider = Slider(1, range=0..1)
layer_weight = LayerWeight(Blend=0.9, Normal=Vector(0, 0, 0))  # -> Fresnel, Facing
layer_weight_2 = LayerWeight(Blend=0.96, Normal=Vector(0, 0, 0))  # -> Fresnel, Facing
layer_weight_3 = LayerWeight(Blend=0.9, Normal=Vector(0, 0, 0))  # -> Fresnel, Facing
multiply = Multiply(Value1=layer_weight_3.Facing, Value2=Slider(1.05, range=0..10), UseClamp=False)
principled = PrincipledBSDF(
    BaseColor=RGB(255, 255, 255),
    Subsurface=0,
    SubsurfaceRadius=Vector(0, 0, 0),
    SubsurfaceColor=RGB(128, 128, 128),
    Metallic=Slider(0, range=0..1),
    Specular=0,
    SpecularTint=Slider(1, range=0..1),
    Roughness=0,
    Anisotropic=0,
    AnisotropicRotation=0,
    Sheen=0,
    SheenTint=0,
    Clearcoat=0,
    ClearcoatRoughness=0,
    IOR=layer_weight.Facing,
    Transmission=Slider(1, range=0..1),
    TransmissionRoughness=Slider(0, range=0..1),
    Normal=Vector(0, 0, 0),
    ClearcoatNormal=Vector(0, 0, 0),
    Tangent=Vector(0, 0, 0),
    Distribution="GGX")
color_ramp = ColorRamp(
    Fac=layer_weight_2.Facing,
    StopColours=[ColourSwatch(SwatchColor=RGB(0, 0, 0)), ColourSwatch(SwatchColor=RGB(255, 255, 255))],
    StopPositions=[Slider(0.802, range=0..1), Slider(1, range=0..1)],
    Interpolation="Ease")  # -> Color, Alpha
glass = GlassBSDF(Color=RGB(255, 255, 255), Roughness=0, IOR=0, Normal=Vector(0, 0, 0), Distribution="Multiscatter_GGX")
number_slider_2 = Slider(20, range=0..100)
sph = Sphere(Base=PlaneXY(0, 0, 0), Radius=15)
texcoord = TextureCoordinate()  # -> Generated, Normal, UV, Object, Camera, Window, Reflection, WcsBox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
divide = Divide(Value1=1, Value2=color_ramp.Color, UseClamp=False)
gradient = Gradient(Vector=Vector(0, 0, 0), Gradient="Easing")  # -> Color, Fac
preview = CustomPreview(
    Geometry=sph,
    Material={diffuse=RGB(255, 105, 180), emission=RGB(0, 0, 0), shine=0, specular=RGB(255, 255, 255), transparency=0})
refraction = RefractionBSDF(Color=RGB(255, 255, 255), Roughness=0, IOR=color_ramp.Color, Normal=Vector(0, 0, 0), Distribution="GGX")
msphere = MeshSphere(Base=PlaneXY(0, 0, 0), Radius=Slider(15, range=0..50), UCount=number_slider_2, VCount=number_slider_2)
camera_info = CameraData()  # -> ViewVector, ViewZDepth, ViewDistance
layer_weight_4 = LayerWeight(Blend=0.96, Normal=Vector(0, 0, 0))  # -> Fresnel, Facing
mix = Mix(Color1=RGB(128, 128, 128), Color2=RGB(128, 128, 128), Fac=0, Blend="Blend")
preview_2 = CustomPreview(
    Geometry=msphere,
    Material={diffuse=RGB(255, 105, 180), emission=RGB(0, 0, 0), shine=0, specular=RGB(255, 255, 255), transparency=0})
output = Output(Surface=refraction, Volume=RGB(128, 128, 128), Displacement=Vector(0, 0, 0))
sph_2 = Sphere(Base=PlaneXY(0, 0, 0), Radius=10)
emission = EmissionBSDF(Color=RGB(255, 18, 18), Strength=1)
color_ramp_2 = ColorRamp(
    Fac=layer_weight_4.Facing,
    StopColours=[ColourSwatch(SwatchColor=RGB(0, 0, 0)), ColourSwatch(SwatchColor=RGB(255, 255, 255)), ColourSwatch(SwatchColor=RGB(0, 0, 0))],
    StopPositions=[Slider(0.796, range=0..1), Slider(0.798, range=0..1), Slider(0.8, range=0..1)],
    Interpolation="Ease")  # -> Color, Alpha
blend = Blend(Closure1=refraction, Closure2=emission, Fac=color_ramp_2.Color)
output_2 = Output(Surface=blend, Volume=RGB(128, 128, 128), Displacement=Vector(0, 0, 0))
