# Grasshopper definition blackhole1.gh (Grasshopper 1.0.7)
# plug-ins: Shader Nodes

layer_weight = LayerWeight(Blend=0.94, Normal=Vector(0, 0, 0))  # -> Fresnel, Facing
diffuse = DiffuseBSDF(Color=RGB(0, 215, 252), Roughness=0, Normal=Vector(0, 0, 0))
number_slider = Slider(0.1, range=0..10)
color_ramp = ColorRamp(
    Fac=layer_weight.Facing,
    StopColours=[ColourSwatch(SwatchColor=RGB(28, 24, 24)), ColourSwatch(SwatchColor=RGB(255, 255, 255))],
    StopPositions=[Slider(0, range=0..1), Slider(1, range=0..1)],
    Interpolation="Ease")  # -> Color, Alpha
anisotropic = AnisotropicBSDF(
    Color=RGB(255, 255, 255),
    Tangent=Vector(0, 0, 0),
    Normal=Vector(0, 0, 0),
    Roughness=0,
    Anisotropy=0,
    Rotation=0,
    Distribution="Multiscatter_GGX")
layer_weight_2 = LayerWeight(Blend=0.94, Normal=Vector(0, 0, 0))  # -> Fresnel, Facing
swatch = ColourSwatch(SwatchColor=RGB(242, 0, 0))
divide = Divide(Value1=1, Value2=color_ramp.Color, UseClamp=False)
glass = GlassBSDF(Color=RGB(255, 255, 255), Roughness=0, IOR=divide, Normal=Vector(0, 0, 0), Distribution="Multiscatter_GGX")
principled = PrincipledBSDF(
    BaseColor=RGB(255, 255, 255),
    Subsurface=0,
    SubsurfaceRadius=Vector(0, 0, 0),
    SubsurfaceColor=RGB(128, 128, 128),
    Metallic=0,
    Specular=0,
    SpecularTint=0,
    Roughness=0,
    Anisotropic=0,
    AnisotropicRotation=0,
    Sheen=0,
    SheenTint=0,
    Clearcoat=0,
    ClearcoatRoughness=1,
    IOR=divide,
    Transmission=1,
    TransmissionRoughness=0,
    Normal=Vector(0, 0, 0),
    ClearcoatNormal=Vector(0, 0, 0),
    Tangent=Vector(0, 0, 0),
    Distribution="GGX")
color_ramp_2 = ColorRamp(
    Fac=layer_weight_2.Facing,
    StopColours=[ColourSwatch(SwatchColor=RGB(0, 0, 0)), ColourSwatch(SwatchColor=RGB(255, 255, 255)), ColourSwatch(SwatchColor=RGB(0, 0, 0))],
    StopPositions=[Slider(0.32, range=0..1), Slider(0.26, range=0..1), Slider(0.2, range=0..1)],
    Interpolation="Ease")  # -> Color, Alpha
refraction = RefractionBSDF(Color=RGB(255, 255, 255), Roughness=0, IOR=divide, Normal=Vector(0, 0, 0), Distribution="Beckmann")
blend = Blend(Closure1=refraction, Closure2=anisotropic, Fac=color_ramp_2.Color)
layer_weight_3 = LayerWeight(Blend=0.94, Normal=Vector(0, 0, 0))  # -> Fresnel, Facing
color_ramp_3 = ColorRamp(
    Fac=layer_weight_3.Facing,
    StopColours=[ColourSwatch(SwatchColor=RGB(0, 0, 0)), ColourSwatch(SwatchColor=RGB(255, 255, 255)), ColourSwatch(SwatchColor=RGB(255, 255, 255))],
    StopPositions=[Slider(0.51, range=0..1), Slider(0.17, range=0..1), Slider(0, range=0..1)],
    Interpolation="Ease")  # -> Color, Alpha
blend_2 = Blend(Closure1=blend, Closure2=RGB(128, 128, 128), Fac=color_ramp_3.Color)
output = Output(Surface=blend_2, Volume=RGB(128, 128, 128), Displacement=Vector(0, 0, 0))
