# Grasshopper definition test.gh (Grasshopper 1.0.7)
# plug-ins: Pufferfish, Physarealm, Kangaroo2 Components, Shortest Walk in Gh, horsterCameraControl, Telepathy, Shader Nodes

color_ramp = ColorRamp(
    Fac=Slider(0.5, range=0..1),
    StopColours=[ColourSwatch(SwatchColor=RGB(0, 229, 255)), ColourSwatch(SwatchColor=RGB(186, 87, 0)), ColourSwatch(SwatchColor=RGB(0, 98, 255))],
    StopPositions=[Slider(0.6, range=0..1), Slider(0.2, range=0..1)],
    Interpolation="Ease")  # -> Color, Alpha
mix = Mix(Color1=ColourSwatch(SwatchColor=RGB(181, 0, 0)), Color2=color_ramp.Color, Fac=0.5, Blend="Blend")
diffuse = DiffuseBSDF(Color=mix, Roughness=Slider(0, range=0..1), Normal=Vector(0, 0, 0))
output = Output(Surface=diffuse, Volume=RGB(128, 128, 128), Displacement=Vector(0, 0, 0))
emission = EmissionBSDF(Color=RGB(255, 192, 115), Strength=0.25)
anisotropic = AnisotropicBSDF(
    Color=RGB(255, 255, 255),
    Tangent=Vector(0, 0, 0),
    Normal=Vector(0, 0, 0),
    Roughness=0,
    Anisotropy=0,
    Rotation=0,
    Distribution="Multiscatter_GGX")
layer_weight = LayerWeight(Blend=0.94, Normal=Vector(0, 0, 0))  # -> Fresnel, Facing
diffuse_2 = DiffuseBSDF(Color=RGB(222, 169, 44), Roughness=0, Normal=Vector(0, 0, 0))
color_ramp_2 = ColorRamp(
    Fac=layer_weight.Facing,
    StopColours=[ColourSwatch(SwatchColor=RGB(28, 24, 24)), ColourSwatch(SwatchColor=RGB(255, 255, 255))],
    StopPositions=[Slider(0, range=0..1), Slider(1, range=0..1)],
    Interpolation="Ease")  # -> Color, Alpha
layer_weight_2 = LayerWeight(Blend=0.94, Normal=Vector(0, 0, 0))  # -> Fresnel, Facing
divide = Divide(Value1=1, Value2=color_ramp_2.Color, UseClamp=False)
color_ramp_3 = ColorRamp(
    Fac=layer_weight_2.Facing,
    StopColours=[ColourSwatch(SwatchColor=RGB(0, 0, 0)), ColourSwatch(SwatchColor=RGB(255, 255, 255)), ColourSwatch(SwatchColor=RGB(255, 255, 255)), ColourSwatch(SwatchColor=RGB(0, 0, 0))],
    StopPositions=[Slider(0.3, range=0..1), Slider(0.29, range=0..1), Slider(0.21, range=0..1), Slider(0.2, range=0..1)],
    Interpolation="Ease")  # -> Color, Alpha
refraction = RefractionBSDF(Color=RGB(255, 255, 255), Roughness=0, IOR=divide, Normal=Vector(0, 0, 0), Distribution="Beckmann")
blend = Blend(Closure1=refraction, Closure2=anisotropic, Fac=color_ramp_3.Color)
layer_weight_3 = LayerWeight(Blend=0.94, Normal=Vector(0, 0, 0))  # -> Fresnel, Facing
layer_weight_4 = LayerWeight(Blend=0.95, Normal=Vector(0, 0, 0))  # -> Fresnel, Facing
emission_2 = EmissionBSDF(Color=RGB(0, 255, 0), Strength=1)
color_ramp_4 = ColorRamp(
    Fac=layer_weight_3.Facing,
    StopColours=[ColourSwatch(SwatchColor=RGB(0, 0, 0)), ColourSwatch(SwatchColor=RGB(255, 255, 255)), ColourSwatch(SwatchColor=RGB(255, 255, 255))],
    StopPositions=[Slider(0.51, range=0..1), Slider(0.17, range=0..1), Slider(0, range=0..1)],
    Interpolation="Ease")  # -> Color, Alpha
blend_2 = Blend(Closure1=blend, Closure2=RGB(128, 128, 128), Fac=color_ramp_4.Color)
diffuse_3 = DiffuseBSDF(Color=RGB(0, 255, 0), Roughness=0, Normal=Vector(0, 0, 0))
refraction_2 = RefractionBSDF(Color=RGB(255, 255, 255), Roughness=0, IOR=1.1, Normal=Vector(0, 0, 0), Distribution="GGX")
output_2 = Output(Surface=blend_2, Volume=RGB(128, 128, 128), Displacement=Vector(0, 0, 0))
output_3 = Output(Surface=emission_2, Volume=RGB(128, 128, 128), Displacement=Vector(0, 0, 0))
output_4 = Output(Surface=refraction_2, Volume=RGB(128, 128, 128), Displacement=Vector(0, 0, 0))
density = Slider(50, range=10..50)
viscosity = Slider(100, range=0..200)
lenght = Slider(150, range=0..150)
mepoint = Point(<point referenced from the Rhino model>)
mepoint_2 = RemoteSender(mepoint)
number_slider = Slider(100, range=0..100)
density_2 = RemoteSender(density)
viscosity_2 = RemoteSender(viscosity)
pt = ConstructPoint(XCoordinate=0, YCoordinate=0, ZCoordinate=0)  # disabled
number_slider_2 = Slider(10, range=0..100)
time = RemoteSender(lenght)
# Camera
time_2 = RemoteReceiver(time)  # disabled
subtraction = Subtraction(A=time_2, B=180)  # disabled
multiplication = Multiplication(A=subtraction, B=0.8)  # disabled
pt_2 = ConstructPoint(XCoordinate=0, YCoordinate=0, ZCoordinate=multiplication)  # disabled
num = Slider(20, range=0..100)
toggle = BooleanToggle(True)  # disabled
size = Slider(5, range=0..100)
move = Move(Geometry=pt, Motion=pt_2)  # -> Geometry, Transform; disabled
move_2 = Move(Geometry=pt, Motion=Vector(0, 0, 1000))  # -> Geometry, Transform; disabled
multiplication_2 = Multiplication(A=size, B=0.5, C=num)
setcam = SetCamera(CameraLocation=move.Geometry, TargetLocation=move_2.Geometry, Activate=toggle)  # disabled
multiplication_3 = Multiplication(A=multiplication_2, B=-1)
addition = Addition(A=num, B=1)
# Bounding Sphere
number_slider_3 = Slider(500, range=0..500)
pt_3 = ConstructPoint(XCoordinate=0, YCoordinate=0, ZCoordinate=-2000)
density_3 = RemoteReceiver(density_2)
lenght_2 = Slider(200, range=0..5000)
time_3 = RemoteReceiver(time)
dom = ConstructDomain(DomainStart=0, DomainEnd=lenght_2)
density_4 = RemoteReceiver(density_2)
viscosity_3 = RemoteReceiver(viscosity_2)
number_slider_4 = Slider(5, range=0..100)
series = Series(Start=multiplication_3, Step=size, Count=addition)
remap = RemapNumbers(Value=time_3, Source=Domain(0, 1000), Target=dom)  # -> Mapped, Clipped
series_2 = Series(Start=multiplication_3, Step=size, Count=addition)
pt_4 = ConstructPoint(XCoordinate=0, YCoordinate=0, ZCoordinate=0)
fallof = Slider(150, range=0..1000)
radiusbound = RemoteSender(number_slider_3)
# Point Grid Representation
radiusbound_2 = RemoteReceiver(radiusbound)
# Wormholes
radiusbound_3 = RemoteReceiver(radiusbound)
division = Division(A=radiusbound_2, B=50)
box = CenterBox(Base=PlaneXY(0, 0, 0), X=division, Y=division, Z=division)
box_2 = CenterBox(Base=PlaneXY(0, 0, 0), X=division, Y=division, Z=division)
expression = Expression(x=radiusbound_3, y=density_3, Expression="x^2*y/100000*pi")
sph = Sphere(Base=PlaneXY(0, 0, 0), Radius=expr("X*0.5", radiusbound_3))
expression_2 = Expression(x=number_slider_3, y=density_4, Expression="x^2*y/100000*pi")
series_3 = Series(Start=multiplication_3, Step=size, Count=addition)
# This moves the time black hole
move_3 = Move(Geometry=sph, Motion=Vector(0, 0, -75))  # -> Geometry, Transform
arrbox = BoxArray(Geometry=pt_4, Cell=box, XCount=number_slider_4, YCount=number_slider_4, ZCount=number_slider_4)  # -> Geometry, Transform
pcharge = PointCharge(Point=pt_3, Charge=expr("x/100", Slider(5, range=-1..5)), Decay=Slider(-0.4, range=-5..1))
vec = VectorXYZ(XComponent=expr("x*-1", multiplication_2), YComponent=expr("x*-1", multiplication_2), ZComponent=series)  # -> Vector, Length
vec_2 = VectorXYZ(XComponent=expr("x*-1", multiplication_2), YComponent=expr("x*-1", multiplication_2), ZComponent=series_2)  # -> Vector, Length
vec_3 = VectorXYZ(XComponent=expr("x*-1", multiplication_2), YComponent=expr("x*-1", multiplication_2), ZComponent=series_3)  # -> Vector, Length
mepoint_3 = RemoteReceiver(mepoint_2)
pop3d = Populate3D(Region=move_3.Geometry, Count=expression, Seed=54465483)
sph_2 = Sphere(Base=PlaneXY(0, 0, 0), Radius=number_slider_3)
multiplication_4 = Multiplication(A=number_slider_4, B=division, C=-1)
sqgrid = Square(Plane=vec_2.Vector, Size=size, ExtentX=num, ExtentY=num)  # -> Cells, Points
panel = Panel(sqgrid.Points)
sqgrid_2 = Square(Plane=vec.Vector, Size=size, ExtentX=num, ExtentY=num)  # -> Cells, Points
panel_2 = Panel(sqgrid_2.Points)
dom_2 = ConstructDomain(DomainStart=0, DomainEnd=fallof)
move_4 = Move(Geometry=sph_2, Motion=Vector(0, 0, 150))  # -> Geometry, Transform
brepinc = PointInBrep(Brep=move_3.Geometry, Point=pop3d, Strict=False)
vec_4 = VectorXYZ(XComponent=multiplication_4, YComponent=multiplication_4, ZComponent=multiplication_4)  # -> Vector, Length
sqgrid_3 = Square(Plane=vec_3.Vector, Size=size, ExtentX=num, ExtentY=num)  # -> Cells, Points
panel_3 = Panel(sqgrid_3.Points)
pl = ConstructPlane(Origin=Point(-50, 0, 0), XAxis=Vector(0, 1, 0), YAxis=Vector(0, 0, 1))
rotate = Rotate(Geometry=sqgrid.Points, Angle=1.570796327, Plane=PlaneXY(0, 0, 0))  # -> Geometry, Transform
dispatch = Dispatch(List=pop3d, DispatchPattern=brepinc)  # -> ListA, ListB
pop3d_2 = Populate3D(Region=move_4.Geometry, Count=expression_2, Seed=56456456)
rotate_2 = Rotate(Geometry=sqgrid_2.Points, Angle=-1.570796327, Plane=pl)  # -> Geometry, Transform
move_5 = Move(Geometry=arrbox.Geometry, Motion=vec_4.Vector)  # -> Geometry, Transform
move_6 = Move(Geometry=sqgrid_3.Points, Motion=Vector(0, 0, 0))  # -> Geometry, Transform
move_7 = Move(Geometry=rotate.Geometry, Motion=Vector(0, 0, 0))  # -> Geometry, Transform
randomize = Cluster_2(L=dispatch.ListA)
move_8 = Move(Geometry=rotate_2.Geometry, Motion=Vector(0, 0, 0))  # -> Geometry, Transform
number_slider_5 = Slider(10, range=0..100)
brepinc_2 = PointInBrep(Brep=move_4.Geometry, Point=pop3d_2, Strict=False)
number_slider_6 = Slider(10, range=0..100)
sqgrid_4 = Square(Plane=PlaneXY(0, 0, 0), Size=10, ExtentX=10, ExtentY=10)  # -> Cells, Points
pt_5 = ConstructPoint(XCoordinate=0, YCoordinate=0, ZCoordinate=-550)
# Dimension Basis / Secondary Pendulum
number_slider_7 = Slider(0.001, range=-50.001..50)
pl_2 = PlaneNormal(Origin=dispatch.ListA, ZAxis=randomize)
dispatch_2 = Dispatch(List=pop3d_2, DispatchPattern=brepinc_2)  # -> ListA, ListB
number_slider_8 = Slider(30, range=0..100)
move_9 = Move(Geometry=sqgrid_4.Points, Motion=Vector(-50, -50, 0))  # -> Geometry, Transform
centerholes = RemoteSender(pl_2)
centerholes_2 = RemoteReceiver(centerholes)
cluster = Cluster_2(L=dispatch_2.ListA)
pl_3 = PlaneNormal(Origin=dispatch_2.ListA, ZAxis=cluster)
point_charge = PointCharge(Point=pt_3, Charge=expr("x/100", number_slider_7), Decay=Slider(0, range=0..100))
point_charge_2 = PointCharge(Point=pt_5, Charge=expr("x/100", Slider(-0.001, range=-50.001..50)), Decay=Slider(0.35, range=0..100))  # disabled
dimpoints = RemoteSender(pl_3)
# Dimension Basis / Primary Pendulum
dimpoints_2 = RemoteReceiver(dimpoints)
fspin = SpinForce(Plane=dimpoints_2, Strength=Slider(4, range=0..150), Radius=expr("x*0.5+5", Slider(100, range=0..500)), Decay=2)
mergef = MergeFields(Fields=flatten([fspin, pcharge]))
primary_field = RemoteSender(mergef)
primary_field_2 = RemoteReceiver(primary_field)
fline = FieldLine(Field=primary_field_2, Point=centerholes_2, Steps=lenght_2, Accuracy=1, Method=1)
eval = EvaluateCurve(Curve=fline, Parameter=remap.Mapped)  # -> Point, Tangent, Angle
pl_4 = ConstructPlane(Origin=eval.Point, XAxis=Vector(1, 0, 0), YAxis=Vector(0, 1, 0))
dist = Distance(PointA=mepoint_3, PointB=eval.Point)
greater_than = GreaterThan(Value1=dist, Value2=fallof, UseClamp=False)
dispatch_3 = Dispatch(List=pl_4, DispatchPattern=invert(greater_than))  # -> ListA, ListB
dispatch_4 = Dispatch(List=dist, DispatchPattern=invert(greater_than))  # -> ListA, ListB
# fall figure wrt distance
graph = GraphMapper(
    dispatch_4.ListA,
    x0=0,
    x1=150,
    y0=0,
    y1=20,
    container_name="Bezier",
    cpx=[0, 0.8421875238, 0.7837508917, 1],
    cpy=[0.6451612711, 0.6135716438, 0.0732151866, 0])
sph_3 = Sphere(Base=dispatch_3.ListA, Radius=graph)
msphere = MeshSphere(Base=dispatch_3.ListA, Radius=graph, UCount=number_slider_8, VCount=number_slider_8)
worms = RemoteSender(dispatch_3.ListA)
# Interconnections
worms_2 = RemoteReceiver(worms)
inter = InterconnectPoints(Pts=worms_2)
len = Length(Curve=inter)
expression_3 = Expression(x=Slider(100, range=0..500), y=len, Expression="x>y")
dispatch_5 = Dispatch(List=inter, DispatchPattern=expression_3)  # -> ListA, ListB
length = Length(Curve=dispatch_5.ListA)
bounds = Bounds(Numbers=length)
remap_numbers = RemapNumbers(Value=length, Source=bounds, Target=Domain(3, 0.5))  # -> Mapped, Clipped
remap_numbers_2 = RemapNumbers(Value=length, Source=bounds, Target=Domain(1.1, 1))  # -> Mapped, Clipped
refraction_3 = RefractionBSDF(Color=RGB(255, 255, 255), Roughness=0, IOR=remap_numbers_2.Mapped, Normal=Vector(0, 0, 0), Distribution="GGX")
pipe = Pipe(Curve=dispatch_5.ListA, Radius=remap_numbers.Mapped, Caps=0)  # -> flatten(Pipe)
preview = CustomPreview(
    Geometry=pipe,
    Material={diffuse=RGB(255, 105, 180), emission=RGB(0, 0, 0), shine=0, specular=RGB(255, 255, 255), transparency=0})
output_5 = Output(Surface=refraction_3, Volume=RGB(128, 128, 128), Displacement=Vector(0, 0, 0))

# ----
# interconnections depend on size of blackhole
end = EndPoints(Curve=dispatch_5.ListA)  # -> Start, End
mepoint_4 = RemoteReceiver(mepoint_2)
mepoint_5 = RemoteReceiver(mepoint_2)
dist_2 = Distance(PointA=end.Start, PointB=mepoint_4)  # -> expr("x/70", Distance)
dist_3 = Distance(PointA=end.End, PointB=mepoint_5)  # -> expr("x/70", Distance)
graph_2 = GraphMapper(dist_2, x0=0.65, x1=2.85, y0=0, y1=1.5, container_name="Bezier", cpx=[0, 1, 0, 1], cpy=[1, 1, 0, 0.01405465603])
graph_3 = GraphMapper(dist_3, x0=0.65, x1=2.85, y0=0, y1=1.5, container_name="Bezier", cpx=[0, 1, 0, 1], cpy=[1, 1, 0, 0])
lng = ListLength(List=dispatch_5.ListA)
series_4 = Series(Start=0, Step=0, Count=lng)
series_5 = Series(Start=1, Step=0, Count=lng)
weave = Weave(Pattern=[0, 1], Stream0=graph_2, Stream1=graph_3, NullGaps=False)
weave_2 = Weave(Pattern=[0, 1], Stream0=series_4, Stream1=series_5, NullGaps=False)
partition = PartitionList(List=weave, Size=2)
partition_2 = PartitionList(List=weave_2, Size=2)
vpipe = PipeVariable(Curve=reparameterize(graft(dispatch_5.ListA)), Parameters=partition_2, Radii=partition, Caps=0)  # -> flatten(Pipe)
preview_2 = CustomPreview(
    Geometry=vpipe,
    Material={diffuse=RGB(255, 105, 180), emission=RGB(0, 0, 0), shine=0, specular=RGB(255, 255, 255), transparency=0})

preview_3 = CustomPreview(
    Geometry=msphere,
    Material={diffuse=RGB(255, 105, 180), emission=RGB(0, 0, 0), shine=0, specular=RGB(255, 255, 255), transparency=0})
mepoint_6 = RemoteReceiver(mepoint_2)
primary_field_3 = RemoteReceiver(primary_field)
centerholes_3 = RemoteReceiver(centerholes)
worms_3 = RemoteReceiver(worms)
worms_4 = RemoteReceiver(worms)
lng_2 = ListLength(List=eval.Point)
dist_4 = Distance(PointA=eval.Point, PointB=mepoint_6)
populate_3d = Populate3D(Region={Plane=PlaneXY(0, 0, 0), X=Domain(0, 10), Y=Domain(0, 10), Z=Domain(0, 2)}, Count=lng_2, Seed=58654)
cluster_2 = Cluster(L=populate_3d)
graph_4 = GraphMapper(
    dist_4,
    x0=0,
    x1=150,
    y0=0,
    y1=20,
    container_name="Bezier",
    cpx=[0, 0.5112859011, 0.75, 1],
    cpy=[0.5057080984, 0.451572597, 0.75, 0])
evaluate_field = EvaluateField(Field=primary_field_3, Point=eval.Point)  # -> Tensor, Strength
rotate_3d = Rotate3D(Geometry=evaluate_field.Tensor, Angle=2.35619449, Center=eval.Point, Axis=cluster_2)  # -> Geometry, Transform
fallof_2 = Slider(150, range=0..1000)
mepoint_7 = RemoteReceiver(mepoint_2)
plane_normal = PlaneNormal(Origin=eval.Point, ZAxis=rotate_3d.Geometry)
dist_5 = Distance(PointA=mepoint_7, PointB=eval.Point)
dom_3 = ConstructDomain(DomainStart=0, DomainEnd=fallof_2)
greater_than_2 = GreaterThan(Value1=dist_5, Value2=fallof_2, UseClamp=False)
dispatch_6 = Dispatch(List=graph_4, DispatchPattern=invert(greater_than_2))  # -> ListA, ListB
dispatch_7 = Dispatch(List=plane_normal, DispatchPattern=invert(greater_than_2))  # -> ListA, ListB
spin_force = SpinForce(
    Plane=dispatch_7.ListA,
    Strength=expr("x/100", Slider(0.008, range=0..10)),
    Radius=dispatch_6.ListA,
    Decay=Slider(0.85, range=0..10))
merge_fields = MergeFields(Fields=flatten([point_charge, point_charge_2, spin_force]))
# Bounding Box
secondary_field = RemoteSender(merge_fields)
secondary_field_2 = RemoteReceiver(secondary_field)

# ----
# Point Grid Representation
# Grid Connections
radiusbound_4 = RemoteReceiver(radiusbound)  # disabled
secondary_field_3 = RemoteReceiver(secondary_field)  # disabled
division_2 = Division(A=radiusbound_4, B=50)  # disabled
box_3 = CenterBox(Base=PlaneXY(0, 0, 0), X=division_2, Y=division_2, Z=division_2)  # disabled
number_slider_9 = Slider(5, range=0..100)  # disabled
pt_6 = ConstructPoint(XCoordinate=0, YCoordinate=0, ZCoordinate=0)  # disabled
arrbox_2 = BoxArray(Geometry=pt_6, Cell=box_3, XCount=number_slider_9, YCount=number_slider_9, ZCount=number_slider_9)  # -> Geometry, Transform; disabled
number_slider_10 = Slider(5, range=0..100)  # disabled
multiplication_5 = Multiplication(A=number_slider_9, B=division_2, C=-1)  # disabled
vec_5 = VectorXYZ(XComponent=multiplication_5, YComponent=multiplication_5, ZComponent=multiplication_5)  # -> Vector, Length; disabled
move_10 = Move(Geometry=arrbox_2.Geometry, Motion=vec_5.Vector)  # -> Geometry, Transform; disabled
evf = EvaluateField(Field=secondary_field_3, Point=move_10.Geometry)  # -> Tensor, Strength; disabled
amp = Amplitude(Vector=evf.Tensor, Amplitude=number_slider_10)  # disabled
move_11 = Move(Geometry=move_10.Geometry, Motion=amp)  # -> Geometry, Transform; disabled
number_slider_11 = Slider(25, range=0..30)  # disabled
inter_2 = InterconnectPoints(Pts=move_11.Geometry)  # disabled
len_2 = Length(Curve=inter_2)  # disabled
greater_than_3 = GreaterThan(Value1=len_2, Value2=number_slider_11, UseClamp=False)  # disabled
swatch = ColourSwatch(SwatchColor=RGB(255, 255, 255))  # disabled
dispatch_8 = Dispatch(List=inter_2, DispatchPattern=greater_than_3)  # -> ListA, ListB; disabled
preview_4 = CustomPreview(Geometry=dispatch_8.ListB, Material=swatch)  # disabled

# ----
# Line Representation
radiusbound_5 = RemoteReceiver(radiusbound)
density_5 = RemoteReceiver(density_2)
expression_4 = Expression(x=radiusbound_5, y=density_5, Expression="(x/6*sqrt(3))^2*y/10000*pi")
polygon = Polygon(Plane=PlaneXY(0, 0, 0), Radius=expr("x/6*sqrt(3)", radiusbound_5), Segments=4, FilletRadius=0)  # -> Polygon, Length
vec_6 = VectorXYZ(XComponent=0, YComponent=0, ZComponent=expr("-0.1*x", radiusbound_5))  # -> Vector, Length
move_12 = Move(Geometry=polygon.Polygon, Motion=vec_6.Vector)  # -> Geometry, Transform
pop2d = Populate2D(Region=move_12.Geometry, Count=expression_4, Seed=1)
circle = CircleCNR(Center=Point(0, 0, 0), Normal=Vector(0, 0, 1), Radius=expr("x/6", radiusbound_5))
move_13 = Move(Geometry=circle, Motion=vec_6.Vector)  # -> Geometry, Transform
incurve = PointInCurve(Point=pop2d, Curve=move_13.Geometry)  # -> Relationship, Point
dispatch_9 = Dispatch(List=pop2d, DispatchPattern=incurve.Relationship)  # -> ListA, ListB
secondary_field_4 = RemoteReceiver(secondary_field)
pt_7 = Point(dispatch_9.ListA)
fline_2 = FieldLine(Field=secondary_field_4, Point=pt_7, Steps=50, Accuracy=10, Method=1)
move_14 = Move(Geometry=pt_7, Motion=Vector(1, 1, 0))  # -> Geometry, Transform
move_15 = Move(Geometry=pt_7, Motion=Vector(-1, 1, 0))  # -> Geometry, Transform
ln = Line(StartPoint=pt_7, EndPoint=move_14.Geometry)
ln_2 = Line(StartPoint=pt_7, EndPoint=move_15.Geometry)
extrcrv = ExtrudeAlong(Base=ln, Curve=fline_2)
extrcrv_2 = ExtrudeAlong(Base=ln_2, Curve=fline_2)
preview_5 = CustomPreview(
    Geometry=[extrcrv, extrcrv_2],
    Material={diffuse=RGB(0, 0, 0), emission=RGB(250, 250, 40), shine=0, specular=RGB(255, 255, 255), transparency=0})

secondary_field_5 = RemoteReceiver(secondary_field)
evf_2 = EvaluateField(Field=secondary_field_2, Point=move_5.Geometry)  # -> Tensor, Strength
amp_2 = Amplitude(Vector=evf_2.Tensor, Amplitude=Slider(5, range=0..100))
pop2d_2 = Populate2D(Region=move_12.Geometry, Count=8000, Seed=1)
move_16 = Move(Geometry=move_5.Geometry, Motion=amp_2)  # -> Geometry, Transform
flip = FlipMatrix(Data=move_16.Geometry)  # -> flatten(Data)
evf_3 = EvaluateField(Field=secondary_field_5, Point=move_7.Geometry)  # -> Tensor, Strength
evf_4 = EvaluateField(Field=secondary_field_5, Point=move_8.Geometry)  # -> Tensor, Strength
pline = PolyLine(Vertices=move_16.Geometry, Closed=False)
evf_5 = EvaluateField(Field=secondary_field_5, Point=move_6.Geometry)  # -> Tensor, Strength
fline_3 = FieldLine(Field=secondary_field_4, Point=pop2d_2, Steps=25, Accuracy=10, Method=1)
evf_6 = EvaluateField(Field=secondary_field_5, Point=move_9.Geometry)  # -> Tensor, Strength
pline_2 = PolyLine(Vertices=flip, Closed=False)
amp_3 = Amplitude(Vector=evf_3.Tensor, Amplitude=number_slider_2)
amp_4 = Amplitude(Vector=evf_4.Tensor, Amplitude=number_slider_2)
amp_5 = Amplitude(Vector=evf_5.Tensor, Amplitude=number_slider_2)
amp_6 = Amplitude(Vector=evf_6.Tensor, Amplitude=Slider(5, range=0..100))
explode = Explode(Curve=fline_2, Recursive=True)  # -> Segments, Vertices
move_17 = Move(Geometry=move_7.Geometry, Motion=amp_3)  # -> Geometry, Transform
move_18 = Move(Geometry=move_8.Geometry, Motion=amp_4)  # -> Geometry, Transform
pt_8 = Point(move_17.Geometry)
pt_9 = Point(move_18.Geometry)
move_19 = Move(Geometry=move_6.Geometry, Motion=amp_5)  # -> Geometry, Transform
move_20 = Move(Geometry=move_9.Geometry, Motion=amp_6)  # -> Geometry, Transform
pt_10 = Point(move_19.Geometry)
pt_11 = Point(explode.Vertices)
pt_12 = Point(move_20.Geometry)
preview_6 = CustomPreview(Geometry=fline_2, Material=ColourSwatch(SwatchColor=RGB(255, 255, 255)))
end_2 = EndPoints(Curve=fline_3)  # -> Start, End
pline_3 = PolyLine(Vertices=pt_8, Closed=False)
pline_4 = PolyLine(Vertices=pt_9, Closed=False)
flip_2 = FlipMatrix(Data=pt_12)
pline_5 = PolyLine(Vertices=pt_10, Closed=False)
pt_13 = Point(end_2.End)
pline_6 = PolyLine(Vertices=pt_12, Closed=False)
preview_7 = CustomPreview(Geometry=pt_13, Material=ColourSwatch(SwatchColor=RGBA(255, 255, 255, 190)))
pline_7 = PolyLine(Vertices=flip_2, Closed=False)
explode_2 = Explode(Curve=fline_2, Recursive=True)  # -> Segments, Vertices
len_3 = Length(Curve=explode_2.Segments)
relay = Relay([pline_5, pline_3, pline_4])
remap_2 = RemapNumbers(Value=len_3, Source=Domain(1, 30), Target=Domain(0, 1))  # -> Mapped, Clipped
gradient = Gradient(
    LowerLimit=0,
    UpperLimit=1,
    Parameter=remap_2.Mapped,
    stops=[0.138: RGB(75, 107, 169), 0.235: RGB(173, 203, 249), 0.383: RGB(254, 244, 84), 0.662: RGB(234, 126, 0), 1: RGB(234, 38, 0)])
preview_8 = CustomPreview(Geometry=relay, Material=ColourSwatch(SwatchColor=RGB(255, 255, 255)))
preview_9 = CustomPreview(Geometry=pt_8, Material=ColourSwatch(SwatchColor=RGB(255, 255, 255)))
bnd = Bounds(Numbers=len_3)
preview_10 = CustomPreview(Geometry=explode_2.Segments, Material=gradient)
number_slider_12 = Slider(20, range=0..100)  # disabled
number_slider_13 = Slider(20, range=0..100)  # disabled
number_slider_14 = Slider(5, range=0..10)  # disabled
multiplication_6 = Multiplication(A=number_slider_13, B=0.275)  # disabled
multiplication_7 = Multiplication(A=number_slider_12, B=0.275)  # disabled
pt_14 = ConstructPoint(XCoordinate=0, YCoordinate=0, ZCoordinate=0)  # disabled
number_slider_15 = Slider(50, range=0..100)  # disabled
series_6 = Series(Start=-50, Step=10, Count=20)  # disabled
secondary_field_6 = RemoteReceiver(secondary_field)  # disabled
vec_7 = VectorXYZ(XComponent=expr("x*-1", number_slider_15), YComponent=expr("x*-1", number_slider_15), ZComponent=series_6)  # -> Vector, Length; disabled
sqgrid_5 = Square(Plane=PlaneXY(0, 0, 0), Size=10, ExtentX=10, ExtentY=10)  # -> Cells, graft(Points); disabled
number_slider_16 = Slider(5, range=0..100)  # disabled
move_21 = Move(Geometry=sqgrid_5.Points, Motion=vec_7.Vector)  # -> Geometry, Transform; disabled
evf_7 = EvaluateField(Field=secondary_field_6, Point=move_21.Geometry)  # -> Tensor, Strength; disabled
amp_7 = Amplitude(Vector=evf_7.Tensor, Amplitude=number_slider_16)  # disabled
move_22 = Move(Geometry=move_21.Geometry, Motion=amp_7)  # -> Geometry, Transform; disabled
pt_15 = Point(move_22.Geometry)  # disabled
flip_3 = FlipMatrix(Data=pt_15)  # disabled
pline_8 = PolyLine(Vertices=pt_15, Closed=False)  # disabled
pline_9 = PolyLine(Vertices=flip_3, Closed=False)  # disabled
time_4 = Slider(360, range=180..360)  # disabled
time_5 = Slider(300, range=180..360)  # disabled
number_slider_17 = Slider(50, range=0..100)
division_3 = Division(A=number_slider_17, B=number_slider_14)  # disabled
division_4 = Division(A=number_slider_17, B=number_slider_14)  # disabled
addition_2 = Addition(A=division_4, B=multiplication_6)  # disabled
number_slider_18 = Slider(50, range=0..100)
division_5 = Division(A=number_slider_18, B=number_slider_14)  # disabled
division_6 = Division(A=number_slider_18, B=number_slider_14)  # disabled
rectangle = Rectangle(Plane=PlaneXY(0, 0, 0), XSize=division_3, YSize=division_5, Radius=0)  # -> Rectangle, Length; disabled
addition_3 = Addition(A=division_6, B=multiplication_7)  # disabled
arrrec = RectangularArray(Geometry=pt_14, Cell=rectangle.Rectangle, XCount=number_slider_12, YCount=number_slider_13)  # -> Geometry, Transform; disabled
number_slider_19 = Slider(50, range=0..200)
vec_8 = VectorXYZ(XComponent=expr("x*-2", addition_2), YComponent=expr("x*-2", addition_3), ZComponent=expr("x*-0.5", number_slider_19))  # -> Vector, Length; disabled
move_23 = Move(Geometry=arrrec.Geometry, Motion=vec_8.Vector)  # -> Geometry, Transform; disabled
multiplication_8 = Multiplication(A=number_slider_17, B=2)
multiplication_9 = Multiplication(A=number_slider_18, B=2)
rectangle_2 = Rectangle(Plane=PlaneXY(0, 0, 0), XSize=multiplication_8, YSize=multiplication_9, Radius=0)  # -> Rectangle, Length
division_7 = Division(A=time_4, B=5)  # disabled
vec_9 = VectorXYZ(
    XComponent=expr("x*-1", number_slider_17),
    YComponent=expr("x*-1", number_slider_18),
    ZComponent=expr("x*-1", number_slider_19))  # -> Vector, Length
addition_4 = Addition(A=division_7, B=288)  # disabled
box_4 = CenterBox(Base=PlaneXY(0, 0, 0), X=number_slider_17, Y=number_slider_18, Z=number_slider_19)
move_24 = Move(Geometry=box_4, Motion=Vector(0, 0, 30))  # -> Geometry, Transform
density_6 = Slider(20, range=0..200)
pop2d_3 = Populate2D(Region=rectangle_2.Rectangle, Count=density_6, Seed=1)  # -> flatten(Population)
move_25 = Move(Geometry=pop2d_3, Motion=vec_9.Vector)  # -> Geometry, Transform
number_slider_20 = Slider(-0.75, range=-5..1)  # disabled
number_slider_21 = Slider(46, range=0..100)  # disabled
number_slider_22 = Slider(1, range=-1..1)  # disabled
pop3d_3 = Populate3D(Region={Plane=PlaneXY(0, 0, 0), X=Domain(0, 10), Y=Domain(0, 10), Z=Domain(0, 2)}, Count=density_6, Seed=56456456)
pt_16 = ConstructPoint(XCoordinate=0, YCoordinate=0, ZCoordinate=expr("x*-3", number_slider_19))  # disabled
lenght_3 = Slider(4000, range=0..5000)  # disabled
cluster_3 = Cluster(L=pop3d_3)
pl_5 = PlaneNormal(Origin=pop3d_3, ZAxis=cluster_3)
construct_domain = ConstructDomain(DomainStart=0, DomainEnd=expr("x", lenght_3))  # disabled
pcharge_2 = PointCharge(Point=pt_16, Charge=expr("x/100", number_slider_22), Decay=number_slider_20)  # disabled
multiplication_10 = Multiplication(A=addition_4, B=10)  # disabled
fspin_2 = SpinForce(Plane=pl_5, Strength=Slider(1, range=0..150), Radius=Slider(10, range=0..10), Decay=2)
mergef_2 = MergeFields(Fields=flatten([pcharge_2, fspin_2]))  # disabled
number_slider_23 = Slider(-52.1, range=-100..0)  # disabled
random = Random(Range=construct_domain, Number=density_6, Seed=31)  # disabled
subtraction_2 = Subtraction(A=multiplication_10, B=random)  # disabled
modulus = Modulus(A=subtraction_2, B=lenght_3)  # disabled
subtraction_3 = Subtraction(A=time_4, B=180)  # disabled
multiplication_11 = Multiplication(A=subtraction_3, B=0.8)  # disabled
pt_17 = Point([<point referenced from the Rhino model> x54])  # disabled
pt_18 = Point([Point(-18.02058058, 11.26218216, 78.08147021), Point(-17.71586708, 6.135892401, 151.5055019), Point(6.680257831, 14.38221341, -21.1583887), Point(-10.56075766, -15.14873669, 4.352259269), Point(16.2652882, 9.968771205, -33.43015236), Point(13.42850181, -0.1305878808, 72.6700905)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])  # disabled
pt_19 = ConstructPoint(XCoordinate=0, YCoordinate=0, ZCoordinate=multiplication_11)  # disabled
pt_20 = ConstructPoint(XCoordinate=0, YCoordinate=0, ZCoordinate=0)  # disabled
toggle_2 = BooleanToggle(True)  # disabled
fline_4 = FieldLine(Field=mergef_2, Point=move_25.Geometry, Steps=lenght_3, Accuracy=0.1, Method=3)  # disabled
move_26 = Move(Geometry=pt_20, Motion=pt_19)  # -> Geometry, Transform; disabled
move_27 = Move(Geometry=pt_20, Motion=Vector(0, 0, 1000))  # -> Geometry, Transform; disabled
setcam_2 = SetCamera(CameraLocation=move_26.Geometry, TargetLocation=move_27.Geometry, Activate=toggle_2)  # disabled
pt_21 = ConstructPoint(XCoordinate=0, YCoordinate=0, ZCoordinate=expr("x*2", number_slider_19))  # disabled
populate_3d_2 = Populate3D(Region={Plane=PlaneXY(0, 0, 0), X=Domain(0, 10), Y=Domain(0, 10), Z=Domain(0, 2)}, Count=density_6, Seed=58654)  # disabled
number_slider_24 = Slider(0.001, range=-50.001..50)  # disabled
number_slider_25 = Slider(0, range=0..100)  # disabled
number_slider_26 = Slider(-0.001, range=-50.001..50)  # disabled
number_slider_27 = Slider(0.35, range=0..100)  # disabled
eval_2 = EvaluateCurve(Curve=fline_4, Parameter=modulus)  # -> flatten(Point), Tangent, Angle; disabled
inter_3 = InterconnectPoints(Pts=eval_2.Point)  # disabled
length_2 = Length(Curve=inter_3)  # disabled
bounds_2 = Bounds(Numbers=length_2)  # disabled
len_4 = Length(Curve=inter_3)  # disabled
remap_numbers_3 = RemapNumbers(Value=length_2, Source=bounds_2, Target=Domain(0, 1))  # -> Mapped, Clipped; disabled
expression_5 = Expression(x=number_slider_21, y=len_4, Expression="x>y")  # disabled
dispatch_10 = Dispatch(List=inter_3, DispatchPattern=expression_5)  # -> ListA, ListB; disabled
gradient_2 = Gradient(LowerLimit=0, UpperLimit=1, Parameter=remap_numbers_3.Mapped, stops=[0: RGB(255, 130, 160), 0.85: RGB(220, 0, 40)])  # disabled
custom_preview = CustomPreview(Geometry=dispatch_10.ListA, Material=gradient_2)  # disabled
cluster_4 = Cluster(L=populate_3d_2)  # disabled
number_slider_28 = Slider(1, range=0..10)  # disabled
point_charge_3 = PointCharge(Point=pt_16, Charge=expr("x/100", number_slider_24), Decay=number_slider_25)  # disabled
point_charge_4 = PointCharge(Point=pt_21, Charge=expr("x/100", number_slider_26), Decay=number_slider_27)  # disabled
pl_6 = ConstructPlane(Origin=eval_2.Point, XAxis=Vector(1, 0, 0), YAxis=Vector(0, 1, 0))  # disabled
deconstruct = Deconstruct(Point=eval_2.Point)  # -> XComponent, YComponent, ZComponent; disabled
graph_mapper = GraphMapper(deconstruct.ZComponent, x0=-20, x1=130, y0=0, y1=5, container_name="Bezier", cpx=[0, 0, 1, 1], cpy=[1, 0, 0, 1])  # disabled
graph_mapper_2 = GraphMapper(
    deconstruct.ZComponent,
    x0=-20,
    x1=130,
    y0=0,
    y1=500,
    container_name="Bezier",
    cpx=[0, 0, 1, 1],
    cpy=[0, 0.875, 0.8951612711, 0])  # disabled
graph_mapper_3 = GraphMapper(
    deconstruct.ZComponent,
    x0=-20,
    x1=250,
    y0=0,
    y1=10,
    container_name="Bezier",
    cpx=[0, 0.1090909094, 0.4878787994, 1],
    cpy=[0, 0.4959677458, 0.2540322542, 0])  # disabled
evaluate_field_2 = EvaluateField(Field=mergef_2, Point=eval_2.Point)  # -> Tensor, Strength; disabled
multiplication_12 = Multiplication(A=graph_mapper_3, B=2)  # disabled
sph_4 = Sphere(Base=pl_6, Radius=number_slider_28)  # disabled
number_slider_29 = Slider(3, range=0..10)  # disabled
number_slider_30 = Slider(0.008, range=0..10)  # disabled
inter_4 = InterconnectPoints(Pts=eval_2.Point)  # disabled
number_slider_31 = Slider(0.85, range=0..10)  # disabled
scale = Scale(Geometry=sph_4, Center=pl_6, Factor=1.5)  # -> Geometry, Transform; disabled
rotate_3d_2 = Rotate3D(Geometry=evaluate_field_2.Tensor, Angle=2.35619449, Center=eval_2.Point, Axis=cluster_4)  # -> Geometry, Transform; disabled
preview_11 = CustomPreview(
    Geometry=sph_4,
    Material={diffuse=RGB(0, 0, 0), emission=RGB(0, 0, 0), shine=1, specular=RGB(255, 255, 255), transparency=1})  # disabled
preview_12 = CustomPreview(
    Geometry=scale.Geometry,
    Material={diffuse=RGB(0, 0, 0), emission=RGB(0, 0, 0), shine=1, specular=RGB(255, 255, 255), transparency=1})  # disabled
box_5 = Box2Pt(PointA=Point(-40, -40, -50), PointB=Point(40, 40, 150), Plane=PlaneXY(0, 0, 0))  # disabled
plane_normal_2 = PlaneNormal(Origin=eval_2.Point, ZAxis=rotate_3d_2.Geometry)  # disabled
ptemi = PointEmitter(Points=eval_2.Point)  # disabled
ptsf = PointsFood(Points=eval_2.Point)  # disabled
trigger = Trigger(Interval=-20, TimerInterval=20, Target=prealm)  # disabled
boxenvir = BoxEnvironment(XResolution=100, YResolution=100, ZResolution=100, Box=box_5)  # disabled
spin_force_2 = SpinForce(Plane=plane_normal_2, Strength=expr("x/100", number_slider_30), Radius=multiplication_12, Decay=number_slider_31)  # disabled
merge_fields_2 = MergeFields(Fields=flatten([point_charge_3, point_charge_4, spin_force_2]))  # disabled
prealm = Physarealm(Environment=boxenvir, Emitter=ptemi, Food=ptsf, Reset=True)  # -> ChemoAttractorField, Population, Iteration; disabled
number_slider_32 = Slider(13, range=0..20)  # disabled
poploc = PopulationLocations(Population=prealm.Population)  # disabled
poptrail = PopulationTrail(Population=prealm.Population, HistoryStep=10, Reset=False)  # disabled
prox = Proximity3D(Points=poploc, Group=number_slider_32)  # -> flatten(Links), Topology; disabled
dupln = RemoveDuplicateLines(Lines=prox.Links, Tolerance=0.01)  # disabled
avr = Average(Input=poploc)  # disabled
ln_3 = Line(StartPoint=poploc, EndPoint=avr)  # disabled
shortwalk = ShortestWalk(Curves=dupln, WantedPath=ln_3)  # -> ShortestWalk, Succession, Direction, Length; disabled
number_slider_33 = Slider(6, range=0..20)  # disabled
join = JoinCurves(Curves=shortwalk.ShortestWalk, Preserve=False)  # disabled
divide_2 = DivideCurve(Curve=join, Count=number_slider_33, Kinks=False)  # -> Points, Tangents, Parameters; disabled
intcrv_t = InterpolateT(Vertices=divide_2.Points, TangentStart=Vector(0, 0, 0), TangentEnd=Vector(0, 0, 0), KnotStyle=1)  # -> Curve, Length, Domain; disabled
series_7 = Series(Start=0, Step=1, Count=400)  # disabled
item = ListItem(Index=series_7, Wrap=True)  # disabled
field_line = FieldLine(Field=merge_fields_2, Point=move_23.Geometry, Steps=3000, Accuracy=0.1, Method=1)  # disabled
length_3 = Length(Curve=field_line)  # disabled
planesrf = PlaneSurface(Plane=PlaneXY(0, 0, 0), XSize=Domain(-10, 10), YSize=Domain(-10, 10))  # disabled
reb = RebuildCurve(Curve=field_line, Degree=2, Count=30, Tangents=False)  # disabled
move_28 = Move(Geometry=planesrf, Motion=Vector(0, 0, 50))  # -> Geometry, Transform; disabled
bounds_3 = Bounds(Numbers=length_3)  # disabled
pcx = CurvePlane(Curve=reb, Plane=move_28.Geometry)  # -> flatten(Points), ParamsC, ParamsP; disabled
item_2 = ListItem(List=pcx.Points, Index=series_7, Wrap=True)  # disabled
ptstrimcrv = PointsTrimCurve(Curve=reb, Points=item_2, Flip=False)  # -> flatten(Trimmed), SubDomains, Intersected; disabled
remap_numbers_4 = RemapNumbers(Value=length_3, Source=bounds_3, Target=Domain(0, 1))  # -> Mapped, Clipped; disabled
plntrimcrv = PlaneTrimCurve(Curve=reb, Plane=move_28.Geometry, Flip=True)  # -> flatten(Trimmed), Parameters, Intersected; disabled
brep = Brep(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)  # disabled
brep_2 = Brep(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)  # disabled
brep_3 = Brep(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)  # disabled
brep_4 = Brep(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)  # disabled
colour = ColourPicker(PickedColour=RGB(0, 0, 0))  # disabled
move_29 = Move(Geometry=brep, Motion=Vector(0, 0, -250))  # -> Geometry, Transform; disabled
gradient_3 = Gradient(LowerLimit=0, UpperLimit=1, Parameter=remap_numbers_4.Mapped, stops=[0.296: RGB(0, 0, 0), 1: RGB(255, 255, 255)])  # disabled
scale_2 = Scale(Geometry=move_29.Geometry, Center=Point(0, 0, 0), Factor=0.5)  # -> Geometry, Transform; disabled
mesh_uv = MeshSurface(Surface=scale_2.Geometry, UCount=30, VCount=40, Overhang=True, Equalize=False)  # disabled
custom_preview_2 = CustomPreview(Geometry=field_line, Material=gradient_3)  # disabled
custom_preview_3 = CustomPreview(Geometry=plntrimcrv.Trimmed, Material=gradient_3)  # disabled
demesh = DeconstructMesh(Mesh=mesh_uv)  # -> Vertices, Faces, Colours, Normals; disabled
pt_22 = Point(demesh.Vertices)  # disabled
evf_8 = EvaluateField(Field=merge_fields_2, Point=pt_22)  # -> Tensor, Strength; disabled
number_slider_34 = Slider(15, range=0..100)  # disabled
vec_10 = Vector(evf_8.Tensor)  # disabled
amp_8 = Amplitude(Vector=vec_10, Amplitude=number_slider_34)  # disabled
move_30 = Move(Geometry=pt_22, Motion=amp_8)  # -> Geometry, Transform; disabled
conmesh = ConstructMesh(Vertices=move_30.Geometry, Faces=demesh.Faces)  # disabled
subdmesh = SubDFromMesh(Mesh=conmesh, Creases=1, Corners=1, Interpolate=False)  # disabled
swatch_2 = ColourSwatch(SwatchColor=RGBA(112, 112, 112, 51))  # disabled
preview_13 = CustomPreview(
    Geometry=subdmesh,
    Material={diffuse=RGB(0, 0, 0), emission=RGB(0, 0, 0), shine=1, specular=RGB(255, 255, 255), transparency=1})  # disabled

# ==== cluster Cluster
L = ClusterInput()
lng = ListLength(List=L)
random = Random(Range=Domain(-1, 1), Number=lng, Seed=5454)
random_2 = Random(Range=Domain(-1, 1), Number=lng, Seed=5754)
random_3 = Random(Range=Domain(-1, 1), Number=lng, Seed=5)
vec = VectorXYZ(XComponent=random_3, YComponent=random_2, ZComponent=random)  # -> Vector, Length
V = ClusterOutput(vec.Vector)

# ==== cluster Cluster_2
L = ClusterInput()
lng = ListLength(List=L)
random = Random(Range=Domain(-1, 1), Number=lng, Seed=2)
random_2 = Random(Range=Domain(-1, 1), Number=lng, Seed=6)
random_3 = Random(Range=Domain(-1, 1), Number=lng, Seed=12)
vec = VectorXYZ(XComponent=random, YComponent=random_2, ZComponent=random_3)  # -> Vector, Length
V = ClusterOutput(vec.Vector)
