# Grasshopper definition skeletalMoverride.gh (Grasshopper 0.8.66)

geo = Geometry([<20, culture=neutral, publickeytoken=null referenced from the Rhino model> x2])

explode = Explode(Curve=flatten(geo), Recursive=True)  # -> Segments, Vertices
duppt = RemoveDuplicatePts(Points=flatten(explode.Vertices), Tolerance=0.01)
dupln = RemoveDuplicateLines(Lines=flatten(explode.Segments), Tolerance=0.01)
pt = Point(duppt)
voronoi³ = Voronoi3D(Points=pt)  # -> Cells, Boundary
scale = Scale(Geometry=voronoi³.Cells, Center=pt, Factor=Slider(0.17, range=0.01..1))  # -> Geometry, Transform
explode_2 = BrepComponents(Brep=scale.Geometry)  # -> Faces, Edges, Vertices
explode_3 = BrepComponents(Brep=explode_2.Faces)  # -> Faces, Edges, Vertices
join = JoinCurves(Curves=explode_3.Edges, Preserve=False)  # -> flatten(Curves)

wires = BrepWireframe(Brep=voronoi³.Cells, Density=-1)
preview = CustomPreview(Geometry=wires, Shader=ColourSwatch(SwatchColor=RGB(176, 176, 176)))

explode_4 = BrepComponents(Brep=voronoi³.Cells)  # -> Faces, Edges, Vertices
explode_5 = BrepComponents(Brep=explode_4.Faces)  # -> Faces, Edges, Vertices
join_2 = JoinCurves(Curves=explode_5.Edges, Preserve=False)  # -> flatten(Curves)
pcen = PolygonCenter(Polyline=join_2)  # -> CenterV, CenterE
lng = ListLength(List=pcen.CenterE)
sort_pt = SortPoints(Points=pcen.CenterE)  # -> Points, Indices
series = Series(Start=0, Step=1, Count=lng)
sort = SortList(Keys=sort_pt.Indices, ValuesA=series)  # -> Keys, ValuesA
replace = ListReplace(List=join, Item=join, Indices=sort.ValuesA, Wrap=False)
shift = ShiftList(List=sort_pt.Points, Shift=-1, Wrap=True)
shift_2 = ShiftList(List=sort_pt.Points, Shift=1, Wrap=True)
dist = Distance(PointA=shift, PointB=sort_pt.Points)
dist_2 = Distance(PointA=shift_2, PointB=sort_pt.Points)
smaller = SmallerThan(FirstNumber=dist_2, SecondNumber=0.01)  # -> SmallerThan, OrEqualTo
smaller_2 = SmallerThan(FirstNumber=dist, SecondNumber=0.01)  # -> SmallerThan, OrEqualTo
cull = CullPattern(List=replace, CullPattern=smaller.SmallerThan)  # -> graft(List)
cull_2 = CullPattern(List=replace, CullPattern=smaller_2.SmallerThan)  # -> graft(List)
data = Data([cull_2, cull])

data_2 = Data(data)
pcen_2 = PolygonCenter(Polyline=data_2)  # -> CenterV, CenterE
item = ListItem(List=pcen_2.CenterE, Index=1, Wrap=False)
item_2 = ListItem(List=pcen_2.CenterE, Index=0, Wrap=False)
item_3 = ListItem(List=data_2, Index=0, Wrap=False)
vec2pt = Vector2Pt(PointA=item_2, PointB=item, Unitize=False)  # -> Vector, Length
extr = Extrude(Base=item_3, Direction=vec2pt.Vector)
quad = MeshQuad(CornerA=0, CornerB=1, CornerC=3, CornerD=2)

# ---- group: dull culling
eval = EvaluateCurve(Curve=reparameterize(dupln), Parameter=0.5)  # -> Point, Tangent, Length
cap = CapHoles(Brep=extr)
in = Inside(Brep=cap, Point=eval.Point, Strict=False)
sort_2 = SortList(Keys=in)  # -> reverse(Keys), ValuesA
item_4 = ListItem(List=sort_2.Keys, Index=0, Wrap=False)
cull_3 = CullPattern(List=flatten(extr), CullPattern=flatten(item_4))

# ----
explode_6 = BrepComponents(Brep=cull_3)  # -> Faces, Edges, Vertices
explode_7 = BrepComponents(Brep=explode_6.Faces)  # -> Faces, Edges, Vertices
item_5 = ListItem(List=explode_7.Vertices, Index=2, Wrap=False)
item_6 = ListItem(List=explode_7.Vertices, Index=3, Wrap=False)
item_7 = ListItem(List=explode_7.Vertices, Index=1, Wrap=False)
item_8 = ListItem(List=explode_7.Vertices, Index=0, Wrap=False)
mesh = Mesh(Vertices=[item_7, item_8, item_5, item_6], Faces=quad)  # -> flatten(Mesh)

join_3 = BrepJoin(Breps=cull_3)  # -> Breps, Closed
edges = BrepEdges(Brep=join_3.Breps)  # -> Naked, Interior, NonManifold
join_4 = JoinCurves(Curves=edges.Naked, Preserve=False)
pcen_3 = PolygonCenter(Polyline=join_4)  # -> CenterV, CenterE
explode_8 = Explode(Curve=join_4, Recursive=True)  # -> Segments, Vertices
graft = GraftTree(Data=pcen_3.CenterE, Strip=False)
end = EndPoints(Curve=explode_8.Segments)  # -> Start, End
ln = Line(StartPoint=graft, EndPoint=end.End)  # -> graft(Line)
ln_2 = Line(StartPoint=graft, EndPoint=end.Start)  # -> graft(Line)
join_5 = JoinCurves(Curves=[ln_2, ln], Preserve=False)
explode_9 = Explode(Curve=join_5, Recursive=True)  # -> Segments, Vertices
triangle = MeshTriangle(CornerA=0, CornerB=1, CornerC=2)
mesh_2 = Mesh(Vertices=explode_9.Vertices, Faces=triangle)

wbjoin = WeaverBirdsJoinMeshesAndWeld(Mesh=flatten([mesh, mesh_2]), Weld=True)
weldvertices = MeshWeldVertices(Mesh=wbjoin, Tolerance=0.01)  # -> RuntimeMessage, Mesh
vb = VBScript(x=weldvertices.Mesh)  # -> out, A; inputs x: Mesh
# ---------- vb: C# ----------
    x.Normals.ComputeNormals
    x.FaceNormals.ComputeFaceNormals
    x.UnifyNormals
    A = x
# ---------- end vb ----------
wblaplace = WeaverBirdsLaplacianSmoothing(MeshCurves=vb.A, Level=1, SmoothNakedEdges=1, Thin=Slider(0.442, range=0..2))
wbcatmullclark = WeaverBirdsCatmullClarkSubdivision(MeshCurves=wblaplace, Level=3, SmoothNakedEdges=1)
preview_2 = CustomPreview(Geometry=wbcatmullclark, Shader=ColourSwatch(SwatchColor=RGB(87, 87, 87)))
