# Grasshopper definition study3.gh (Grasshopper 1.0.7)
# Copyright: Free

brep = Brep(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)
bbox = BoundingBox(Content=brep, Plane=PlaneXY(0, 0, 0))  # -> Box, Box_2
pop3d = Populate3D(Region=brep, Count=Slider(34, range=6..100), Seed=Slider(14, range=0..100))
pull = PullPoint(Point=pop3d, Geometry=brep, ClosestOnly=True)  # -> ClosestPoint, Distance
facet = FacetDome(Points=pull.ClosestPoint, Box=bbox.Box)  # -> Pattern, Dome
boundary = BoundarySurfaces(Edges=facet.Pattern)
amp = Amplitude(Vector=boundary, Amplitude=Slider(30.63, range=0..100))
move = Move(Geometry=facet.Pattern, Motion=amp)  # -> Geometry, Transform
pcen = PolygonCenter(Polyline=move.Geometry)  # -> CenterV, CenterE, CenterA
amp_2 = Amplitude(Vector=boundary, Amplitude=Slider(18.15, range=0..100))
scale = Scale(Geometry=move.Geometry, Center=pcen.CenterV, Factor=Slider(0.71, range=0..2))  # -> Geometry, Transform
move_2 = Move(Geometry=pcen.CenterV, Motion=amp_2)  # -> Geometry, Transform
merge = Merge(Data1=graft(facet.Pattern), Data2=graft(scale.Geometry))
loft = Loft(Curves=merge, Options={Adjust=False, Closed=False, LoftEnds=0, LoftSimp=0, LoftType=0, Rebuild=10, Refit=0.01})
extr = ExtrudePoint(Base=scale.Geometry, Point=move_2.Geometry)
join = BrepJoin(Breps=flatten([extr, loft]))  # -> Breps, Closed
preview = CustomPreview(Geometry=join.Breps, Material=ColourSwatch(SwatchColor=RGB(79, 182, 255)))
