# Grasshopper definition ARCH470_Classwork1_OzgurGulsuna_2307668.gh (Grasshopper 1.0.7)

number_slider = Slider(5, range=2..10)
geometry = Geometry(<brep referenced from the Rhino model>)
geometry_2 = Geometry(<brep referenced from the Rhino model>)
brep = Brep(<brep referenced from the Rhino model>)
number_slider_2 = Slider(0, range=0..1)
expression = Expression(x=number_slider, y=Slider(1, range=0..1), Expression="1/x")
scale = Scale(Geometry=flatten(geometry), Center=Point(0, 0, 0), Factor=expression)  # -> Geometry, Transform
scale_2 = Scale(Geometry=flatten(geometry_2), Center=Point(0, 0, 0), Factor=expression)  # -> Geometry, Transform
divide_domain² = DivideDomain²(Domain=brep, UCount=number_slider, VCount=number_slider)
expression_2 = Expression(x=expression, y=number_slider_2, Expression="{0, -5*x, y}")
expression_3 = Expression(x=expression, y=number_slider_2, Expression="{0, 5*x, y}")
isotrim = Isotrim(Surface=brep, Domain=divide_domain²)
deconstruct_brep = DeconstructBrep(Brep=isotrim)  # -> Faces, Edges, Vertices
area = Area(Geometry=deconstruct_brep.Faces)  # -> Area, Centroid
move = Move(Geometry=scale_2.Geometry, Motion=area.Centroid)  # -> Geometry, Transform
move_2 = Move(Geometry=scale.Geometry, Motion=area.Centroid)  # -> Geometry, Transform
move_3 = Move(Geometry=move.Geometry, Motion=expression_2)  # -> Geometry, Transform
move_4 = Move(Geometry=move_2.Geometry, Motion=expression_3)  # -> Geometry, Transform
