# Grasshopper definition leaf_v6.gh (Grasshopper 1.0.7)

number_slider = Slider(0.452, range=0..1)
number_slider_2 = Slider(0.876, range=0..1)
number_slider_3 = Slider(16.387, range=0..20)
multiplication = Multiplication(A=number_slider_3, B=number_slider_2)
multiplication_2 = Multiplication(A=number_slider_3, B=number_slider_2)
multiplication_3 = Multiplication(A=multiplication, B=number_slider)
number_slider_4 = Slider(2.517, range=0..10)
construct_domain = ConstructDomain(DomainStart="0", DomainEnd="1")
construct_domain_2 = ConstructDomain(DomainStart="0", DomainEnd=number_slider_3)
construct_domain_3 = ConstructDomain(DomainStart="0", DomainEnd="1")
construct_domain_4 = ConstructDomain(DomainStart="0", DomainEnd="1")
construct_domain_5 = ConstructDomain(DomainStart="0", DomainEnd=multiplication_3)
remap_numbers = RemapNumbers(Value=number_slider, Source=construct_domain_4, Target=construct_domain_5)  # -> Mapped, Clipped
construct_domain_6 = ConstructDomain(DomainStart=remap_numbers.Mapped, DomainEnd=multiplication_2)
remap_numbers_2 = RemapNumbers(Value=Slider(0.652, range=0..1), Source=construct_domain_3, Target=construct_domain_6)  # -> Mapped, Clipped
remap_numbers_3 = RemapNumbers(Value=number_slider_2, Source=construct_domain, Target=construct_domain_2)  # -> Mapped, Clipped
vector_xyz = VectorXYZ(XComponent=0, YComponent=remap_numbers_2.Mapped, ZComponent=0)  # -> Vector, Length
vector_xyz_2 = VectorXYZ(XComponent=0, YComponent=number_slider_3, ZComponent=0)  # -> Vector, Length
vector_xyz_3 = VectorXYZ(XComponent=0, YComponent=remap_numbers.Mapped, ZComponent=0)  # -> Vector, Length
origin = Point(<point referenced from the Rhino model>)
vector_xyz_4 = VectorXYZ(XComponent=0, YComponent=remap_numbers_3.Mapped, ZComponent=0)  # -> Vector, Length
move = Move(Geometry=origin, Motion=vector_xyz_2.Vector)  # -> Geometry, Transform
move_2 = Move(Geometry=origin, Motion=vector_xyz.Vector)  # -> Geometry, Transform
move_3 = Move(Geometry=origin, Motion=vector_xyz_4.Vector)  # -> Geometry, Transform
move_4 = Move(Geometry=origin, Motion=vector_xyz_3.Vector)  # -> Geometry, Transform
line = Line(StartPoint=origin, EndPoint=move.Geometry)
number_slider_5 = Slider(0.401, range=0..1.57)
number_slider_6 = Slider(0.46, range=0..1)
number_slider_7 = Slider(0.06, range=0..1)
number_slider_8 = Slider(0.975, range=0..1.57)
number_slider_9 = Slider(0.15, range=0..1)
number_slider_10 = Slider(0.906, range=0..1.57)
vector_xyz_5 = VectorXYZ(XComponent=Slider(7.6, range=0..10), YComponent=0, ZComponent=0)  # -> Vector, Length
number_slider_11 = Slider(2.7, range=0..10)
vector_xyz_6 = VectorXYZ(XComponent=Slider(12, range=0..12), YComponent=0, ZComponent=0)  # -> Vector, Length
vector_xyz_7 = VectorXYZ(XComponent=Slider(8.49, range=0..12), YComponent=0, ZComponent=0)  # -> Vector, Length
range = Range(Domain=Domain(0, 1), Steps=10)
curve_domain = CurveDomain(Curve=line)  # -> Curve, Domain
move_5 = Move(Geometry=move_3.Geometry, Motion=vector_xyz_5.Vector)  # -> Geometry, Transform
move_6 = Move(Geometry=move_2.Geometry, Motion=vector_xyz_6.Vector)  # -> Geometry, Transform
move_7 = Move(Geometry=move_4.Geometry, Motion=vector_xyz_7.Vector)  # -> Geometry, Transform
rotate_3d = Rotate3D(Geometry=move_6.Geometry, Angle=Slider(0.118, range=-1.57..1.57), Center=move_2.Geometry, Axis=Vector(0, 0, 1))  # -> Geometry, Transform
rotate_3d_2 = Rotate3D(Geometry=move_5.Geometry, Angle=Slider(0.699, range=-1.57..1.57), Center=move_3.Geometry, Axis=Vector(0, 0, 1))  # -> Geometry, Transform
rotate_3d_3 = Rotate3D(Geometry=move_7.Geometry, Angle=Slider(-0.539, range=-1.57..1.57), Center=move_4.Geometry, Axis=Vector(0, 0, 1))  # -> Geometry, Transform
vector_2pt = Vector2Pt(PointA=move_3.Geometry, PointB=rotate_3d_2.Geometry, Unitize=False)  # -> Vector, Length
vector_2pt_2 = Vector2Pt(PointA=move_4.Geometry, PointB=rotate_3d_3.Geometry, Unitize=False)  # -> Vector, Length
vector_2pt_3 = Vector2Pt(PointA=move_2.Geometry, PointB=rotate_3d.Geometry, Unitize=False)  # -> Vector, Length
multiplication_4 = Multiplication(A=number_slider_5, B=-1)
multiplication_5 = Multiplication(A=vector_2pt_2.Vector, B=Slider(0.5, range=0..1))
multiplication_6 = Multiplication(A=number_slider_8, B=-1)
multiplication_7 = Multiplication(A=vector_2pt.Vector, B=Slider(0.56, range=0..1))
multiplication_8 = Multiplication(A=vector_2pt.Vector, B=Slider(0.35, range=0..1))
multiplication_9 = Multiplication(A=vector_2pt_2.Vector, B=Slider(0.36, range=0..1))
multiplication_10 = Multiplication(A=vector_2pt_3.Vector, B=Slider(0.52, range=0..1))
multiplication_11 = Multiplication(A=number_slider_10, B=-1)
multiplication_12 = Multiplication(A=vector_2pt_3.Vector, B=Slider(0.42, range=0..1))
move_8 = Move(Geometry=move_3.Geometry, Motion=multiplication_7)  # -> Geometry, Transform
move_9 = Move(Geometry=move_4.Geometry, Motion=multiplication_9)  # -> Geometry, Transform
move_10 = Move(Geometry=move_8.Geometry, Motion=multiplication_8)  # -> Geometry, Transform
move_11 = Move(Geometry=move_9.Geometry, Motion=multiplication_5)  # -> Geometry, Transform
move_12 = Move(Geometry=move_2.Geometry, Motion=multiplication_12)  # -> Geometry, Transform
move_13 = Move(Geometry=move_12.Geometry, Motion=multiplication_10)  # -> Geometry, Transform
rotate_3d_4 = Rotate3D(Geometry=move_11.Geometry, Angle=number_slider_8, Center=move_9.Geometry, Axis=Vector(0, 0, 1))  # -> Geometry, Transform
rotate_3d_5 = Rotate3D(Geometry=move_10.Geometry, Angle=multiplication_4, Center=move_8.Geometry, Axis=Vector(0, 0, 1))  # -> Geometry, Transform
rotate_3d_6 = Rotate3D(Geometry=move_11.Geometry, Angle=multiplication_6, Center=move_9.Geometry, Axis=Vector(0, 0, 1))  # -> Geometry, Transform
rotate_3d_7 = Rotate3D(Geometry=move_10.Geometry, Angle=number_slider_5, Center=move_8.Geometry, Axis=Vector(0, 0, 1))  # -> Geometry, Transform
rotate_3d_8 = Rotate3D(Geometry=move_13.Geometry, Angle=number_slider_10, Center=move_12.Geometry, Axis=Vector(0, 0, 1))  # -> Geometry, Transform
rotate_3d_9 = Rotate3D(Geometry=move_13.Geometry, Angle=multiplication_11, Center=move_12.Geometry, Axis=Vector(0, 0, 1))  # -> Geometry, Transform
merge = Merge(Data1=[rotate_3d_8.Geometry, move_12.Geometry, rotate_3d.Geometry])
merge_2 = Merge(Data1=[move.Geometry, move_2.Geometry, move_12.Geometry, rotate_3d_8.Geometry])
merge_3 = Merge(Data1=[rotate_3d_4.Geometry, move_9.Geometry, rotate_3d_3.Geometry])
merge_4 = Merge(Data1=[rotate_3d_9.Geometry, move_12.Geometry, move_2.Geometry, move_4.Geometry, move_9.Geometry, rotate_3d_4.Geometry])
merge_5 = Merge(Data1=[rotate_3d.Geometry, move_12.Geometry, rotate_3d_9.Geometry])
merge_6 = Merge(Data1=[move.Geometry, move_3.Geometry, move_8.Geometry, rotate_3d_7.Geometry])
merge_7 = Merge(Data1=[rotate_3d_7.Geometry, move_8.Geometry, rotate_3d_2.Geometry])
merge_8 = Merge(Data1=[rotate_3d_2.Geometry, move_8.Geometry, rotate_3d_5.Geometry])
merge_9 = Merge(Data1=[rotate_3d_3.Geometry, move_9.Geometry, rotate_3d_6.Geometry])
merge_10 = Merge(Data1=[rotate_3d_6.Geometry, move_9.Geometry, move_4.Geometry, origin])
merge_11 = Merge(Data1=[rotate_3d_5.Geometry, move_8.Geometry, move_3.Geometry, move_2.Geometry, move_12.Geometry, rotate_3d_8.Geometry])
merge_12 = Merge(Data1=[rotate_3d_4.Geometry, move_9.Geometry, rotate_3d_3.Geometry])
merge_13 = Merge(Data1=[rotate_3d_9.Geometry, move_12.Geometry, move_2.Geometry, move_4.Geometry, move_9.Geometry, rotate_3d_4.Geometry])
merge_14 = Merge(Data1=[rotate_3d_8.Geometry, move_12.Geometry, rotate_3d.Geometry])
merge_15 = Merge(Data1=[rotate_3d.Geometry, move_12.Geometry, rotate_3d_9.Geometry])
merge_16 = Merge(Data1=[rotate_3d_3.Geometry, move_9.Geometry, rotate_3d_6.Geometry])
merge_17 = Merge(Data1=[rotate_3d_6.Geometry, move_9.Geometry, move_4.Geometry, origin])
interpolate = Interpolate(
    Vertices=[move.Geometry, rotate_3d_8.Geometry, rotate_3d.Geometry, rotate_3d_9.Geometry, rotate_3d_4.Geometry, rotate_3d_3.Geometry, rotate_3d_6.Geometry, origin],
    Degree=3,
    Periodic=False,
    KnotStyle=1)  # -> Curve, Length, Domain
merge_18 = Merge(Data1=[move.Geometry, rotate_3d_8.Geometry, rotate_3d.Geometry, rotate_3d_9.Geometry, rotate_3d_4.Geometry, rotate_3d_3.Geometry, rotate_3d_6.Geometry, origin])
interpolate_2 = Interpolate(Vertices=merge_2, Degree=1, Periodic=False, KnotStyle=1)  # -> Curve, Length, Domain
merge_19 = Merge(Data1=[rotate_3d_9.Geometry, move_12.Geometry, move_2.Geometry, origin])
merge_20 = Merge(Data1=[rotate_3d.Geometry, move_12.Geometry, rotate_3d_9.Geometry])
interpolate_3 = Interpolate(Vertices=merge, Degree=1, Periodic=False, KnotStyle=1)  # -> Curve, Length, Domain
merge_21 = Merge(Data1=[rotate_3d_8.Geometry, move_12.Geometry, rotate_3d.Geometry])
interpolate_4 = Interpolate(Vertices=merge_5, Degree=1, Periodic=False, KnotStyle=1)  # -> Curve, Length, Domain
interpolate_5 = Interpolate(Vertices=merge_4, Degree=1, Periodic=False, KnotStyle=1)  # -> Curve, Length, Domain
merge_22 = Merge(Data1=[move.Geometry, move_2.Geometry, move_12.Geometry, rotate_3d_8.Geometry])
interpolate_6 = Interpolate(Vertices=merge_3, Degree=1, Periodic=False, KnotStyle=1)  # -> Curve, Length, Domain
interpolate_7 = Interpolate(Vertices=merge_8, Degree=1, Periodic=False, KnotStyle=1)  # -> Curve, Length, Domain
interpolate_8 = Interpolate(Vertices=merge_7, Degree=1, Periodic=False, KnotStyle=1)  # -> Curve, Length, Domain
interpolate_9 = Interpolate(Vertices=merge_15, Degree=1, Periodic=False, KnotStyle=1)  # -> Curve, Length, Domain
interpolate_10 = Interpolate(Vertices=merge_6, Degree=1, Periodic=False, KnotStyle=1)  # -> Curve, Length, Domain
interpolate_11 = Interpolate(
    Vertices=[move.Geometry, rotate_3d_7.Geometry, rotate_3d_2.Geometry, rotate_3d_5.Geometry, rotate_3d_8.Geometry, rotate_3d.Geometry, rotate_3d_9.Geometry, rotate_3d_4.Geometry, rotate_3d_3.Geometry, rotate_3d_6.Geometry, origin],
    Degree=3,
    Periodic=False,
    KnotStyle=1)  # -> Curve, Length, Domain
interpolate_12 = Interpolate(Vertices=merge_9, Degree=1, Periodic=False, KnotStyle=1)  # -> Curve, Length, Domain
interpolate_13 = Interpolate(Vertices=merge_11, Degree=1, Periodic=False, KnotStyle=1)  # -> Curve, Length, Domain
interpolate_14 = Interpolate(Vertices=merge_10, Degree=1, Periodic=False, KnotStyle=1)  # -> Curve, Length, Domain
interpolate_15 = Interpolate(Vertices=merge_13, Degree=1, Periodic=False, KnotStyle=1)  # -> Curve, Length, Domain
interpolate_16 = Interpolate(Vertices=merge_14, Degree=1, Periodic=False, KnotStyle=1)  # -> Curve, Length, Domain
interpolate_17 = Interpolate(Vertices=merge_12, Degree=1, Periodic=False, KnotStyle=1)  # -> Curve, Length, Domain
interpolate_18 = Interpolate(
    Vertices=[move.Geometry, rotate_3d_8.Geometry, rotate_3d.Geometry, rotate_3d_9.Geometry, origin],
    Degree=3,
    Periodic=False,
    KnotStyle=1)  # -> Curve, Length, Domain
interpolate_19 = Interpolate(Vertices=merge_16, Degree=1, Periodic=False, KnotStyle=1)  # -> Curve, Length, Domain
interpolate_20 = Interpolate(Vertices=merge_17, Degree=1, Periodic=False, KnotStyle=1)  # -> Curve, Length, Domain
curve_closest_point = CurveClosestPoint(
    Point=[move.Geometry, rotate_3d_8.Geometry, rotate_3d.Geometry, rotate_3d_9.Geometry, origin],
    Curve=interpolate_18.Curve)  # -> Point, flatten(Parameter), Distance
interpolate_21 = Interpolate(Vertices=merge_22, Degree=1, Periodic=False, KnotStyle=1)  # -> Curve, Length, Domain
nurbs_curve = NurbsCurve(Vertices=merge, Degree=2, Periodic=False)  # -> Curve, Length, Domain
nurbs_curve_2 = NurbsCurve(Vertices=merge_2, Degree=2, Periodic=False)  # -> Curve, Length, Domain
interpolate_22 = Interpolate(Vertices=merge_21, Degree=1, Periodic=False, KnotStyle=1)  # -> Curve, Length, Domain
merge_23 = Merge(Data1=[move.Geometry, rotate_3d_7.Geometry, rotate_3d_2.Geometry, rotate_3d_5.Geometry, rotate_3d_8.Geometry, rotate_3d.Geometry, rotate_3d_9.Geometry, rotate_3d_4.Geometry, rotate_3d_3.Geometry, rotate_3d_6.Geometry, origin])
interpolate_23 = Interpolate(Vertices=merge_20, Degree=1, Periodic=False, KnotStyle=1)  # -> Curve, Length, Domain
nurbs_curve_3 = NurbsCurve(Vertices=merge_3, Degree=2, Periodic=False)  # -> Curve, Length, Domain
interpolate_24 = Interpolate(Vertices=merge_19, Degree=1, Periodic=False, KnotStyle=1)  # -> Curve, Length, Domain
nurbs_curve_4 = NurbsCurve(Vertices=merge_4, Degree=2, Periodic=False)  # -> Curve, Length, Domain
nurbs_curve_5 = NurbsCurve(Vertices=merge_10, Degree=2, Periodic=False)  # -> Curve, Length, Domain
nurbs_curve_6 = NurbsCurve(Vertices=merge_11, Degree=2, Periodic=False)  # -> Curve, Length, Domain
nurbs_curve_7 = NurbsCurve(Vertices=merge_12, Degree=2, Periodic=False)  # -> Curve, Length, Domain
nurbs_curve_8 = NurbsCurve(Vertices=merge_14, Degree=2, Periodic=False)  # -> Curve, Length, Domain
nurbs_curve_9 = NurbsCurve(Vertices=merge_13, Degree=2, Periodic=False)  # -> Curve, Length, Domain
nurbs_curve_10 = NurbsCurve(Vertices=merge_5, Degree=2, Periodic=False)  # -> Curve, Length, Domain
nurbs_curve_11 = NurbsCurve(Vertices=merge_17, Degree=2, Periodic=False)  # -> Curve, Length, Domain
nurbs_curve_12 = NurbsCurve(Vertices=merge_8, Degree=2, Periodic=False)  # -> Curve, Length, Domain
nurbs_curve_13 = NurbsCurve(Vertices=merge_9, Degree=2, Periodic=False)  # -> Curve, Length, Domain
nurbs_curve_14 = NurbsCurve(Vertices=merge_7, Degree=2, Periodic=False)  # -> Curve, Length, Domain
nurbs_curve_15 = NurbsCurve(Vertices=merge_6, Degree=3, Periodic=False)  # -> Curve, Length, Domain
nurbs_curve_16 = NurbsCurve(Vertices=merge_15, Degree=2, Periodic=False)  # -> Curve, Length, Domain
nurbs_curve_17 = NurbsCurve(Vertices=merge_16, Degree=2, Periodic=False)  # -> Curve, Length, Domain
nurbs_curve_18 = NurbsCurve(Vertices=merge_21, Degree=2, Periodic=False)  # -> Curve, Length, Domain
nurbs_curve_19 = NurbsCurve(Vertices=merge_22, Degree=2, Periodic=False)  # -> Curve, Length, Domain
nurbs_curve_20 = NurbsCurve(Vertices=merge_20, Degree=2, Periodic=False)  # -> Curve, Length, Domain
nurbs_curve_21 = NurbsCurve(Vertices=merge_19, Degree=2, Periodic=False)  # -> Curve, Length, Domain
curve_closest_point_2 = CurveClosestPoint(Point=merge_18, Curve=interpolate.Curve)  # -> Point, flatten(Parameter), Distance
curve_closest_point_3 = CurveClosestPoint(Point=merge_23, Curve=interpolate_11.Curve)  # -> Point, flatten(Parameter), Distance
shatter = Shatter(Curve=interpolate_18.Curve, Parameters=curve_closest_point.Parameter)
merge_24 = Merge(Data1=[nurbs_curve_15.Curve, nurbs_curve_14.Curve, nurbs_curve_12.Curve, nurbs_curve_6.Curve, nurbs_curve_8.Curve, nurbs_curve_16.Curve, nurbs_curve_9.Curve, nurbs_curve_7.Curve, nurbs_curve_17.Curve, nurbs_curve_11.Curve])
merge_25 = Merge(Data1=[nurbs_curve_19.Curve, nurbs_curve_18.Curve, nurbs_curve_20.Curve, nurbs_curve_21.Curve])
merge_26 = Merge(Data1=[interpolate_21.Curve, interpolate_22.Curve, interpolate_23.Curve, interpolate_24.Curve])
shatter_2 = Shatter(Curve=interpolate_11.Curve, Parameters=curve_closest_point_3.Parameter)
shatter_3 = Shatter(Curve=interpolate.Curve, Parameters=curve_closest_point_2.Parameter)
merge_27 = Merge(Data1=[nurbs_curve_2.Curve, nurbs_curve.Curve, nurbs_curve_10.Curve, nurbs_curve_4.Curve, nurbs_curve_3.Curve, nurbs_curve_13.Curve, nurbs_curve_5.Curve])
tween_curve = TweenCurve(CurveA=shatter, CurveB=merge_25, Factor=number_slider_6, BlendType=0)
tween_curve_2 = TweenCurve(CurveA=shatter, CurveB=merge_25, Factor=number_slider_9, BlendType=0)
tween_curve_3 = TweenCurve(CurveA=shatter, CurveB=merge_25, Factor=number_slider_7, BlendType=0)
tween_curve_4 = TweenCurve(CurveA=shatter_2, CurveB=merge_24, Factor=Slider(0, range=0..1), BlendType=0)
tween_curve_5 = TweenCurve(CurveA=shatter_2, CurveB=merge_24, Factor=number_slider_6, BlendType=0)
tween_curve_6 = TweenCurve(CurveA=shatter_2, CurveB=merge_24, Factor=number_slider_9, BlendType=0)
construct_domain_7 = ConstructDomain(DomainStart=0, DomainEnd=9)
tween_curve_7 = TweenCurve(CurveA=shatter_3, CurveB=merge_27, Factor=number_slider_6, BlendType=0)
tween_curve_8 = TweenCurve(CurveA=shatter_3, CurveB=merge_27, Factor=number_slider_9, BlendType=0)
tween_curve_9 = TweenCurve(CurveA=shatter_3, CurveB=merge_27, Factor=number_slider_7, BlendType=0)
range_2 = Range(Domain=construct_domain_7, Steps=9)
list_item = ListItem(List=tween_curve_4, Index=range_2, Wrap=True)
list_item_2 = ListItem(List=tween_curve_5, Index=range_2, Wrap=True)
list_item_3 = ListItem(List=tween_curve_6, Index=range_2, Wrap=True)
length = Length(Curve=list_item_3)
expression = Expression(x=length, y=Slider(1.67, range=0..10), Expression="Ceiling(1*x*y)")
multiplication_13 = Multiplication(A=expression, B=2)
multiplication_14 = Multiplication(A=expression, B=4)
divide_curve = DivideCurve(Curve=list_item_3, Count=multiplication_13, Kinks=False)  # -> Points, Tangents, Parameters
divide_curve_2 = DivideCurve(Curve=list_item_3, Count=multiplication_13, Kinks=False)  # -> Points, Tangents, Parameters
divide_curve_3 = DivideCurve(Curve=list_item_2, Count=expression, Kinks=False)  # -> Points, Tangents, Parameters
divide_curve_4 = DivideCurve(Curve=list_item, Count=multiplication_14, Kinks=False)  # -> Points, Tangents, Parameters
construct_domain_8 = ConstructDomain(DomainStart=0, DomainEnd=9)
range_3 = Range(Domain=construct_domain_8, Steps=9)
construct_domain_9 = ConstructDomain(DomainStart=0, DomainEnd=9)
range_4 = Range(Domain=construct_domain_9, Steps=9)
list_item_4 = ListItem(List=tween_curve_9, Index=range_3, Wrap=True)
list_item_5 = ListItem(List=tween_curve_7, Index=range_3, Wrap=True)
list_item_6 = ListItem(List=tween_curve_8, Index=range_3, Wrap=True)
list_item_7 = ListItem(List=tween_curve_3, Index=range_4, Wrap=True)
list_item_8 = ListItem(List=tween_curve, Index=range_4, Wrap=True)
list_item_9 = ListItem(List=tween_curve_2, Index=range_4, Wrap=True)
list_item_10 = ListItem(List=merge_26, Index=range_4, Wrap=True)
split_list = SplitList(List=divide_curve.Points, Index=1)  # -> ListA, ListB
split_list_2 = SplitList(List=divide_curve_3.Points, Index=1)  # -> ListA, ListB
split_list_3 = SplitList(List=divide_curve_2.Points, Index=1)  # -> ListA, ListB
split_list_4 = SplitList(List=divide_curve_4.Points, Index=1)  # -> ListA, ListB
length_2 = Length(Curve=list_item_6)
length_3 = Length(Curve=list_item_9)
reverse_list = ReverseList(List=split_list.ListB)
reverse_list_2 = ReverseList(List=split_list_2.ListB)
reverse_list_3 = ReverseList(List=split_list_3.ListB)
expression_2 = Expression(x=length_2, y=Slider(1, range=0..10), Expression="Ceiling(1*x*y)")
reverse_list_4 = ReverseList(List=split_list_4.ListB)
expression_3 = Expression(x=length_3, y=Slider(1.39, range=0..10), Expression="Ceiling(1*x*y)")
split_list_5 = SplitList(List=reverse_list, Index=2)  # -> ListA, ListB
split_list_6 = SplitList(List=reverse_list_2, Index=1)  # -> ListA, ListB
split_list_7 = SplitList(List=reverse_list_3, Index=1)  # -> ListA, ListB
split_list_8 = SplitList(List=reverse_list_4, Index=2)  # -> ListA, ListB
multiplication_15 = Multiplication(A=expression_2, B=2)
multiplication_16 = Multiplication(A=expression_2, B=4)
reverse_list_5 = ReverseList(List=split_list_5.ListB)
multiplication_17 = Multiplication(A=expression_3, B=2)
multiplication_18 = Multiplication(A=expression_3, B=4)
divide_curve_5 = DivideCurve(Curve=list_item_6, Count=multiplication_15, Kinks=False)  # -> Points, Tangents, Parameters
reverse_list_6 = ReverseList(List=split_list_6.ListB)
divide_curve_6 = DivideCurve(Curve=list_item_6, Count=multiplication_15, Kinks=False)  # -> Points, Tangents, Parameters
divide_curve_7 = DivideCurve(Curve=list_item_9, Count=multiplication_17, Kinks=False)  # -> Points, Tangents, Parameters
reverse_list_7 = ReverseList(List=split_list_8.ListB)
divide_curve_8 = DivideCurve(Curve=list_item_9, Count=multiplication_17, Kinks=False)  # -> Points, Tangents, Parameters
divide_curve_9 = DivideCurve(Curve=list_item_5, Count=expression_2, Kinks=False)  # -> Points, Tangents, Parameters
divide_curve_10 = DivideCurve(Curve=list_item_4, Count=multiplication_16, Kinks=False)  # -> Points, Tangents, Parameters
divide_curve_11 = DivideCurve(Curve=list_item_8, Count=expression_3, Kinks=False)  # -> Points, Tangents, Parameters
dispatch = Dispatch(List=reverse_list_5, DispatchPattern=[True, False])  # -> ListA, ListB
divide_curve_12 = DivideCurve(Curve=list_item_7, Count=multiplication_18, Kinks=False)  # -> Points, Tangents, Parameters
divide_curve_13 = DivideCurve(Curve=list_item_10, Count=expression_3, Kinks=False)  # -> Points, Tangents, Parameters
reverse_list_8 = ReverseList(List=split_list_7.ListB)
dispatch_2 = Dispatch(List=reverse_list_7, DispatchPattern=[True, False])  # -> ListA, ListB
split_list_9 = SplitList(List=divide_curve_5.Points, Index=1)  # -> ListA, ListB
split_list_10 = SplitList(List=divide_curve_9.Points, Index=1)  # -> ListA, ListB
split_list_11 = SplitList(List=divide_curve_6.Points, Index=1)  # -> ListA, ListB
split_list_12 = SplitList(List=divide_curve_7.Points, Index=1)  # -> ListA, ListB
split_list_13 = SplitList(List=divide_curve_11.Points, Index=1)  # -> ListA, ListB
split_list_14 = SplitList(List=divide_curve_8.Points, Index=1)  # -> ListA, ListB
split_list_15 = SplitList(List=divide_curve_10.Points, Index=1)  # -> ListA, ListB
split_list_16 = SplitList(List=divide_curve_12.Points, Index=1)  # -> ListA, ListB
reverse_list_9 = ReverseList(List=split_list_9.ListB)
reverse_list_10 = ReverseList(List=split_list_10.ListB)
reverse_list_11 = ReverseList(List=split_list_11.ListB)
reverse_list_12 = ReverseList(List=split_list_12.ListB)
reverse_list_13 = ReverseList(List=split_list_13.ListB)
reverse_list_14 = ReverseList(List=split_list_14.ListB)
reverse_list_15 = ReverseList(List=split_list_15.ListB)
split_list_17 = SplitList(List=reverse_list_9, Index=2)  # -> ListA, ListB
reverse_list_16 = ReverseList(List=split_list_16.ListB)
split_list_18 = SplitList(List=reverse_list_10, Index=1)  # -> ListA, ListB
split_list_19 = SplitList(List=reverse_list_11, Index=1)  # -> ListA, ListB
split_list_20 = SplitList(List=reverse_list_12, Index=2)  # -> ListA, ListB
split_list_21 = SplitList(List=reverse_list_13, Index=1)  # -> ListA, ListB
split_list_22 = SplitList(List=reverse_list_15, Index=2)  # -> ListA, ListB
split_list_23 = SplitList(List=reverse_list_14, Index=1)  # -> ListA, ListB
reverse_list_17 = ReverseList(List=split_list_17.ListB)
split_list_24 = SplitList(List=reverse_list_16, Index=2)  # -> ListA, ListB
reverse_list_18 = ReverseList(List=split_list_20.ListB)
reverse_list_19 = ReverseList(List=split_list_18.ListB)
reverse_list_20 = ReverseList(List=split_list_22.ListB)
reverse_list_21 = ReverseList(List=split_list_21.ListB)
reverse_list_22 = ReverseList(List=split_list_24.ListB)
dispatch_3 = Dispatch(List=reverse_list_17, DispatchPattern=[True, False])  # -> ListA, ListB
dispatch_4 = Dispatch(List=reverse_list_18, DispatchPattern=[True, False])  # -> ListA, ListB
reverse_list_23 = ReverseList(List=split_list_19.ListB)
reverse_list_24 = ReverseList(List=split_list_23.ListB)
dispatch_5 = Dispatch(List=reverse_list_20, DispatchPattern=[True, False])  # -> ListA, ListB
dispatch_6 = Dispatch(List=reverse_list_22, DispatchPattern=[True, False])  # -> ListA, ListB
line_2 = Line(StartPoint=reverse_list_6, EndPoint=dispatch.ListB)
line_3 = Line(StartPoint=reverse_list_6, EndPoint=dispatch.ListA)
line_4 = Line(StartPoint=reverse_list_8, EndPoint=dispatch_2.ListB)
merge_28 = Merge(Data1=[interpolate_10.Curve, interpolate_8.Curve, interpolate_7.Curve, interpolate_13.Curve, interpolate_16.Curve, interpolate_9.Curve, interpolate_15.Curve, interpolate_17.Curve, interpolate_19.Curve, interpolate_20.Curve])
list_item_11 = ListItem(List=merge_28, Index=range_2, Wrap=True)
divide_curve_14 = DivideCurve(Curve=list_item_11, Count=expression, Kinks=False)  # -> Points, Tangents, Parameters
line_5 = Line(StartPoint=divide_curve_3.Points, EndPoint=divide_curve_14.Points)
line_6 = Line(StartPoint=reverse_list_8, EndPoint=dispatch_2.ListA)
line_7 = Line(StartPoint=reverse_list_19, EndPoint=dispatch_3.ListB)
line_8 = Line(StartPoint=reverse_list_19, EndPoint=dispatch_3.ListA)
line_9 = Line(StartPoint=reverse_list_23, EndPoint=dispatch_5.ListB)
merge_29 = Merge(Data1=[interpolate_2.Curve, interpolate_3.Curve, interpolate_4.Curve, interpolate_5.Curve, interpolate_6.Curve, interpolate_12.Curve, interpolate_14.Curve])
list_item_12 = ListItem(List=merge_29, Index=range_3, Wrap=True)
divide_curve_15 = DivideCurve(Curve=list_item_12, Count=expression_2, Kinks=False)  # -> Points, Tangents, Parameters
line_10 = Line(StartPoint=divide_curve_9.Points, EndPoint=divide_curve_15.Points)
line_11 = Line(StartPoint=reverse_list_21, EndPoint=dispatch_4.ListB)
line_12 = Line(StartPoint=reverse_list_23, EndPoint=dispatch_5.ListA)
line_13 = Line(StartPoint=divide_curve_11.Points, EndPoint=divide_curve_13.Points)
line_14 = Line(StartPoint=reverse_list_21, EndPoint=dispatch_4.ListA)
line_15 = Line(StartPoint=reverse_list_24, EndPoint=dispatch_6.ListB)
line_16 = Line(StartPoint=reverse_list_24, EndPoint=dispatch_6.ListA)
