# Grasshopper definition ARCH470_gh01_OzgurGulsuna_2307668.gh (Grasshopper 1.0.7)

crv = Curve(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)
crv_2 = Curve(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)
crv_3 = Curve(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)
series = Series(Start=0, Step=1, Count=30)
crossref = CrossReference(ListA=series, ListB=series, CrossMode=1)  # -> ListA, ListB
pt = ConstructPoint(XCoordinate=crossref.ListA, YCoordinate=crossref.ListB, ZCoordinate=0)
crv_cp = CurveClosestPoint(Point=pt, Curve=crv_3)  # -> Point, Parameter, Distance
crv_cp_2 = CurveClosestPoint(Point=pt, Curve=crv_2)  # -> Point, Parameter, Distance
dom = ConstructDomain(DomainStart=Slider(0.2, range=0..2), DomainEnd=Slider(0.5, range=0..1))
smaller = SmallerThan(FirstNumber=crv_cp.Distance, SecondNumber=crv_cp_2.Distance)  # -> SmallerThan, OrEqualTo
crv_cp_3 = CurveClosestPoint(Point=pt, Curve=crv)  # -> Point, Parameter, Distance
p_n_c = PickNChoose(Pattern=smaller.SmallerThan, Stream0=crv_cp_2.Distance, Stream1=crv_cp.Distance)
smaller_2 = SmallerThan(FirstNumber=p_n_c, SecondNumber=crv_cp_3.Distance)  # -> SmallerThan, OrEqualTo
# Multiple Curve Attractors
p_n_c_2 = PickNChoose(Pattern=smaller_2.SmallerThan, Stream0=crv_cp_3.Distance, Stream1=p_n_c)
bnd = Bounds(Numbers=p_n_c_2)
remap = RemapNumbers(Value=p_n_c_2, Source=bnd, Target=dom)  # -> Mapped, Clipped
circle = CircleCNR(Center=pt, Normal=Vector(0, 0, 1), Radius=remap.Mapped)
infill = ColourSwatch(SwatchColor=RGB(196, 155, 255))
border = ColourSwatch(SwatchColor=RGB(234, 21, 255))
boundary = BoundarySurfaces(Edges=circle)
preview = CustomPreview(Geometry=boundary, Material=infill)
preview_2 = CustomPreview(Geometry=circle, Material=border)
