# Grasshopper definition ARCH470_gh02_OzgurGulsuna_2307668.gh (Grasshopper 1.0.7)

# Circle holes distributed over a loft plane w/ point attractor
crv = Curve(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)
crv_2 = Curve(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)
pt = Point(Point(19.0712146, 11.79904243, 32.24001587))
number_slider = Slider(10, range=0..12)
loft = Loft(Curves=[crv_2, crv], Options={Adjust=False, Closed=False, LoftEnds=0, LoftSimp=0, LoftType=0, Rebuild=10, Refit=0.01})
divide = DivideDomain²(Domain=loft, UCount=number_slider, VCount=number_slider)
subsrf = Isotrim(Surface=loft, Domain=divide)
dom = ConstructDomain(DomainStart=Slider(0.2, range=0..1), DomainEnd=expr("20/x", number_slider))
sdivide = DivideSurface(Surface=subsrf, UCount=2, VCount=2)  # -> flatten(Points), flatten(Normals), Parameters
cull = CullPattern(List=sdivide.Normals, CullPattern=[False, False, False, False, True, False, False, False, False])
cull_2 = CullPattern(List=sdivide.Points, CullPattern=[False, False, False, False, True, False, False, False, False])
dist = Distance(PointA=pt, PointB=cull_2)
bnd = Bounds(Numbers=dist)
remap = RemapNumbers(Value=dist, Source=bnd, Target=dom)  # -> Mapped, Clipped
circle = CircleCNR(Center=cull_2, Normal=cull, Radius=remap.Mapped)
extr = Extrude(Base=circle, Direction=expr("-x*10", cull))
move = Move(Geometry=extr, Motion=expr("x*2", cull))  # -> Geometry, Transform
cap = CapHoles(Brep=move.Geometry)
trim = TrimSolid(Shape=loft, Cutters=cap)
