# Grasshopper definition arch470_gh_classwork.gh (Grasshopper 1.0.7)

# Line/Curve Attractor
series = Series(Start=0, Step=1, Count=10)
# Point Attractor
series_2 = Series(Start=0, Step=1, Count=10)
# Closed Curve Attractor
series_3 = Series(Start=0, Step=1, Count=10)
# Line/Curve Attractor - Rotation
series_4 = Series(Start=0, Step=1, Count=10)
crossref = CrossReference(ListA=series, ListB=series, CrossMode=1)  # -> ListA, ListB
crossref_2 = CrossReference(ListA=series_2, ListB=series_2, CrossMode=1)  # -> ListA, ListB
crv = Curve(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)
crossref_3 = CrossReference(ListA=series_3, ListB=series_3, CrossMode=1)  # -> ListA, ListB
crv_2 = Curve(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)
crossref_4 = CrossReference(ListA=series_4, ListB=series_4, CrossMode=1)  # -> ListA, ListB
crv_3 = Curve(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)
pt = ConstructPoint(XCoordinate=crossref.ListA, YCoordinate=crossref.ListB, ZCoordinate=0)
pt_2 = ConstructPoint(XCoordinate=crossref_2.ListA, YCoordinate=crossref_2.ListB, ZCoordinate=0)
pt_3 = ConstructPoint(XCoordinate=crossref_3.ListA, YCoordinate=crossref_3.ListB, ZCoordinate=0)
pt_4 = Point(Point(2.035139136, 2.157628859, 0))
pt_5 = ConstructPoint(XCoordinate=crossref_4.ListA, YCoordinate=crossref_4.ListB, ZCoordinate=0)
crv_cp = CurveClosestPoint(Point=pt, Curve=crv)  # -> Point, Parameter, Distance
dist = Distance(PointA=pt_4, PointB=pt_2)
sph = Sphere(Base=pt_4, Radius=0.2)
crv_cp_2 = CurveClosestPoint(Point=pt_5, Curve=crv_3)  # -> Point, Parameter, Distance
incurve = PointInCurve(Point=pt_3, Curve=crv_2)  # -> Relationship, Point
bnd = Bounds(Numbers=crv_cp.Distance)
dom = ConstructDomain(DomainStart=Slider(0.1, range=0..0.1), DomainEnd=Slider(0.5, range=0..1))
bnd_2 = Bounds(Numbers=dist)
dom_2 = ConstructDomain(DomainStart=Slider(0.1, range=0..0.1), DomainEnd=Slider(0.5, range=0..1))
smaller = SmallerThan(FirstNumber=incurve.Relationship, SecondNumber="2")  # -> SmallerThan, OrEqualTo
dom_3 = ConstructDomain(DomainStart="0", DomainEnd="pi/2")
yz = YZPlane(Origin=pt_5)
remap = RemapNumbers(Value=crv_cp.Distance, Source=bnd, Target=dom)  # -> Mapped, Clipped
bnd_3 = Bounds(Numbers=crv_cp_2.Distance)
remap_2 = RemapNumbers(Value=dist, Source=bnd_2, Target=dom_2)  # -> Mapped, Clipped
dispatch = Dispatch(List=pt_3, DispatchPattern=smaller.SmallerThan)  # -> ListA, ListB
crv_cp_3 = CurveClosestPoint(Point=dispatch.ListA, Curve=crv_2)  # -> Point, Parameter, Distance
dom_4 = ConstructDomain(DomainStart=Slider(0.1, range=0..0.1), DomainEnd=Slider(0.5, range=0..1))
circle = CircleCNR(Center=pt, Normal=Vector(0, 0, 1), Radius=remap.Mapped)
circle_2 = CircleCNR(Center=pt_2, Normal=Vector(0, 0, 1), Radius=remap_2.Mapped)
circle_3 = CircleCNR(Center=pt_5, Normal=Vector(0, 0, 1), Radius=Slider(0.4, range=0..1))
remap_3 = RemapNumbers(Value=crv_cp_2.Distance, Source=bnd_3, Target=dom_3)  # -> Mapped, Clipped
bnd_4 = Bounds(Numbers=crv_cp_3.Distance)
boundary = BoundarySurfaces(Edges=circle)
remap_4 = RemapNumbers(Value=crv_cp_3.Distance, Source=bnd_4, Target=dom_4)  # -> Mapped, Clipped
rotate = Rotate(Geometry=circle_3, Angle=remap_3.Mapped, Plane=yz)  # -> Geometry, Transform
boundary_2 = BoundarySurfaces(Edges=rotate.Geometry)
circle_4 = CircleCNR(Center=dispatch.ListA, Normal=Vector(0, 0, 1), Radius=remap_4.Mapped)
boundary_3 = BoundarySurfaces(Edges=circle_4)
