# Grasshopper definition 2D_Field_Lines.gh (Grasshopper 1.0.7)

number_slider = Slider(37.238, range=0..50)
pt = Point([<point referenced from the Rhino model> x3])
pt_2 = Point([<point referenced from the Rhino model> x2])
pt_3 = Point([<point referenced from the Rhino model> x3])
rectangle = Rectangle(Plane=PlaneXY(0, 0, 0), XSize=number_slider, YSize=number_slider, Radius=0)  # -> Rectangle, Length
pcharge = PointCharge(Point=[pt_2, pt], Charge=Slider(-0.013, range=-1.001..1), Decay=Slider(0.227, range=0..50), Bounds=rectangle.Rectangle)
pt_4 = Point(<point referenced from the Rhino model>)
pt_5 = Point(<point referenced from the Rhino model>)
fspin = SpinForce(Plane=pt_3, Strength=Slider(0.09, range=0..50), Radius=Slider(2.586, range=0..10), Decay=2, Bounds=rectangle.Rectangle)
ln = Line(StartPoint=pt_4, EndPoint=pt_5)
mergef = MergeFields(Fields=[fspin, pcharge])
divide = DivideCurve(Curve=ln, Count=40, Kinks=False)  # -> Points, Tangents, Parameters
# Parameter Ideas
# 
#  - # of points
# - charge or discharge
fline = FieldLine(Field=mergef, Point=divide.Points, Steps=2000, Accuracy=0.1, Method=4)
