# Grasshopper definition 2D_Vector_Lines.gh (Grasshopper 1.0.7)

recgrid = Rectangular(Plane=PlaneXY(0, 0, 0), SizeX=2, SizeY=2, ExtentX=10, ExtentY=10)  # -> flatten(Cells), Points
pt = Point(<point referenced from the Rhino model>)
pt_2 = Point(<point referenced from the Rhino model>)
pt_3 = Point(recgrid.Points)
pop2d = Populate2D(Region={Plane=PlaneXY(0, 0, 0), Size=Domain2(u=0..20, v=0..20)}, Count=100, Seed=1)
pcharge = PointCharge(Point=pt, Charge=expr("x/100", Slider(0.076, range=0..1)), Decay=Slider(0.308, range=0..1), Bounds=recgrid.Cells)
pcharge_2 = PointCharge(Point=pt_2, Charge=expr("x/100", Slider(0.076, range=0..1)), Decay=Slider(0.308, range=0..1), Bounds=recgrid.Cells)
mergef = MergeFields(Fields=[pcharge_2, pcharge])
fline = FieldLine(Field=mergef, Point=pt_3, Steps=1000, Accuracy=0.1, Method=3)
