# Grasshopper definition 3dline_v1.gh (Grasshopper 1.0.7)

pt = Point(<point referenced from the Rhino model>)
pt_2 = Point(<point referenced from the Rhino model>)
pop2d = Populate2D(Region={Plane=PlaneXY(0, 0, 0), Size=Domain2(u=0..20, v=0..20)}, Count=100, Seed=1)
box = Box2Pt(PointA=pt, PointB=pt_2, Plane=PlaneXY(0, 0, 0))
recgrid = Rectangular(Plane=PlaneXY(0, 0, 0), SizeX=2, SizeY=2, ExtentX=10, ExtentY=10)  # -> flatten(Cells), Points
pt_3 = Point(<point referenced from the Rhino model>)
pt_4 = Point(<point referenced from the Rhino model>)
pt_5 = Point(recgrid.Points)
pt_6 = Point(<point referenced from the Rhino model>)
arrlinear = LinearArray(Geometry=pt_5, Direction=Vector(0, 0, 1), Count=10)  # -> Geometry, Transform
pcharge = PointCharge(Point=pt_3, Charge=expr("x/100", Slider(0.02, range=0..1)), Decay=Slider(0.269, range=0..1))
pcharge_2 = PointCharge(Point=pt_4, Charge=expr("x/100", Slider(-0.029, range=-1..1)), Decay=Slider(0.134, range=0..1))
fspin = SpinForce(Plane=pt_6, Strength=Slider(0.005, range=0..10), Radius=Slider(4.074, range=0..10), Decay=2)
mergef = MergeFields(Fields=[pcharge_2, fspin, pcharge])
fline = FieldLine(Field=mergef, Point=pt_5, Steps=Slider(79, range=0..500), Accuracy=0.1, Method=3)
