# Grasshopper definition 3dline_v11.gh (Grasshopper 1.0.7)
# plug-ins: Pufferfish

random = Random(Range=Domain(0, 1), Number=12, Seed=544)
split_list = SplitList(List=random, Index=1)  # -> ListA, ListB
split_list_2 = SplitList(List=split_list.ListB, Index=1)  # -> ListA, ListB
split_list_3 = SplitList(List=split_list_2.ListB, Index=1)  # -> ListA, ListB
split_list_4 = SplitList(List=split_list_3.ListB, Index=1)  # -> ListA, ListB
split_list_5 = SplitList(List=split_list_4.ListB, Index=1)  # -> ListA, ListB
split_list_6 = SplitList(List=split_list_5.ListB, Index=1)  # -> ListA, ListB
split_list_7 = SplitList(List=split_list_6.ListB, Index=1)  # -> ListA, ListB
split_list_8 = SplitList(List=split_list_7.ListB, Index=1)  # -> ListA, ListB
split_list_9 = SplitList(List=split_list_8.ListB, Index=1)  # -> ListA, ListB
split_list_10 = SplitList(List=split_list_9.ListB, Index=1)  # -> ListA, ListB
split_list_11 = SplitList(List=split_list_10.ListB, Index=1)  # -> ListA, ListB
split_list_12 = SplitList(List=split_list_11.ListB, Index=1)  # -> ListA, ListB
point = Point(Point(20, 20, 200))
point_2 = Point(Point(0, 0, 0))
box_2pt = Box2Pt(PointA=point_2, PointB=point, Plane=PlaneXY(0, 0, 0))
construct_point = ConstructPoint(XCoordinate=split_list_10.ListA, YCoordinate=split_list_11.ListA, ZCoordinate=split_list_12.ListA)
plane = Plane(PlaneXY(0, 0, 0))
point_3 = Point(<point referenced from the Rhino model>)
construct_point_2 = ConstructPoint(XCoordinate=split_list_7.ListA, YCoordinate=split_list_8.ListA, ZCoordinate=split_list_9.ListA)
construct_point_3 = ConstructPoint(XCoordinate=split_list_4.ListA, YCoordinate=split_list_5.ListA, ZCoordinate=split_list_6.ListA)
point_4 = Point(<point referenced from the Rhino model>)
construct_point_4 = ConstructPoint(XCoordinate=split_list.ListA, YCoordinate=split_list_2.ListA, ZCoordinate=split_list_3.ListA)
populate_3d = Populate3D(Region=box_2pt, Count=Slider(10, range=0..20), Seed=85)
number_slider = Slider(20, range=0..50)
time = Slider(0, range=0..100)
time_2 = Slider(400, range=0..400)
number_slider_2 = Slider(4, range=0..10)
number_slider_3 = Slider(5, range=0..20)
cluster = Cluster(L=populate_3d)
random_2 = Random(Range=Domain(0, 50), Number=10, Seed=Slider(31852, range=0..100000))
vector_2pt = Vector2Pt(PointA=construct_point_2, PointB=construct_point, Unitize=False)  # -> Vector, Length
vector_2pt_2 = Vector2Pt(PointA=point_4, PointB=point_3, Unitize=False)  # -> Vector, Length
populate_3d_2 = Populate3D(
    Region={Plane=PlaneXY(0, 0, 0), X=Domain(0, 10), Y=Domain(0, 10), Z=Domain(0, 2)},
    Count=expr("x*4", 10),
    Seed=Slider(213, range=0..500))
plane_normal = PlaneNormal(Origin=populate_3d, ZAxis=cluster)
trigger = Trigger(Interval=20, TimerInterval=20, Target=data_recorder)  # disabled
rectangular = Rectangular(Plane=PlaneXY(0, 0, 0), SizeX=2, SizeY=2, ExtentX=10, ExtentY=10)  # -> flatten(Cells), Points
rectangular_2 = Rectangular(Plane=PlaneXY(0, 0, 0), SizeX=number_slider_2, SizeY=number_slider_2, ExtentX=number_slider_3, ExtentY=number_slider_3)  # -> flatten(Cells), Points
number_slider_4 = Slider(20, range=0..20)
data_recorder = DataRecorder(flatten("1"), DataLimit=-10, RecordData=True)
point_5 = Point(<point referenced from the Rhino model>)
dispatch = Dispatch(List=populate_3d_2, DispatchPattern=[True, False])  # -> ListA, ListB
number_slider_5 = Slider(4000, range=0..5000)
populate_3d_3 = Populate3D(Region={Plane=PlaneXY(0, 0, 0), X=Domain(0, 10), Y=Domain(0, 10), Z=Domain(0, 2)}, Count=number_slider_4, Seed=58654)
series = Series(Start=0, Step=2, Count=100)
point_6 = Point(flatten(rectangular_2.Points))
populate_3d_4 = Populate3D(Region={Plane=PlaneXY(0, 0, 0), X=Domain(0, 10), Y=Domain(0, 10), Z=Domain(0, 2)}, Count=number_slider_4, Seed=1)
point_7 = Point(rectangular.Points)
linear_array = LinearArray(Geometry=point_7, Direction=Vector(0, 0, 1), Count=20)  # -> flatten(Geometry), Transform
bounding_box = BoundingBox(Content=linear_array.Geometry, Plane=PlaneXY(0, 0, 0), UnionBox=True)  # -> Box, Box_2
move = Move(Geometry=bounding_box.Box, Motion=Vector(0, 0, -80))  # -> Geometry, Transform
populate_3d_5 = Populate3D(Region=move.Geometry, Count=number_slider, Seed=2)
list_length = ListLength(List=data_recorder)
point_charge = PointCharge(Point=point_5, Charge=expr("x/100", Slider(1, range=-1..1)), Decay=Slider(-1, range=-1..1))
cluster_2 = Cluster(L=populate_3d_3)
point_8 = Point(<point referenced from the Rhino model>)
point_9 = Point(<point referenced from the Rhino model>)
vector_2pt_3 = Vector2Pt(PointA=dispatch.ListB, PointB=dispatch.ListA, Unitize=False)  # -> Vector, Length
cluster_3 = Cluster(L=populate_3d_4)
rotate = Rotate(Geometry=cluster_3, Angle=expr("x/50", time_2), Plane=PlaneXY(0, 0, 0))  # -> Geometry, Transform
list_item = ListItem(List=populate_3d_5, Index=random_2, Wrap=True)
panel = Panel(list_length)
dispatch_2 = Dispatch(List=vector_2pt_3.Vector, DispatchPattern=[True, False])  # -> ListA, ListB
construct_domain = ConstructDomain(DomainStart=0, DomainEnd=expr("x", number_slider_5))
spin_force = SpinForce(Plane=plane_normal, Strength=Slider(20, range=0..150), Radius=Slider(8, range=0..10), Decay=2)
multiplication = Multiplication(A=time_2, B=10)
point_charge_2 = PointCharge(Point=point_8, Charge=expr("x/100", Slider(-0.001, range=-50.001..50)), Decay=Slider(0.35, range=0..100))
point_charge_3 = PointCharge(Point=point_9, Charge=expr("x/100", Slider(0.001, range=-50.001..50)), Decay=Slider(0, range=0..100))
random_3 = Random(Range=construct_domain, Number=number_slider, Seed=31)
addition = Addition(A=multiplication, B=random_3)
merge_fields = MergeFields(Fields=flatten([point_charge, spin_force]))
subtraction = Subtraction(A=multiplication, B=random_3)
modulus = Modulus(A=subtraction, B=number_slider_5)
rectangle = Rectangle(Plane=PlaneXY(0, 0, 0), XSize=Domain(0, 20), YSize=Domain(0, 20), Radius=0)  # -> Rectangle, Length
number_slider_6 = Slider(5, range=0..10)
move_2 = Move(Geometry=rectangle.Rectangle, Motion=Vector(0, 0, 15))  # -> Geometry, Transform
field_line = FieldLine(Field=merge_fields, Point=populate_3d_5, Steps=number_slider_5, Accuracy=0.1, Method=3)
divide_curve = DivideCurve(Curve=field_line, Count=1, Kinks=False)  # -> Points, Tangents, Parameters
dispatch_3 = Dispatch(List=divide_curve.Points, DispatchPattern=[True, False])  # -> flatten(ListA), ListB
evaluate_curve = EvaluateCurve(Curve=field_line, Parameter=modulus)  # -> flatten(Point), Tangent, Angle
construct_plane = ConstructPlane(Origin=evaluate_curve.Point, XAxis=Vector(1, 0, 0), YAxis=vector_2pt_2.Vector)
evaluate_field = EvaluateField(Field=merge_fields, Point=evaluate_curve.Point)  # -> Tensor, Strength
plane_normal_2 = PlaneNormal(Origin=evaluate_curve.Point, ZAxis=evaluate_field.Tensor)
rotate_3d = Rotate3D(Geometry=evaluate_field.Tensor, Angle=1.570796327, Center=evaluate_curve.Point, Axis=cluster_2)  # -> Geometry, Transform
construct_plane_2 = ConstructPlane(Origin=evaluate_curve.Point, XAxis=dispatch_2.ListA, YAxis=dispatch_2.ListB)
plane_normal_3 = PlaneNormal(Origin=evaluate_curve.Point, ZAxis=rotate_3d.Geometry)
plane_normal_4 = PlaneNormal(Origin=evaluate_curve.Point, ZAxis=rotate.Geometry)
dispatch_4 = Dispatch(List=evaluate_curve.Point, DispatchPattern=[True, False])  # -> ListA, ListB
point_charge_4 = PointCharge(Point=dispatch_4.ListA, Charge=expr("x/1000", Slider(0, range=-50..50)), Decay=Slider(2, range=0..100))
list_item_2 = ListItem(List=point_charge_4, Index=5, Wrap=True)
point_charge_5 = PointCharge(Point=dispatch_4.ListB, Charge=expr("x/1000", Slider(-1, range=-50..50)), Decay=Slider(2, range=-10..10))  # disabled
construct_domain_2 = ConstructDomain(DomainStart=450, DomainEnd=700)
deconstruct = Deconstruct(Point=evaluate_curve.Point)  # -> XComponent, YComponent, ZComponent
graph_mapper = GraphMapper(deconstruct.ZComponent, x0=10, x1=200, y0=0, y1=18, container_name="Bezier", cpx=[0, 0, 1, 1], cpy=[0, 1, 1, 0])
spin_force_2 = SpinForce(
    Plane=plane_normal_3,
    Strength=expr("x/100", Slider(0.01, range=0..1)),
    Radius=graph_mapper,
    Decay=Slider(2, range=0..100))
merge_fields_2 = MergeFields(Fields=flatten([spin_force_2, point_charge_3, point_charge_2]))
field_line_2 = FieldLine(Field=merge_fields_2, Point=point_6, Steps=8000, Accuracy=0.1, Method=1)
tensor_display = TensorDisplay(Field=merge_fields_2, Section=move_2.Geometry, Samples=1000)
length = Length(Curve=field_line_2)
rebuild_curve = RebuildCurve(Curve=field_line_2, Degree=2, Count=10, Tangents=False)  # disabled
bounds = Bounds(Numbers=length)
divide_distance = DivideDistance(Curve=field_line_2)  # -> Points, Tangents, Parameters
number_slider_7 = Slider(55, range=0..100)
construct_plane_3 = ConstructPlane(Origin=Point(0, 0, 0), XAxis=Vector(1, 0, 0), YAxis=Vector(0, 1, 0))  # disabled
point_10 = Point(<point referenced from the Rhino model>)  # disabled
polyline = PolyLine(Vertices=[Point(0, 0, 0), Point(0, 0, 200)], Closed=False)
remap_numbers = RemapNumbers(Value=length, Source=bounds, Target=Domain(0, 1))  # -> Mapped, Clipped
curve_closest_point = CurveClosestPoint(Point=point_10, Curve=field_line_2)  # -> Point, Parameter, Distance; disabled
move_3 = Move(Geometry=construct_plane_3, Motion=Vector(0, 0, 80))  # -> Geometry, Transform; disabled
linear_array_2 = LinearArray(Geometry=polyline, Direction=Vector(4, 0, 0), Count=6)  # -> flatten(Geometry), Transform
curve_plane = CurvePlane(Curve=field_line_2, Plane=move_3.Geometry)  # -> Points, ParamsC, ParamsP; disabled
gradient = Gradient(
    LowerLimit=0,
    UpperLimit=1,
    Parameter=remap_numbers.Mapped,
    stops=[0: RGB(255, 0, 0), 0.5: RGB(255, 255, 0), 1: RGB(173, 255, 47)])
linear_array_3 = LinearArray(Geometry=linear_array_2.Geometry, Direction=Vector(0, 4, 0), Count=6)  # -> flatten(Geometry), Transform
tween_curve = TweenCurve(CurveA=field_line_2, CurveB=linear_array_3.Geometry, Factor=Slider(0, range=0..1), BlendType=0)
custom_preview = CustomPreview(Geometry=field_line_2, Material=gradient)
list_item_3 = ListItem(List=field_line_2, Index=number_slider_7, Wrap=True)
list_item_4 = ListItem(List=linear_array_3.Geometry, Index=number_slider_7, Wrap=True)
point_on_curve = PointOnCurve(list_item_3, parameter=0.476)
list_item_5 = ListItem(Index=10, Wrap=True)
points_trim_curve = PointsTrimCurve(Curve=list_item_3, Points=point_on_curve, Flip=False)  # -> Trimmed, SubDomains, Intersected
series_2 = Series(Start=0, Step=0.1, Count=10)
tween_curve_2 = TweenCurve(CurveA=points_trim_curve.Trimmed, CurveB=list_item_4, Factor=series_2, BlendType=0)
divide_curve_2 = DivideCurve(Curve=tween_curve_2, Count=Slider(20, range=0..100), Kinks=False)  # -> flatten(Points), Tangents, Parameters
series_3 = Series(Start=1, Step=34, Count=10)  # -> flatten(Series)
list_item_6 = ListItem(List=divide_curve_2.Points, Index=series_3, Wrap=True)  # -> flatten(Item)
polyline_2 = PolyLine(Vertices=list_item_6, Closed=False)

# ==== cluster Cluster
L = ClusterInput()
lng = ListLength(List=L)
random = Random(Range=Domain(-1, 1), Number=lng, Seed=6)
random_2 = Random(Range=Domain(-1, 1), Number=lng, Seed=2)
random_3 = Random(Range=Domain(-1, 1), Number=lng, Seed=12)
vec = VectorXYZ(XComponent=random_2, YComponent=random, ZComponent=random_3)  # -> Vector, Length
V = ClusterOutput(vec.Vector)
