# Grasshopper definition 3dline_v2.gh (Grasshopper 1.0.7)

pt = Point(<point referenced from the Rhino model>)
pt_2 = Point(<point referenced from the Rhino model>)
pop2d = Populate2D(Region={Plane=PlaneXY(0, 0, 0), Size=Domain2(u=0..20, v=0..20)}, Count=100, Seed=1)
box = Box2Pt(PointA=pt, PointB=pt_2, Plane=PlaneXY(0, 0, 0))
recgrid = Rectangular(Plane=PlaneXY(0, 0, 0), SizeX=2, SizeY=2, ExtentX=10, ExtentY=10)  # -> flatten(Cells), Points
pt_3 = Point(<point referenced from the Rhino model>)
pt_4 = Point(<point referenced from the Rhino model>)
pt_5 = Point(<point referenced from the Rhino model>)
pt_6 = Point(recgrid.Points)
arrlinear = LinearArray(Geometry=pt_6, Direction=Vector(0, 0, 1), Count=20)  # -> flatten(Geometry), Transform
bbox = BoundingBox(Content=arrlinear.Geometry, Plane=PlaneXY(0, 0, 0), UnionBox=True)  # -> Box, Box_2
pop3d = Populate3D(Region=bbox.Box, Count=100, Seed=1)
pcharge = PointCharge(Point=pt_3, Charge=expr("x/100", Slider(36.504, range=-1..100)), Decay=Slider(95.838, range=0..100))
pcharge_2 = PointCharge(Point=pt_4, Charge=expr("x/100", Slider(1, range=-1..1)), Decay=Slider(-1, range=-1..1))
fspin = SpinForce(Plane=pt_5, Strength=Slider(13.622, range=0..100), Radius=Slider(10, range=0..10), Decay=2)
mergef = MergeFields(Fields=[pcharge_2, fspin, pcharge])
fline = FieldLine(Field=mergef, Point=pop3d, Steps=Slider(409, range=0..500), Accuracy=0.1, Method=3)
divide = DivideCurve(Curve=fline, Count=1, Kinks=False)  # -> Points, Tangents, Parameters
dispatch = Dispatch(List=divide.Points, DispatchPattern=[True, False])  # -> ListA, ListB
