# Grasshopper definition 3dline_v3.gh (Grasshopper 1.0.7)

time = Slider(0, range=0..100)
pt = Point(<point referenced from the Rhino model>)
pt_2 = Point(<point referenced from the Rhino model>)
pop2d = Populate2D(Region={Plane=PlaneXY(0, 0, 0), Size=Domain2(u=0..20, v=0..20)}, Count=100, Seed=1)
box = Box2Pt(PointA=pt, PointB=pt_2, Plane=PlaneXY(0, 0, 0))
recgrid = Rectangular(Plane=PlaneXY(0, 0, 0), SizeX=1, SizeY=1, ExtentX=20, ExtentY=20)  # -> flatten(Cells), Points
recgrid_2 = Rectangular(Plane=PlaneXY(0, 0, 0), SizeX=2, SizeY=2, ExtentX=10, ExtentY=10)  # -> flatten(Cells), Points
pt_3 = Point(<point referenced from the Rhino model>)
number_slider = Slider(189, range=0..500)
pt_4 = Point(<point referenced from the Rhino model>)
pt_5 = Point(<point referenced from the Rhino model>)
series = Series(Start=0, Step=2, Count=100)
random = Random(Range=Domain(0, 50), Number=10, Seed=Slider(4284, range=0..100000))
pt_6 = Point(recgrid.Points)
pt_7 = Point(recgrid_2.Points)
arrlinear = LinearArray(Geometry=pt_7, Direction=Vector(0, 0, 1), Count=20)  # -> flatten(Geometry), Transform
bbox = BoundingBox(Content=arrlinear.Geometry, Plane=PlaneXY(0, 0, 0), UnionBox=True)  # -> Box, Box_2
pop3d = Populate3D(Region=bbox.Box, Count=50, Seed=1)
pcharge = PointCharge(Point=pt_4, Charge=expr("x/100", Slider(1, range=-1..1)), Decay=Slider(-1, range=-1..1))
trigger = Trigger(Interval=1, TimerInterval=5, Target=[rec, random_2])  # disabled
pcharge_2 = PointCharge(Point=pt_3, Charge=expr("x/100", Slider(36.504, range=-1..100)), Decay=Slider(95.838, range=0..100))
rec = DataRecorder(flatten("1"), DataLimit=-10, RecordData=True)
item = ListItem(List=pop3d, Index=random, Wrap=True)
lng = ListLength(List=rec)
number_slider_2 = Slider(327, range=0..1000)
dom = ConstructDomain(DomainStart=0, DomainEnd=number_slider_2)
random_2 = Random(Range=dom, Number=50, Seed=2)
panel = Panel(lng)
fspin = SpinForce(Plane=pt_5, Strength=Slider(13.622, range=0..100), Radius=Slider(10, range=0..10), Decay=2)
mergef = MergeFields(Fields=[pcharge, fspin, pcharge_2])
addition = Addition(A=panel, B=random_2)
mod = Modulus(A=addition, B=number_slider_2)
fline = FieldLine(Field=mergef, Point=pop3d, Steps=500, Accuracy=0.1, Method=3)
curvepoint = PointOnCurve(fline, parameter=0.207)  # disabled
divide = DivideCurve(Curve=fline, Count=1, Kinks=False)  # -> Points, Tangents, Parameters
dispatch = Dispatch(List=divide.Points, DispatchPattern=[True, False])  # -> ListA, ListB
eval = EvaluateCurve(Curve=fline, Parameter=mod)  # -> Point, Tangent, Angle
pt_8 = Point(eval.Point)
pcharge_3 = PointCharge(Point=pt_8, Charge=expr("x/100", Slider(36.504, range=-1..100)), Decay=Slider(95.838, range=0..100))
fline_2 = FieldLine(Field=pcharge_3, Steps=1000, Accuracy=0.1, Method=3)
