# Grasshopper definition leaf_v1.gh (Grasshopper 1.0.7)

number_slider = Slider(10, range=0..10)
multiplication = Multiplication(A=Slider(0.139, range=0..1), B=number_slider)
multiplication_2 = Multiplication(A=Slider(0.439, range=0..1), B=number_slider)
multiplication_3 = Multiplication(A=Slider(0.737, range=0..1), B=number_slider)
origin = Point(<point referenced from the Rhino model>)
vector_xyz = VectorXYZ(XComponent=0, YComponent=multiplication, ZComponent=0)  # -> Vector, Length
vector_xyz_2 = VectorXYZ(XComponent=0, YComponent=multiplication_3, ZComponent=0)  # -> Vector, Length
vector_xyz_3 = VectorXYZ(XComponent=0, YComponent=number_slider, ZComponent=0)  # -> Vector, Length
vector_xyz_4 = VectorXYZ(XComponent=0, YComponent=multiplication_2, ZComponent=0)  # -> Vector, Length
unit_z = UnitZ(Factor=1)
unit_z_2 = UnitZ(Factor=1)
move = Move(Geometry=origin, Motion=vector_xyz_3.Vector)  # -> flatten(Geometry), Transform
move_2 = Move(Geometry=origin, Motion=vector_xyz_2.Vector)  # -> Geometry, Transform
move_3 = Move(Geometry=origin, Motion=vector_xyz.Vector)  # -> Geometry, Transform
move_4 = Move(Geometry=origin, Motion=vector_xyz_4.Vector)  # -> Geometry, Transform
number_slider_2 = Slider(1, range=0..3)
cross_product = CrossProduct(VectorB=unit_z, Unitize=False)  # -> Vector, Length
cross_product_2 = CrossProduct(VectorB=unit_z_2, Unitize=False)  # -> Vector, Length
vector_xyz_5 = VectorXYZ(XComponent=0, YComponent=Slider(3, range=0..3), ZComponent=0)  # -> Vector, Length
vector_xyz_6 = VectorXYZ(XComponent=0, YComponent=Slider(3, range=0..3), ZComponent=0)  # -> Vector, Length
vector_xyz_7 = VectorXYZ(XComponent=0, YComponent=Slider(3, range=0..3), ZComponent=0)  # -> Vector, Length
multiplication_4 = Multiplication(B=cross_product.Vector)
multiplication_5 = Multiplication(B=cross_product_2.Vector)
move_5 = Move(Geometry=move_2.Geometry, Motion=vector_xyz_6.Vector)  # -> Geometry, Transform
move_6 = Move(Geometry=move_3.Geometry, Motion=vector_xyz_5.Vector)  # -> Geometry, Transform
move_7 = Move(Geometry=move_4.Geometry, Motion=vector_xyz_7.Vector)  # -> Geometry, Transform
rotate_3d = Rotate3D(Geometry=move_7.Geometry, Angle=Slider(-1, range=-3.141..0), Center=move_4.Geometry, Axis=Vector(0, 0, 1))  # -> Geometry, Transform
rotate_3d_2 = Rotate3D(Geometry=move_5.Geometry, Angle=Slider(-1, range=-3.141..0), Center=move_2.Geometry, Axis=Vector(0, 0, 1))  # -> Geometry, Transform
rotate_3d_3 = Rotate3D(Geometry=move_6.Geometry, Angle=Slider(-1, range=-3.141..0), Center=move_3.Geometry, Axis=Vector(0, 0, 1))  # -> Geometry, Transform
md_slider = MDSlider(
    SliderMode=0,
    slider_value=Point(0.5681502179, 0.2592341725, 0.5),
    x_domain=Domain(0, 10),
    y_domain=Domain(0, 10),
    z_domain=Domain(0, 1))
md_slider_2 = MDSlider(
    SliderMode=0,
    slider_value=Point(0.5569882277, 0.2621966106, 0.5),
    x_domain=Domain(0, 10),
    y_domain=Domain(0, 10),
    z_domain=Domain(0, 1))
line = Line(StartPoint=move.Geometry, EndPoint=origin)
explode = Explode(Curve=line, Recursive=True)  # -> Segments, Vertices
split_list = SplitList(List=explode.Vertices, Index=1)  # -> flatten(ListA), flatten(ListB)
nurbs_curve = NurbsCurve(Vertices=[split_list.ListA, md_slider_2, md_slider, split_list.ListB], Degree=3, Periodic=False)  # -> Curve, Length, Domain
bezier_span = BezierSpan(StartPoint=split_list.ListA, StartTangent=md_slider_2, EndPoint=split_list.ListB, EndTangent=md_slider_2)  # -> Curve, Length, Domain
unit_z_3 = UnitZ(Factor=1)
polyline = PolyLine(Vertices=[move.Geometry, move_4.Geometry, rotate_3d.Geometry], Closed=False)
polyline_2 = PolyLine(Vertices=[rotate_3d.Geometry, move_4.Geometry, origin], Closed=False)
divide_length = DivideLength(Curve=bezier_span.Curve, Length=Slider(0.621, range=0..1))  # -> Points, Tangents, Parameters
cross_product_3 = CrossProduct(VectorA=divide_length.Tangents, VectorB=unit_z_3, Unitize=False)  # -> Vector, Length
length_parameter = LengthParameter(Curve=bezier_span.Curve, Parameter=divide_length.Parameters)  # -> expr("x*8", Length), Length_2
graph_mapper = GraphMapper(
    length_parameter.Length,
    x0=0,
    x1=1,
    y0=0,
    y1=5,
    amplitude=0.3052169085,
    container_name="Perlin",
    decay=0.1235439777,
    frequency=0.3037935793,
    x_offset=0.2507518828,
    y_offset=0)
multiplication_6 = Multiplication(A=graph_mapper, B=cross_product_3.Vector)
move_8 = Move(Geometry=divide_length.Points, Motion=expr("x*2", multiplication_6))  # -> Geometry, Transform
polyline_3 = PolyLine(Vertices=[rotate_3d_3.Geometry, move_3.Geometry, origin], Closed=False)
polyline_4 = PolyLine(Vertices=[rotate_3d.Geometry, move_4.Geometry, move_3.Geometry, rotate_3d_3.Geometry], Closed=False)
polyline_5 = PolyLine(Vertices=[move.Geometry, move_4.Geometry, rotate_3d.Geometry], Closed=False)
sine = Sine(Value=length_parameter.Length)
nurbs_curve_2 = NurbsCurve(Vertices=move_8.Geometry, Degree=3, Periodic=False)  # -> Curve, Length, Domain
polyline_6 = PolyLine(Vertices=[rotate_3d_3.Geometry, move_3.Geometry, origin], Closed=False)
polyline_7 = PolyLine(Vertices=[rotate_3d_2.Geometry, move_2.Geometry, move_4.Geometry, rotate_3d.Geometry], Closed=False)
polyline_8 = PolyLine(Vertices=[rotate_3d.Geometry, move_4.Geometry, move_3.Geometry, rotate_3d_3.Geometry], Closed=False)
polyline_9 = PolyLine(Vertices=[move.Geometry, move_2.Geometry, rotate_3d_2.Geometry], Closed=False)
