# Grasshopper definition leaf_v14.gh (Grasshopper 1.0.7)
# plug-ins: Kangaroo2 Components

leaf_size = Slider(18, range=0..40)
branchlenght_a = Slider(4.5, range=0..20)
branchlenght_b = Slider(3.8, range=0..20)
branchangle_c = Slider(1.2, range=-1.57..1.57)
subbranchlenght_b = Slider(0.45, range=0..1)
branchcurvature_1 = Slider(0.85, range=0..1)
branchcount = Slider(1, range=0..10)
# Controls
hummidity = Slider(45.1, range=0..100)
weather_temperature = Slider(25.651, range=0..40)
branchlenght_c = Slider(3.2, range=0..20)
branchangle_a = Slider(1.5, range=-1.57..1.57)
branchangle_b = Slider(1.3, range=-1.57..1.57)
subbranchangle_a = Slider(0.1, range=0..1.57)
subbranchangle_b = Slider(0.1, range=0..1.57)
subbranchangle_c = Slider(0.1, range=0..1.57)
subbranchposition_a = Slider(0.5, range=0..1)
subbranchposition_b = Slider(0.5, range=0..1)
subbranchposition_c = Slider(0.5, range=0..1)
subbranchlenght_a = Slider(0.4, range=0..1)
subbranchlenght_c = Slider(0.45, range=0..1)
branchcurvature_2 = Slider(0.6, range=0..1)
branchcurvature_3 = Slider(0.17, range=0..1)
outeredge = Slider(0.5, range=0..1)
toppoint = Slider(0.47, range=0..1)
midpoint = Slider(0.451, range=0..1)
botpoint = Slider(0.615, range=0..1)
outer_edge_color = ColourSwatch(SwatchColor=RGB(35, 96, 21))
branching = MDSlider(
    SliderMode=0,
    slider_value=Point(0.2745250627, 0.5311132009, 0.5),
    x_domain=Domain(0, 5),
    y_domain=Domain(-1, 5),
    z_domain=Domain(0, 1))
md_slider = MDSlider(
    SliderMode=0,
    slider_value=Point(0.7147818285, 0.3751862171, 0.5),
    x_domain=Domain(-18, 18),
    y_domain=Domain(-18, 18),
    z_domain=Domain(0, 1))
md_slider_2 = MDSlider(
    SliderMode=0,
    slider_value=Point(0.534299781, 0.6346332725, 0.5),
    x_domain=Domain(-18, 18),
    y_domain=Domain(-18, 18),
    z_domain=Domain(0, 1))

swirl = BooleanToggle(False)
vein_color = ColourSwatch(SwatchColor=RGB(157, 197, 94))
body_color = ColourSwatch(SwatchColor=RGB(41, 103, 21))

expression = Expression(x=weather_temperature, Expression="If(x≥5, x/42+0.85714, 1)")
expression_2 = Expression(x=weather_temperature, Expression="If(x≥4, x/22+0.85714, 1)")
expression_3 = Expression(x=weather_temperature, Expression="If(x≥3, x/16+0.85714, 1)")
expression_4 = Expression(x=weather_temperature, Expression="If(x≥0,-x/80+1, 1)")
expression_5 = Expression(x=weather_temperature, Expression="If(x<40,-x/80+1, 1)")
expression_6 = Expression(x=weather_temperature, Expression="If(x≥40,0.5, 1)")
expression_7 = Expression(x=weather_temperature, Expression="If(x≥0,-x/53.333+1, 1)")
expression_8 = Expression(x=weather_temperature, Expression="If(x<40,-x/53.333+1, 1)")
expression_9 = Expression(x=weather_temperature, Expression="If(x≥40,0.25, 1)")
expression_10 = Expression(x=weather_temperature, Expression="If(x≥0,-x/32+1, 1)")
expression_11 = Expression(x=weather_temperature, Expression="If(x<40,-x/32+1, 1)")
expression_12 = Expression(x=weather_temperature, Expression="If(x≥40,-0.25, 1)")
expression_13 = Expression(x=weather_temperature, Expression="If(x≥0,x/15+1, 1)")
expression_14 = Expression(x=weather_temperature, Expression="If(x<15,x/15+1, 1)")
expression_15 = Expression(x=weather_temperature, Expression="If(x≥15,2, 1)")
division = Division(A=hummidity, B=33.333)
division_2 = Division(A=hummidity, B=500)
# Corelation
division_3 = Division(A=weather_temperature, B=110)
addition = Addition(A=division_2, B=1)
subtraction = Subtraction(A=outeredge, B=division_3)
addition_2 = Addition(A=division, B=1)
multiplication = Multiplication(A=subbranchposition_a, B=addition)
multiplication_2 = Multiplication(A=subbranchposition_c, B=addition)
multiplication_3 = Multiplication(A=subbranchposition_b, B=addition)
division_4 = Division(A=hummidity, B=-250)
division_5 = Division(A=hummidity, B=-90)
division_6 = Division(A=hummidity, B=90)
subtraction_2 = Subtraction(A=weather_temperature, B=30)
expression_16 = Expression(x=subtraction_2, Expression="If(x>0,x,0)")
division_7 = Division(A=expression_16, B=10)
multiplication_4 = Multiplication(A=division_4, B=division_7)
multiplication_5 = Multiplication(A=division_5, B=division_7)
multiplication_6 = Multiplication(A=division_6, B=division_7)
gate_and = GateAnd(A=expression_4, C=expression_5)
gate_and_2 = GateAnd(A=expression_13, C=expression_14)
multiplication_7 = Multiplication(A=addition_2, B=subbranchangle_a, C=expression_15, D=expression_14, E=gate_and_2)
multiplication_8 = Multiplication(A=addition_2, B=subbranchangle_b, C=expression_15, D=expression_14, E=gate_and_2)
multiplication_9 = Multiplication(A=addition_2, B=subbranchangle_c, C=expression_15, D=expression_14, E=gate_and_2)
gate_and_3 = GateAnd(A=expression_7, C=expression_8)
gate_and_4 = GateAnd(A=expression_10, C=expression_11)
addition_3 = Addition(A=multiplication_4, B=1)
addition_4 = Addition(A=multiplication_5, B=1)
addition_5 = Addition(A=multiplication_6, B=1)
multiplication_10 = Multiplication(A=expression, B=branchlenght_a)
multiplication_11 = Multiplication(A=expression_2, B=branchlenght_b)
multiplication_12 = Multiplication(A=expression_3, B=branchlenght_c)
multiplication_13 = Multiplication(A=addition_3, B=branchangle_a, C=expression_6, D=expression_5, E=gate_and)
multiplication_14 = Multiplication(A=addition_4, B=branchangle_b, C=expression_9, D=expression_8, E=gate_and_3)
multiplication_15 = Multiplication(A=addition_5, B=branchangle_c, C=expression_12, D=expression_11, E=gate_and_4)
division_8 = Division(A=hummidity, B=100)
division_9 = Division(A=weather_temperature, B=40)
construct_domain = ConstructDomain(DomainStart=-5, DomainEnd=32)
construct_domain_2 = ConstructDomain(DomainStart=0.4, DomainEnd=1)
addition_6 = Addition(A=division_8, B=0.5)
multiplication_16 = Multiplication(A=md_slider_2, B=division_9, C=division_8)
remap_numbers = RemapNumbers(Value=weather_temperature, Source=construct_domain, Target=construct_domain_2)  # -> Mapped, Clipped
multiplication_17 = Multiplication(A=md_slider, B=division_9, C=addition_6)
multiplication_18 = Multiplication(A=leaf_size, B=remap_numbers.Mapped)

construct_point = ConstructPoint(XCoordinate=0, YCoordinate=0, ZCoordinate=0)

# ---- group: Main Branching
multiplication_19 = Multiplication(A=multiplication_18, B=botpoint, C=toppoint)
multiplication_20 = Multiplication(A=multiplication_18, B=toppoint)
# Main Branching
construct_domain_3 = ConstructDomain(DomainStart="0", DomainEnd="1")
construct_domain_4 = ConstructDomain(DomainStart="0", DomainEnd=multiplication_18)
construct_domain_5 = ConstructDomain(DomainStart="0", DomainEnd="1")
construct_domain_6 = ConstructDomain(DomainStart="0", DomainEnd="1")
construct_domain_7 = ConstructDomain(DomainStart="0", DomainEnd=multiplication_19)
remap_numbers_2 = RemapNumbers(Value=toppoint, Source=construct_domain_3, Target=construct_domain_4)  # -> Mapped, Clipped
remap_numbers_3 = RemapNumbers(Value=botpoint, Source=construct_domain_6, Target=construct_domain_7)  # -> Mapped, Clipped
construct_domain_8 = ConstructDomain(DomainStart=remap_numbers_3.Mapped, DomainEnd=multiplication_20)
remap_numbers_4 = RemapNumbers(Value=midpoint, Source=construct_domain_5, Target=construct_domain_8)  # -> Mapped, Clipped
vector_xyz = VectorXYZ(XComponent=0, YComponent=remap_numbers_2.Mapped, ZComponent=0)  # -> Vector, Length
move = Move(Geometry=construct_point, Motion=vector_xyz.Vector)  # -> Geometry, Transform
vector_xyz_2 = VectorXYZ(XComponent=0, YComponent=remap_numbers_4.Mapped, ZComponent=0)  # -> Vector, Length
move_2 = Move(Geometry=construct_point, Motion=vector_xyz_2.Vector)  # -> Geometry, Transform
vector_xyz_3 = VectorXYZ(XComponent=0, YComponent=remap_numbers_3.Mapped, ZComponent=0)  # -> Vector, Length
move_3 = Move(Geometry=construct_point, Motion=vector_xyz_3.Vector)  # -> Geometry, Transform
vector_xyz_4 = VectorXYZ(XComponent=multiplication_10, YComponent=0, ZComponent=0)  # -> Vector, Length
vector_xyz_5 = VectorXYZ(XComponent=multiplication_11, YComponent=0, ZComponent=0)  # -> Vector, Length
vector_xyz_6 = VectorXYZ(XComponent=multiplication_12, YComponent=0, ZComponent=0)  # -> Vector, Length
move_4 = Move(Geometry=move.Geometry, Motion=vector_xyz_4.Vector)  # -> Geometry, Transform
move_5 = Move(Geometry=move_2.Geometry, Motion=vector_xyz_5.Vector)  # -> Geometry, Transform
move_6 = Move(Geometry=move_3.Geometry, Motion=vector_xyz_6.Vector)  # -> Geometry, Transform
rotate_3d = Rotate3D(Geometry=move_4.Geometry, Angle=multiplication_13, Center=move.Geometry, Axis=Vector(0, 0, 1))  # -> Geometry, Transform
rotate_3d_2 = Rotate3D(Geometry=move_5.Geometry, Angle=multiplication_14, Center=move_2.Geometry, Axis=Vector(0, 0, 1))  # -> Geometry, Transform
rotate_3d_3 = Rotate3D(Geometry=move_6.Geometry, Angle=multiplication_15, Center=move_3.Geometry, Axis=Vector(0, 0, 1))  # -> Geometry, Transform
vector_2pt = Vector2Pt(PointA=move.Geometry, PointB=rotate_3d.Geometry, Unitize=False)  # -> Vector, Length
vector_2pt_2 = Vector2Pt(PointA=move_2.Geometry, PointB=rotate_3d_2.Geometry, Unitize=False)  # -> Vector, Length
vector_2pt_3 = Vector2Pt(PointA=move_3.Geometry, PointB=rotate_3d_3.Geometry, Unitize=False)  # -> Vector, Length
multiplication_21 = Multiplication(A=vector_2pt.Vector, B=multiplication)
multiplication_22 = Multiplication(A=vector_2pt.Vector, B=subbranchlenght_a)
multiplication_23 = Multiplication(A=multiplication_7, B=-1)
multiplication_24 = Multiplication(A=vector_2pt_2.Vector, B=multiplication_3)
multiplication_25 = Multiplication(A=vector_2pt_2.Vector, B=subbranchlenght_b)
multiplication_26 = Multiplication(A=vector_2pt_3.Vector, B=multiplication_2)
multiplication_27 = Multiplication(A=multiplication_8, B=-1)
multiplication_28 = Multiplication(A=vector_2pt_3.Vector, B=subbranchlenght_c)
multiplication_29 = Multiplication(A=multiplication_9, B=-1)
move_7 = Move(Geometry=move.Geometry, Motion=multiplication_21)  # -> Geometry, Transform
move_8 = Move(Geometry=move_7.Geometry, Motion=multiplication_22)  # -> Geometry, Transform
move_9 = Move(Geometry=move_2.Geometry, Motion=multiplication_24)  # -> Geometry, Transform
move_10 = Move(Geometry=move_9.Geometry, Motion=multiplication_25)  # -> Geometry, Transform
move_11 = Move(Geometry=move_3.Geometry, Motion=multiplication_26)  # -> Geometry, Transform
move_12 = Move(Geometry=move_11.Geometry, Motion=multiplication_28)  # -> Geometry, Transform
rotate_3d_4 = Rotate3D(Geometry=move_8.Geometry, Angle=multiplication_7, Center=move_7.Geometry, Axis=Vector(0, 0, 1))  # -> Geometry, Transform
rotate_3d_5 = Rotate3D(Geometry=move_8.Geometry, Angle=multiplication_23, Center=move_7.Geometry, Axis=Vector(0, 0, 1))  # -> Geometry, Transform
rotate_3d_6 = Rotate3D(Geometry=move_10.Geometry, Angle=multiplication_8, Center=move_9.Geometry, Axis=Vector(0, 0, 1))  # -> Geometry, Transform
rotate_3d_7 = Rotate3D(Geometry=move_10.Geometry, Angle=multiplication_27, Center=move_9.Geometry, Axis=Vector(0, 0, 1))  # -> Geometry, Transform
rotate_3d_8 = Rotate3D(Geometry=move_12.Geometry, Angle=multiplication_9, Center=move_11.Geometry, Axis=Vector(0, 0, 1))  # -> Geometry, Transform
rotate_3d_9 = Rotate3D(Geometry=move_12.Geometry, Angle=multiplication_29, Center=move_11.Geometry, Axis=Vector(0, 0, 1))  # -> Geometry, Transform

# ----
vector_xyz_7 = VectorXYZ(XComponent=0, YComponent=multiplication_18, ZComponent=0)  # -> Vector, Length
move_13 = Move(Geometry=construct_point, Motion=vector_xyz_7.Vector)  # -> Geometry, Transform

merge = Merge(Data1=[rotate_3d_4.Geometry, move_7.Geometry, rotate_3d.Geometry])
merge_2 = Merge(Data1=[rotate_3d.Geometry, move_7.Geometry, rotate_3d_5.Geometry])
merge_3 = Merge(Data1=[rotate_3d_5.Geometry, move_7.Geometry, move.Geometry, move_2.Geometry, move_9.Geometry, rotate_3d_6.Geometry])
merge_4 = Merge(Data1=[rotate_3d_6.Geometry, move_9.Geometry, rotate_3d_2.Geometry])
merge_5 = Merge(Data1=[rotate_3d_2.Geometry, move_9.Geometry, rotate_3d_7.Geometry])
merge_6 = Merge(Data1=[rotate_3d_7.Geometry, move_9.Geometry, move_2.Geometry, move_3.Geometry, move_11.Geometry, rotate_3d_8.Geometry])
merge_7 = Merge(Data1=[rotate_3d_8.Geometry, move_11.Geometry, rotate_3d_3.Geometry])
merge_8 = Merge(Data1=[rotate_3d_3.Geometry, move_11.Geometry, rotate_3d_9.Geometry])
merge_9 = Merge(Data1=[rotate_3d_9.Geometry, move_11.Geometry, move_3.Geometry, construct_point])
interpolate = Interpolate(
    Vertices=[move_13.Geometry, rotate_3d_4.Geometry, rotate_3d.Geometry, rotate_3d_5.Geometry, rotate_3d_6.Geometry, rotate_3d_2.Geometry, rotate_3d_7.Geometry, rotate_3d_8.Geometry, rotate_3d_3.Geometry, rotate_3d_9.Geometry, construct_point],
    Degree=3,
    Periodic=False,
    KnotStyle=1)  # -> Curve, Length, Domain
merge_10 = Merge(Data1=[move_13.Geometry, move.Geometry, move_7.Geometry, rotate_3d_4.Geometry])
merge_11 = Merge(Data1=[move_13.Geometry, rotate_3d_4.Geometry, rotate_3d.Geometry, rotate_3d_5.Geometry, rotate_3d_6.Geometry, rotate_3d_2.Geometry, rotate_3d_7.Geometry, rotate_3d_8.Geometry, rotate_3d_3.Geometry, rotate_3d_9.Geometry, construct_point])
interpolate_2 = Interpolate(Vertices=merge_10, Degree=1, Periodic=False, KnotStyle=1)  # -> Curve, Length, Domain
interpolate_3 = Interpolate(Vertices=merge, Degree=1, Periodic=False, KnotStyle=1)  # -> Curve, Length, Domain
interpolate_4 = Interpolate(Vertices=merge_2, Degree=1, Periodic=False, KnotStyle=1)  # -> Curve, Length, Domain
interpolate_5 = Interpolate(Vertices=merge_3, Degree=1, Periodic=False, KnotStyle=1)  # -> Curve, Length, Domain
interpolate_6 = Interpolate(Vertices=merge_4, Degree=1, Periodic=False, KnotStyle=1)  # -> Curve, Length, Domain
interpolate_7 = Interpolate(Vertices=merge_5, Degree=1, Periodic=False, KnotStyle=1)  # -> Curve, Length, Domain
interpolate_8 = Interpolate(Vertices=merge_6, Degree=1, Periodic=False, KnotStyle=1)  # -> Curve, Length, Domain
interpolate_9 = Interpolate(Vertices=merge_7, Degree=1, Periodic=False, KnotStyle=1)  # -> Curve, Length, Domain
interpolate_10 = Interpolate(Vertices=merge_8, Degree=1, Periodic=False, KnotStyle=1)  # -> Curve, Length, Domain
interpolate_11 = Interpolate(Vertices=merge_9, Degree=1, Periodic=False, KnotStyle=1)  # -> Curve, Length, Domain
curve_closest_point = CurveClosestPoint(Point=merge_11, Curve=interpolate.Curve)  # -> Point, flatten(Parameter), Distance
nurbs_curve = NurbsCurve(Vertices=merge_10, Degree=3, Periodic=False)  # -> Curve, Length, Domain
nurbs_curve_2 = NurbsCurve(Vertices=merge, Degree=2, Periodic=False)  # -> Curve, Length, Domain
nurbs_curve_3 = NurbsCurve(Vertices=merge_2, Degree=2, Periodic=False)  # -> Curve, Length, Domain
nurbs_curve_4 = NurbsCurve(Vertices=merge_3, Degree=2, Periodic=False)  # -> Curve, Length, Domain
nurbs_curve_5 = NurbsCurve(Vertices=merge_4, Degree=2, Periodic=False)  # -> Curve, Length, Domain
nurbs_curve_6 = NurbsCurve(Vertices=merge_5, Degree=2, Periodic=False)  # -> Curve, Length, Domain
nurbs_curve_7 = NurbsCurve(Vertices=merge_6, Degree=2, Periodic=False)  # -> Curve, Length, Domain
nurbs_curve_8 = NurbsCurve(Vertices=merge_7, Degree=2, Periodic=False)  # -> Curve, Length, Domain
nurbs_curve_9 = NurbsCurve(Vertices=merge_8, Degree=2, Periodic=False)  # -> Curve, Length, Domain
nurbs_curve_10 = NurbsCurve(Vertices=merge_9, Degree=2, Periodic=False)  # -> Curve, Length, Domain
shatter = Shatter(Curve=interpolate.Curve, Parameters=curve_closest_point.Parameter)
merge_12 = Merge(Data1=[nurbs_curve.Curve, nurbs_curve_2.Curve, nurbs_curve_3.Curve, nurbs_curve_4.Curve, nurbs_curve_5.Curve, nurbs_curve_6.Curve, nurbs_curve_7.Curve, nurbs_curve_8.Curve, nurbs_curve_9.Curve, nurbs_curve_10.Curve])
construct_domain_9 = ConstructDomain(DomainStart=0, DomainEnd=9)
tween_curve = TweenCurve(CurveA=shatter, CurveB=merge_12, Factor=branchcurvature_2, BlendType=0)
tween_curve_2 = TweenCurve(CurveA=shatter, CurveB=merge_12, Factor=branchcurvature_1, BlendType=0)
tween_curve_3 = TweenCurve(CurveA=shatter, CurveB=merge_12, Factor=subtraction, BlendType=0)
mirror = Mirror(Geometry=tween_curve_3, Plane=PlaneYZ(0, 0, 0))  # -> Geometry, Transform
range = Range(Domain=construct_domain_9, Steps=9)
list_item = ListItem(List=tween_curve, Index=range, Wrap=True)
list_item_2 = ListItem(List=tween_curve_2, Index=range, Wrap=True)
list_item_3 = ListItem(List=tween_curve_3, Index=range, Wrap=True)
merge_13 = Merge(Data1=[mirror.Geometry, tween_curve_3])
length = Length(Curve=list_item)
expression_17 = Expression(x=length, y=branchcount, Expression="Ceiling(1*x*y)")
multiplication_30 = Multiplication(A=expression_17, B=2)
multiplication_31 = Multiplication(A=expression_17, B=4)
divide_curve = DivideCurve(Curve=list_item, Count=multiplication_30, Kinks=False)  # -> Points, Tangents, Parameters
divide_curve_2 = DivideCurve(Curve=list_item, Count=multiplication_30, Kinks=False)  # -> Points, Tangents, Parameters
divide_curve_3 = DivideCurve(Curve=list_item_2, Count=expression_17, Kinks=False)  # -> Points, Tangents, Parameters
divide_curve_4 = DivideCurve(Curve=list_item_3, Count=multiplication_31, Kinks=False)  # -> Points, Tangents, Parameters
split_list = SplitList(List=divide_curve.Points, Index=1)  # -> ListA, ListB
split_list_2 = SplitList(List=divide_curve_2.Points, Index=1)  # -> ListA, ListB
split_list_3 = SplitList(List=divide_curve_3.Points, Index=1)  # -> ListA, ListB
split_list_4 = SplitList(List=divide_curve_4.Points, Index=1)  # -> ListA, ListB
reverse_list = ReverseList(List=split_list.ListB)
reverse_list_2 = ReverseList(List=split_list_3.ListB)
reverse_list_3 = ReverseList(List=split_list_4.ListB)
reverse_list_4 = ReverseList(List=split_list_2.ListB)
split_list_5 = SplitList(List=reverse_list, Index=2)  # -> ListA, ListB
split_list_6 = SplitList(List=reverse_list_2, Index=1)  # -> ListA, ListB
split_list_7 = SplitList(List=reverse_list_3, Index=2)  # -> ListA, ListB
split_list_8 = SplitList(List=reverse_list_4, Index=1)  # -> ListA, ListB
reverse_list_5 = ReverseList(List=split_list_5.ListB)
reverse_list_6 = ReverseList(List=split_list_6.ListB)
reverse_list_7 = ReverseList(List=split_list_7.ListB)
dispatch = Dispatch(List=reverse_list_5, DispatchPattern=[True, False])  # -> ListA, ListB
reverse_list_8 = ReverseList(List=split_list_8.ListB)
dispatch_2 = Dispatch(List=reverse_list_7, DispatchPattern=[True, False])  # -> ListA, ListB
line = Line(StartPoint=reverse_list_6, EndPoint=dispatch.ListA)
line_2 = Line(StartPoint=reverse_list_6, EndPoint=dispatch.ListB)
line_3 = Line(StartPoint=reverse_list_8, EndPoint=dispatch_2.ListA)
line_4 = Line(StartPoint=reverse_list_8, EndPoint=dispatch_2.ListB)
merge_14 = Merge(Data1=[interpolate_2.Curve, interpolate_3.Curve, interpolate_4.Curve, interpolate_5.Curve, interpolate_6.Curve, interpolate_7.Curve, interpolate_8.Curve, interpolate_9.Curve, interpolate_10.Curve, interpolate_11.Curve])
list_item_4 = ListItem(List=merge_14, Index=range, Wrap=True)
divide_curve_5 = DivideCurve(Curve=list_item_4, Count=expression_17, Kinks=False)  # -> Points, Tangents, Parameters
line_5 = Line(StartPoint=divide_curve_3.Points, EndPoint=divide_curve_5.Points)
merge_15 = Merge(Data1=[merge_14, line, line_2, line_5, line_3, line_4, tween_curve_3])

interpolate_12 = Interpolate(
    Vertices=[move_13.Geometry, rotate_3d_6.Geometry, rotate_3d_2.Geometry, rotate_3d_7.Geometry, construct_point],
    Degree=3,
    Periodic=False,
    KnotStyle=1)  # -> Curve, Length, Domain
merge_16 = Merge(Data1=[move_13.Geometry, move_2.Geometry, move_9.Geometry, rotate_3d_6.Geometry])
merge_17 = Merge(Data1=[rotate_3d_6.Geometry, move_9.Geometry, rotate_3d_2.Geometry])
merge_18 = Merge(Data1=[rotate_3d_2.Geometry, move_9.Geometry, rotate_3d_7.Geometry])
merge_19 = Merge(Data1=[rotate_3d_7.Geometry, move_9.Geometry, move_2.Geometry, construct_point])
curve_closest_point_2 = CurveClosestPoint(
    Point=[move_13.Geometry, rotate_3d_6.Geometry, rotate_3d_2.Geometry, rotate_3d_7.Geometry, construct_point],
    Curve=interpolate_12.Curve)  # -> Point, flatten(Parameter), Distance
interpolate_13 = Interpolate(Vertices=merge_16, Degree=1, Periodic=False, KnotStyle=1)  # -> Curve, Length, Domain
interpolate_14 = Interpolate(Vertices=merge_17, Degree=1, Periodic=False, KnotStyle=1)  # -> Curve, Length, Domain
interpolate_15 = Interpolate(Vertices=merge_18, Degree=1, Periodic=False, KnotStyle=1)  # -> Curve, Length, Domain
interpolate_16 = Interpolate(Vertices=merge_19, Degree=1, Periodic=False, KnotStyle=1)  # -> Curve, Length, Domain
shatter_2 = Shatter(Curve=interpolate_12.Curve, Parameters=curve_closest_point_2.Parameter)
nurbs_curve_11 = NurbsCurve(Vertices=merge_16, Degree=2, Periodic=False)  # -> Curve, Length, Domain
nurbs_curve_12 = NurbsCurve(Vertices=merge_17, Degree=2, Periodic=False)  # -> Curve, Length, Domain
nurbs_curve_13 = NurbsCurve(Vertices=merge_18, Degree=2, Periodic=False)  # -> Curve, Length, Domain
nurbs_curve_14 = NurbsCurve(Vertices=merge_19, Degree=2, Periodic=False)  # -> Curve, Length, Domain
merge_20 = Merge(Data1=[nurbs_curve_11.Curve, nurbs_curve_12.Curve, nurbs_curve_13.Curve, nurbs_curve_14.Curve])
construct_domain_10 = ConstructDomain(DomainStart=0, DomainEnd=9)
tween_curve_4 = TweenCurve(CurveA=shatter_2, CurveB=merge_20, Factor=branchcurvature_2, BlendType=0)
tween_curve_5 = TweenCurve(CurveA=shatter_2, CurveB=merge_20, Factor=branchcurvature_1, BlendType=0)
tween_curve_6 = TweenCurve(CurveA=shatter_2, CurveB=merge_20, Factor=branchcurvature_3, BlendType=0)
mirror_2 = Mirror(Geometry=tween_curve_6, Plane=PlaneYZ(0, 0, 0))  # -> Geometry, Transform
range_2 = Range(Domain=construct_domain_10, Steps=9)
list_item_5 = ListItem(List=tween_curve_4, Index=range_2, Wrap=True)
list_item_6 = ListItem(List=tween_curve_5, Index=range_2, Wrap=True)
list_item_7 = ListItem(List=tween_curve_6, Index=range_2, Wrap=True)
merge_21 = Merge(Data1=[tween_curve_6, mirror_2.Geometry])
length_2 = Length(Curve=list_item_5)
expression_18 = Expression(x=length_2, y=branchcount, Expression="Ceiling(1*x*y)")
multiplication_32 = Multiplication(A=expression_18, B=2)
multiplication_33 = Multiplication(A=expression_18, B=4)
divide_curve_6 = DivideCurve(Curve=list_item_5, Count=multiplication_32, Kinks=False)  # -> Points, Tangents, Parameters
divide_curve_7 = DivideCurve(Curve=list_item_5, Count=multiplication_32, Kinks=False)  # -> Points, Tangents, Parameters
divide_curve_8 = DivideCurve(Curve=list_item_6, Count=expression_18, Kinks=False)  # -> Points, Tangents, Parameters
divide_curve_9 = DivideCurve(Curve=list_item_7, Count=multiplication_33, Kinks=False)  # -> Points, Tangents, Parameters
split_list_9 = SplitList(List=divide_curve_7.Points, Index=1)  # -> ListA, ListB
split_list_10 = SplitList(List=divide_curve_9.Points, Index=1)  # -> ListA, ListB
split_list_11 = SplitList(List=divide_curve_8.Points, Index=1)  # -> ListA, ListB
split_list_12 = SplitList(List=divide_curve_6.Points, Index=1)  # -> ListA, ListB
reverse_list_9 = ReverseList(List=split_list_9.ListB)
reverse_list_10 = ReverseList(List=split_list_12.ListB)
reverse_list_11 = ReverseList(List=split_list_11.ListB)
reverse_list_12 = ReverseList(List=split_list_10.ListB)
split_list_13 = SplitList(List=reverse_list_9, Index=2)  # -> ListA, ListB
split_list_14 = SplitList(List=reverse_list_10, Index=1)  # -> ListA, ListB
split_list_15 = SplitList(List=reverse_list_11, Index=1)  # -> ListA, ListB
split_list_16 = SplitList(List=reverse_list_12, Index=2)  # -> ListA, ListB
reverse_list_13 = ReverseList(List=split_list_13.ListB)
reverse_list_14 = ReverseList(List=split_list_14.ListB)
reverse_list_15 = ReverseList(List=split_list_15.ListB)
reverse_list_16 = ReverseList(List=split_list_16.ListB)
dispatch_3 = Dispatch(List=reverse_list_13, DispatchPattern=[True, False])  # -> ListA, ListB
dispatch_4 = Dispatch(List=reverse_list_16, DispatchPattern=[True, False])  # -> ListA, ListB
merge_22 = Merge(Data1=[interpolate_13.Curve, interpolate_14.Curve, interpolate_15.Curve, interpolate_16.Curve])
list_item_8 = ListItem(List=merge_22, Index=range_2, Wrap=True)
divide_curve_10 = DivideCurve(Curve=list_item_8, Count=expression_18, Kinks=False)  # -> Points, Tangents, Parameters
line_6 = Line(StartPoint=reverse_list_15, EndPoint=dispatch_3.ListA)
line_7 = Line(StartPoint=reverse_list_15, EndPoint=dispatch_3.ListB)
line_8 = Line(StartPoint=divide_curve_8.Points, EndPoint=divide_curve_10.Points)
line_9 = Line(StartPoint=reverse_list_14, EndPoint=dispatch_4.ListA)
line_10 = Line(StartPoint=reverse_list_14, EndPoint=dispatch_4.ListB)
merge_23 = Merge(Data1=[merge_22, line_6, line_7, line_8, line_9, line_10, tween_curve_6])

merge_24 = Merge(Data1=[move_13.Geometry, rotate_3d_6.Geometry, rotate_3d_2.Geometry, rotate_3d_7.Geometry, rotate_3d_8.Geometry, rotate_3d_3.Geometry, rotate_3d_9.Geometry, construct_point])
interpolate_17 = Interpolate(
    Vertices=[move_13.Geometry, rotate_3d_6.Geometry, rotate_3d_2.Geometry, rotate_3d_7.Geometry, rotate_3d_8.Geometry, rotate_3d_3.Geometry, rotate_3d_9.Geometry, construct_point],
    Degree=3,
    Periodic=False,
    KnotStyle=1)  # -> Curve, Length, Domain
merge_25 = Merge(Data1=[move_13.Geometry, move_2.Geometry, move_9.Geometry, rotate_3d_6.Geometry])
merge_26 = Merge(Data1=[rotate_3d_6.Geometry, move_9.Geometry, rotate_3d_2.Geometry])
merge_27 = Merge(Data1=[rotate_3d_2.Geometry, move_9.Geometry, rotate_3d_7.Geometry])
merge_28 = Merge(Data1=[rotate_3d_7.Geometry, move_9.Geometry, move_2.Geometry, move_3.Geometry, move_11.Geometry, rotate_3d_8.Geometry])
merge_29 = Merge(Data1=[rotate_3d_8.Geometry, move_11.Geometry, rotate_3d_3.Geometry])
merge_30 = Merge(Data1=[rotate_3d_3.Geometry, move_11.Geometry, rotate_3d_9.Geometry])
merge_31 = Merge(Data1=[rotate_3d_9.Geometry, move_11.Geometry, move_3.Geometry, construct_point])
interpolate_18 = Interpolate(Vertices=merge_25, Degree=1, Periodic=False, KnotStyle=1)  # -> Curve, Length, Domain
interpolate_19 = Interpolate(Vertices=merge_26, Degree=1, Periodic=False, KnotStyle=1)  # -> Curve, Length, Domain
interpolate_20 = Interpolate(Vertices=merge_27, Degree=1, Periodic=False, KnotStyle=1)  # -> Curve, Length, Domain
interpolate_21 = Interpolate(Vertices=merge_28, Degree=1, Periodic=False, KnotStyle=1)  # -> Curve, Length, Domain
interpolate_22 = Interpolate(Vertices=merge_29, Degree=1, Periodic=False, KnotStyle=1)  # -> Curve, Length, Domain
interpolate_23 = Interpolate(Vertices=merge_30, Degree=1, Periodic=False, KnotStyle=1)  # -> Curve, Length, Domain
interpolate_24 = Interpolate(Vertices=merge_31, Degree=1, Periodic=False, KnotStyle=1)  # -> Curve, Length, Domain
curve_closest_point_3 = CurveClosestPoint(Point=merge_24, Curve=interpolate_17.Curve)  # -> Point, flatten(Parameter), Distance
nurbs_curve_15 = NurbsCurve(Vertices=merge_25, Degree=2, Periodic=False)  # -> Curve, Length, Domain
nurbs_curve_16 = NurbsCurve(Vertices=merge_26, Degree=2, Periodic=False)  # -> Curve, Length, Domain
nurbs_curve_17 = NurbsCurve(Vertices=merge_27, Degree=2, Periodic=False)  # -> Curve, Length, Domain
nurbs_curve_18 = NurbsCurve(Vertices=merge_28, Degree=2, Periodic=False)  # -> Curve, Length, Domain
nurbs_curve_19 = NurbsCurve(Vertices=merge_29, Degree=2, Periodic=False)  # -> Curve, Length, Domain
nurbs_curve_20 = NurbsCurve(Vertices=merge_30, Degree=2, Periodic=False)  # -> Curve, Length, Domain
nurbs_curve_21 = NurbsCurve(Vertices=merge_31, Degree=2, Periodic=False)  # -> Curve, Length, Domain
shatter_3 = Shatter(Curve=interpolate_17.Curve, Parameters=curve_closest_point_3.Parameter)
merge_32 = Merge(Data1=[nurbs_curve_15.Curve, nurbs_curve_16.Curve, nurbs_curve_17.Curve, nurbs_curve_18.Curve, nurbs_curve_19.Curve, nurbs_curve_20.Curve, nurbs_curve_21.Curve])
construct_domain_11 = ConstructDomain(DomainStart=0, DomainEnd=9)
tween_curve_7 = TweenCurve(CurveA=shatter_3, CurveB=merge_32, Factor=branchcurvature_2, BlendType=0)
tween_curve_8 = TweenCurve(CurveA=shatter_3, CurveB=merge_32, Factor=branchcurvature_1, BlendType=0)
tween_curve_9 = TweenCurve(CurveA=shatter_3, CurveB=merge_32, Factor=branchcurvature_3, BlendType=0)
mirror_3 = Mirror(Geometry=tween_curve_9, Plane=PlaneYZ(0, 0, 0))  # -> Geometry, Transform
range_3 = Range(Domain=construct_domain_11, Steps=9)
list_item_9 = ListItem(List=tween_curve_7, Index=range_3, Wrap=True)
list_item_10 = ListItem(List=tween_curve_8, Index=range_3, Wrap=True)
list_item_11 = ListItem(List=tween_curve_9, Index=range_3, Wrap=True)
merge_33 = Merge(Data1=[tween_curve_9, mirror_3.Geometry])
length_3 = Length(Curve=list_item_9)
expression_19 = Expression(x=length_3, y=branchcount, Expression="Ceiling(1*x*y)")
multiplication_34 = Multiplication(A=expression_19, B=4)
multiplication_35 = Multiplication(A=expression_19, B=2)
divide_curve_11 = DivideCurve(Curve=list_item_9, Count=multiplication_35, Kinks=False)  # -> Points, Tangents, Parameters
divide_curve_12 = DivideCurve(Curve=list_item_10, Count=expression_19, Kinks=False)  # -> Points, Tangents, Parameters
divide_curve_13 = DivideCurve(Curve=list_item_9, Count=multiplication_35, Kinks=False)  # -> Points, Tangents, Parameters
divide_curve_14 = DivideCurve(Curve=list_item_11, Count=multiplication_34, Kinks=False)  # -> Points, Tangents, Parameters
split_list_17 = SplitList(List=divide_curve_11.Points, Index=1)  # -> ListA, ListB
split_list_18 = SplitList(List=divide_curve_12.Points, Index=1)  # -> ListA, ListB
split_list_19 = SplitList(List=divide_curve_14.Points, Index=1)  # -> ListA, ListB
split_list_20 = SplitList(List=divide_curve_13.Points, Index=1)  # -> ListA, ListB
reverse_list_17 = ReverseList(List=split_list_17.ListB)
reverse_list_18 = ReverseList(List=split_list_18.ListB)
reverse_list_19 = ReverseList(List=split_list_19.ListB)
reverse_list_20 = ReverseList(List=split_list_20.ListB)
split_list_21 = SplitList(List=reverse_list_17, Index=2)  # -> ListA, ListB
split_list_22 = SplitList(List=reverse_list_18, Index=1)  # -> ListA, ListB
split_list_23 = SplitList(List=reverse_list_19, Index=2)  # -> ListA, ListB
split_list_24 = SplitList(List=reverse_list_20, Index=1)  # -> ListA, ListB
reverse_list_21 = ReverseList(List=split_list_21.ListB)
reverse_list_22 = ReverseList(List=split_list_22.ListB)
reverse_list_23 = ReverseList(List=split_list_23.ListB)
reverse_list_24 = ReverseList(List=split_list_24.ListB)
dispatch_5 = Dispatch(List=reverse_list_23, DispatchPattern=[True, False])  # -> ListA, ListB
dispatch_6 = Dispatch(List=reverse_list_21, DispatchPattern=[True, False])  # -> ListA, ListB
line_11 = Line(StartPoint=reverse_list_22, EndPoint=dispatch_6.ListA)
line_12 = Line(StartPoint=reverse_list_22, EndPoint=dispatch_6.ListB)
line_13 = Line(StartPoint=reverse_list_24, EndPoint=dispatch_5.ListA)
line_14 = Line(StartPoint=reverse_list_24, EndPoint=dispatch_5.ListB)
merge_34 = Merge(Data1=[interpolate_18.Curve, interpolate_19.Curve, interpolate_20.Curve, interpolate_21.Curve, interpolate_22.Curve, interpolate_23.Curve, interpolate_24.Curve])
list_item_12 = ListItem(List=merge_34, Index=range_3, Wrap=True)
divide_curve_15 = DivideCurve(Curve=list_item_12, Count=expression_19, Kinks=False)  # -> Points, Tangents, Parameters
line_15 = Line(StartPoint=divide_curve_12.Points, EndPoint=divide_curve_15.Points)
merge_35 = Merge(Data1=[merge_34, line_11, line_12, line_15, line_13, line_14, tween_curve_9])

# ----
# Sub-Branches
interpolate_25 = Interpolate(
    Vertices=[move_13.Geometry, rotate_3d.Geometry, rotate_3d_2.Geometry, rotate_3d_3.Geometry, construct_point],
    Degree=3,
    Periodic=False,
    KnotStyle=1)  # -> Curve, Length, Domain
merge_36 = Merge(Data1=[move_13.Geometry, rotate_3d.Geometry, rotate_3d_2.Geometry, rotate_3d_3.Geometry, construct_point])
merge_37 = Merge(Data1=[move_13.Geometry, move.Geometry, rotate_3d.Geometry])
merge_38 = Merge(Data1=[rotate_3d.Geometry, move.Geometry, move_2.Geometry, rotate_3d_2.Geometry])
merge_39 = Merge(Data1=[rotate_3d_2.Geometry, move_2.Geometry, move_3.Geometry, rotate_3d_3.Geometry])
merge_40 = Merge(Data1=[rotate_3d_3.Geometry, move_3.Geometry, construct_point])
interpolate_26 = Interpolate(Vertices=merge_37, Degree=1, Periodic=False, KnotStyle=1)  # -> Curve, Length, Domain
interpolate_27 = Interpolate(Vertices=merge_38, Degree=1, Periodic=False, KnotStyle=1)  # -> Curve, Length, Domain
interpolate_28 = Interpolate(Vertices=merge_39, Degree=1, Periodic=False, KnotStyle=1)  # -> Curve, Length, Domain
interpolate_29 = Interpolate(Vertices=merge_40, Degree=1, Periodic=False, KnotStyle=1)  # -> Curve, Length, Domain
curve_closest_point_4 = CurveClosestPoint(Point=merge_36, Curve=interpolate_25.Curve)  # -> Point, flatten(Parameter), Distance
nurbs_curve_22 = NurbsCurve(Vertices=merge_37, Degree=2, Periodic=False)  # -> Curve, Length, Domain
nurbs_curve_23 = NurbsCurve(Vertices=merge_40, Degree=2, Periodic=False)  # -> Curve, Length, Domain
nurbs_curve_24 = NurbsCurve(Vertices=merge_38, Degree=2, Periodic=False)  # -> Curve, Length, Domain
nurbs_curve_25 = NurbsCurve(Vertices=merge_39, Degree=2, Periodic=False)  # -> Curve, Length, Domain
shatter_4 = Shatter(Curve=interpolate_25.Curve, Parameters=curve_closest_point_4.Parameter)
merge_41 = Merge(Data1=[nurbs_curve_22.Curve, nurbs_curve_24.Curve, nurbs_curve_25.Curve, nurbs_curve_23.Curve])
construct_domain_12 = ConstructDomain(DomainStart=0, DomainEnd=9)
tween_curve_10 = TweenCurve(CurveA=shatter_4, CurveB=merge_41, Factor=branchcurvature_2, BlendType=0)
tween_curve_11 = TweenCurve(CurveA=shatter_4, CurveB=merge_41, Factor=branchcurvature_1, BlendType=0)
tween_curve_12 = TweenCurve(CurveA=shatter_4, CurveB=merge_41, Factor=subtraction, BlendType=0)
mirror_4 = Mirror(Geometry=tween_curve_12, Plane=PlaneYZ(0, 0, 0))  # -> Geometry, Transform
range_4 = Range(Domain=construct_domain_12, Steps=9)
list_item_13 = ListItem(List=tween_curve_10, Index=range_4, Wrap=True)
list_item_14 = ListItem(List=tween_curve_11, Index=range_4, Wrap=True)
list_item_15 = ListItem(List=tween_curve_12, Index=range_4, Wrap=True)
merge_42 = Merge(Data1=[tween_curve_12, mirror_4.Geometry])
length_4 = Length(Curve=list_item_13)
expression_20 = Expression(x=length_4, y=branchcount, Expression="Ceiling(1*x*y)")
multiplication_36 = Multiplication(A=expression_20, B=2)
multiplication_37 = Multiplication(A=expression_20, B=4)
divide_curve_16 = DivideCurve(Curve=list_item_13, Count=multiplication_36, Kinks=False)  # -> Points, Tangents, Parameters
divide_curve_17 = DivideCurve(Curve=list_item_14, Count=expression_20, Kinks=False)  # -> Points, Tangents, Parameters
divide_curve_18 = DivideCurve(Curve=list_item_15, Count=multiplication_37, Kinks=False)  # -> Points, Tangents, Parameters
divide_curve_19 = DivideCurve(Curve=list_item_13, Count=multiplication_36, Kinks=False)  # -> Points, Tangents, Parameters
split_list_25 = SplitList(List=divide_curve_16.Points, Index=1)  # -> ListA, ListB
split_list_26 = SplitList(List=divide_curve_17.Points, Index=1)  # -> ListA, ListB
split_list_27 = SplitList(List=divide_curve_18.Points, Index=1)  # -> ListA, ListB
split_list_28 = SplitList(List=divide_curve_19.Points, Index=1)  # -> ListA, ListB
reverse_list_25 = ReverseList(List=split_list_25.ListB)
reverse_list_26 = ReverseList(List=split_list_26.ListB)
reverse_list_27 = ReverseList(List=split_list_27.ListB)
reverse_list_28 = ReverseList(List=split_list_28.ListB)
split_list_29 = SplitList(List=reverse_list_25, Index=2)  # -> ListA, ListB
split_list_30 = SplitList(List=reverse_list_26, Index=1)  # -> ListA, ListB
split_list_31 = SplitList(List=reverse_list_27, Index=2)  # -> ListA, ListB
split_list_32 = SplitList(List=reverse_list_28, Index=1)  # -> ListA, ListB
reverse_list_29 = ReverseList(List=split_list_29.ListB)
reverse_list_30 = ReverseList(List=split_list_30.ListB)
reverse_list_31 = ReverseList(List=split_list_31.ListB)
reverse_list_32 = ReverseList(List=split_list_32.ListB)
dispatch_7 = Dispatch(List=reverse_list_31, DispatchPattern=[True, False])  # -> ListA, ListB
dispatch_8 = Dispatch(List=reverse_list_29, DispatchPattern=[True, False])  # -> ListA, ListB
merge_43 = Merge(Data1=[interpolate_26.Curve, interpolate_27.Curve, interpolate_28.Curve, interpolate_29.Curve])
list_item_16 = ListItem(List=merge_43, Index=range_4, Wrap=True)
divide_curve_20 = DivideCurve(Curve=list_item_16, Count=expression_20, Kinks=False)  # -> Points, Tangents, Parameters
line_16 = Line(StartPoint=reverse_list_30, EndPoint=dispatch_8.ListA)
line_17 = Line(StartPoint=reverse_list_30, EndPoint=dispatch_8.ListB)
line_18 = Line(StartPoint=divide_curve_17.Points, EndPoint=divide_curve_20.Points)
line_19 = Line(StartPoint=reverse_list_32, EndPoint=dispatch_7.ListA)
line_20 = Line(StartPoint=reverse_list_32, EndPoint=dispatch_7.ListB)
merge_44 = Merge(Data1=[line_16, merge_43, line_17, line_18, line_19, line_20, tween_curve_12])

merge_45 = Merge(Data1=[move_13.Geometry, rotate_3d_2.Geometry, construct_point])
merge_46 = Merge(Data1=[move_13.Geometry, move_2.Geometry, rotate_3d_2.Geometry])
merge_47 = Merge(Data1=[rotate_3d_2.Geometry, move_2.Geometry, construct_point])
interpolate_30 = Interpolate(Vertices=[move_13.Geometry, rotate_3d_2.Geometry, construct_point], Degree=3, Periodic=False, KnotStyle=1)  # -> Curve, Length, Domain
curve_closest_point_5 = CurveClosestPoint(Point=merge_45, Curve=interpolate_30.Curve)  # -> Point, flatten(Parameter), Distance
interpolate_31 = Interpolate(Vertices=merge_46, Degree=1, Periodic=False, KnotStyle=1)  # -> Curve, Length, Domain
interpolate_32 = Interpolate(Vertices=merge_47, Degree=1, Periodic=False, KnotStyle=1)  # -> Curve, Length, Domain
construct_domain_13 = ConstructDomain(DomainStart=0, DomainEnd=9)
shatter_5 = Shatter(Curve=interpolate_30.Curve, Parameters=curve_closest_point_5.Parameter)
nurbs_curve_26 = NurbsCurve(Vertices=merge_46, Degree=2, Periodic=False)  # -> Curve, Length, Domain
nurbs_curve_27 = NurbsCurve(Vertices=merge_47, Degree=2, Periodic=False)  # -> Curve, Length, Domain
merge_48 = Merge(Data1=[nurbs_curve_26.Curve, nurbs_curve_27.Curve])
tween_curve_13 = TweenCurve(CurveA=shatter_5, CurveB=merge_48, Factor=branchcurvature_2, BlendType=0)
tween_curve_14 = TweenCurve(CurveA=shatter_5, CurveB=merge_48, Factor=branchcurvature_1, BlendType=0)
tween_curve_15 = TweenCurve(CurveA=shatter_5, CurveB=merge_48, Factor=subtraction, BlendType=0)
mirror_5 = Mirror(Geometry=tween_curve_15, Plane=PlaneYZ(0, 0, 0))  # -> Geometry, Transform
range_5 = Range(Domain=construct_domain_13, Steps=9)
merge_49 = Merge(Data1=[tween_curve_15, mirror_5.Geometry])
list_item_17 = ListItem(List=tween_curve_13, Index=range_5, Wrap=True)
length_5 = Length(Curve=list_item_17)
list_item_18 = ListItem(List=tween_curve_14, Index=range_5, Wrap=True)
list_item_19 = ListItem(List=tween_curve_15, Index=range_5, Wrap=True)
expression_21 = Expression(x=length_5, y=branchcount, Expression="Ceiling(1*x*y)")
multiplication_38 = Multiplication(A=expression_21, B=2)
multiplication_39 = Multiplication(A=expression_21, B=4)
divide_curve_21 = DivideCurve(Curve=list_item_17, Count=multiplication_38, Kinks=False)  # -> Points, Tangents, Parameters
divide_curve_22 = DivideCurve(Curve=list_item_18, Count=expression_21, Kinks=False)  # -> Points, Tangents, Parameters
divide_curve_23 = DivideCurve(Curve=list_item_19, Count=multiplication_39, Kinks=False)  # -> Points, Tangents, Parameters
divide_curve_24 = DivideCurve(Curve=list_item_17, Count=multiplication_38, Kinks=False)  # -> Points, Tangents, Parameters
split_list_33 = SplitList(List=divide_curve_21.Points, Index=1)  # -> ListA, ListB
split_list_34 = SplitList(List=divide_curve_22.Points, Index=1)  # -> ListA, ListB
split_list_35 = SplitList(List=divide_curve_23.Points, Index=1)  # -> ListA, ListB
split_list_36 = SplitList(List=divide_curve_24.Points, Index=1)  # -> ListA, ListB
reverse_list_33 = ReverseList(List=split_list_33.ListB)
reverse_list_34 = ReverseList(List=split_list_34.ListB)
reverse_list_35 = ReverseList(List=split_list_35.ListB)
reverse_list_36 = ReverseList(List=split_list_36.ListB)
split_list_37 = SplitList(List=reverse_list_33, Index=2)  # -> ListA, ListB
split_list_38 = SplitList(List=reverse_list_34, Index=1)  # -> ListA, ListB
split_list_39 = SplitList(List=reverse_list_35, Index=2)  # -> ListA, ListB
split_list_40 = SplitList(List=reverse_list_36, Index=1)  # -> ListA, ListB
reverse_list_37 = ReverseList(List=split_list_37.ListB)
reverse_list_38 = ReverseList(List=split_list_38.ListB)
reverse_list_39 = ReverseList(List=split_list_39.ListB)
reverse_list_40 = ReverseList(List=split_list_40.ListB)
dispatch_9 = Dispatch(List=reverse_list_37, DispatchPattern=[True, False])  # -> ListA, ListB
dispatch_10 = Dispatch(List=reverse_list_39, DispatchPattern=[True, False])  # -> ListA, ListB
merge_50 = Merge(Data1=[interpolate_31.Curve, interpolate_32.Curve])
list_item_20 = ListItem(List=merge_50, Index=range_5, Wrap=True)
divide_curve_25 = DivideCurve(Curve=list_item_20, Count=expression_21, Kinks=False)  # -> Points, Tangents, Parameters
line_21 = Line(StartPoint=reverse_list_38, EndPoint=dispatch_9.ListA)
line_22 = Line(StartPoint=reverse_list_38, EndPoint=dispatch_9.ListB)
line_23 = Line(StartPoint=divide_curve_22.Points, EndPoint=divide_curve_25.Points)
line_24 = Line(StartPoint=reverse_list_40, EndPoint=dispatch_10.ListA)
line_25 = Line(StartPoint=reverse_list_40, EndPoint=dispatch_10.ListB)
merge_51 = Merge(Data1=[merge_50, line_21, line_22, line_23, line_24, line_25, tween_curve_15])

interpolate_33 = Interpolate(
    Vertices=[move_13.Geometry, rotate_3d_2.Geometry, rotate_3d_3.Geometry, construct_point],
    Degree=3,
    Periodic=False,
    KnotStyle=1)  # -> Curve, Length, Domain
merge_52 = Merge(Data1=[move_13.Geometry, move_2.Geometry, rotate_3d_2.Geometry])
merge_53 = Merge(Data1=[rotate_3d_2.Geometry, move_2.Geometry, move_3.Geometry, rotate_3d_3.Geometry])
merge_54 = Merge(Data1=[rotate_3d_3.Geometry, move_3.Geometry, construct_point])
merge_55 = Merge(Data1=[move_13.Geometry, rotate_3d_2.Geometry, rotate_3d_3.Geometry, construct_point])
curve_closest_point_6 = CurveClosestPoint(Point=merge_55, Curve=interpolate_33.Curve)  # -> Point, flatten(Parameter), Distance
interpolate_34 = Interpolate(Vertices=merge_52, Degree=1, Periodic=False, KnotStyle=1)  # -> Curve, Length, Domain
interpolate_35 = Interpolate(Vertices=merge_53, Degree=1, Periodic=False, KnotStyle=1)  # -> Curve, Length, Domain
interpolate_36 = Interpolate(Vertices=merge_54, Degree=1, Periodic=False, KnotStyle=1)  # -> Curve, Length, Domain
shatter_6 = Shatter(Curve=interpolate_33.Curve, Parameters=curve_closest_point_6.Parameter)
nurbs_curve_28 = NurbsCurve(Vertices=merge_52, Degree=2, Periodic=False)  # -> Curve, Length, Domain
nurbs_curve_29 = NurbsCurve(Vertices=merge_53, Degree=2, Periodic=False)  # -> Curve, Length, Domain
nurbs_curve_30 = NurbsCurve(Vertices=merge_54, Degree=2, Periodic=False)  # -> Curve, Length, Domain
merge_56 = Merge(Data1=[nurbs_curve_28.Curve, nurbs_curve_29.Curve, nurbs_curve_30.Curve])
construct_domain_14 = ConstructDomain(DomainStart=0, DomainEnd=9)
tween_curve_16 = TweenCurve(CurveA=shatter_6, CurveB=merge_56, Factor=branchcurvature_2, BlendType=0)
tween_curve_17 = TweenCurve(CurveA=shatter_6, CurveB=merge_56, Factor=branchcurvature_1, BlendType=0)
tween_curve_18 = TweenCurve(CurveA=shatter_6, CurveB=merge_56, Factor=subtraction, BlendType=0)
mirror_6 = Mirror(Geometry=tween_curve_18, Plane=PlaneYZ(0, 0, 0))  # -> Geometry, Transform
range_6 = Range(Domain=construct_domain_14, Steps=9)
list_item_21 = ListItem(List=tween_curve_16, Index=range_6, Wrap=True)
list_item_22 = ListItem(List=tween_curve_17, Index=range_6, Wrap=True)
list_item_23 = ListItem(List=tween_curve_18, Index=range_6, Wrap=True)
merge_57 = Merge(Data1=[tween_curve_18, mirror_6.Geometry])
length_6 = Length(Curve=list_item_21)
expression_22 = Expression(x=length_6, y=branchcount, Expression="Ceiling(1*x*y)")
multiplication_40 = Multiplication(A=expression_22, B=2)
multiplication_41 = Multiplication(A=expression_22, B=4)
divide_curve_26 = DivideCurve(Curve=list_item_21, Count=multiplication_40, Kinks=False)  # -> Points, Tangents, Parameters
divide_curve_27 = DivideCurve(Curve=list_item_22, Count=expression_22, Kinks=False)  # -> Points, Tangents, Parameters
divide_curve_28 = DivideCurve(Curve=list_item_23, Count=multiplication_41, Kinks=False)  # -> Points, Tangents, Parameters
divide_curve_29 = DivideCurve(Curve=list_item_21, Count=multiplication_40, Kinks=False)  # -> Points, Tangents, Parameters
split_list_41 = SplitList(List=divide_curve_26.Points, Index=1)  # -> ListA, ListB
split_list_42 = SplitList(List=divide_curve_27.Points, Index=1)  # -> ListA, ListB
split_list_43 = SplitList(List=divide_curve_28.Points, Index=1)  # -> ListA, ListB
split_list_44 = SplitList(List=divide_curve_29.Points, Index=1)  # -> ListA, ListB
reverse_list_41 = ReverseList(List=split_list_41.ListB)
reverse_list_42 = ReverseList(List=split_list_42.ListB)
reverse_list_43 = ReverseList(List=split_list_43.ListB)
reverse_list_44 = ReverseList(List=split_list_44.ListB)
split_list_45 = SplitList(List=reverse_list_41, Index=2)  # -> ListA, ListB
split_list_46 = SplitList(List=reverse_list_42, Index=1)  # -> ListA, ListB
split_list_47 = SplitList(List=reverse_list_43, Index=2)  # -> ListA, ListB
split_list_48 = SplitList(List=reverse_list_44, Index=1)  # -> ListA, ListB
reverse_list_45 = ReverseList(List=split_list_45.ListB)
reverse_list_46 = ReverseList(List=split_list_46.ListB)
reverse_list_47 = ReverseList(List=split_list_47.ListB)
reverse_list_48 = ReverseList(List=split_list_48.ListB)
dispatch_11 = Dispatch(List=reverse_list_45, DispatchPattern=[True, False])  # -> ListA, ListB
dispatch_12 = Dispatch(List=reverse_list_47, DispatchPattern=[True, False])  # -> ListA, ListB
merge_58 = Merge(Data1=[interpolate_34.Curve, interpolate_35.Curve, interpolate_36.Curve])
list_item_24 = ListItem(List=merge_58, Index=range_6, Wrap=True)
divide_curve_30 = DivideCurve(Curve=list_item_24, Count=expression_22, Kinks=False)  # -> Points, Tangents, Parameters
line_26 = Line(StartPoint=reverse_list_46, EndPoint=dispatch_11.ListA)
line_27 = Line(StartPoint=reverse_list_46, EndPoint=dispatch_11.ListB)
line_28 = Line(StartPoint=divide_curve_27.Points, EndPoint=divide_curve_30.Points)
line_29 = Line(StartPoint=reverse_list_48, EndPoint=dispatch_12.ListA)
line_30 = Line(StartPoint=reverse_list_48, EndPoint=dispatch_12.ListB)
merge_59 = Merge(Data1=[merge_58, line_26, line_27, line_28, line_29, line_30, tween_curve_18])

construct_domain_15 = ConstructDomain(DomainStart=0, DomainEnd=9)
bezier_span = BezierSpan(StartPoint=move_13.Geometry, StartTangent=multiplication_16, EndPoint=construct_point, EndTangent=multiplication_17)  # -> Curve, Length, Domain
merge_60 = Merge(Data1=move_13.Geometry, Data2=construct_point)
range_7 = Range(Domain=construct_domain_15, Steps=9)
nurbs_curve_31 = NurbsCurve(Vertices=merge_60, Degree=1, Periodic=False)  # -> Curve, Length, Domain
interpolate_37 = Interpolate(Vertices=merge_60, Degree=1, Periodic=False, KnotStyle=1)  # -> Curve, Length, Domain
merge_61 = Merge(Data1=nurbs_curve_31.Curve)
tween_curve_19 = TweenCurve(CurveA=bezier_span.Curve, CurveB=merge_61, Factor=branchcurvature_2, BlendType=0)
tween_curve_20 = TweenCurve(CurveA=bezier_span.Curve, CurveB=merge_61, Factor=branchcurvature_1, BlendType=0)
tween_curve_21 = TweenCurve(CurveA=bezier_span.Curve, CurveB=merge_61, Factor=subtraction, BlendType=0)
mirror_7 = Mirror(Geometry=tween_curve_21, Plane=PlaneYZ(0, 0, 0))  # -> Geometry, Transform
list_item_25 = ListItem(List=tween_curve_19, Index=range_7, Wrap=True)
list_item_26 = ListItem(List=tween_curve_20, Index=range_7, Wrap=True)
list_item_27 = ListItem(List=tween_curve_21, Index=range_7, Wrap=True)
merge_62 = Merge(Data1=[tween_curve_21, mirror_7.Geometry])
length_7 = Length(Curve=list_item_25)
expression_23 = Expression(x=length_7, y=branchcount, Expression="Ceiling(1*x*y)")
multiplication_42 = Multiplication(A=expression_23, B=2)
multiplication_43 = Multiplication(A=expression_23, B=4)
divide_curve_31 = DivideCurve(Curve=list_item_25, Count=multiplication_42, Kinks=False)  # -> Points, Tangents, Parameters
divide_curve_32 = DivideCurve(Curve=list_item_26, Count=expression_23, Kinks=False)  # -> Points, Tangents, Parameters
divide_curve_33 = DivideCurve(Curve=list_item_27, Count=multiplication_43, Kinks=False)  # -> Points, Tangents, Parameters
divide_curve_34 = DivideCurve(Curve=list_item_25, Count=multiplication_42, Kinks=False)  # -> Points, Tangents, Parameters
split_list_49 = SplitList(List=divide_curve_31.Points, Index=1)  # -> ListA, ListB
split_list_50 = SplitList(List=divide_curve_32.Points, Index=1)  # -> ListA, ListB
split_list_51 = SplitList(List=divide_curve_34.Points, Index=1)  # -> ListA, ListB
split_list_52 = SplitList(List=divide_curve_33.Points, Index=1)  # -> ListA, ListB
reverse_list_49 = ReverseList(List=split_list_49.ListB)
reverse_list_50 = ReverseList(List=split_list_50.ListB)
reverse_list_51 = ReverseList(List=split_list_51.ListB)
reverse_list_52 = ReverseList(List=split_list_52.ListB)
split_list_53 = SplitList(List=reverse_list_49, Index=2)  # -> ListA, ListB
split_list_54 = SplitList(List=reverse_list_50, Index=1)  # -> ListA, ListB
split_list_55 = SplitList(List=reverse_list_51, Index=1)  # -> ListA, ListB
split_list_56 = SplitList(List=reverse_list_52, Index=2)  # -> ListA, ListB
reverse_list_53 = ReverseList(List=split_list_53.ListB)
reverse_list_54 = ReverseList(List=split_list_54.ListB)
reverse_list_55 = ReverseList(List=split_list_55.ListB)
reverse_list_56 = ReverseList(List=split_list_56.ListB)
dispatch_13 = Dispatch(List=reverse_list_53, DispatchPattern=[True, False])  # -> ListA, ListB
dispatch_14 = Dispatch(List=reverse_list_56, DispatchPattern=[True, False])  # -> ListA, ListB
merge_63 = Merge(Data1=interpolate_37.Curve)
list_item_28 = ListItem(List=merge_63, Index=range_7, Wrap=True)
divide_curve_35 = DivideCurve(Curve=list_item_28, Count=expression_23, Kinks=False)  # -> Points, Tangents, Parameters
line_31 = Line(StartPoint=reverse_list_54, EndPoint=dispatch_13.ListA)
line_32 = Line(StartPoint=reverse_list_54, EndPoint=dispatch_13.ListB)
line_33 = Line(StartPoint=divide_curve_32.Points, EndPoint=divide_curve_35.Points)
line_34 = Line(StartPoint=reverse_list_55, EndPoint=dispatch_14.ListA)
line_35 = Line(StartPoint=reverse_list_55, EndPoint=dispatch_14.ListB)
merge_64 = Merge(Data1=[line_35, line_34, line_33, line_32, line_31, merge_63, tween_curve_21])

bezier_span_2 = BezierSpan(StartPoint=move_13.Geometry, StartTangent=multiplication_16, EndPoint=construct_point, EndTangent=multiplication_17)  # -> Curve, Length, Domain
merge_65 = Merge(Data1=move_13.Geometry, Data2=construct_point)
nurbs_curve_32 = NurbsCurve(Vertices=merge_65, Degree=1, Periodic=False)  # -> Curve, Length, Domain
merge_66 = Merge(Data1=nurbs_curve_32.Curve)
interpolate_38 = Interpolate(Vertices=merge_65, Degree=1, Periodic=False, KnotStyle=1)  # -> Curve, Length, Domain
tween_curve_22 = TweenCurve(CurveA=bezier_span_2.Curve, CurveB=merge_66, Factor=branchcurvature_2, BlendType=0)
tween_curve_23 = TweenCurve(CurveA=bezier_span_2.Curve, CurveB=merge_66, Factor=subtraction, BlendType=0)
tween_curve_24 = TweenCurve(CurveA=bezier_span_2.Curve, CurveB=merge_66, Factor=branchcurvature_1, BlendType=0)
merge_67 = Merge(Data1=[tween_curve_23, tween_curve_22, tween_curve_24])
mirror_8 = Mirror(Geometry=merge_67, Plane=PlaneYZ(0, 0, 0))  # -> Geometry, Transform
merge_68 = Merge(Data1=[interpolate_38.Curve, tween_curve_23, merge_67])
merge_69 = Merge(Data1=[mirror_8.Geometry, merge_68])

# ----
# Branching Selection
deconstruct = Deconstruct(Point=branching)  # -> XComponent, YComponent, ZComponent
expression_24 = Expression(x=deconstruct.YComponent, Expression="If((x≥3) ,true,false)")
expression_25 = Expression(x=deconstruct.YComponent, Expression="If((x<3) ,true,false)")
expression_26 = Expression(x=deconstruct.YComponent, Expression="If((x≥2) ,true,false)")
expression_27 = Expression(x=deconstruct.YComponent, Expression="If((x<2) ,true,false)")
expression_28 = Expression(x=deconstruct.YComponent, Expression="If((x≥1) ,true,false)")
expression_29 = Expression(x=deconstruct.YComponent, Expression="If((x<1) ,true,false)")
expression_30 = Expression(x=deconstruct.YComponent, Expression="If((x≥0) ,true,false)")
expression_31 = Expression(x=deconstruct.YComponent, Expression="If((x<0) ,true,false)")
expression_32 = Expression(x=deconstruct.YComponent, Expression="If((x≥-1) ,true,false)")
expression_33 = Expression(x=deconstruct.XComponent, Expression="If((x≥3) ,true,false)")
expression_34 = Expression(x=deconstruct.XComponent, Expression="If(x<3,true,false) ")
expression_35 = Expression(x=deconstruct.XComponent, Expression="If(x<3,true,false) ")
gate_and_5 = GateAnd(A=expression_34, B=expression_35)
gate_and_6 = GateAnd(A=expression_25, B=expression_26)
gate_and_7 = GateAnd(A=expression_27, B=expression_28)
gate_and_8 = GateAnd(A=expression_29, B=expression_30)
gate_and_9 = GateAnd(A=expression_31, B=expression_32)
gate_and_10 = GateAnd(A=expression_33, B=expression_24)
gate_and_11 = GateAnd(A=gate_and_6, B=expression_33)
gate_and_12 = GateAnd(A=expression_33, B=gate_and_7)
gate_and_13 = GateAnd(A=expression_33, B=gate_and_8)
gate_and_14 = GateAnd(A=gate_and_9, B=expression_33)
dispatch_15 = Dispatch(List=merge_13, DispatchPattern=gate_and_10)  # -> ListA, ListB
dispatch_16 = Dispatch(List=merge_21, DispatchPattern=gate_and_12)  # -> ListA, ListB
dispatch_17 = Dispatch(List=merge_15, DispatchPattern=gate_and_10)  # -> ListA, ListB
dispatch_18 = Dispatch(List=merge_35, DispatchPattern=gate_and_11)  # -> ListA, ListB
dispatch_19 = Dispatch(List=merge_23, DispatchPattern=gate_and_12)  # -> ListA, ListB
dispatch_20 = Dispatch(List=merge_64, DispatchPattern=gate_and_13)  # -> ListA, ListB
dispatch_21 = Dispatch(List=merge_68, DispatchPattern=gate_and_14)  # -> ListA, ListB
dispatch_22 = Dispatch(List=merge_69, DispatchPattern=gate_and_14)  # -> ListA, ListB
dispatch_23 = Dispatch(List=merge_62, DispatchPattern=gate_and_13)  # -> ListA, ListB
dispatch_24 = Dispatch(List=merge_33, DispatchPattern=gate_and_11)  # -> ListA, ListB
join_curves = JoinCurves(Curves=dispatch_18.ListA, Preserve=False)
join_curves_2 = JoinCurves(Curves=dispatch_19.ListA, Preserve=False)
join_curves_3 = JoinCurves(Curves=dispatch_20.ListA, Preserve=False)
join_curves_4 = JoinCurves(Curves=dispatch_21.ListA, Preserve=False)
join_curves_5 = JoinCurves(Curves=dispatch_17.ListA, Preserve=False)
gate_and_15 = GateAnd(A=gate_and_5, B=expression_24)
gate_and_16 = GateAnd(A=gate_and_5, B=gate_and_6)
gate_and_17 = GateAnd(A=gate_and_5, B=gate_and_7)
gate_and_18 = GateAnd(A=gate_and_5, B=gate_and_8)
gate_and_19 = GateAnd(A=gate_and_9, B=gate_and_5)
dispatch_25 = Dispatch(List=merge_44, DispatchPattern=gate_and_15)  # -> ListA, ListB
dispatch_26 = Dispatch(List=merge_69, DispatchPattern=gate_and_19)  # -> ListA, ListB
dispatch_27 = Dispatch(List=merge_59, DispatchPattern=gate_and_16)  # -> ListA, ListB
dispatch_28 = Dispatch(List=merge_51, DispatchPattern=gate_and_17)  # -> ListA, ListB
dispatch_29 = Dispatch(List=merge_64, DispatchPattern=gate_and_18)  # -> ListA, ListB
dispatch_30 = Dispatch(List=merge_68, DispatchPattern=gate_and_19)  # -> ListA, ListB
dispatch_31 = Dispatch(List=merge_42, DispatchPattern=gate_and_15)  # -> ListA, ListB
dispatch_32 = Dispatch(List=merge_57, DispatchPattern=gate_and_16)  # -> ListA, ListB
dispatch_33 = Dispatch(List=merge_49, DispatchPattern=gate_and_17)  # -> ListA, ListB
dispatch_34 = Dispatch(List=merge_62, DispatchPattern=gate_and_18)  # -> ListA, ListB
join_curves_6 = JoinCurves(Curves=dispatch_25.ListA, Preserve=False)
join_curves_7 = JoinCurves(Curves=dispatch_27.ListA, Preserve=False)
join_curves_8 = JoinCurves(Curves=dispatch_28.ListA, Preserve=False)
join_curves_9 = JoinCurves(Curves=dispatch_29.ListA, Preserve=False)
join_curves_10 = JoinCurves(Curves=dispatch_30.ListA, Preserve=False)
mirror_9 = Mirror(
    Geometry=[join_curves, join_curves_5, join_curves_2, join_curves_6, join_curves_7, join_curves_8, join_curves_9, join_curves_3, join_curves_4, join_curves_10],
    Plane=PlaneYZ(0, 0, 0))  # -> Geometry, Transform

merge_70 = Merge(Data1=[mirror_9.Geometry, join_curves_5, join_curves, join_curves_2, join_curves_3, join_curves_4, join_curves_10, join_curves_9, join_curves_8, join_curves_7, join_curves_6])  # -> flatten(Result)

# ---- group: Swirl
# Swirl
md_slider_3 = MDSlider(
    SliderMode=0,
    slider_value=Point(0.544216249, 0.6271125743, 0.5),
    x_domain=Domain(-15, 15),
    y_domain=Domain(-10, 10),
    z_domain=Domain(0, 1))
md_slider_4 = MDSlider(
    SliderMode=0,
    slider_value=Point(0.4662505359, 0.183240937, 0.5),
    x_domain=Domain(-15, 15),
    y_domain=Domain(-10, 10),
    z_domain=Domain(0, 1))
bezier_span_3 = BezierSpan(StartPoint=construct_point, StartTangent=md_slider_3, EndPoint=move_13.Geometry, EndTangent=md_slider_4)  # -> Curve, Length, Domain
dispatch_35 = Dispatch(List=bezier_span_3.Curve, DispatchPattern=swirl)  # -> ListA, ListB
merge_71 = Merge(Data1=merge_70)  # -> simplify(flatten(Result))
line_36 = Line(StartPoint=construct_point, EndPoint=move_13.Geometry)
merge_72 = Merge(Data1=dispatch_35.ListA)
rebuild_curve = RebuildCurve(Curve=merge_71, Degree=1, Count=200, Tangents=False)
flow = Flow(Geometry=rebuild_curve, Base=line_36, Target=merge_72, ReverseBase=False, ReverseTarget=False, Stretch=True, Rigid=False)
dispatch_36 = Dispatch(List=flow, DispatchPattern=swirl)  # -> ListA, ListB
boundary_surfaces = BoundarySurfaces(Edges=flow)
dispatch_37 = Dispatch(List=boundary_surfaces, DispatchPattern=swirl)  # -> ListA, ListB
custom_preview = CustomPreview(Geometry=dispatch_36.ListA, Material=vein_color)
custom_preview_2 = CustomPreview(Geometry=dispatch_37.ListA, Material=body_color)

# ----
boundary_surfaces_2 = BoundarySurfaces(Edges=merge_70)

# ---- group: VORONOI EXPERIMENTS
end_points = EndPoints(Curve=merge_70)  # -> Start, End; disabled
triremesh = TriRemesh(Geometry=boundary_surfaces_2, Sharp=True, Length=0.5, Iterations=50)  # -> Triangulation, Dual, Creases; disabled
merge_73 = Merge(Data1=end_points.Start, Data2=end_points.End)  # -> flatten(Result); disabled
delaunay_edges = DelaunayEdges(Points=merge_73, Plane=PlaneXY(0, 0, 0))  # -> Connectivity, Edges; disabled
voronoi = Voronoi(Points=merge_73, Radius=2, BruteForceOverride=False)  # disabled
explode = Explode(Curve=voronoi, Recursive=True)  # -> Segments, flatten(Vertices); disabled
point_in_curve = PointInCurve(Point=explode.Vertices, Curve=boundary_surfaces_2)  # -> Relationship, Point; disabled
larger_than = LargerThan(FirstNumber=point_in_curve.Relationship, SecondNumber=1)  # -> LargerThan, OrEqualTo; disabled
dispatch_38 = Dispatch(List=explode.Segments, DispatchPattern=larger_than.LargerThan)  # -> ListA, ListB; disabled
merge_74 = Merge(Data1=dispatch_38.ListA)  # disabled

# ----
dispatch_39 = Dispatch(List=boundary_surfaces_2, DispatchPattern=swirl)  # -> ListA, ListB
dispatch_40 = Dispatch(List=merge_70, DispatchPattern=swirl)  # -> ListA, ListB
dispatch_41 = Dispatch(
    List=[dispatch_15.ListA, dispatch_31.ListA, dispatch_32.ListA, dispatch_24.ListA, dispatch_16.ListA, dispatch_33.ListA, dispatch_23.ListA, dispatch_34.ListA, dispatch_22.ListA, dispatch_26.ListA],
    DispatchPattern=swirl)  # -> ListA, ListB
custom_preview_3 = CustomPreview(Geometry=dispatch_39.ListB, Material=body_color)
custom_preview_4 = CustomPreview(Geometry=dispatch_40.ListB, Material=vein_color)
custom_preview_5 = CustomPreview(Geometry=dispatch_41.ListB, Material=outer_edge_color)
