# Grasshopper definition leaf_v3.gh (Grasshopper 1.0.7)

number_slider = Slider(7, range=0..10)
multiplication = Multiplication(A=Slider(0.146, range=0..1), B=number_slider)
multiplication_2 = Multiplication(A=Slider(0.252, range=0..1), B=number_slider)
multiplication_3 = Multiplication(A=Slider(0.789, range=0..1), B=number_slider)
origin = Point(<point referenced from the Rhino model>)
vector_xyz = VectorXYZ(XComponent=0, YComponent=multiplication, ZComponent=0)  # -> Vector, Length
vector_xyz_2 = VectorXYZ(XComponent=0, YComponent=multiplication_3, ZComponent=0)  # -> Vector, Length
vector_xyz_3 = VectorXYZ(XComponent=0, YComponent=number_slider, ZComponent=0)  # -> Vector, Length
vector_xyz_4 = VectorXYZ(XComponent=0, YComponent=multiplication_2, ZComponent=0)  # -> Vector, Length
move = Move(Geometry=origin, Motion=vector_xyz_2.Vector)  # -> Geometry, Transform
move_2 = Move(Geometry=origin, Motion=vector_xyz.Vector)  # -> Geometry, Transform
move_3 = Move(Geometry=origin, Motion=vector_xyz_4.Vector)  # -> Geometry, Transform
move_4 = Move(Geometry=origin, Motion=vector_xyz_3.Vector)  # -> flatten(Geometry), Transform
number_slider_2 = Slider(1, range=0..3)
point = Point(<point referenced from the Rhino model>)
point_2 = Point(<point referenced from the Rhino model>)
vector_xyz_5 = VectorXYZ(XComponent=0, YComponent=Slider(3, range=0..3), ZComponent=0)  # -> Vector, Length
vector_xyz_6 = VectorXYZ(XComponent=0, YComponent=Slider(3, range=0..3), ZComponent=0)  # -> Vector, Length
point_3 = Point([<point referenced from the Rhino model> x11])
vector_xyz_7 = VectorXYZ(XComponent=0, YComponent=Slider(4.005, range=0..5), ZComponent=0)  # -> Vector, Length
line = Line(StartPoint=point, EndPoint=point_2)
nurbs_curve = NurbsCurve(Vertices=point_3, Degree=Slider(10, range=2..10), Periodic=False)  # -> Curve, Length, Domain
move_5 = Move(Geometry=move.Geometry, Motion=vector_xyz_6.Vector)  # -> Geometry, Transform
move_6 = Move(Geometry=move_2.Geometry, Motion=vector_xyz_5.Vector)  # -> Geometry, Transform
move_7 = Move(Geometry=move_3.Geometry, Motion=vector_xyz_7.Vector)  # -> Geometry, Transform
interpolate = Interpolate(Vertices=point_3, Degree=8, Periodic=False, KnotStyle=1)  # -> Curve, Length, Domain
tween_curve = TweenCurve(CurveA=line, CurveB=interpolate.Curve, Factor=Slider(0.3, range=0..1), BlendType=0)
rotate_3d = Rotate3D(Geometry=move_7.Geometry, Angle=Slider(-0.234, range=-3.141..0), Center=move_3.Geometry, Axis=Vector(0, 0, 1))  # -> Geometry, Transform
rotate_3d_2 = Rotate3D(Geometry=move_5.Geometry, Angle=Slider(-1.016, range=-3.141..0), Center=move.Geometry, Axis=Vector(0, 0, 1))  # -> Geometry, Transform
rotate_3d_3 = Rotate3D(Geometry=move_6.Geometry, Angle=Slider(-1, range=-3.141..0), Center=move_2.Geometry, Axis=Vector(0, 0, 1))  # -> Geometry, Transform
md_slider = MDSlider(
    SliderMode=0,
    slider_value=Point(0.04795353587, 0.2659770686, 0.5),
    x_domain=Domain(0, 10),
    y_domain=Domain(0, 10),
    z_domain=Domain(0, 1))
md_slider_2 = MDSlider(
    SliderMode=0,
    slider_value=Point(0.4914692204, 0.5413993277, 0.5),
    x_domain=Domain(-5, 25),
    y_domain=Domain(-5, 5),
    z_domain=Domain(0, 1))
line_2 = Line(StartPoint=move_4.Geometry, EndPoint=origin)
explode = Explode(Curve=line_2, Recursive=True)  # -> Segments, Vertices
split_list = SplitList(List=explode.Vertices, Index=1)  # -> flatten(ListA), flatten(ListB)
md_slider_3 = MDSlider(
    SliderMode=0,
    slider_value=Point(0.439896002, 0.4020973764, 0.5),
    x_domain=Domain(-5, 25),
    y_domain=Domain(-5, 5),
    z_domain=Domain(0, 1))
bezier_span = BezierSpan(StartPoint=split_list.ListA, StartTangent=md_slider_2, EndPoint=split_list.ListB, EndTangent=md_slider_2)  # -> Curve, Length, Domain
nurbs_curve_2 = NurbsCurve(Vertices=[split_list.ListA, md_slider_2, md_slider, split_list.ListB], Degree=3, Periodic=False)  # -> Curve, Length, Domain
polyline = PolyLine(Vertices=[rotate_3d.Geometry, move_3.Geometry, origin], Closed=False)
polyline_2 = PolyLine(Vertices=[move_4.Geometry, move_3.Geometry, rotate_3d.Geometry], Closed=False)
md_slider_4 = MDSlider(
    SliderMode=0,
    slider_value=Point(0.7929035389, 0.3624193145, 0.5),
    x_domain=Domain(0, 10),
    y_domain=Domain(0, 10),
    z_domain=Domain(0, 1))
explode_2 = Explode(Curve=polyline, Recursive=True)  # -> Segments, Vertices
dispatch = Dispatch(List=explode_2.Vertices, DispatchPattern=[True, False])  # -> ListA, ListB
md_slider_5 = MDSlider(
    SliderMode=0,
    slider_value=Point(0.7369429425, 0.4464959866, 0.5),
    x_domain=Domain(0, 10),
    y_domain=Domain(0, 10),
    z_domain=Domain(0, 1))
explode_3 = Explode(Curve=polyline_2, Recursive=True)  # -> Segments, Vertices
dispatch_2 = Dispatch(List=dispatch.ListA, DispatchPattern=[True, False])  # -> ListA, ListB
point_4 = Point([<point referenced from the Rhino model> x7])
vector_xyz_8 = VectorXYZ(XComponent=md_slider_4, YComponent=md_slider_5, ZComponent=0)  # -> Vector, Length
interpolate_2 = Interpolate(Vertices=point_4, Degree=3, Periodic=False, KnotStyle=1)  # -> Curve, Length, Domain
polyline_3 = PolyLine(Vertices=[rotate_3d_3.Geometry, move_2.Geometry, origin], Closed=False)
polyline_4 = PolyLine(Vertices=[rotate_3d.Geometry, move_3.Geometry, move_2.Geometry, rotate_3d_3.Geometry], Closed=False)
polyline_5 = PolyLine(Vertices=[move_4.Geometry, move_3.Geometry, rotate_3d.Geometry], Closed=False)
explode_4 = Explode(Curve=polyline_2, Recursive=True)  # -> Segments, Vertices
bezier_span_2 = BezierSpan(StartPoint=dispatch_2.ListA, StartTangent=md_slider_3, EndPoint=dispatch_2.ListB, EndTangent=md_slider_3)  # -> Curve, Length, Domain
point_5 = Point(<point referenced from the Rhino model>)
dispatch_3 = Dispatch(List=explode_4.Vertices, DispatchPattern=[True, False])  # -> ListA, ListB
dispatch_4 = Dispatch(List=dispatch_3.ListA, DispatchPattern=[True, False])  # -> ListA, ListB
explode_5 = Explode(Curve=interpolate_2.Curve, Recursive=True)  # -> Segments, Vertices
shatter = Shatter(Curve=interpolate_2.Curve, Parameters=point_5)
line_3 = Line(StartPoint=dispatch_4.ListA, EndPoint=dispatch_4.ListB)
line_4 = Line(StartPoint=dispatch_2.ListA, EndPoint=dispatch_2.ListB)
polyline_6 = PolyLine(Vertices=[rotate_3d_3.Geometry, move_2.Geometry, origin], Closed=False)
polyline_7 = PolyLine(Vertices=[rotate_3d_2.Geometry, move.Geometry, move_3.Geometry, rotate_3d.Geometry], Closed=False)
polyline_8 = PolyLine(Vertices=[rotate_3d.Geometry, move_3.Geometry, move_2.Geometry, rotate_3d_3.Geometry], Closed=False)
kinky_curve = KinkyCurve(Vertices=[dispatch_4.ListA, dispatch_4.ListB, dispatch_2.ListB], Degree=9, Angle=0.2)  # -> Curve, Length, Domain
polyline_9 = PolyLine(Vertices=[move_4.Geometry, move.Geometry, rotate_3d_2.Geometry], Closed=False)
join_curves = JoinCurves(Curves=[line_4, line_3], Preserve=False)
interpolate_3 = Interpolate(Vertices=[dispatch_4.ListA, dispatch_4.ListB, dispatch_2.ListB], Degree=7, Periodic=False, KnotStyle=2)  # -> Curve, Length, Domain
interpolate_t = InterpolateT(
    Vertices=[dispatch_4.ListA, dispatch_4.ListB, dispatch_2.ListB],
    TangentStart=md_slider_4,
    TangentEnd=md_slider_5,
    KnotStyle=1)  # -> Curve, Length, Domain
curve_closest_point = CurveClosestPoint()  # -> Point, Parameter, Distance
bezier_span_3 = BezierSpan(StartPoint=dispatch_4.ListA, StartTangent=md_slider_3, EndPoint=dispatch_4.ListB, EndTangent=md_slider_3)  # -> Curve, Length, Domain
rebuild_curve = RebuildCurve(Curve=join_curves, Degree=5, Count=10, Tangents=False)
length_parameter = LengthParameter(Curve=interpolate_3.Curve, Parameter=rotate_3d.Geometry)  # -> Length, Length_2
curve_closest_point_2 = CurveClosestPoint(Point=rotate_3d.Geometry, Curve=interpolate_3.Curve)  # -> Point, Parameter, Distance
shatter_2 = Shatter(Curve=interpolate_3.Curve, Parameters=length_parameter.Length_2)
tween_curve_2 = TweenCurve(CurveA=interpolate_3.Curve, CurveB=line_2, Factor=0.25, BlendType=0)
tween_curve_3 = TweenCurve(CurveA=interpolate_3.Curve, CurveB=line_2, Factor=0.5, BlendType=0)
tween_curve_4 = TweenCurve(CurveA=interpolate_3.Curve, CurveB=line_2, Factor=0.75, BlendType=0)
shatter_3 = Shatter(Curve=interpolate_3.Curve, Parameters=curve_closest_point_2.Parameter)
nurbs_curve_3 = NurbsCurve(Vertices=explode_3.Vertices, Degree=2, Periodic=False)  # -> Curve, Length, Domain
number_slider_3 = Slider(0.499, range=0..1)
nurbs_curve_4 = NurbsCurve(Vertices=explode_2.Vertices, Degree=2, Periodic=False)  # -> Curve, Length, Domain
tween_curve_5 = TweenCurve(CurveA=nurbs_curve_4.Curve, Factor=0.5, BlendType=0)
list_item = ListItem(List=shatter_3, Index=0, Wrap=True)
list_item_2 = ListItem(List=shatter_3, Index=1, Wrap=True)
tween_curve_6 = TweenCurve(CurveA=nurbs_curve_3.Curve, CurveB=list_item, Factor=number_slider_3, BlendType=0)
tween_curve_7 = TweenCurve(CurveA=nurbs_curve_4.Curve, CurveB=list_item_2, Factor=number_slider_3, BlendType=0)
