# Grasshopper definition leaf_v8.gh (Grasshopper 1.0.7)

number_slider = Slider(23, range=0..40)
number_slider_2 = Slider(0.252, range=0..1)
number_slider_3 = Slider(1, range=0..1)
number_slider_4 = Slider(0.27, range=0..1)
number_slider_5 = Slider(0.171, range=0..1.57)
number_slider_6 = Slider(0.52, range=0..1)
number_slider_7 = Slider(0.824, range=0..1.57)
number_slider_8 = Slider(0.35, range=0..1)
number_slider_9 = Slider(0.66, range=0..1)
number_slider_10 = Slider(0.266, range=0..1.57)
multiplication = Multiplication(A=number_slider, B=number_slider_2)
multiplication_2 = Multiplication(A=number_slider, B=number_slider_2)
multiplication_3 = Multiplication(A=multiplication, B=number_slider_3)
number_slider_11 = Slider(2.517, range=0..10)
construct_domain = ConstructDomain(DomainStart="0", DomainEnd="1")
construct_domain_2 = ConstructDomain(DomainStart="0", DomainEnd=number_slider)
construct_domain_3 = ConstructDomain(DomainStart="0", DomainEnd="1")
construct_domain_4 = ConstructDomain(DomainStart="0", DomainEnd="1")
construct_domain_5 = ConstructDomain(DomainStart="0", DomainEnd=multiplication_3)
remap_numbers = RemapNumbers(Value=number_slider_3, Source=construct_domain_4, Target=construct_domain_5)  # -> Mapped, Clipped
construct_domain_6 = ConstructDomain(DomainStart=remap_numbers.Mapped, DomainEnd=multiplication_2)
remap_numbers_2 = RemapNumbers(Value=Slider(0.065, range=0..1), Source=construct_domain_3, Target=construct_domain_6)  # -> Mapped, Clipped
remap_numbers_3 = RemapNumbers(Value=number_slider_2, Source=construct_domain, Target=construct_domain_2)  # -> Mapped, Clipped
construct_point = ConstructPoint(XCoordinate=0, YCoordinate=0, ZCoordinate=0)
vector_xyz = VectorXYZ(XComponent=0, YComponent=remap_numbers_2.Mapped, ZComponent=0)  # -> Vector, Length
vector_xyz_2 = VectorXYZ(XComponent=0, YComponent=number_slider, ZComponent=0)  # -> Vector, Length
vector_xyz_3 = VectorXYZ(XComponent=0, YComponent=remap_numbers.Mapped, ZComponent=0)  # -> Vector, Length
vector_xyz_4 = VectorXYZ(XComponent=0, YComponent=remap_numbers_3.Mapped, ZComponent=0)  # -> Vector, Length
move = Move(Geometry=construct_point, Motion=vector_xyz_2.Vector)  # -> Geometry, Transform
move_2 = Move(Geometry=construct_point, Motion=vector_xyz.Vector)  # -> Geometry, Transform
move_3 = Move(Geometry=construct_point, Motion=vector_xyz_4.Vector)  # -> Geometry, Transform
move_4 = Move(Geometry=construct_point, Motion=vector_xyz_3.Vector)  # -> Geometry, Transform
line = Line(StartPoint=construct_point, EndPoint=move.Geometry)
vector_xyz_5 = VectorXYZ(XComponent=Slider(10.12, range=0..20), YComponent=0, ZComponent=0)  # -> Vector, Length
number_slider_12 = Slider(2.7, range=0..10)
vector_xyz_6 = VectorXYZ(XComponent=Slider(9.22, range=0..20), YComponent=0, ZComponent=0)  # -> Vector, Length
vector_xyz_7 = VectorXYZ(XComponent=Slider(9.17, range=0..20), YComponent=0, ZComponent=0)  # -> Vector, Length
range = Range(Domain=Domain(0, 1), Steps=10)
curve_domain = CurveDomain(Curve=line)  # -> Curve, Domain
move_5 = Move(Geometry=move_3.Geometry, Motion=vector_xyz_5.Vector)  # -> Geometry, Transform
move_6 = Move(Geometry=move_2.Geometry, Motion=vector_xyz_6.Vector)  # -> Geometry, Transform
move_7 = Move(Geometry=move_4.Geometry, Motion=vector_xyz_7.Vector)  # -> Geometry, Transform
rotate_3d = Rotate3D(Geometry=move_6.Geometry, Angle=Slider(0.6, range=-1.57..1.57), Center=move_2.Geometry, Axis=Vector(0, 0, 1))  # -> Geometry, Transform
rotate_3d_2 = Rotate3D(Geometry=move_5.Geometry, Angle=Slider(1.172, range=-1.57..1.57), Center=move_3.Geometry, Axis=Vector(0, 0, 1))  # -> Geometry, Transform
rotate_3d_3 = Rotate3D(Geometry=move_7.Geometry, Angle=Slider(-0.576, range=-1.57..1.57), Center=move_4.Geometry, Axis=Vector(0, 0, 1))  # -> Geometry, Transform
vector_2pt = Vector2Pt(PointA=move_3.Geometry, PointB=rotate_3d_2.Geometry, Unitize=False)  # -> Vector, Length
vector_2pt_2 = Vector2Pt(PointA=move_4.Geometry, PointB=rotate_3d_3.Geometry, Unitize=False)  # -> Vector, Length
vector_2pt_3 = Vector2Pt(PointA=move_2.Geometry, PointB=rotate_3d.Geometry, Unitize=False)  # -> Vector, Length
multiplication_4 = Multiplication(A=number_slider_5, B=-1)
multiplication_5 = Multiplication(A=vector_2pt_2.Vector, B=Slider(0.55, range=0..1))
multiplication_6 = Multiplication(A=number_slider_7, B=-1)
multiplication_7 = Multiplication(A=vector_2pt.Vector, B=Slider(0.24, range=0..1))
multiplication_8 = Multiplication(A=vector_2pt.Vector, B=Slider(0.54, range=0..1))
multiplication_9 = Multiplication(A=vector_2pt_2.Vector, B=Slider(0.43, range=0..1))
multiplication_10 = Multiplication(A=vector_2pt_3.Vector, B=Slider(0.47, range=0..1))
multiplication_11 = Multiplication(A=number_slider_10, B=-1)
multiplication_12 = Multiplication(A=vector_2pt_3.Vector, B=Slider(0.42, range=0..1))
move_8 = Move(Geometry=move_3.Geometry, Motion=multiplication_7)  # -> Geometry, Transform
move_9 = Move(Geometry=move_4.Geometry, Motion=multiplication_9)  # -> Geometry, Transform
move_10 = Move(Geometry=move_8.Geometry, Motion=multiplication_8)  # -> Geometry, Transform
move_11 = Move(Geometry=move_9.Geometry, Motion=multiplication_5)  # -> Geometry, Transform
move_12 = Move(Geometry=move_2.Geometry, Motion=multiplication_12)  # -> Geometry, Transform
move_13 = Move(Geometry=move_12.Geometry, Motion=multiplication_10)  # -> Geometry, Transform
rotate_3d_4 = Rotate3D(Geometry=move_11.Geometry, Angle=number_slider_7, Center=move_9.Geometry, Axis=Vector(0, 0, 1))  # -> Geometry, Transform
rotate_3d_5 = Rotate3D(Geometry=move_10.Geometry, Angle=multiplication_4, Center=move_8.Geometry, Axis=Vector(0, 0, 1))  # -> Geometry, Transform
rotate_3d_6 = Rotate3D(Geometry=move_11.Geometry, Angle=multiplication_6, Center=move_9.Geometry, Axis=Vector(0, 0, 1))  # -> Geometry, Transform
rotate_3d_7 = Rotate3D(Geometry=move_10.Geometry, Angle=number_slider_5, Center=move_8.Geometry, Axis=Vector(0, 0, 1))  # -> Geometry, Transform
rotate_3d_8 = Rotate3D(Geometry=move_13.Geometry, Angle=number_slider_10, Center=move_12.Geometry, Axis=Vector(0, 0, 1))  # -> Geometry, Transform
rotate_3d_9 = Rotate3D(Geometry=move_13.Geometry, Angle=multiplication_11, Center=move_12.Geometry, Axis=Vector(0, 0, 1))  # -> Geometry, Transform
merge = Merge(Data1=[rotate_3d_8.Geometry, move_12.Geometry, rotate_3d.Geometry])
merge_2 = Merge(Data1=[move.Geometry, move_2.Geometry, move_12.Geometry, rotate_3d_8.Geometry])
merge_3 = Merge(Data1=[rotate_3d_4.Geometry, move_9.Geometry, rotate_3d_3.Geometry])
merge_4 = Merge(Data1=[rotate_3d_9.Geometry, move_12.Geometry, move_2.Geometry, move_4.Geometry, move_9.Geometry, rotate_3d_4.Geometry])
merge_5 = Merge(Data1=[rotate_3d.Geometry, move_12.Geometry, rotate_3d_9.Geometry])
merge_6 = Merge(Data1=[move.Geometry, move_3.Geometry, move_8.Geometry, rotate_3d_7.Geometry])
merge_7 = Merge(Data1=[rotate_3d_7.Geometry, move_8.Geometry, rotate_3d_2.Geometry])
merge_8 = Merge(Data1=[rotate_3d_2.Geometry, move_8.Geometry, rotate_3d_5.Geometry])
merge_9 = Merge(Data1=[rotate_3d_3.Geometry, move_9.Geometry, rotate_3d_6.Geometry])
merge_10 = Merge(Data1=[rotate_3d_6.Geometry, move_9.Geometry, move_4.Geometry, construct_point])
merge_11 = Merge(Data1=[rotate_3d_5.Geometry, move_8.Geometry, move_3.Geometry, move_2.Geometry, move_12.Geometry, rotate_3d_8.Geometry])
merge_12 = Merge(Data1=[rotate_3d_4.Geometry, move_9.Geometry, rotate_3d_3.Geometry])
merge_13 = Merge(Data1=[rotate_3d_9.Geometry, move_12.Geometry, move_2.Geometry, move_4.Geometry, move_9.Geometry, rotate_3d_4.Geometry])
merge_14 = Merge(Data1=[rotate_3d_8.Geometry, move_12.Geometry, rotate_3d.Geometry])
merge_15 = Merge(Data1=[rotate_3d.Geometry, move_12.Geometry, rotate_3d_9.Geometry])
merge_16 = Merge(Data1=[rotate_3d_3.Geometry, move_9.Geometry, rotate_3d_6.Geometry])
merge_17 = Merge(Data1=[rotate_3d_6.Geometry, move_9.Geometry, move_4.Geometry, construct_point])
merge_18 = Merge(Data1=[rotate_3d_9.Geometry, move_12.Geometry, move_2.Geometry, construct_point])
merge_19 = Merge(Data1=[rotate_3d.Geometry, move_12.Geometry, rotate_3d_9.Geometry])
interpolate = Interpolate(
    Vertices=[move.Geometry, rotate_3d_8.Geometry, rotate_3d.Geometry, rotate_3d_9.Geometry, rotate_3d_4.Geometry, rotate_3d_3.Geometry, rotate_3d_6.Geometry, construct_point],
    Degree=3,
    Periodic=False,
    KnotStyle=1)  # -> Curve, Length, Domain
merge_20 = Merge(Data1=[rotate_3d_8.Geometry, move_12.Geometry, rotate_3d.Geometry])
merge_21 = Merge(Data1=[move.Geometry, rotate_3d_8.Geometry, rotate_3d.Geometry, rotate_3d_9.Geometry, rotate_3d_4.Geometry, rotate_3d_3.Geometry, rotate_3d_6.Geometry, construct_point])
merge_22 = Merge(Data1=[move.Geometry, move_2.Geometry, move_12.Geometry, rotate_3d_8.Geometry])
interpolate_2 = Interpolate(Vertices=merge_2, Degree=1, Periodic=False, KnotStyle=1)  # -> Curve, Length, Domain
interpolate_3 = Interpolate(Vertices=merge, Degree=1, Periodic=False, KnotStyle=1)  # -> Curve, Length, Domain
interpolate_4 = Interpolate(
    Vertices=[move.Geometry, rotate_3d_8.Geometry, rotate_3d.Geometry, rotate_3d_9.Geometry, construct_point],
    Degree=3,
    Periodic=False,
    KnotStyle=1)  # -> Curve, Length, Domain
interpolate_5 = Interpolate(Vertices=merge_5, Degree=1, Periodic=False, KnotStyle=1)  # -> Curve, Length, Domain
interpolate_6 = Interpolate(Vertices=merge_4, Degree=1, Periodic=False, KnotStyle=1)  # -> Curve, Length, Domain
interpolate_7 = Interpolate(Vertices=merge_3, Degree=1, Periodic=False, KnotStyle=1)  # -> Curve, Length, Domain
interpolate_8 = Interpolate(Vertices=merge_8, Degree=1, Periodic=False, KnotStyle=1)  # -> Curve, Length, Domain
interpolate_9 = Interpolate(Vertices=merge_7, Degree=1, Periodic=False, KnotStyle=1)  # -> Curve, Length, Domain
interpolate_10 = Interpolate(Vertices=merge_15, Degree=1, Periodic=False, KnotStyle=1)  # -> Curve, Length, Domain
interpolate_11 = Interpolate(Vertices=merge_6, Degree=1, Periodic=False, KnotStyle=1)  # -> Curve, Length, Domain
curve_closest_point = CurveClosestPoint(
    Point=[move.Geometry, rotate_3d_8.Geometry, rotate_3d.Geometry, rotate_3d_9.Geometry, construct_point],
    Curve=interpolate_4.Curve)  # -> Point, flatten(Parameter), Distance
interpolate_12 = Interpolate(
    Vertices=[move.Geometry, rotate_3d_7.Geometry, rotate_3d_2.Geometry, rotate_3d_5.Geometry, rotate_3d_8.Geometry, rotate_3d.Geometry, rotate_3d_9.Geometry, rotate_3d_4.Geometry, rotate_3d_3.Geometry, rotate_3d_6.Geometry, construct_point],
    Degree=3,
    Periodic=False,
    KnotStyle=1)  # -> Curve, Length, Domain
interpolate_13 = Interpolate(Vertices=merge_9, Degree=1, Periodic=False, KnotStyle=1)  # -> Curve, Length, Domain
interpolate_14 = Interpolate(Vertices=merge_11, Degree=1, Periodic=False, KnotStyle=1)  # -> Curve, Length, Domain
interpolate_15 = Interpolate(Vertices=merge_10, Degree=1, Periodic=False, KnotStyle=1)  # -> Curve, Length, Domain
interpolate_16 = Interpolate(Vertices=merge_13, Degree=1, Periodic=False, KnotStyle=1)  # -> Curve, Length, Domain
interpolate_17 = Interpolate(Vertices=merge_14, Degree=1, Periodic=False, KnotStyle=1)  # -> Curve, Length, Domain
interpolate_18 = Interpolate(Vertices=merge_12, Degree=1, Periodic=False, KnotStyle=1)  # -> Curve, Length, Domain
interpolate_19 = Interpolate(Vertices=merge_16, Degree=1, Periodic=False, KnotStyle=1)  # -> Curve, Length, Domain
interpolate_20 = Interpolate(Vertices=merge_17, Degree=1, Periodic=False, KnotStyle=1)  # -> Curve, Length, Domain
interpolate_21 = Interpolate(Vertices=merge_22, Degree=1, Periodic=False, KnotStyle=1)  # -> Curve, Length, Domain
interpolate_22 = Interpolate(Vertices=merge_20, Degree=1, Periodic=False, KnotStyle=1)  # -> Curve, Length, Domain
interpolate_23 = Interpolate(Vertices=merge_19, Degree=1, Periodic=False, KnotStyle=1)  # -> Curve, Length, Domain
interpolate_24 = Interpolate(Vertices=merge_18, Degree=1, Periodic=False, KnotStyle=1)  # -> Curve, Length, Domain
nurbs_curve = NurbsCurve(Vertices=merge, Degree=2, Periodic=False)  # -> Curve, Length, Domain
nurbs_curve_2 = NurbsCurve(Vertices=merge_2, Degree=2, Periodic=False)  # -> Curve, Length, Domain
nurbs_curve_3 = NurbsCurve(Vertices=merge_3, Degree=2, Periodic=False)  # -> Curve, Length, Domain
nurbs_curve_4 = NurbsCurve(Vertices=merge_4, Degree=2, Periodic=False)  # -> Curve, Length, Domain
nurbs_curve_5 = NurbsCurve(Vertices=merge_10, Degree=2, Periodic=False)  # -> Curve, Length, Domain
nurbs_curve_6 = NurbsCurve(Vertices=merge_11, Degree=2, Periodic=False)  # -> Curve, Length, Domain
nurbs_curve_7 = NurbsCurve(Vertices=merge_12, Degree=2, Periodic=False)  # -> Curve, Length, Domain
nurbs_curve_8 = NurbsCurve(Vertices=merge_14, Degree=2, Periodic=False)  # -> Curve, Length, Domain
nurbs_curve_9 = NurbsCurve(Vertices=merge_13, Degree=2, Periodic=False)  # -> Curve, Length, Domain
nurbs_curve_10 = NurbsCurve(Vertices=merge_5, Degree=2, Periodic=False)  # -> Curve, Length, Domain
nurbs_curve_11 = NurbsCurve(Vertices=merge_17, Degree=2, Periodic=False)  # -> Curve, Length, Domain
nurbs_curve_12 = NurbsCurve(Vertices=merge_8, Degree=2, Periodic=False)  # -> Curve, Length, Domain
nurbs_curve_13 = NurbsCurve(Vertices=merge_9, Degree=2, Periodic=False)  # -> Curve, Length, Domain
nurbs_curve_14 = NurbsCurve(Vertices=merge_7, Degree=2, Periodic=False)  # -> Curve, Length, Domain
nurbs_curve_15 = NurbsCurve(Vertices=merge_6, Degree=3, Periodic=False)  # -> Curve, Length, Domain
nurbs_curve_16 = NurbsCurve(Vertices=merge_15, Degree=2, Periodic=False)  # -> Curve, Length, Domain
nurbs_curve_17 = NurbsCurve(Vertices=merge_16, Degree=2, Periodic=False)  # -> Curve, Length, Domain
nurbs_curve_18 = NurbsCurve(Vertices=merge_20, Degree=2, Periodic=False)  # -> Curve, Length, Domain
nurbs_curve_19 = NurbsCurve(Vertices=merge_22, Degree=2, Periodic=False)  # -> Curve, Length, Domain
nurbs_curve_20 = NurbsCurve(Vertices=merge_19, Degree=2, Periodic=False)  # -> Curve, Length, Domain
nurbs_curve_21 = NurbsCurve(Vertices=merge_18, Degree=2, Periodic=False)  # -> Curve, Length, Domain
curve_closest_point_2 = CurveClosestPoint(Point=merge_21, Curve=interpolate.Curve)  # -> Point, flatten(Parameter), Distance
merge_23 = Merge(Data1=[move.Geometry, rotate_3d_7.Geometry, rotate_3d_2.Geometry, rotate_3d_5.Geometry, rotate_3d_8.Geometry, rotate_3d.Geometry, rotate_3d_9.Geometry, rotate_3d_4.Geometry, rotate_3d_3.Geometry, rotate_3d_6.Geometry, construct_point])
shatter = Shatter(Curve=interpolate_4.Curve, Parameters=curve_closest_point.Parameter)
merge_24 = Merge(Data1=[nurbs_curve_19.Curve, nurbs_curve_18.Curve, nurbs_curve_20.Curve, nurbs_curve_21.Curve])
curve_closest_point_3 = CurveClosestPoint(Point=merge_23, Curve=interpolate_12.Curve)  # -> Point, flatten(Parameter), Distance
shatter_2 = Shatter(Curve=interpolate.Curve, Parameters=curve_closest_point_2.Parameter)
merge_25 = Merge(Data1=[nurbs_curve_2.Curve, nurbs_curve.Curve, nurbs_curve_10.Curve, nurbs_curve_4.Curve, nurbs_curve_3.Curve, nurbs_curve_13.Curve, nurbs_curve_5.Curve])
merge_26 = Merge(Data1=[nurbs_curve_15.Curve, nurbs_curve_14.Curve, nurbs_curve_12.Curve, nurbs_curve_6.Curve, nurbs_curve_8.Curve, nurbs_curve_16.Curve, nurbs_curve_9.Curve, nurbs_curve_7.Curve, nurbs_curve_17.Curve, nurbs_curve_11.Curve])
tween_curve = TweenCurve(CurveA=shatter, CurveB=merge_24, Factor=number_slider_9, BlendType=0)
tween_curve_2 = TweenCurve(CurveA=shatter, CurveB=merge_24, Factor=number_slider_8, BlendType=0)
tween_curve_3 = TweenCurve(CurveA=shatter, CurveB=merge_24, Factor=number_slider_6, BlendType=0)
shatter_3 = Shatter(Curve=interpolate_12.Curve, Parameters=curve_closest_point_3.Parameter)
tween_curve_4 = TweenCurve(CurveA=shatter_2, CurveB=merge_25, Factor=number_slider_9, BlendType=0)
tween_curve_5 = TweenCurve(CurveA=shatter_2, CurveB=merge_25, Factor=number_slider_8, BlendType=0)
tween_curve_6 = TweenCurve(CurveA=shatter_2, CurveB=merge_25, Factor=number_slider_6, BlendType=0)
tween_curve_7 = TweenCurve(CurveA=shatter_3, CurveB=merge_26, Factor=number_slider_4, BlendType=0)
tween_curve_8 = TweenCurve(CurveA=shatter_3, CurveB=merge_26, Factor=number_slider_8, BlendType=0)
tween_curve_9 = TweenCurve(CurveA=shatter_3, CurveB=merge_26, Factor=number_slider_9, BlendType=0)
construct_domain_7 = ConstructDomain(DomainStart=0, DomainEnd=9)
range_2 = Range(Domain=construct_domain_7, Steps=9)
list_item = ListItem(List=tween_curve_7, Index=range_2, Wrap=True)
list_item_2 = ListItem(List=tween_curve_9, Index=range_2, Wrap=True)
list_item_3 = ListItem(List=tween_curve_8, Index=range_2, Wrap=True)
construct_domain_8 = ConstructDomain(DomainStart=0, DomainEnd=9)
range_3 = Range(Domain=construct_domain_8, Steps=9)
construct_domain_9 = ConstructDomain(DomainStart=0, DomainEnd=9)
range_4 = Range(Domain=construct_domain_9, Steps=9)
length = Length(Curve=list_item_3)
list_item_4 = ListItem(List=tween_curve_3, Index=range_3, Wrap=True)
list_item_5 = ListItem(List=tween_curve, Index=range_3, Wrap=True)
list_item_6 = ListItem(List=tween_curve_2, Index=range_3, Wrap=True)
list_item_7 = ListItem(List=tween_curve_6, Index=range_4, Wrap=True)
list_item_8 = ListItem(List=tween_curve_4, Index=range_4, Wrap=True)
list_item_9 = ListItem(List=tween_curve_5, Index=range_4, Wrap=True)
expression = Expression(x=length, y=Slider(1.11, range=0..10), Expression="Ceiling(1*x*y)")
length_2 = Length(Curve=list_item_6)
length_3 = Length(Curve=list_item_9)
multiplication_13 = Multiplication(A=expression, B=2)
multiplication_14 = Multiplication(A=expression, B=4)
expression_2 = Expression(x=length_2, y=Slider(1.39, range=0..10), Expression="Ceiling(1*x*y)")
expression_3 = Expression(x=length_3, y=Slider(1.27, range=0..10), Expression="Ceiling(1*x*y)")
divide_curve = DivideCurve(Curve=list_item_3, Count=multiplication_13, Kinks=False)  # -> Points, Tangents, Parameters
divide_curve_2 = DivideCurve(Curve=list_item_3, Count=multiplication_13, Kinks=False)  # -> Points, Tangents, Parameters
divide_curve_3 = DivideCurve(Curve=list_item_2, Count=expression, Kinks=False)  # -> Points, Tangents, Parameters
divide_curve_4 = DivideCurve(Curve=list_item, Count=multiplication_14, Kinks=False)  # -> Points, Tangents, Parameters
multiplication_15 = Multiplication(A=expression_2, B=2)
multiplication_16 = Multiplication(A=expression_2, B=4)
multiplication_17 = Multiplication(A=expression_3, B=2)
multiplication_18 = Multiplication(A=expression_3, B=4)
divide_curve_5 = DivideCurve(Curve=list_item_6, Count=multiplication_15, Kinks=False)  # -> Points, Tangents, Parameters
divide_curve_6 = DivideCurve(Curve=list_item_6, Count=multiplication_15, Kinks=False)  # -> Points, Tangents, Parameters
divide_curve_7 = DivideCurve(Curve=list_item_9, Count=multiplication_17, Kinks=False)  # -> Points, Tangents, Parameters
divide_curve_8 = DivideCurve(Curve=list_item_9, Count=multiplication_17, Kinks=False)  # -> Points, Tangents, Parameters
divide_curve_9 = DivideCurve(Curve=list_item_5, Count=expression_2, Kinks=False)  # -> Points, Tangents, Parameters
divide_curve_10 = DivideCurve(Curve=list_item_4, Count=multiplication_16, Kinks=False)  # -> Points, Tangents, Parameters
split_list = SplitList(List=divide_curve.Points, Index=1)  # -> ListA, ListB
divide_curve_11 = DivideCurve(Curve=list_item_8, Count=expression_3, Kinks=False)  # -> Points, Tangents, Parameters
split_list_2 = SplitList(List=divide_curve_3.Points, Index=1)  # -> ListA, ListB
divide_curve_12 = DivideCurve(Curve=list_item_7, Count=multiplication_18, Kinks=False)  # -> Points, Tangents, Parameters
split_list_3 = SplitList(List=divide_curve_2.Points, Index=1)  # -> ListA, ListB
split_list_4 = SplitList(List=divide_curve_4.Points, Index=1)  # -> ListA, ListB
reverse_list = ReverseList(List=split_list.ListB)
reverse_list_2 = ReverseList(List=split_list_2.ListB)
reverse_list_3 = ReverseList(List=split_list_3.ListB)
split_list_5 = SplitList(List=divide_curve_5.Points, Index=1)  # -> ListA, ListB
split_list_6 = SplitList(List=divide_curve_9.Points, Index=1)  # -> ListA, ListB
split_list_7 = SplitList(List=divide_curve_6.Points, Index=1)  # -> ListA, ListB
split_list_8 = SplitList(List=divide_curve_7.Points, Index=1)  # -> ListA, ListB
split_list_9 = SplitList(List=divide_curve_11.Points, Index=1)  # -> ListA, ListB
reverse_list_4 = ReverseList(List=split_list_4.ListB)
split_list_10 = SplitList(List=divide_curve_8.Points, Index=1)  # -> ListA, ListB
split_list_11 = SplitList(List=reverse_list, Index=2)  # -> ListA, ListB
split_list_12 = SplitList(List=divide_curve_10.Points, Index=1)  # -> ListA, ListB
split_list_13 = SplitList(List=reverse_list_2, Index=1)  # -> ListA, ListB
split_list_14 = SplitList(List=divide_curve_12.Points, Index=1)  # -> ListA, ListB
split_list_15 = SplitList(List=reverse_list_3, Index=1)  # -> ListA, ListB
reverse_list_5 = ReverseList(List=split_list_5.ListB)
split_list_16 = SplitList(List=reverse_list_4, Index=2)  # -> ListA, ListB
reverse_list_6 = ReverseList(List=split_list_8.ListB)
reverse_list_7 = ReverseList(List=split_list_6.ListB)
reverse_list_8 = ReverseList(List=split_list_7.ListB)
reverse_list_9 = ReverseList(List=split_list_9.ListB)
reverse_list_10 = ReverseList(List=split_list_10.ListB)
reverse_list_11 = ReverseList(List=split_list_11.ListB)
reverse_list_12 = ReverseList(List=split_list_12.ListB)
reverse_list_13 = ReverseList(List=split_list_14.ListB)
split_list_17 = SplitList(List=reverse_list_5, Index=2)  # -> ListA, ListB
reverse_list_14 = ReverseList(List=split_list_13.ListB)
split_list_18 = SplitList(List=reverse_list_6, Index=2)  # -> ListA, ListB
split_list_19 = SplitList(List=reverse_list_7, Index=1)  # -> ListA, ListB
split_list_20 = SplitList(List=reverse_list_8, Index=1)  # -> ListA, ListB
reverse_list_15 = ReverseList(List=split_list_16.ListB)
split_list_21 = SplitList(List=reverse_list_9, Index=1)  # -> ListA, ListB
split_list_22 = SplitList(List=reverse_list_10, Index=1)  # -> ListA, ListB
split_list_23 = SplitList(List=reverse_list_12, Index=2)  # -> ListA, ListB
split_list_24 = SplitList(List=reverse_list_13, Index=2)  # -> ListA, ListB
dispatch = Dispatch(List=reverse_list_11, DispatchPattern=[True, False])  # -> ListA, ListB
reverse_list_16 = ReverseList(List=split_list_17.ListB)
reverse_list_17 = ReverseList(List=split_list_18.ListB)
reverse_list_18 = ReverseList(List=split_list_15.ListB)
reverse_list_19 = ReverseList(List=split_list_19.ListB)
reverse_list_20 = ReverseList(List=split_list_21.ListB)
reverse_list_21 = ReverseList(List=split_list_23.ListB)
dispatch_2 = Dispatch(List=reverse_list_15, DispatchPattern=[True, False])  # -> ListA, ListB
reverse_list_22 = ReverseList(List=split_list_24.ListB)
dispatch_3 = Dispatch(List=reverse_list_16, DispatchPattern=[True, False])  # -> ListA, ListB
dispatch_4 = Dispatch(List=reverse_list_17, DispatchPattern=[True, False])  # -> ListA, ListB
reverse_list_23 = ReverseList(List=split_list_20.ListB)
reverse_list_24 = ReverseList(List=split_list_22.ListB)
dispatch_5 = Dispatch(List=reverse_list_21, DispatchPattern=[True, False])  # -> ListA, ListB
dispatch_6 = Dispatch(List=reverse_list_22, DispatchPattern=[True, False])  # -> ListA, ListB
line_2 = Line(StartPoint=reverse_list_14, EndPoint=dispatch.ListB)
line_3 = Line(StartPoint=reverse_list_14, EndPoint=dispatch.ListA)
line_4 = Line(StartPoint=reverse_list_18, EndPoint=dispatch_2.ListB)
merge_27 = Merge(Data1=[interpolate_11.Curve, interpolate_9.Curve, interpolate_8.Curve, interpolate_14.Curve, interpolate_17.Curve, interpolate_10.Curve, interpolate_16.Curve, interpolate_18.Curve, interpolate_19.Curve, interpolate_20.Curve])
list_item_10 = ListItem(List=merge_27, Index=range_2, Wrap=True)
divide_curve_13 = DivideCurve(Curve=list_item_10, Count=expression, Kinks=False)  # -> Points, Tangents, Parameters
line_5 = Line(StartPoint=divide_curve_3.Points, EndPoint=divide_curve_13.Points)
line_6 = Line(StartPoint=reverse_list_18, EndPoint=dispatch_2.ListA)
boolean_toggle = BooleanToggle(True)
line_7 = Line(StartPoint=reverse_list_19, EndPoint=dispatch_3.ListB)
line_8 = Line(StartPoint=reverse_list_19, EndPoint=dispatch_3.ListA)
line_9 = Line(StartPoint=reverse_list_20, EndPoint=dispatch_4.ListB)
line_10 = Line(StartPoint=reverse_list_23, EndPoint=dispatch_5.ListB)
line_11 = Line(StartPoint=reverse_list_20, EndPoint=dispatch_4.ListA)
line_12 = Line(StartPoint=reverse_list_23, EndPoint=dispatch_5.ListA)
line_13 = Line(StartPoint=reverse_list_24, EndPoint=dispatch_6.ListB)
merge_28 = Merge(Data1=[interpolate_2.Curve, interpolate_3.Curve, interpolate_5.Curve, interpolate_6.Curve, interpolate_7.Curve, interpolate_13.Curve, interpolate_15.Curve])
list_item_11 = ListItem(List=merge_28, Index=range_4, Wrap=True)
divide_curve_14 = DivideCurve(Curve=list_item_11, Count=expression_3, Kinks=False)  # -> Points, Tangents, Parameters
line_14 = Line(StartPoint=divide_curve_11.Points, EndPoint=divide_curve_14.Points)
line_15 = Line(StartPoint=reverse_list_24, EndPoint=dispatch_6.ListA)
merge_29 = Merge(Data1=[interpolate_21.Curve, interpolate_22.Curve, interpolate_23.Curve, interpolate_24.Curve])
list_item_12 = ListItem(List=merge_29, Index=range_3, Wrap=True)
divide_curve_15 = DivideCurve(Curve=list_item_12, Count=expression_2, Kinks=False)  # -> Points, Tangents, Parameters
line_16 = Line(StartPoint=divide_curve_9.Points, EndPoint=divide_curve_15.Points)
merge_30 = Merge(Data1=[merge_27, line_3, line_2, line_5, line_6, line_4, tween_curve_7])
dispatch_7 = Dispatch(List=merge_30, DispatchPattern=boolean_toggle)  # -> ListA, ListB
join_curves = JoinCurves(Curves=dispatch_7.ListA, Preserve=False)
merge_31 = Merge(Data1=[rotate_3d.Geometry, move_2.Geometry, move_4.Geometry, rotate_3d_3.Geometry])
merge_32 = Merge(Data1=[rotate_3d_2.Geometry, move_3.Geometry, move_2.Geometry, rotate_3d.Geometry])
merge_33 = Merge(Data1=[move.Geometry, move_3.Geometry, rotate_3d_2.Geometry])
interpolate_25 = Interpolate(
    Vertices=[move.Geometry, rotate_3d_2.Geometry, rotate_3d.Geometry, rotate_3d_3.Geometry, construct_point],
    Degree=3,
    Periodic=False,
    KnotStyle=1)  # -> Curve, Length, Domain
merge_34 = Merge(Data1=[rotate_3d_3.Geometry, move_4.Geometry, construct_point])
mirror = Mirror(Plane=PlaneYZ(0, 0, 0))  # -> Geometry, Transform
merge_35 = Merge(Data1=[move.Geometry, move_2.Geometry, rotate_3d.Geometry])
interpolate_26 = Interpolate(Vertices=merge_33, Degree=1, Periodic=False, KnotStyle=1)  # -> Curve, Length, Domain
merge_36 = Merge(Data1=[rotate_3d.Geometry, move_2.Geometry, construct_point])
merge_37 = Merge(Data1=[rotate_3d.Geometry, move_2.Geometry, move_4.Geometry, rotate_3d_3.Geometry])
interpolate_27 = Interpolate(Vertices=merge_31, Degree=1, Periodic=False, KnotStyle=1)  # -> Curve, Length, Domain
interpolate_28 = Interpolate(Vertices=merge_32, Degree=1, Periodic=False, KnotStyle=1)  # -> Curve, Length, Domain
merge_38 = Merge(Data1=[move.Geometry, rotate_3d.Geometry, construct_point])
merge_39 = Merge(Data1=[move.Geometry, move_2.Geometry, rotate_3d.Geometry])
interpolate_29 = Interpolate(Vertices=merge_34, Degree=1, Periodic=False, KnotStyle=1)  # -> Curve, Length, Domain
merge_40 = Merge(Data1=[move.Geometry, rotate_3d_2.Geometry, rotate_3d.Geometry, rotate_3d_3.Geometry, construct_point])
merge_41 = Merge(Data1=[rotate_3d_3.Geometry, move_4.Geometry, construct_point])
interpolate_30 = Interpolate(Vertices=[move.Geometry, rotate_3d.Geometry, construct_point], Degree=3, Periodic=False, KnotStyle=1)  # -> Curve, Length, Domain
interpolate_31 = Interpolate(Vertices=merge_35, Degree=1, Periodic=False, KnotStyle=1)  # -> Curve, Length, Domain
interpolate_32 = Interpolate(Vertices=merge_36, Degree=1, Periodic=False, KnotStyle=1)  # -> Curve, Length, Domain
interpolate_33 = Interpolate(Vertices=merge_37, Degree=1, Periodic=False, KnotStyle=1)  # -> Curve, Length, Domain
interpolate_34 = Interpolate(Vertices=merge_39, Degree=1, Periodic=False, KnotStyle=1)  # -> Curve, Length, Domain
nurbs_curve_22 = NurbsCurve(Vertices=merge_32, Degree=2, Periodic=False)  # -> Curve, Length, Domain
nurbs_curve_23 = NurbsCurve(Vertices=merge_31, Degree=2, Periodic=False)  # -> Curve, Length, Domain
nurbs_curve_24 = NurbsCurve(Vertices=merge_33, Degree=2, Periodic=False)  # -> Curve, Length, Domain
nurbs_curve_25 = NurbsCurve(Vertices=merge_34, Degree=2, Periodic=False)  # -> Curve, Length, Domain
interpolate_35 = Interpolate(Vertices=merge_41, Degree=1, Periodic=False, KnotStyle=1)  # -> Curve, Length, Domain
merge_42 = Merge(Data1=[move.Geometry, rotate_3d.Geometry, rotate_3d_3.Geometry, construct_point])
interpolate_36 = Interpolate(
    Vertices=[move.Geometry, rotate_3d.Geometry, rotate_3d_3.Geometry, construct_point],
    Degree=3,
    Periodic=False,
    KnotStyle=1)  # -> Curve, Length, Domain
curve_closest_point_4 = CurveClosestPoint(Point=merge_38, Curve=interpolate_30.Curve)  # -> Point, flatten(Parameter), Distance
nurbs_curve_26 = NurbsCurve(Vertices=merge_35, Degree=2, Periodic=False)  # -> Curve, Length, Domain
nurbs_curve_27 = NurbsCurve(Vertices=merge_36, Degree=2, Periodic=False)  # -> Curve, Length, Domain
curve_closest_point_5 = CurveClosestPoint(Point=merge_40, Curve=interpolate_25.Curve)  # -> Point, flatten(Parameter), Distance
nurbs_curve_28 = NurbsCurve(Vertices=merge_39, Degree=2, Periodic=False)  # -> Curve, Length, Domain
nurbs_curve_29 = NurbsCurve(Vertices=merge_37, Degree=2, Periodic=False)  # -> Curve, Length, Domain
nurbs_curve_30 = NurbsCurve(Vertices=merge_41, Degree=2, Periodic=False)  # -> Curve, Length, Domain
curve_closest_point_6 = CurveClosestPoint(Point=merge_42, Curve=interpolate_36.Curve)  # -> Point, flatten(Parameter), Distance
shatter_4 = Shatter(Curve=interpolate_30.Curve, Parameters=curve_closest_point_4.Parameter)
shatter_5 = Shatter(Curve=interpolate_25.Curve, Parameters=curve_closest_point_5.Parameter)
merge_43 = Merge(Data1=[nurbs_curve_26.Curve, nurbs_curve_27.Curve])
shatter_6 = Shatter(Curve=interpolate_36.Curve, Parameters=curve_closest_point_6.Parameter)
merge_44 = Merge(Data1=[nurbs_curve_24.Curve, nurbs_curve_22.Curve, nurbs_curve_23.Curve, nurbs_curve_25.Curve])
merge_45 = Merge(Data1=[nurbs_curve_28.Curve, nurbs_curve_29.Curve, nurbs_curve_30.Curve])
tween_curve_10 = TweenCurve(CurveA=shatter_4, CurveB=merge_43, Factor=number_slider_8, BlendType=0)
tween_curve_11 = TweenCurve(CurveA=shatter_4, CurveB=merge_43, Factor=number_slider_4, BlendType=0)
tween_curve_12 = TweenCurve(CurveA=shatter_5, CurveB=merge_44, Factor=number_slider_8, BlendType=0)
tween_curve_13 = TweenCurve(CurveA=shatter_4, CurveB=merge_43, Factor=number_slider_9, BlendType=0)
tween_curve_14 = TweenCurve(CurveA=shatter_5, CurveB=merge_44, Factor=number_slider_4, BlendType=0)
tween_curve_15 = TweenCurve(CurveA=shatter_5, CurveB=merge_44, Factor=number_slider_9, BlendType=0)
tween_curve_16 = TweenCurve(CurveA=shatter_6, CurveB=merge_45, Factor=number_slider_8, BlendType=0)
tween_curve_17 = TweenCurve(CurveA=shatter_6, CurveB=merge_45, Factor=number_slider_4, BlendType=0)
tween_curve_18 = TweenCurve(CurveA=shatter_6, CurveB=merge_45, Factor=number_slider_9, BlendType=0)
construct_domain_10 = ConstructDomain(DomainStart=0, DomainEnd=9)
range_5 = Range(Domain=construct_domain_10, Steps=9)
construct_domain_11 = ConstructDomain(DomainStart=0, DomainEnd=9)
range_6 = Range(Domain=construct_domain_11, Steps=9)
list_item_13 = ListItem(List=tween_curve_11, Index=range_5, Wrap=True)
list_item_14 = ListItem(List=tween_curve_13, Index=range_5, Wrap=True)
list_item_15 = ListItem(List=tween_curve_10, Index=range_5, Wrap=True)
list_item_16 = ListItem(List=tween_curve_14, Index=range_6, Wrap=True)
list_item_17 = ListItem(List=tween_curve_15, Index=range_6, Wrap=True)
list_item_18 = ListItem(List=tween_curve_12, Index=range_6, Wrap=True)
construct_domain_12 = ConstructDomain(DomainStart=0, DomainEnd=9)
range_7 = Range(Domain=construct_domain_12, Steps=9)
length_4 = Length(Curve=list_item_15)
length_5 = Length(Curve=list_item_18)
list_item_19 = ListItem(List=tween_curve_17, Index=range_7, Wrap=True)
list_item_20 = ListItem(List=tween_curve_18, Index=range_7, Wrap=True)
list_item_21 = ListItem(List=tween_curve_16, Index=range_7, Wrap=True)
expression_4 = Expression(x=length_4, y=Slider(2.09, range=0..10), Expression="Ceiling(1*x*y)")
expression_5 = Expression(x=length_5, y=Slider(1.03, range=0..10), Expression="Ceiling(1*x*y)")
length_6 = Length(Curve=list_item_21)
multiplication_19 = Multiplication(A=expression_4, B=2)
multiplication_20 = Multiplication(A=expression_4, B=4)
multiplication_21 = Multiplication(A=expression_5, B=2)
multiplication_22 = Multiplication(A=expression_5, B=4)
divide_curve_16 = DivideCurve(Curve=list_item_15, Count=multiplication_19, Kinks=False)  # -> Points, Tangents, Parameters
expression_6 = Expression(x=length_6, y=Slider(1.03, range=0..10), Expression="Ceiling(1*x*y)")
divide_curve_17 = DivideCurve(Curve=list_item_15, Count=multiplication_19, Kinks=False)  # -> Points, Tangents, Parameters
divide_curve_18 = DivideCurve(Curve=list_item_18, Count=multiplication_21, Kinks=False)  # -> Points, Tangents, Parameters
divide_curve_19 = DivideCurve(Curve=list_item_18, Count=multiplication_21, Kinks=False)  # -> Points, Tangents, Parameters
divide_curve_20 = DivideCurve(Curve=list_item_14, Count=expression_4, Kinks=False)  # -> Points, Tangents, Parameters
divide_curve_21 = DivideCurve(Curve=list_item_13, Count=multiplication_20, Kinks=False)  # -> Points, Tangents, Parameters
divide_curve_22 = DivideCurve(Curve=list_item_17, Count=expression_5, Kinks=False)  # -> Points, Tangents, Parameters
divide_curve_23 = DivideCurve(Curve=list_item_16, Count=multiplication_22, Kinks=False)  # -> Points, Tangents, Parameters
multiplication_23 = Multiplication(A=expression_6, B=2)
multiplication_24 = Multiplication(A=expression_6, B=4)
divide_curve_24 = DivideCurve(Curve=list_item_21, Count=multiplication_23, Kinks=False)  # -> Points, Tangents, Parameters
divide_curve_25 = DivideCurve(Curve=list_item_21, Count=multiplication_23, Kinks=False)  # -> Points, Tangents, Parameters
split_list_25 = SplitList(List=divide_curve_16.Points, Index=1)  # -> ListA, ListB
split_list_26 = SplitList(List=divide_curve_20.Points, Index=1)  # -> ListA, ListB
split_list_27 = SplitList(List=divide_curve_17.Points, Index=1)  # -> ListA, ListB
split_list_28 = SplitList(List=divide_curve_18.Points, Index=1)  # -> ListA, ListB
divide_curve_26 = DivideCurve(Curve=list_item_20, Count=expression_6, Kinks=False)  # -> Points, Tangents, Parameters
split_list_29 = SplitList(List=divide_curve_22.Points, Index=1)  # -> ListA, ListB
split_list_30 = SplitList(List=divide_curve_19.Points, Index=1)  # -> ListA, ListB
divide_curve_27 = DivideCurve(Curve=list_item_19, Count=multiplication_24, Kinks=False)  # -> Points, Tangents, Parameters
split_list_31 = SplitList(List=divide_curve_21.Points, Index=1)  # -> ListA, ListB
split_list_32 = SplitList(List=divide_curve_23.Points, Index=1)  # -> ListA, ListB
reverse_list_25 = ReverseList(List=split_list_25.ListB)
reverse_list_26 = ReverseList(List=split_list_28.ListB)
reverse_list_27 = ReverseList(List=split_list_26.ListB)
reverse_list_28 = ReverseList(List=split_list_27.ListB)
reverse_list_29 = ReverseList(List=split_list_29.ListB)
reverse_list_30 = ReverseList(List=split_list_30.ListB)
reverse_list_31 = ReverseList(List=split_list_31.ListB)
split_list_33 = SplitList(List=divide_curve_24.Points, Index=1)  # -> ListA, ListB
reverse_list_32 = ReverseList(List=split_list_32.ListB)
split_list_34 = SplitList(List=divide_curve_26.Points, Index=1)  # -> ListA, ListB
split_list_35 = SplitList(List=reverse_list_25, Index=2)  # -> ListA, ListB
split_list_36 = SplitList(List=divide_curve_25.Points, Index=1)  # -> ListA, ListB
split_list_37 = SplitList(List=reverse_list_26, Index=2)  # -> ListA, ListB
split_list_38 = SplitList(List=reverse_list_27, Index=1)  # -> ListA, ListB
split_list_39 = SplitList(List=reverse_list_28, Index=1)  # -> ListA, ListB
split_list_40 = SplitList(List=reverse_list_29, Index=1)  # -> ListA, ListB
split_list_41 = SplitList(List=reverse_list_30, Index=1)  # -> ListA, ListB
split_list_42 = SplitList(List=divide_curve_27.Points, Index=1)  # -> ListA, ListB
split_list_43 = SplitList(List=reverse_list_31, Index=2)  # -> ListA, ListB
split_list_44 = SplitList(List=reverse_list_32, Index=2)  # -> ListA, ListB
reverse_list_33 = ReverseList(List=split_list_33.ListB)
reverse_list_34 = ReverseList(List=split_list_35.ListB)
reverse_list_35 = ReverseList(List=split_list_34.ListB)
reverse_list_36 = ReverseList(List=split_list_37.ListB)
reverse_list_37 = ReverseList(List=split_list_36.ListB)
reverse_list_38 = ReverseList(List=split_list_38.ListB)
reverse_list_39 = ReverseList(List=split_list_42.ListB)
reverse_list_40 = ReverseList(List=split_list_40.ListB)
split_list_45 = SplitList(List=reverse_list_33, Index=2)  # -> ListA, ListB
reverse_list_41 = ReverseList(List=split_list_43.ListB)
reverse_list_42 = ReverseList(List=split_list_44.ListB)
split_list_46 = SplitList(List=reverse_list_35, Index=1)  # -> ListA, ListB
split_list_47 = SplitList(List=reverse_list_37, Index=1)  # -> ListA, ListB
dispatch_8 = Dispatch(List=reverse_list_34, DispatchPattern=[True, False])  # -> ListA, ListB
split_list_48 = SplitList(List=reverse_list_39, Index=2)  # -> ListA, ListB
dispatch_9 = Dispatch(List=reverse_list_36, DispatchPattern=[True, False])  # -> ListA, ListB
reverse_list_43 = ReverseList(List=split_list_45.ListB)
reverse_list_44 = ReverseList(List=split_list_39.ListB)
reverse_list_45 = ReverseList(List=split_list_41.ListB)
reverse_list_46 = ReverseList(List=split_list_46.ListB)
dispatch_10 = Dispatch(List=reverse_list_41, DispatchPattern=[True, False])  # -> ListA, ListB
dispatch_11 = Dispatch(List=reverse_list_42, DispatchPattern=[True, False])  # -> ListA, ListB
reverse_list_47 = ReverseList(List=split_list_48.ListB)
dispatch_12 = Dispatch(List=reverse_list_43, DispatchPattern=[True, False])  # -> ListA, ListB
reverse_list_48 = ReverseList(List=split_list_47.ListB)
dispatch_13 = Dispatch(List=reverse_list_47, DispatchPattern=[True, False])  # -> ListA, ListB
line_17 = Line(StartPoint=reverse_list_38, EndPoint=dispatch_8.ListB)
line_18 = Line(StartPoint=reverse_list_38, EndPoint=dispatch_8.ListA)
line_19 = Line(StartPoint=reverse_list_40, EndPoint=dispatch_9.ListB)
line_20 = Line(StartPoint=reverse_list_44, EndPoint=dispatch_10.ListB)
line_21 = Line(StartPoint=reverse_list_44, EndPoint=dispatch_10.ListA)
line_22 = Line(StartPoint=reverse_list_40, EndPoint=dispatch_9.ListA)
line_23 = Line(StartPoint=reverse_list_45, EndPoint=dispatch_11.ListB)
merge_46 = Merge(Data1=[interpolate_31.Curve, interpolate_32.Curve])
list_item_22 = ListItem(List=merge_46, Index=range_5, Wrap=True)
divide_curve_28 = DivideCurve(Curve=list_item_22, Count=expression_4, Kinks=False)  # -> Points, Tangents, Parameters
line_24 = Line(StartPoint=divide_curve_20.Points, EndPoint=divide_curve_28.Points)
line_25 = Line(StartPoint=reverse_list_45, EndPoint=dispatch_11.ListA)
merge_47 = Merge(Data1=[interpolate_26.Curve, interpolate_28.Curve, interpolate_27.Curve, interpolate_29.Curve])
list_item_23 = ListItem(List=merge_47, Index=range_6, Wrap=True)
divide_curve_29 = DivideCurve(Curve=list_item_23, Count=expression_5, Kinks=False)  # -> Points, Tangents, Parameters
line_26 = Line(StartPoint=divide_curve_22.Points, EndPoint=divide_curve_29.Points)
line_27 = Line(StartPoint=reverse_list_46, EndPoint=dispatch_12.ListB)
line_28 = Line(StartPoint=reverse_list_46, EndPoint=dispatch_12.ListA)
line_29 = Line(StartPoint=reverse_list_48, EndPoint=dispatch_13.ListB)
line_30 = Line(StartPoint=reverse_list_48, EndPoint=dispatch_13.ListA)
merge_48 = Merge(Data1=[interpolate_34.Curve, interpolate_33.Curve, interpolate_35.Curve])
list_item_24 = ListItem(List=merge_48, Index=range_7, Wrap=True)
divide_curve_30 = DivideCurve(Curve=list_item_24, Count=expression_6, Kinks=False)  # -> Points, Tangents, Parameters
line_31 = Line(StartPoint=divide_curve_26.Points, EndPoint=divide_curve_30.Points)
merge_49 = Merge(Data1=[line_22, merge_47, line_19, line_26, line_25, line_23])
dispatch_14 = Dispatch(List=merge_49, DispatchPattern=boolean_toggle)  # -> ListA, ListB
join_curves_2 = JoinCurves(Curves=dispatch_14.ListB, Preserve=False)
merge_50 = Merge(Data1=move.Geometry, Data2=construct_point)
interpolate_37 = Interpolate(Vertices=merge_50, Degree=1, Periodic=False, KnotStyle=1)  # -> Curve, Length, Domain
nurbs_curve_31 = NurbsCurve(Vertices=merge_50, Degree=1, Periodic=False)  # -> Curve, Length, Domain
md_slider = MDSlider(
    SliderMode=0,
    slider_value=Point(0.9223490459, 0.2327255621, 0.5),
    x_domain=Domain(-18, 18),
    y_domain=Domain(-18, 18),
    z_domain=Domain(0, 1))
md_slider_2 = MDSlider(
    SliderMode=0,
    slider_value=Point(0.9894570141, 0.9349696462, 0.5),
    x_domain=Domain(-18, 18),
    y_domain=Domain(-18, 18),
    z_domain=Domain(0, 1))
bezier_span = BezierSpan(StartPoint=move.Geometry, StartTangent=md_slider, EndPoint=construct_point, EndTangent=md_slider_2)  # -> Curve, Length, Domain
merge_51 = Merge(Data1=nurbs_curve_31.Curve)
merge_52 = Merge(Data1=move.Geometry, Data2=construct_point)
tween_curve_19 = TweenCurve(CurveA=bezier_span.Curve, CurveB=merge_51, Factor=number_slider_8, BlendType=0)
bezier_span_2 = BezierSpan(StartPoint=move.Geometry, StartTangent=md_slider, EndPoint=construct_point, EndTangent=md_slider_2)  # -> Curve, Length, Domain
tween_curve_20 = TweenCurve(CurveA=bezier_span.Curve, CurveB=merge_51, Factor=number_slider_4, BlendType=0)
tween_curve_21 = TweenCurve(CurveA=bezier_span.Curve, CurveB=merge_51, Factor=number_slider_9, BlendType=0)
nurbs_curve_32 = NurbsCurve(Vertices=merge_52, Degree=1, Periodic=False)  # -> Curve, Length, Domain
construct_domain_13 = ConstructDomain(DomainStart=0, DomainEnd=9)
range_8 = Range(Domain=construct_domain_13, Steps=9)
list_item_25 = ListItem(List=tween_curve_20, Index=range_8, Wrap=True)
list_item_26 = ListItem(List=tween_curve_21, Index=range_8, Wrap=True)
list_item_27 = ListItem(List=tween_curve_19, Index=range_8, Wrap=True)
merge_53 = Merge(Data1=nurbs_curve_32.Curve)
length_7 = Length(Curve=list_item_27)
expression_7 = Expression(x=length_7, y=Slider(0.19, range=0..10), Expression="Ceiling(1*x*y)")
multiplication_25 = Multiplication(A=expression_7, B=2)
multiplication_26 = Multiplication(A=expression_7, B=4)
interpolate_38 = Interpolate(Vertices=merge_52, Degree=1, Periodic=False, KnotStyle=1)  # -> Curve, Length, Domain
tween_curve_22 = TweenCurve(CurveA=bezier_span_2.Curve, CurveB=merge_53, Factor=number_slider_9, BlendType=0)
tween_curve_23 = TweenCurve(CurveA=bezier_span_2.Curve, CurveB=merge_53, Factor=number_slider_8, BlendType=0)
tween_curve_24 = TweenCurve(CurveA=bezier_span_2.Curve, CurveB=merge_53, Factor=number_slider_4, BlendType=0)
divide_curve_31 = DivideCurve(Curve=list_item_27, Count=multiplication_25, Kinks=False)  # -> Points, Tangents, Parameters
divide_curve_32 = DivideCurve(Curve=list_item_27, Count=multiplication_25, Kinks=False)  # -> Points, Tangents, Parameters
divide_curve_33 = DivideCurve(Curve=list_item_26, Count=expression_7, Kinks=False)  # -> Points, Tangents, Parameters
divide_curve_34 = DivideCurve(Curve=list_item_25, Count=multiplication_26, Kinks=False)  # -> Points, Tangents, Parameters
split_list_49 = SplitList(List=divide_curve_31.Points, Index=1)  # -> ListA, ListB
split_list_50 = SplitList(List=divide_curve_33.Points, Index=1)  # -> ListA, ListB
split_list_51 = SplitList(List=divide_curve_32.Points, Index=1)  # -> ListA, ListB
split_list_52 = SplitList(List=divide_curve_34.Points, Index=1)  # -> ListA, ListB
reverse_list_49 = ReverseList(List=split_list_49.ListB)
reverse_list_50 = ReverseList(List=split_list_50.ListB)
reverse_list_51 = ReverseList(List=split_list_51.ListB)
reverse_list_52 = ReverseList(List=split_list_52.ListB)
split_list_53 = SplitList(List=reverse_list_49, Index=2)  # -> ListA, ListB
split_list_54 = SplitList(List=reverse_list_50, Index=1)  # -> ListA, ListB
split_list_55 = SplitList(List=reverse_list_51, Index=1)  # -> ListA, ListB
split_list_56 = SplitList(List=reverse_list_52, Index=2)  # -> ListA, ListB
reverse_list_53 = ReverseList(List=split_list_53.ListB)
reverse_list_54 = ReverseList(List=split_list_54.ListB)
reverse_list_55 = ReverseList(List=split_list_56.ListB)
dispatch_15 = Dispatch(List=reverse_list_53, DispatchPattern=[True, False])  # -> ListA, ListB
reverse_list_56 = ReverseList(List=split_list_55.ListB)
dispatch_16 = Dispatch(List=reverse_list_55, DispatchPattern=[True, False])  # -> ListA, ListB
line_32 = Line(StartPoint=reverse_list_54, EndPoint=dispatch_15.ListB)
line_33 = Line(StartPoint=reverse_list_54, EndPoint=dispatch_15.ListA)
line_34 = Line(StartPoint=reverse_list_56, EndPoint=dispatch_16.ListB)
line_35 = Line(StartPoint=reverse_list_56, EndPoint=dispatch_16.ListA)
merge_54 = Merge(Data1=interpolate_37.Curve)
list_item_28 = ListItem(List=merge_54, Index=range_8, Wrap=True)
divide_curve_35 = DivideCurve(Curve=list_item_28, Count=expression_7, Kinks=False)  # -> Points, Tangents, Parameters
line_36 = Line(StartPoint=divide_curve_33.Points, EndPoint=divide_curve_35.Points)
