# Grasshopper definition unnamed.gh (Grasshopper 1.0.7)

construct_point = ConstructPoint(XCoordinate=0, YCoordinate=0, ZCoordinate=0)
construct_point_2 = ConstructPoint(XCoordinate=0, YCoordinate=10, ZCoordinate=0)
line = Line(StartPoint=construct_point, EndPoint=construct_point_2)
point = Point(<point referenced from the Rhino model>)
point_2 = Point(<point referenced from the Rhino model>)
point_3 = Point([<point referenced from the Rhino model> x6])
nurbs_curve = NurbsCurve(Vertices=point_3, Degree=Slider(2, range=0..10), Periodic=False)  # -> Curve, Length, Domain
point_4 = Point()
bezier_span = BezierSpan(StartPoint=construct_point, StartTangent=point, EndPoint=construct_point_2, EndTangent=point_2)  # -> Curve, Length, Domain
construct_point_3 = ConstructPoint(XCoordinate=0, YCoordinate=2, ZCoordinate=0)
divide_curve = DivideCurve(Curve=nurbs_curve.Curve, Count=15, Kinks=False)  # -> Points, Tangents, Parameters
point_5 = Point(<point referenced from the Rhino model>)
point_6 = Point(<point referenced from the Rhino model>)
line_2 = Line(StartPoint=point_5, EndPoint=point_6)
line_3 = Line(StartPoint=point_5, EndPoint=point_6)
curve_middle = CurveMiddle(Curve=line_3)
move = Move(Geometry=curve_middle, Motion=construct_point_3)  # -> Geometry, Transform
distance = Distance(PointA=divide_curve.Points, PointB=curve_middle)
sort_list = SortList(Keys=distance)  # -> Keys, ValuesA
reverse_list = ReverseList(List=sort_list.Keys)
split_list = SplitList(List=reverse_list, Index=1)  # -> ListA, ListB
member_index = MemberIndex(Set=distance, Member=split_list.ListA)  # -> Index, Count
list_item = ListItem(List=divide_curve.Points, Index=member_index.Index, Wrap=True)  # -> flatten(Item)
vector_2pt = Vector2Pt(PointA=list_item, PointB=curve_middle, Unitize=True)  # -> Vector, Length

vector_xyz = VectorXYZ(XComponent=0, YComponent=10, ZComponent=0)  # -> Vector, Length; disabled
point_7 = Point(<point referenced from the Rhino model>)  # disabled
move_2 = Move(Geometry=point_7, Motion=vector_xyz.Vector)  # -> Geometry, Transform; disabled
vector_xyz_2 = VectorXYZ(XComponent=10, YComponent=0, ZComponent=0)  # -> Vector, Length; disabled
move_3 = Move(Geometry=point_7, Motion=vector_xyz_2.Vector)  # -> Geometry, Transform; disabled
line_4 = Line(StartPoint=point_7, EndPoint=move_2.Geometry)  # disabled
line_5 = Line(StartPoint=point_7, EndPoint=move_3.Geometry)  # disabled
number_slider = Slider(3, range=0..10)  # disabled
number_slider_2 = Slider(0.158, range=0..1)  # disabled
divide_curve_2 = DivideCurve(Curve=[line_4, line_5], Count=40, Kinks=False)  # -> flatten(Points), Tangents, Parameters; disabled
move_away_from = MoveAwayFrom(Geometry=divide_curve_2.Points, Distance=number_slider)  # -> Geometry, Transform; disabled

multiplication = Multiplication(A=vector_2pt.Vector, B=Slider(2.091, range=-5..5))
move_4 = Move(Geometry=list_item, Motion=multiplication)  # -> Geometry, Transform
polyline = PolyLine(Vertices=[point_5, move.Geometry, move_4.Geometry, curve_middle, point_6], Closed=False)
rebuild_curve = RebuildCurve(Curve=polyline, Degree=4, Count=24, Tangents=False)
tween_curve = TweenCurve(CurveA=rebuild_curve, CurveB=nurbs_curve.Curve, Factor=Slider(0.719, range=0..1), BlendType=0)
tween_curve_2 = TweenCurve(CurveA=rebuild_curve, CurveB=nurbs_curve.Curve, Factor=Slider(0.405, range=0..1), BlendType=0)
tween_curve_3 = TweenCurve(CurveA=rebuild_curve, CurveB=nurbs_curve.Curve, Factor=Slider(0.293, range=0..1), BlendType=0)
