# Grasshopper definition unnamsddfed_v2.gh (Grasshopper 1.0.7)

curve = Curve(<curve referenced from the Rhino model>)
control_points = ControlPoints(Curve=curve)  # -> Points, Weights, Knots
curve_2 = Curve(<curve referenced from the Rhino model>)
rebuild_curve = RebuildCurve(Curve=curve, Degree=4, Count=1, Tangents=False)
control_points_2 = ControlPoints(Curve=curve_2)  # -> Points, Weights, Knots
vector_xyz = VectorXYZ(XComponent=0, YComponent=10, ZComponent=0)  # -> Vector, Length
point = Point(<point referenced from the Rhino model>)
point_2 = Point([<point referenced from the Rhino model> x3])
point_3 = Point([<point referenced from the Rhino model> x4])
nurbs_curve = NurbsCurve(Vertices=control_points_2.Points, Degree=3, Periodic=False)  # -> Curve, Length, Domain
nurbs_curve_2 = NurbsCurve(Vertices=control_points.Points, Degree=3, Periodic=False)  # -> Curve, Length, Domain
move = Move(Geometry=point, Motion=vector_xyz.Vector)  # -> Geometry, Transform
graph_mapper = GraphMapper(
    Slider(0.255, range=0..1),
    x0=0,
    x1=1,
    y0=0,
    y1=1,
    amplitude=0.2611384988,
    container_name="Perlin",
    decay=0.524330914,
    frequency=0.307760492,
    x_offset=0.4714134336,
    y_offset=0.4437255859)
number_slider = Slider(0.502, range=0..1)
line = Line(StartPoint=point, EndPoint=move.Geometry)
point_4 = Point(<point referenced from the Rhino model>)
tween_curve = TweenCurve(CurveA=nurbs_curve_2.Curve, CurveB=nurbs_curve.Curve, Factor=Slider(0.515, range=0..1), BlendType=0)
curve_middle = CurveMiddle(Curve=line)
panel = Panel(graph_mapper)
number_slider_2 = Slider(0.538, range=0..1)
nurbs_curve_3 = NurbsCurve(Degree=3, Periodic=False)  # -> Curve, Length, Domain
line_2 = Line(StartPoint=curve_middle, EndPoint=point_4)

construct_point = ConstructPoint(XCoordinate=0, YCoordinate=0, ZCoordinate=0)
construct_point_2 = ConstructPoint(XCoordinate=0, YCoordinate=10, ZCoordinate=0)
line_3 = Line(StartPoint=construct_point, EndPoint=construct_point_2)
point_5 = Point(<point referenced from the Rhino model>)
point_6 = Point(<point referenced from the Rhino model>)
point_7 = Point([<point referenced from the Rhino model> x6])
nurbs_curve_4 = NurbsCurve(Vertices=point_7, Degree=Slider(2, range=0..10), Periodic=False)  # -> Curve, Length, Domain
point_8 = Point()
bezier_span = BezierSpan(StartPoint=construct_point, StartTangent=point_5, EndPoint=construct_point_2, EndTangent=point_6)  # -> Curve, Length, Domain
construct_point_3 = ConstructPoint(XCoordinate=0, YCoordinate=0.01, ZCoordinate=0)
divide_curve = DivideCurve(Curve=nurbs_curve_4.Curve, Count=15, Kinks=False)  # -> Points, Tangents, Parameters
point_9 = Point(<point referenced from the Rhino model>)
point_10 = Point(<point referenced from the Rhino model>)
line_4 = Line(StartPoint=point_9, EndPoint=point_10)
line_5 = Line(StartPoint=point_9, EndPoint=point_10)
curve_middle_2 = CurveMiddle(Curve=line_5)
move_2 = Move(Geometry=curve_middle_2, Motion=construct_point_3)  # -> Geometry, Transform
distance = Distance(PointA=divide_curve.Points, PointB=curve_middle_2)
sort_list = SortList(Keys=distance)  # -> Keys, ValuesA
reverse_list = ReverseList(List=sort_list.Keys)
split_list = SplitList(List=reverse_list, Index=1)  # -> ListA, ListB
member_index = MemberIndex(Set=distance, Member=split_list.ListA)  # -> Index, Count
list_item = ListItem(List=divide_curve.Points, Index=member_index.Index, Wrap=True)  # -> flatten(Item)
vector_2pt = Vector2Pt(PointA=list_item, PointB=curve_middle_2, Unitize=True)  # -> Vector, Length
multiplication = Multiplication(A=vector_2pt.Vector, B=Slider(2.091, range=-5..5))
move_3 = Move(Geometry=list_item, Motion=multiplication)  # -> Geometry, Transform
polyline = PolyLine(Vertices=[point_9, move_2.Geometry, move_3.Geometry, curve_middle_2, point_10], Closed=False)
tween_curve_2 = TweenCurve(CurveA=polyline, CurveB=nurbs_curve_4.Curve, Factor=Slider(0.203, range=0..1), BlendType=0)
tween_curve_3 = TweenCurve(CurveA=polyline, CurveB=nurbs_curve_4.Curve, Factor=Slider(0.803, range=0..1), BlendType=0)
tween_curve_4 = TweenCurve(CurveA=polyline, CurveB=nurbs_curve_4.Curve, Factor=Slider(0.474, range=0..1), BlendType=0)
divide_curve_2 = DivideCurve(Curve=polyline, Count=15, Kinks=False)  # -> Points, Tangents, Parameters

vector_xyz_2 = VectorXYZ(XComponent=0, YComponent=10, ZComponent=0)  # -> Vector, Length; disabled
point_11 = Point(<point referenced from the Rhino model>)  # disabled
move_4 = Move(Geometry=point_11, Motion=vector_xyz_2.Vector)  # -> Geometry, Transform; disabled
vector_xyz_3 = VectorXYZ(XComponent=10, YComponent=0, ZComponent=0)  # -> Vector, Length; disabled
move_5 = Move(Geometry=point_11, Motion=vector_xyz_3.Vector)  # -> Geometry, Transform; disabled
line_6 = Line(StartPoint=point_11, EndPoint=move_4.Geometry)  # disabled
line_7 = Line(StartPoint=point_11, EndPoint=move_5.Geometry)  # disabled
number_slider_3 = Slider(3, range=0..10)  # disabled
number_slider_4 = Slider(0.158, range=0..1)  # disabled
divide_curve_3 = DivideCurve(Curve=[line_6, line_7], Count=40, Kinks=False)  # -> flatten(Points), Tangents, Parameters; disabled
move_away_from = MoveAwayFrom(Geometry=divide_curve_3.Points, Distance=number_slider_3)  # -> Geometry, Transform; disabled

nurbs_curve_5 = NurbsCurve(Vertices=[point_4, curve_middle, point], Degree=2, Periodic=False)  # -> Curve, Length, Domain
nurbs_curve_6 = NurbsCurve(Vertices=[move.Geometry, point_2], Degree=3, Periodic=False)  # -> Curve, Length, Domain
nurbs_curve_7 = NurbsCurve(Vertices=point_3, Degree=3, Periodic=False)  # -> Curve, Length, Domain
connect_curves = ConnectCurves(Curves=[nurbs_curve_7.Curve, nurbs_curve_6.Curve], Continuity=0, Close=True, Bulge=1)
blend_curve = BlendCurve(CurveA=nurbs_curve_7.Curve, CurveB=nurbs_curve_6.Curve, BulgeA=1, BulgeB=1, Continuity=0)
tween_curve_5 = TweenCurve(CurveA=nurbs_curve_7.Curve, CurveB=nurbs_curve_5.Curve, Factor=number_slider, BlendType=0)
polyline_2 = PolyLine(Vertices=[move.Geometry, curve_middle, point_4], Closed=False)
tween_curve_6 = TweenCurve(CurveA=nurbs_curve_6.Curve, CurveB=polyline_2, Factor=number_slider, BlendType=0)
rebuild_curve_2 = RebuildCurve(Curve=tween_curve_6, Degree=3, Count=6, Tangents=True)
polyline_3 = PolyLine(Vertices=[point_4, curve_middle, point], Closed=False)
divide_curve_4 = DivideCurve(Curve=polyline_3, Count=10, Kinks=False)  # -> Points, Tangents, Parameters
divide_curve_5 = DivideCurve(Curve=nurbs_curve_7.Curve, Count=20, Kinks=False)  # -> Points, Tangents, Parameters
divide_curve_6 = DivideCurve(Curve=polyline_2, Count=15, Kinks=False)  # -> Points, Tangents, Parameters
divide_curve_7 = DivideCurve(Curve=rebuild_curve_2, Count=15, Kinks=False)  # -> Points, Tangents, Parameters
divide_curve_8 = DivideCurve(Curve=tween_curve_5, Count=10, Kinks=False)  # -> Points, Tangents, Parameters
divide_curve_9 = DivideCurve(Curve=nurbs_curve_6.Curve, Count=30, Kinks=False)  # -> Points, Tangents, Parameters
dispatch = Dispatch(List=divide_curve_5.Points, DispatchPattern=[True, False])  # -> ListA, ListB
dispatch_2 = Dispatch(List=divide_curve_9.Points, DispatchPattern=[True, False])  # -> ListA, ListB
line_8 = Line(StartPoint=divide_curve_4.Points, EndPoint=divide_curve_8.Points)
line_9 = Line(StartPoint=divide_curve_6.Points, EndPoint=divide_curve_7.Points)
line_10 = Line(StartPoint=divide_curve_8.Points, EndPoint=dispatch.ListA)
line_11 = Line(StartPoint=divide_curve_8.Points, EndPoint=dispatch.ListB)
line_12 = Line(StartPoint=divide_curve_7.Points, EndPoint=dispatch_2.ListA)
line_13 = Line(StartPoint=divide_curve_7.Points, EndPoint=dispatch_2.ListB)
join_curves = JoinCurves(Curves=[line_9, line_10, line_8, line_11, line_12, line_13, polyline_3, polyline_2], Preserve=False)
point_12 = Point(<point referenced from the Rhino model>)
circular_arc = CircularArc({Angle=0, Angle=1.415388817, Plane=Plane(origin=(33.86157504, 5.337107017, 0), x=(0.728943344, -0.684574029, 0), y=(0.684574029, 0.728943344, 0)), Radius=7.627272247})
vector_xyz_4 = VectorXYZ(XComponent=20, YComponent=0, ZComponent=0)  # -> Vector, Length
curve_3 = Curve(<curve referenced from the Rhino model>)
rebuild_curve_3 = RebuildCurve(Curve=join_curves, Degree=20, Count=80, Tangents=curve_3)
curve_4 = Curve(<curve referenced from the Rhino model>)
bend_deform = BendDeform(Geometry=rebuild_curve_3, BendingArc=circular_arc)
flow = Flow(
    Geometry=rebuild_curve_3,
    Base=curve_4,
    Target=curve_3,
    ReverseBase=False,
    ReverseTarget=False,
    Stretch=True,
    Rigid=False)
