# Grasshopper definition unnamsdfed.gh (Grasshopper 1.0.7)

vector_xyz = VectorXYZ(XComponent=0, YComponent=10, ZComponent=0)  # -> Vector, Length
point = Point(<point referenced from the Rhino model>)
point_2 = Point([<point referenced from the Rhino model> x3])
point_3 = Point([<point referenced from the Rhino model> x4])
move = Move(Geometry=point, Motion=vector_xyz.Vector)  # -> Geometry, Transform
number_slider = Slider(0.783, range=0..1)
line = Line(StartPoint=point, EndPoint=move.Geometry)
point_4 = Point(<point referenced from the Rhino model>)
curve_middle = CurveMiddle(Curve=line)
number_slider_2 = Slider(0.538, range=0..1)
nurbs_curve = NurbsCurve(Vertices=[move.Geometry, point_2], Degree=3, Periodic=False)  # -> Curve, Length, Domain
nurbs_curve_2 = NurbsCurve(Vertices=point_3, Degree=3, Periodic=False)  # -> Curve, Length, Domain
line_2 = Line(StartPoint=curve_middle, EndPoint=point_4)
connect_curves = ConnectCurves(Curves=[nurbs_curve_2.Curve, nurbs_curve.Curve], Continuity=0, Close=True, Bulge=1)
polyline = PolyLine(Vertices=[point_4, curve_middle, point], Closed=False)
nurbs_curve_3 = NurbsCurve(Vertices=[point_4, curve_middle, point], Degree=2, Periodic=False)  # -> Curve, Length, Domain
tween_curve = TweenCurve(CurveA=nurbs_curve_2.Curve, CurveB=nurbs_curve_3.Curve, Factor=number_slider, BlendType=0)
blend_curve = BlendCurve(CurveA=nurbs_curve_2.Curve, CurveB=nurbs_curve.Curve, BulgeA=1, BulgeB=1, Continuity=0)
polyline_2 = PolyLine(Vertices=[move.Geometry, curve_middle, point_4], Closed=False)
tween_curve_2 = TweenCurve(CurveA=nurbs_curve.Curve, CurveB=polyline_2, Factor=number_slider, BlendType=0)
interpolate = Interpolate(Vertices=[point_4, curve_middle, point], Degree=8, Periodic=False, KnotStyle=0)  # -> Curve, Length, Domain
rebuild_curve = RebuildCurve(Curve=tween_curve_2, Degree=3, Count=6, Tangents=True)

construct_point = ConstructPoint(XCoordinate=0, YCoordinate=0, ZCoordinate=0)
construct_point_2 = ConstructPoint(XCoordinate=0, YCoordinate=10, ZCoordinate=0)
line_3 = Line(StartPoint=construct_point, EndPoint=construct_point_2)
point_5 = Point(<point referenced from the Rhino model>)
point_6 = Point(<point referenced from the Rhino model>)
point_7 = Point([<point referenced from the Rhino model> x6])
nurbs_curve_4 = NurbsCurve(Vertices=point_7, Degree=Slider(2, range=0..10), Periodic=False)  # -> Curve, Length, Domain
point_8 = Point()
bezier_span = BezierSpan(StartPoint=construct_point, StartTangent=point_5, EndPoint=construct_point_2, EndTangent=point_6)  # -> Curve, Length, Domain
construct_point_3 = ConstructPoint(XCoordinate=0, YCoordinate=0.01, ZCoordinate=0)
divide_curve = DivideCurve(Curve=nurbs_curve_4.Curve, Count=15, Kinks=False)  # -> Points, Tangents, Parameters
point_9 = Point(<point referenced from the Rhino model>)
point_10 = Point(<point referenced from the Rhino model>)
line_4 = Line(StartPoint=point_9, EndPoint=point_10)
line_5 = Line(StartPoint=point_9, EndPoint=point_10)
curve_middle_2 = CurveMiddle(Curve=line_5)
move_2 = Move(Geometry=curve_middle_2, Motion=construct_point_3)  # -> Geometry, Transform
distance = Distance(PointA=divide_curve.Points, PointB=curve_middle_2)
sort_list = SortList(Keys=distance)  # -> Keys, ValuesA
reverse_list = ReverseList(List=sort_list.Keys)
split_list = SplitList(List=reverse_list, Index=1)  # -> ListA, ListB
member_index = MemberIndex(Set=distance, Member=split_list.ListA)  # -> Index, Count
list_item = ListItem(List=divide_curve.Points, Index=member_index.Index, Wrap=True)  # -> flatten(Item)
vector_2pt = Vector2Pt(PointA=list_item, PointB=curve_middle_2, Unitize=True)  # -> Vector, Length
multiplication = Multiplication(A=vector_2pt.Vector, B=Slider(2.091, range=-5..5))
move_3 = Move(Geometry=list_item, Motion=multiplication)  # -> Geometry, Transform
polyline_3 = PolyLine(Vertices=[point_9, move_2.Geometry, move_3.Geometry, curve_middle_2, point_10], Closed=False)
tween_curve_3 = TweenCurve(CurveA=polyline_3, CurveB=nurbs_curve_4.Curve, Factor=Slider(0.203, range=0..1), BlendType=0)
tween_curve_4 = TweenCurve(CurveA=polyline_3, CurveB=nurbs_curve_4.Curve, Factor=Slider(0.803, range=0..1), BlendType=0)
tween_curve_5 = TweenCurve(CurveA=polyline_3, CurveB=nurbs_curve_4.Curve, Factor=Slider(0.474, range=0..1), BlendType=0)
divide_curve_2 = DivideCurve(Curve=polyline_3, Count=15, Kinks=False)  # -> Points, Tangents, Parameters

vector_xyz_2 = VectorXYZ(XComponent=0, YComponent=10, ZComponent=0)  # -> Vector, Length; disabled
point_11 = Point(<point referenced from the Rhino model>)  # disabled
move_4 = Move(Geometry=point_11, Motion=vector_xyz_2.Vector)  # -> Geometry, Transform; disabled
vector_xyz_3 = VectorXYZ(XComponent=10, YComponent=0, ZComponent=0)  # -> Vector, Length; disabled
move_5 = Move(Geometry=point_11, Motion=vector_xyz_3.Vector)  # -> Geometry, Transform; disabled
line_6 = Line(StartPoint=point_11, EndPoint=move_4.Geometry)  # disabled
line_7 = Line(StartPoint=point_11, EndPoint=move_5.Geometry)  # disabled
number_slider_3 = Slider(3, range=0..10)  # disabled
number_slider_4 = Slider(0.158, range=0..1)  # disabled
divide_curve_3 = DivideCurve(Curve=[line_6, line_7], Count=40, Kinks=False)  # -> flatten(Points), Tangents, Parameters; disabled
move_away_from = MoveAwayFrom(Geometry=divide_curve_3.Points, Distance=number_slider_3)  # -> Geometry, Transform; disabled
